# Grasshopper definition Curves_To_Brep.gh (Grasshopper 1.0.8)
# plug-ins: RhinoCodePluginGH, Pufferfish, eleFront

panel = Panel("Beam3")
panel_2 = Panel("Beam9")
panel_3 = Panel("Beam8")
panel_4 = Panel("Beam6")
panel_5 = Panel("Beam7")
c_script = CSharpScript(
    switcher=Toggle(False),
    canvas_back=ColourSwatch(SwatchColor=RGB(255, 255, 255)),
    canvas_grid=ColourSwatch(SwatchColor=RGB(255, 255, 255)))  # -> out, a; inputs switcher: Boolean, canvas_back: Color, canvas_grid: Color
# ---------- c_script: C# ----------
// Grasshopper Script Instance
#region Usings
using System;
using System.Linq;
using System.Collections;
using System.Collections.Generic;
using System.Drawing;

using Rhino;
using Rhino.Geometry;

using Grasshopper;
using Grasshopper.Kernel;
using Grasshopper.Kernel.Data;
using Grasshopper.Kernel.Types;
#endregion

public class Script_Instance : GH_ScriptInstance
{
    #region Notes
    /* 
      Members:
        RhinoDoc RhinoDocument
        GH_Document GrasshopperDocument
        IGH_Component Component
        int Iteration

      Methods (Virtual & overridable):
        Print(string text)
        Print(string format, params object[] args)
        Reflect(object obj)
        Reflect(object obj, string method_name)
    */
    #endregion

    private void RunScript(
	bool switcher,
	Color canvas_back,
	Color canvas_grid,
	ref object a)
    {
        // Write your logic here
        if (switcher == true)
    {
      Grasshopper.GUI.Canvas.GH_Skin.canvas_grid = canvas_grid;
      Grasshopper.GUI.Canvas.GH_Skin.canvas_back = canvas_back;
      Grasshopper.GUI.Canvas.GH_Skin.canvas_edge = Color.FromArgb(255, 0, 0, 0);
      Grasshopper.GUI.Canvas.GH_Skin.canvas_shade = Color.FromArgb(80, 0, 0, 0);
    }
    else
    {
      //DEFAULTS
      Grasshopper.GUI.Canvas.GH_Skin.canvas_grid = Color.FromArgb(30, 0, 0, 0);
      Grasshopper.GUI.Canvas.GH_Skin.canvas_back = Color.FromArgb(255, 212, 208, 200);
      Grasshopper.GUI.Canvas.GH_Skin.canvas_edge = Color.FromArgb(255, 0, 0, 0);
      Grasshopper.GUI.Canvas.GH_Skin.canvas_shade = Color.FromArgb(80, 0, 0, 0);
    }
    }
}
# ---------- end c_script ----------
text = Text("Beam10")

# ----
# Importing curves from pointclouds
# Open a Rhino file with the baked curves stored in layers corresponding to the beams.
# The curves produced from the beams from Kjøpmannsgata
# can be found in the GH-file "PointCloud_To_Curves", where they are internalized.
reference_by_layer = ReferenceByLayer(LayerName=text, lightweight=False)
curve = Curve(reference_by_layer)
curve_2 = Curve(flatten(curve))
area = Area(Geometry=curve_2)  # -> Area, Centroid

# ----
# Deletes small curves (Area smaller than 5cm^2)
curve_3 = Curve(curve_2)
data = Data(area.Area)
csharp_script = CSharpScript(iArea=data, iCurves=curve_3)  # -> out, message, iCurve, index, smallCurves; inputs iArea: list of Double, iCurves: list of Curve
# ---------- csharp_script: C# ----------
// Grasshopper Script Instance
using System;
using System.Collections;
using System.Collections.Generic;
using System.Drawing;

using Rhino;
using Rhino.Geometry;

using Grasshopper;
using Grasshopper.Kernel;
using Grasshopper.Kernel.Data;
using Grasshopper.Kernel.Types;
using System.Linq;

public class Script_Instance : GH_ScriptInstance
{
  /* 
    Members:
      RhinoDoc RhinoDocument
      GH_Document GrasshopperDocument
      IGH_Component Component
      int Iteration

    Methods (Virtual & overridable):
      Print(string text)
      Print(string format, params object[] args)
      Reflect(object obj)
      Reflect(object obj, string method_name)
  */
  
  private void RunScript(
	IList<double> iArea,
	IList<Curve> iCurves,
	ref object message,
	ref object iCurve,
	ref object index,
	ref object smallCurves)
  {
    // Write your logic here

    double avgArea = iArea.Average();
    double limit = avgArea/10;

    List<Curve> smallAvgCrv = new List<Curve>();
    List<double> smallArea = new List<double>();
    List<Curve> smallCrv = new List<Curve>();
    List<double> smallIndex = new List<double>();
    for (int i = 0 ; i < iArea.Count-1 ; i++)
    {
        if (iArea[i] < limit)
        {
            smallArea.Add(iArea[i]);
            smallCrv.Add(iCurves[i]);
            smallIndex.Add(i);
        }
        if(iArea[i] < avgArea*0.4)
        {
            smallAvgCrv.Add(iCurves[i]);
            smallIndex.Add(i);
        }
    }

    string iMessage = "";
    
    if(smallAvgCrv.Count != 0)
    {
        iMessage = "!!!! These curves have an area smaller than " + Math.Round(limit,4) + " m^2. This will be deleted from analysis.";

    }

    else
    {
        iMessage = "No curves was removed. ";
    }

    message = iMessage;
    iCurve = smallCrv;
    index = smallIndex;
    smallCurves = smallAvgCrv;
  }
}
# ---------- end csharp_script ----------
curve_4 = Curve(csharp_script.smallCurves)
panel_6 = Panel(csharp_script.message)
cull_index = CullIndex(List=curve_3, Indices=csharp_script.index, Wrap=True)
cull_index_2 = CullIndex(List=data, Indices=csharp_script.index, Wrap=True)
data_2 = Data(flatten(cull_index_2))
# Post processing curves
curve_5 = Curve(flatten(cull_index))

# ----
# 04.18 Partition based on 30%change in Area. Nested list
curve_6 = Curve(curve_5)
csharp_script_2 = CSharpScript(iArea=data_2, iCurves=curve_6)  # -> out, message, sublist0, indexSmallCurve, indexBigCurve, allCurvesTree; inputs iArea: list of Double, iCurves: list of Curve
# ---------- csharp_script_2: C# ----------
// Grasshopper Script Instance
using System;
using System.Collections;
using System.Collections.Generic;
using System.Drawing;

using Rhino;
using Rhino.Geometry;

using Grasshopper;
using Grasshopper.Kernel;
using Grasshopper.Kernel.Data;
using Grasshopper.Kernel.Types;
using System.Linq;

public class Script_Instance : GH_ScriptInstance
{
  /* 
    Members:
      RhinoDoc RhinoDocument
      GH_Document GrasshopperDocument
      IGH_Component Component
      int Iteration

    Methods (Virtual & overridable):
      Print(string text)
      Print(string format, params object[] args)
      Reflect(object obj)
      Reflect(object obj, string method_name)
  */
  
  private void RunScript(
	IList<double> iArea,
	IList<Curve> iCurves,
	ref object message,
	ref object sublist0,
	ref object indexSmallCurve,
	ref object indexBigCurve,
	ref object allCurvesTree)
  {
    // Write your logic here

 
    List<List<Curve>> curves = new List<List<Curve>>(); //all curves 
    List<Curve> subList = new List<Curve>(); //sublists 
    List<double> smallIndex = new List<double>(); //gaps where the next curve is smaller 
    List<double> bigIndex = new List<double>(); //gaps where the next curve is bigger
    List<double> gapIndex = new List<double>(); //first curve in gap
    List<Curve> smallestCurves = new List<Curve>(); //small curve in gap
    List<Curve> biggestCurves = new List<Curve>(); //biggest curves in gap 

    for (int i = 0 ; i < iCurves.Count-1; i++)
    {   
        double LowerLimit = iArea[i]*0.7;
        double UpperLimit = iArea[i]*1.3;


        if(i == iCurves.Count - 2) //add last curve in beam
        {
            subList.Add(iCurves[i]);
            subList.Add(iCurves[i+1]);
            curves.Add(subList);
            break;
         
        }

        if ((iArea[i+1] >= LowerLimit) && (iArea[i+1] <= UpperLimit)) //no gaps in next curve
        {
            subList.Add(iCurves[i]); //mangler den siste kurven
        }

        else { //if gaps 

            if (iArea[i+1] < LowerLimit) //if there is a gap in the next curve, both bigger and smaller
            {
                //get info about gap to projection
                gapIndex.Add(i); //where the gap has happend 
                biggestCurves.Add(iCurves[i]); //add biggest curve
                smallestCurves.Add(iCurves[i+1]); //add smallest curve

                //project smallest curve on big curve in gap
                Point3d endPt = iCurves[i].PointAtEnd;
                Plane planeGap = new Plane(endPt, Vector3d.ZAxis, Vector3d.YAxis);
                Curve projectedCurve = Curve.ProjectToPlane(iCurves[i+1], planeGap);
                
                //Add last curve, the biggest in gap
                subList.Add(iCurves[i]); //last curve before gap
                //The projection curve 

                

                if(i == iCurves.Count - 2) //add last curve in beam
                {
                    curves.Add(subList); 
                    subList = new List<Curve>();
                    subList.Add(projectedCurve);  
                    subList.Add(iCurves[i+1]);
                    curves.Add(subList);
                    break;
                }

                curves.Add(subList); 

                //make a new sublist and continue 
                subList = new List<Curve>();
                //subList.Add(projectedCurve);

                subList.Add(projectedCurve);  
                //push nested list to curves

            }  

            if (iArea[i+1] > UpperLimit) //if there is a gap in the next curve, both bigger and smaller
            {
                
                //get info about gap to projection
                gapIndex.Add(i+1); //index biggest curve in gap
                biggestCurves.Add(iCurves[i+1]); //add biggest curve
                smallestCurves.Add(iCurves[i]); //add smallest curve

                Point3d endPt = iCurves[i+1].PointAtEnd;
                Plane planeGap = new Plane(endPt, Vector3d.ZAxis, Vector3d.YAxis);
                Curve projectedCurve = Curve.ProjectToPlane(iCurves[i], planeGap);
                
                //SMALL curve before gap
                subList.Add(iCurves[i]); 
                //Projected curve in gap 
                subList.Add(projectedCurve);

                //push nested list to curves
                curves.Add(subList); 
                //make a new sublist and continue 
                subList = new List<Curve>();

                //FIRST ITEM IN SUBLIST 
                //subList.Add(projectedCurve);

                //push nested list to curves
                //curves.Add(subList); 

                
            }
        }

    }


    string iMessage = "Curves divided into sublists based on 50% change in Area.";
    
    
    message = iMessage;
    sublist0 = curves[0];
    indexSmallCurve = smallIndex;
    indexBigCurve = gapIndex;

    
    // Create a new data tree to store the curves
    GH_Structure<GH_Curve> curveTree = new GH_Structure<GH_Curve>();

    // Loop through the nested list
    for (int i = 0; i < curves.Count ; i++)
    {
        // Create a new path for the current sublist
        GH_Path path = new GH_Path(i);

        // Loop through the curves in the current sublist
        foreach (Curve curve in curves[i])
        {
            // Add the curve to the data tree under the current path
            curveTree.Append(new GH_Curve(curve), path);
        }
    }

    allCurvesTree = curveTree;
    

  }
}
# ---------- end csharp_script_2 ----------
gaps = ListItem(List=curve_6, Index=csharp_script_2.indexBigCurve, Wrap=True)
curve_7 = Curve(csharp_script_2.sublist0)
data_3 = Data(csharp_script_2.allCurvesTree)
tree_statistics = TreeStatistics(Tree=data_3)  # -> Paths, Length, Count
param_viewer = ParamViewer(data_3)
panel_7 = Panel(tree_statistics.Length)

# ----
# Brep beam - most accurate
panel_8 = Panel("0")
data_4 = Data(flatten(data_3))
simplify_curve = SimplifyCurve(Curve=data_4, Tolerance=panel_8, AngleTolerance="0")  # -> Curve, Simplified
planebeamaxis = PlaneBeamAxis(geometry=simplify_curve.Curve)  # -> line_4, line_3
curve_8 = Curve(planebeamaxis.line_4)
# Lofting to Brep
curve_align_curve_seams = CurveAlignCurveSeams(Curves=data_4, Guide=curve_8, Snap=False)  # -> Aligned, Points, ResultBoolean
curve_9 = Curve(curve_align_curve_seams.Aligned)
loft_options = LoftOptions(Closed=False, Adjust=Toggle(True), Rebuild="100", Refit="1", Type="3")
loft = Loft(Curves=curve_9, Options=loft_options)
brep_join = BrepJoin(Breps=loft)  # -> Breps, Closed
cap_holes = CapHoles(Brep=brep_join.Breps)
solid_union = SolidUnion(Breps=cap_holes)
brep = Brep(solid_union)

# ----
# Bake into seperate rhino file
# C:\Users\sofie\OneDrive - NTNU\Bygg V24\TKT4950 Master's thesis\08 Final versions\BrepGeneration\Brep_From_Curves_Convex.3dm
# C:\Users\sofie\OneDrive - NTNU\Bygg V24\TKT4950 Master's thesis\08 Final versions\BrepGeneration\Brep_From_Curves_Inner.3dm
# C:\Users\rakel\OneDrive - NTNU\Dokumenter\TKT4950 Master's thesis\08 Final versions\BrepGeneration\Brep_From_Curves_Outer.3dm
text_2 = Text(text)
elefront_attributes = EleFrontAttributes(Name=text_2, Layer=text_2)  # -> Attributes, Keys, Values, Name, Layer, ColourSource, DisplayColour, MaterialSource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
panel_9 = Panel("C:\Users\sofie\OneDrive - NTNU\Bygg V24\TKT4950 Master's thesis\08 Final versions\BrepGeneration\Brep_From_Curves_Outer.3dm")
attach_attributes = AttachAttributes(Geometry=brep, Attributes=elefront_attributes.Attributes)
bake_objects_to_file = BakeObjectsToFile(
    FilePath=panel_9,
    Geometry=attach_attributes,
    Attributes=elefront_attributes.Attributes,
    BakeName=text_2,
    Bake=False,
    networkMode=True,
    overwriteMode="Add To File",
    preset="Custom")

# ==== cluster PlaneBeamAxis
geometry = ClusterInput()

bounding_rectangle = BoundingRectangle(Geometry=geometry, Plane=PlaneXY(0, 0, 0), Axis=0, Slide=0, Union=True)  # -> Bounding, DimensionX, DimensionY
deconstruct_brep = DeconstructBrep(Brep=bounding_rectangle.Bounding)  # -> Faces, Edges, Vertices
length = Length(Curve=deconstruct_brep.Edges)
sort_list = SortList(Keys=length, ValuesValuesA=deconstruct_brep.Edges)  # -> Keys, ValuesValuesA
list_item = ListItem(List=sort_list.ValuesValuesA, Index=0, Wrap=True)
list_item_2 = ListItem(List=sort_list.ValuesValuesA, Index=1, Wrap=True)
curve_middle = CurveMiddle(Curve=list_item)
curve_middle_2 = CurveMiddle(Curve=list_item_2)
line = Line(StartPoint=curve_middle, EndPoint=curve_middle_2)

list_item_3 = ListItem(List=sort_list.ValuesValuesA, Index="-1", Wrap=True)
line_2 = Line(list_item_3)
line_3 = ClusterOutput(line)
line_4 = ClusterOutput(line_2)
