# Grasshopper definition Data_Extraction.gh (Grasshopper 1.0.8)
# plug-ins: RhinoCodePluginGH, LunchBox

# ---- group: Insert your own filepath for the Excel spreadsheet you want to write to
panel = Panel("C:\Users\sofie\OneDrive - NTNU\Bygg V24\TKT4950 Master's thesis\04 Coding\Matching Algorithm")
concatenate = Concatenate(Fragment_A=panel, Fragment_B="\", A="MatchingAlgorithmMaterials-MaterialBankGeneration", B=".xlsx")
file_path = FilePath(concatenate)

# ----
# Input Breps as List
brep = Brep(<brep referenced from the Rhino model>)
merge = Merge(Data1=brep)  # -> flatten(Result)

# ----
# Extracting CS data
# data extraced so height>width
# Unit: mm
c_script = CSharpScript(iBrep=merge)  # -> out, CSdata, a; inputs iBrep: list of Brep
# ---------- c_script: C# ----------
// Grasshopper Script Instance
#region Usings
using System;
using System.Linq;
using System.Collections;
using System.Collections.Generic;
using System.Drawing;

using Rhino;
using Rhino.Geometry;

using Grasshopper;
using Grasshopper.Kernel;
using Grasshopper.Kernel.Data;
using Grasshopper.Kernel.Types;
#endregion

public class Script_Instance : GH_ScriptInstance
{
    #region Notes
    /* 
      Members:
        RhinoDoc RhinoDocument
        GH_Document GrasshopperDocument
        IGH_Component Component
        int Iteration

      Methods (Virtual & overridable):
        Print(string text)
        Print(string format, params object[] args)
        Reflect(object obj)
        Reflect(object obj, string method_name)
    */
    #endregion

    private void RunScript(IList<Brep> iBrep, ref object CSdata, ref object a)
    {
        // Write your logic here
        DataTree<double> elementData = new DataTree<double>();
        

        for (int i=0; i<iBrep.Count; i++)
        {
            var edges = iBrep[i].Edges;
           // Use LINQ to get distinct edge lengths
           
            var uniqueLengths = edges
            .Select(edge => Math.Round(edge.ToNurbsCurve().GetLength(),2))
            .Distinct()
            .OrderByDescending(x=>x)
            .ToList();

            double length = Math.Round(uniqueLengths[0]*1000,1);
            double width = Math.Round(uniqueLengths[1]*1000,1);
            double height;
            if (uniqueLengths.Count ==2 )
            {
                height = width;
            }
            else
            {
                height = Math.Round(uniqueLengths[2]*1000,1);
            }
            

            if (width>height)
            {
                double temp = width;
                width=height;
                height = temp;
            }

            // Add data for each iteration to the DataTree
            elementData.Add(i, new GH_Path(0));
            elementData.Add(length, new GH_Path(1));
            elementData.Add(width, new GH_Path(2));
            elementData.Add(height, new GH_Path(3));
            }

        
    
        CSdata = elementData;
        

    }
}
# ---------- end c_script ----------

# ----
# WriteToExcel
# OBS! ExcelFile must be closed when writing
panel_2 = Panel("""ElementID
Length[mm]
Width[mm]
Height[mm]""")
file_path_2 = FilePath(file_path)
excel_write = ExcelWrite(
    WriteExcelData=Toggle(False),
    WorkbookPath=file_path_2,
    WorksheetName="DemandBank",
    ColumnHeadings=panel_2,
    Data=c_script.CSdata,
    ClearSheet=Toggle(True))
# Dimensions multiplied
# with 1000 from m to mm
# Dimensions multiplied
# with 1000 from m to mm
# Dimensions multiplied
# with 1000 from m to mm
panel_3 = Panel(excel_write)
