# Grasshopper definition Matching_Algorithm.gh (Grasshopper 1.0.8)
# plug-ins: RhinoCodePluginGH, LunchBox

# ---- group: Insert filepath for the Excel spreadsheet you want to write to and from
panel = Panel("C:\Users\sofie\OneDrive - NTNU\Bygg V24\TKT4950 Master's thesis\08 Final versions\Results")
panel_2 = Panel("MatchingAlgorithmCaseStudy3")
panel_3 = Panel("MatchingAlgorithmCaseStudy2")
concatenate = Concatenate(Fragment_A=panel, Fragment_B="\", A="MatchingAlgorithmCaseStudy1", B=".xlsx")
file_path = FilePath(concatenate)

# ----
boolean_toggle = BooleanToggle(True)
excel_reader = ExcelReader(ReadExcelData=boolean_toggle, WorkbookPath=file_path, WorksheetName="DemandBank")  # -> Exceptions, ExcelData
excel_reader_2 = ExcelReader(ReadExcelData=boolean_toggle, WorkbookPath=file_path, WorksheetName="MaterialBank")  # -> Exceptions, ExcelData
cull_index = CullIndex(List=excel_reader.ExcelData, Indices="0", Wrap=True)  # -> simplify(List)
cull_index_2 = CullIndex(List=excel_reader_2.ExcelData, Indices="0", Wrap=True)  # -> simplify(List)

# ----
# VolumeCriteriaAlgorithm
# Volume Criteria Algorithm is evaluating the volume utilization of the demand and material elements and chooses the match of elements, that utilize the most volume
c_script = CSharpScript(DemandBank=cull_index, MaterialBank=cull_index_2)  # -> out, demandMatches, demandMatchesBest, demandMatchesNone, matchingDataTree; inputs DemandBank: tree of Double, MaterialBank: tree of Double
# ---------- c_script: C# ----------
// Grasshopper Script Instance
#region Usings
using System;
using System.Linq;
using System.Collections;
using System.Collections.Generic;
using System.Drawing;

using Rhino;
using Rhino.Geometry;

using Grasshopper;
using Grasshopper.Kernel;
using Grasshopper.Kernel.Data;
using Grasshopper.Kernel.Types;
#endregion



public class Script_Instance : GH_ScriptInstance
{
    #region Notes
    /* 
      Members:
        RhinoDoc RhinoDocument
        GH_Document GrasshopperDocument
        IGH_Component Component
        int Iteration

      Methods (Virtual & overridable):
        Print(string text)
        Print(string format, params object[] args)
        Reflect(object obj)
        Reflect(object obj, string method_name)
    */
    #endregion

    private void RunScript(
	DataTree<double> DemandBank,
	DataTree<double> MaterialBank,
	ref object demandMatches,
	ref object demandMatchesBest,
	ref object demandMatchesNone,
	ref object matchingDataTree)
    {
       //Extracting data from the DemandBank
        List<double> demandElement = DemandBank.Branch(0);
        List<double> demandLength = DemandBank.Branch(1);
        List<double> demandWidth = DemandBank.Branch(2);
        List<double> demandHeight = DemandBank.Branch(3);

        //Extracting data from the MaterialBank/supply
        List<double> materialElement = MaterialBank.Branch(0);
        List<double> materialLength = MaterialBank.Branch(1);
        List<double> materialWidth = MaterialBank.Branch(2);
        List<double> materialHeight = MaterialBank.Branch(3);

        //Possible matches
        //List for matches for every demand element
        DataTree<double> dMatch = new DataTree<double>();
        List<int> demandNoMatch = new List<int>();

        for (int i=0; i<demandElement.Count; i++)
        {
            List<double> matchesCurrentDemand = new List<double>(); 
            for (int j=0; j<materialElement.Count; j++)
            {            
                //check length
                if (demandLength[i] <= materialLength[j])
                {
                    if (demandWidth[i] <= materialWidth[j] && demandHeight[i] <= materialHeight[j])
                    {
                        matchesCurrentDemand.Add(materialElement[j]);
                    }
                }

               else { }
            }
            
            dMatch.AddRange(matchesCurrentDemand, new GH_Path(i));
            if (matchesCurrentDemand.Count == 0)
            {
                demandNoMatch.Add(i);
            }
        }

        //Volume utilization ratio
        //Creating list with volumes 
        List<double> dVol = new List<double>();
        List<double> mVol = new List<double>();

        for (int i=0; i<demandElement.Count; i++)
        {
            dVol.Add(demandLength[i]*demandHeight[i]*demandWidth[i]);
        }

        for (int i=0; i<materialElement.Count; i++)
        {
            mVol.Add(materialLength[i]*materialHeight[i]*materialWidth[i]);
        }

        //Finding the volume utilization ratio and store in dictionary              
        Dictionary<(int,int),double> elementDictionary = new Dictionary<(int,int),double>();
        for (int i=0; i<dMatch.BranchCount; i++)
        {
            var dMatchBranches = dMatch.Branch(i);       
            for (int j = 0; j<dMatchBranches.Count;j++)
            {
                int mElement = Convert.ToInt32(dMatchBranches[j]);  //material bank element number
                int dElement = i;                                   //demand bank element number
                double ratio = dVol[i]/mVol[mElement];              //utilization ratio
                
                elementDictionary.Add((dElement,mElement),ratio);
            }
        }

        //Volume criteria
        Dictionary<(int,int),double> elementDictionaryOriginal = elementDictionary;
        Dictionary<(int,int), double> elementDictionaryBest = new Dictionary<(int,int), double>();

        while (elementDictionary.Count>0)
        {
            //Sorting the ratio from highest to lowest based on LINQ 
            var sortedRatios = elementDictionary.OrderByDescending(kv => kv.Value).ToDictionary(kv => kv.Key, kv => kv.Value);

            // Find the highest ratio value in elementDictionary
            double highestRatioValue = elementDictionary.Max(kv => kv.Value);

            // Find all key-value pairs with the highest ratio value
            var highestRatioEntries = elementDictionary.Where(kv => kv.Value == highestRatioValue);

            // If there are multiple entries with the highest ratio value, choose the one where the first key occurs the lowest number of times
            var selectedEntry = highestRatioEntries.OrderBy(kv => elementDictionary.Count(kv2 => kv2.Key.Item1 == kv.Key.Item1)).FirstOrDefault();

            // Add the selected entry to the new dictionary
            elementDictionaryBest.Add(selectedEntry.Key, selectedEntry.Value);

            // Filter the original dictionary to remove entries containing either key item 1 or key item 2
            var filteredEntries = elementDictionary.Where(kv => kv.Key.Item1 != selectedEntry.Key.Item1 && kv.Key.Item2 != selectedEntry.Key.Item2);

            // Create a new dictionary to store the filtered entries
            Dictionary<(int, int), double> newElementDictionary = filteredEntries.ToDictionary(kv => kv.Key, kv => kv.Value);

            // Update the original dictionary reference to point to the new dictionary
            elementDictionary = newElementDictionary;
        }

        // Create a new dictionary to store the pairs where item 1 from the original dictionary is not present
        Dictionary<(int, int), double> elementDictionaryNoMatch = elementDictionaryOriginal
        .Where(kv => !elementDictionary.ContainsKey((kv.Key.Item1, kv.Key.Item2)))
        .ToDictionary(kv => kv.Key, kv => kv.Value);

        // Create a list of demand elements (item 1 from the original dictionary) that have no matches in the best match list
        demandNoMatch.AddRange(elementDictionaryOriginal
            .Select(kv => kv.Key.Item1) // Select item 1 from each key-value pair in the original dictionary
            .Where(demand => !elementDictionaryBest.Any(kv => kv.Key.Item1 == demand)) // Filter out those present in the best match list
            .Distinct() // Ensure only unique values are stored
            .ToList());

        //DataTree to store the matches in
        DataTree<string> matches = new DataTree<string>();
        List<string> demandElements = new List<string>();
        List<string> demandLengths = new List<string>();
        List<string> materialElements = new List<string>();
        List<string> volumeRatio = new List<string>();
        List<string> cutoffMaterial = new List<string>();
        

                
        for (int i=0; i<demandElement.Count; i++)
        {
            demandElements.Add(i.ToString());
            demandLengths.Add(demandLength[i].ToString());
            int demand = i;
            // Find the best match for the current demand element
            bool foundMatch = false;
            foreach (var entry in elementDictionaryBest)
            {
                // If the demand element matches the key's first item
                if (entry.Key.Item1 == demand)
                    {
                    // Add the matching material element to the data tree
                    materialElements.Add(entry.Key.Item2.ToString());
                    volumeRatio.Add(Math.Round((entry.Value)*100,1).ToString());
                    cutoffMaterial.Add(Math.Round(materialLength[entry.Key.Item2]-demandLength[entry.Key.Item1]).ToString());
                    foundMatch = true;
                    break; // Break the loop since we found a match
                    }
            }

            // If no match was found, add "none" to the data tree
            if (!foundMatch)
            {
                materialElements.Add("none");
                volumeRatio.Add("none");
                cutoffMaterial.Add("none");
            }
        }


        matches.AddRange(demandElements, new GH_Path(0));
        matches.AddRange(materialElements, new GH_Path(1));
        matches.AddRange(volumeRatio, new GH_Path(2));
        matches.AddRange(demandLengths, new GH_Path(3));
        matches.AddRange(cutoffMaterial, new GH_Path(4));

        demandMatches = elementDictionaryOriginal.Keys;
        demandMatchesBest = elementDictionaryBest.Keys;
        demandMatchesNone = demandNoMatch;
        matchingDataTree = matches;
        }
    }
# ---------- end c_script ----------

# ----
# WriteToExcel
# OBS! ExcelFile must be closed when writing
panel_4 = Panel("""Demand element ID
Matching element ID
Volume Utilization[%]
Cut-off Lengths [mm]
Cut-off material [mm]""")
file_path_2 = FilePath(concatenate)
excel_write = ExcelWrite(
    WriteExcelData=Toggle(False),
    WorkbookPath=file_path_2,
    WorksheetName="MatchingAlgorithm",
    ColumnHeadings=panel_4,
    Data=c_script.matchingDataTree,
    ClearSheet=Toggle(True))
panel_5 = Panel(excel_write)
