# Grasshopper definition Transformation_PointClouds.gh (Grasshopper 1.0.8)
# plug-ins: RhinoCodePluginGH, eleFront

panel = Panel("04.10 Beam3")
panel_2 = Panel("04.10 Beam6")
panel_3 = Panel("04.10 Beam8")
panel_4 = Panel("04.10 Beam7")
panel_5 = Panel("04.10 Beam9")

# ----
# Change the file path to yours:
panel_6 = Panel("C:\Users\sofie\OneDrive - NTNU\Bygg V24\TKT4950 Master's thesis\05 Scanning\Zivid camera\BeamTemplates\Beam_2000\")
text = Text("04.10 Beam10")
# Step1
concatenate = Concatenate(Fragment_A=panel_6, Fragment_B=text, A="\PointClouds\")

# ----
# Importing pointclouds
csharp_script = CSharpScript(ifolder_path=concatenate)  # -> out, a; inputs ifolder_path: String
# ---------- csharp_script: C# ----------
// Grasshopper Script Instance
using System;
using System.Collections;
using System.Collections.Generic;
using System.Drawing;

using Rhino;
using Rhino.Geometry;

using Grasshopper;
using Grasshopper.Kernel;
using Grasshopper.Kernel.Data;
using Grasshopper.Kernel.Types;

public class Script_Instance : GH_ScriptInstance
{
  /* 
    Members:
      RhinoDoc RhinoDocument
      GH_Document GrasshopperDocument
      IGH_Component Component
      int Iteration

    Methods (Virtual & overridable):
      Print(string text)
      Print(string format, params object[] args)
      Reflect(object obj)
      Reflect(object obj, string method_name)
  */
  
  private void RunScript(string ifolder_path, object y, ref object a)
  {
    // Write your logic here
     List<string> file_paths = new List<string>();

        for (int i = 1; i < 11; i++)
        {
            string file_name = "Pos" + i + " - Cloud.e57";
            file_paths.Add(ifolder_path + file_name); // Add the file path to the list
        }

        a = file_paths;
  }

  
}
# ---------- end csharp_script ----------
csharp_script_2 = CSharpScript(ifolder_path=concatenate)  # -> out, a; inputs ifolder_path: String
# ---------- csharp_script_2: C# ----------
// Grasshopper Script Instance
using System;
using System.Collections;
using System.Collections.Generic;
using System.Drawing;

using Rhino;
using Rhino.Geometry;

using Grasshopper;
using Grasshopper.Kernel;
using Grasshopper.Kernel.Data;
using Grasshopper.Kernel.Types;

public class Script_Instance : GH_ScriptInstance
{
  /* 
    Members:
      RhinoDoc RhinoDocument
      GH_Document GrasshopperDocument
      IGH_Component Component
      int Iteration

    Methods (Virtual & overridable):
      Print(string text)
      Print(string format, params object[] args)
      Reflect(object obj)
      Reflect(object obj, string method_name)
  */
  
  private void RunScript(string ifolder_path, object y, ref object a)
  {
    // Write your logic here
     List<string> file_paths = new List<string>();

        for (int i = 1; i < 11; i++)
        {
            string file_name = "Pos" + i + "flipped - Cloud.e57";
            file_paths.Add(ifolder_path + file_name); // Add the file path to the list
        }

        a = file_paths;
  }

  
}
# ---------- end csharp_script_2 ----------
import_content = ImportContent(
    FilePath=csharp_script.a,
    Name="*",
    Layer="*",
    Linetype="*",
    HatchPattern="*",
    AnnotationStyles="*",
    Materials="*",
    BlockDefinitions="*")  # -> ModelTransform, Objects, Layers, Linetypes, HatchPatterns, AnnotationStyles, Materials, BlockDefinitions
import_content_2 = ImportContent(
    FilePath=csharp_script_2.a,
    Name="*",
    Layer="*",
    Linetype="*",
    HatchPattern="*",
    AnnotationStyles="*",
    Materials="*",
    BlockDefinitions="*")  # -> ModelTransform, Objects, Layers, Linetypes, HatchPatterns, AnnotationStyles, Materials, BlockDefinitions
point_cloud = PointCloud(flatten(import_content.Objects))

point_cloud_2 = PointCloud(flatten(import_content_2.Objects))

# ----
# Fill in path for transformation matrix folder
# Pos6
# Pos7
# Pos8
folderpath_transformationmatrix = Panel("C:\Users\sofie\OneDrive - NTNU\Bygg V24\TKT4950 Master's thesis\08 Final versions\PointCloudGeneration\TransformationMatrix")

# ---- group: Aligning, transformation of all scans. Normal side
# Normal Scans (first side)
# Pos1
# Pos2
# Pos3
# Pos4
# Pos5
# Pos6
# Pos7
# Pos8
# Pos9
# Pos10
panel_7 = Panel("\Pos2.mat.txt")
file_path = FilePath(folderpath_transformationmatrix)
file_path_2 = FilePath(folderpath_transformationmatrix)
file_path_3 = FilePath(folderpath_transformationmatrix)
file_path_4 = FilePath(folderpath_transformationmatrix)
file_path_5 = FilePath(folderpath_transformationmatrix)
file_path_6 = FilePath(folderpath_transformationmatrix)
file_path_7 = FilePath(folderpath_transformationmatrix)
file_path_8 = FilePath(folderpath_transformationmatrix)
file_path_9 = FilePath(folderpath_transformationmatrix)
file_path_10 = FilePath(folderpath_transformationmatrix)
concatenate_2 = Concatenate(FragmentA=file_path, FragmentB=panel_7)
concatenate_3 = Concatenate(FragmentA=file_path_2, FragmentB="\Pos4.mat.txt")
concatenate_4 = Concatenate(FragmentA=file_path_3, FragmentB="\Pos3.mat.txt")
concatenate_5 = Concatenate(FragmentA=file_path_4, FragmentB="\Pos5.mat.txt")
concatenate_6 = Concatenate(FragmentA=file_path_5, FragmentB="\Pos6.mat.txt")
concatenate_7 = Concatenate(FragmentA=file_path_6, FragmentB="\Pos8.mat.txt")
concatenate_8 = Concatenate(FragmentA=file_path_7, FragmentB="\Pos7.mat.txt")
concatenate_9 = Concatenate(FragmentA=file_path_8, FragmentB="\Pos1.mat.txt")
concatenate_10 = Concatenate(FragmentA=file_path_9, FragmentB="\Pos10.mat.txt")
concatenate_11 = Concatenate(FragmentA=file_path_10, FragmentB="\Pos9.mat.txt")
file_path_11 = FilePath(concatenate_9)
file_path_12 = FilePath(concatenate_7)
file_path_13 = FilePath(concatenate_2)
file_path_14 = FilePath(concatenate_6)
file_path_15 = FilePath(concatenate_8)
file_path_16 = FilePath(concatenate_3)
file_path_17 = FilePath(concatenate_4)
file_path_18 = FilePath(concatenate_5)
file_path_19 = FilePath(concatenate_10)
file_path_20 = FilePath(concatenate_11)
read_file = ReadFile(File=file_path_12, PerLineParse=True)  # -> flatten(Content)
read_file_2 = ReadFile(File=file_path_11, PerLineParse=True)  # -> flatten(Content)
read_file_3 = ReadFile(File=file_path_13, PerLineParse=True)  # -> flatten(Content)
read_file_4 = ReadFile(File=file_path_14, PerLineParse=True)  # -> flatten(Content)
read_file_5 = ReadFile(File=file_path_15, PerLineParse=True)  # -> flatten(Content)
read_file_6 = ReadFile(File=file_path_16, PerLineParse=True)  # -> flatten(Content)
read_file_7 = ReadFile(File=file_path_17, PerLineParse=True)  # -> flatten(Content)
read_file_8 = ReadFile(File=file_path_19, PerLineParse=True)  # -> flatten(Content)
read_file_9 = ReadFile(File=file_path_18, PerLineParse=True)  # -> flatten(Content)
read_file_10 = ReadFile(File=file_path_20, PerLineParse=True)  # -> flatten(Content)
python_3_script = Python3Script(x=read_file_2)  # -> Output, flatten(a)
# ---------- python_3_script: Python ----------
# Define the function to parse the input data and return a list of 16 numbers
def parse_input_data(data):
    lines = data.split("\n")
    numbers = []
    for line in lines:
        line_data = line.split()
        for item in line_data:
            numbers.append((item))
    return numbers

# Get input data from Grasshopper panel
data = x

# Parse input data and get the list of 16 numbers
result = parse_input_data(data)

# Output the result
a = result
# ---------- end python_3_script ----------
python_3_script_2 = Python3Script(x=read_file_3)  # -> Output, flatten(a); same code as python_3_script
python_3_script_3 = Python3Script(x=read_file)  # -> Output, flatten(a); same code as python_3_script
python_3_script_4 = Python3Script(x=read_file_4)  # -> Output, flatten(a); same code as python_3_script
python_3_script_5 = Python3Script(x=read_file_5)  # -> Output, flatten(a); same code as python_3_script
python_3_script_6 = Python3Script(x=read_file_6)  # -> Output, flatten(a); same code as python_3_script
python_3_script_7 = Python3Script(x=read_file_7)  # -> Output, flatten(a); same code as python_3_script
python_3_script_8 = Python3Script(x=read_file_8)  # -> Output, flatten(a); same code as python_3_script
python_3_script_9 = Python3Script(x=read_file_9)  # -> Output, flatten(a); same code as python_3_script
python_3_script_10 = Python3Script(x=read_file_10)  # -> Output, flatten(a); same code as python_3_script
panel_8 = Panel(python_3_script_6.a)
panel_9 = Panel(python_3_script_7.a)
panel_10 = Panel(python_3_script_2.a)
panel_11 = Panel(python_3_script_3.a)
panel_12 = Panel(python_3_script_4.a)
panel_13 = Panel(python_3_script_5.a)
panel_14 = Panel(python_3_script.a)
panel_15 = Panel(python_3_script_9.a)
panel_16 = Panel(python_3_script_8.a)
panel_17 = Panel(python_3_script_10.a)
# Step2
panel_18 = Panel("0")
list_item = ListItem(List=point_cloud, Index="2", Wrap=True)
list_item_2 = ListItem(List=point_cloud, Index=panel_18, Wrap=True)
list_item_3 = ListItem(List=point_cloud, Index="4", Wrap=True)
list_item_4 = ListItem(List=point_cloud, Index="7", Wrap=True)
list_item_5 = ListItem(List=point_cloud, Index="3", Wrap=True)
list_item_6 = ListItem(List=point_cloud, Index="5", Wrap=True)
list_item_7 = ListItem(List=point_cloud, Index="6", Wrap=True)
list_item_8 = ListItem(List=point_cloud, Index="1", Wrap=True)
list_item_9 = ListItem(List=point_cloud, Index="9", Wrap=True)
list_item_10 = ListItem(List=point_cloud, Index="8", Wrap=True)
construct_matrix = ConstructMatrix(Rows=4, Columns=4, Values=panel_10)
construct_matrix_2 = ConstructMatrix(Rows=4, Columns=4, Values=panel_9)
construct_matrix_3 = ConstructMatrix(Rows=4, Columns=4, Values=panel_14)
construct_matrix_4 = ConstructMatrix(Rows=4, Columns=4, Values=panel_8)
construct_matrix_5 = ConstructMatrix(Rows=4, Columns=4, Values=panel_12)
construct_matrix_6 = ConstructMatrix(Rows=4, Columns=4, Values=panel_11)
construct_matrix_7 = ConstructMatrix(Rows=4, Columns=4, Values=panel_15)
construct_matrix_8 = ConstructMatrix(Rows=4, Columns=4, Values=panel_13)
construct_matrix_9 = ConstructMatrix(Rows=4, Columns=4, Values=panel_16)
construct_matrix_10 = ConstructMatrix(Rows=4, Columns=4, Values=panel_17)
point_cloud_3 = PointCloud(list_item)
point_cloud_4 = PointCloud(list_item_2)
point_cloud_5 = PointCloud(list_item_8)
point_cloud_6 = PointCloud(list_item_4)
point_cloud_7 = PointCloud(list_item_3)
point_cloud_8 = PointCloud(list_item_5)
point_cloud_9 = PointCloud(list_item_6)
point_cloud_10 = PointCloud(list_item_7)
point_cloud_11 = PointCloud(list_item_9)
point_cloud_12 = PointCloud(list_item_10)
scale = Scale(Geometry=point_cloud_3, Center=Point(0, 0, 0), Factor="0.001")  # -> Geometry, Transform
transform_matrix = TransformMatrix(construct_matrix, Digits=3)
scale_2 = Scale(Geometry=point_cloud_4, Center=Point(0, 0, 0), Factor="0.001")  # -> Geometry, Transform
scale_3 = Scale(Geometry=point_cloud_5, Center=Point(0, 0, 0), Factor="0.001")  # -> Geometry, Transform
transform_matrix_2 = TransformMatrix(construct_matrix_2, Digits=3)
scale_4 = Scale(Geometry=point_cloud_6, Center=Point(0, 0, 0), Factor="0.001")  # -> Geometry, Transform
transform_matrix_3 = TransformMatrix(construct_matrix_3, Digits=3)
scale_5 = Scale(Geometry=point_cloud_9, Center=Point(0, 0, 0), Factor="0.001")  # -> Geometry, Transform
transform_matrix_4 = TransformMatrix(construct_matrix_4, Digits=3)
transform_matrix_5 = TransformMatrix(construct_matrix_7, Digits=3)
scale_6 = Scale(Geometry=point_cloud_7, Center=Point(0, 0, 0), Factor="0.001")  # -> Geometry, Transform
transform_matrix_6 = TransformMatrix(construct_matrix_5, Digits=3)
transform_matrix_7 = TransformMatrix(construct_matrix_6, Digits=3)
scale_7 = Scale(Geometry=point_cloud_8, Center=Point(0, 0, 0), Factor="0.001")  # -> Geometry, Transform
scale_8 = Scale(Geometry=point_cloud_10, Center=Point(0, 0, 0), Factor="0.001")  # -> Geometry, Transform
transform_matrix_8 = TransformMatrix(construct_matrix_8, Digits=3)
scale_9 = Scale(Geometry=point_cloud_11, Center=Point(0, 0, 0), Factor="0.001")  # -> Geometry, Transform
transform_matrix_9 = TransformMatrix(construct_matrix_9, Digits=3)
scale_10 = Scale(Geometry=point_cloud_12, Center=Point(0, 0, 0), Factor="0.001")  # -> Geometry, Transform
transform_matrix_10 = TransformMatrix(construct_matrix_10, Digits=3)
transform = Transform(Geometry=scale_3.Geometry, Transform=transform_matrix)
transform_2 = Transform(Geometry=scale.Geometry, Transform=transform_matrix_2)
# Step3
transform_3 = Transform(Geometry=scale_2.Geometry, Transform=transform_matrix_3)
transform_4 = Transform(Geometry=scale_7.Geometry, Transform=transform_matrix_4)
transform_5 = Transform(Geometry=scale_5.Geometry, Transform=transform_matrix_6)
transform_6 = Transform(Geometry=scale_4.Geometry, Transform=transform_matrix_7)
transform_7 = Transform(Geometry=scale_6.Geometry, Transform=transform_matrix_5)
transform_8 = Transform(Geometry=scale_8.Geometry, Transform=transform_matrix_8)
transform_9 = Transform(Geometry=scale_9.Geometry, Transform=transform_matrix_9)
transform_10 = Transform(Geometry=scale_10.Geometry, Transform=transform_matrix_10)

# ----
list_item_11 = ListItem(List=point_cloud_2, Index="4", Wrap=True)
list_item_12 = ListItem(List=point_cloud_2, Index="0", Wrap=True)
list_item_13 = ListItem(List=point_cloud_2, Index="3", Wrap=True)
list_item_14 = ListItem(List=point_cloud_2, Index="6", Wrap=True)
list_item_15 = ListItem(List=point_cloud_2, Index="5", Wrap=True)
list_item_16 = ListItem(List=point_cloud_2, Index="7", Wrap=True)
list_item_17 = ListItem(List=point_cloud_2, Index="2", Wrap=True)
list_item_18 = ListItem(List=point_cloud_2, Index="1", Wrap=True)

# ---- group: Aligning, transformation of all scans. Flipped side
# Flipped Scans (second side)
# Pos1
# Pos2
# Pos3
# Pos4
# Pos5
panel_19 = Panel("\Pos2.mat.txt")
# Pos9
# Pos10
panel_20 = Panel("\Pos8.mat.txt")
file_path_21 = FilePath(folderpath_transformationmatrix)
file_path_22 = FilePath(folderpath_transformationmatrix)
file_path_23 = FilePath(folderpath_transformationmatrix)
file_path_24 = FilePath(folderpath_transformationmatrix)
file_path_25 = FilePath(folderpath_transformationmatrix)
file_path_26 = FilePath(folderpath_transformationmatrix)
file_path_27 = FilePath(folderpath_transformationmatrix)
file_path_28 = FilePath(folderpath_transformationmatrix)
file_path_29 = FilePath(folderpath_transformationmatrix)
file_path_30 = FilePath(folderpath_transformationmatrix)
concatenate_12 = Concatenate(FragmentA=file_path_21, FragmentB=panel_19)
concatenate_13 = Concatenate(FragmentA=file_path_22, FragmentB="\Pos4.mat.txt")
concatenate_14 = Concatenate(FragmentA=file_path_23, FragmentB="\Pos3.mat.txt")
concatenate_15 = Concatenate(FragmentA=file_path_24, FragmentB="\Pos5.mat.txt")
concatenate_16 = Concatenate(FragmentA=file_path_25, FragmentB="\Pos6.mat.txt")
concatenate_17 = Concatenate(FragmentA=file_path_26, FragmentB=panel_20)
concatenate_18 = Concatenate(FragmentA=file_path_27, FragmentB="\Pos7.mat.txt")
concatenate_19 = Concatenate(FragmentA=file_path_28, FragmentB="\Pos1.mat.txt")
concatenate_20 = Concatenate(FragmentA=file_path_29, FragmentB="\Pos10.mat.txt")
concatenate_21 = Concatenate(FragmentA=file_path_30, FragmentB="\Pos9.mat.txt")
file_path_31 = FilePath(concatenate_19)
file_path_32 = FilePath(concatenate_12)
file_path_33 = FilePath(concatenate_17)
file_path_34 = FilePath(concatenate_16)
file_path_35 = FilePath(concatenate_13)
file_path_36 = FilePath(concatenate_18)
file_path_37 = FilePath(concatenate_14)
file_path_38 = FilePath(concatenate_20)
file_path_39 = FilePath(concatenate_15)
file_path_40 = FilePath(concatenate_21)
read_file_11 = ReadFile(File=file_path_33, PerLineParse=True)  # -> flatten(Content)
read_file_12 = ReadFile(File=file_path_31, PerLineParse=True)  # -> flatten(Content)
read_file_13 = ReadFile(File=file_path_32, PerLineParse=True)  # -> flatten(Content)
read_file_14 = ReadFile(File=file_path_34, PerLineParse=True)  # -> flatten(Content)
read_file_15 = ReadFile(File=file_path_36, PerLineParse=True)  # -> flatten(Content)
read_file_16 = ReadFile(File=file_path_35, PerLineParse=True)  # -> flatten(Content)
read_file_17 = ReadFile(File=file_path_38, PerLineParse=True)  # -> flatten(Content)
read_file_18 = ReadFile(File=file_path_37, PerLineParse=True)  # -> flatten(Content)
read_file_19 = ReadFile(File=file_path_39, PerLineParse=True)  # -> flatten(Content)
read_file_20 = ReadFile(File=file_path_40, PerLineParse=True)  # -> flatten(Content)
python_3_script_11 = Python3Script(x=read_file_12)  # -> Output, flatten(a); same code as python_3_script
python_3_script_12 = Python3Script(x=read_file_13)  # -> Output, flatten(a); same code as python_3_script
python_3_script_13 = Python3Script(x=read_file_11)  # -> Output, flatten(a); same code as python_3_script
python_3_script_14 = Python3Script(x=read_file_14)  # -> Output, flatten(a); same code as python_3_script
python_3_script_15 = Python3Script(x=read_file_15)  # -> Output, flatten(a); same code as python_3_script
python_3_script_16 = Python3Script(x=read_file_16)  # -> Output, flatten(a); same code as python_3_script
python_3_script_17 = Python3Script(x=read_file_17)  # -> Output, flatten(a); same code as python_3_script
python_3_script_18 = Python3Script(x=read_file_18)  # -> Output, flatten(a); same code as python_3_script
python_3_script_19 = Python3Script(x=read_file_19)  # -> Output, flatten(a); same code as python_3_script
python_3_script_20 = Python3Script(x=read_file_20)  # -> Output, flatten(a); same code as python_3_script
panel_21 = Panel(python_3_script_16.a)
panel_22 = Panel(python_3_script_18.a)
panel_23 = Panel(python_3_script_12.a)
panel_24 = Panel(python_3_script_13.a)
panel_25 = Panel(python_3_script_14.a)
panel_26 = Panel(python_3_script_15.a)
panel_27 = Panel(python_3_script_17.a)
panel_28 = Panel(python_3_script_19.a)
panel_29 = Panel(python_3_script_20.a)
panel_30 = Panel(python_3_script_11.a)
list_item_19 = ListItem(List=point_cloud_2, Index="8", Wrap=True)
list_item_20 = ListItem(List=point_cloud_2, Index="9", Wrap=True)
construct_matrix_11 = ConstructMatrix(Rows=4, Columns=4, Values=panel_23)
construct_matrix_12 = ConstructMatrix(Rows=4, Columns=4, Values=panel_22)
construct_matrix_13 = ConstructMatrix(Rows=4, Columns=4, Values=panel_30)
construct_matrix_14 = ConstructMatrix(Rows=4, Columns=4, Values=panel_21)
construct_matrix_15 = ConstructMatrix(Rows=4, Columns=4, Values=panel_25)
construct_matrix_16 = ConstructMatrix(Rows=4, Columns=4, Values=panel_24)
construct_matrix_17 = ConstructMatrix(Rows=4, Columns=4, Values=panel_28)
construct_matrix_18 = ConstructMatrix(Rows=4, Columns=4, Values=panel_26)
construct_matrix_19 = ConstructMatrix(Rows=4, Columns=4, Values=panel_27)
construct_matrix_20 = ConstructMatrix(Rows=4, Columns=4, Values=panel_29)
point_cloud_13 = PointCloud(list_item_17)
point_cloud_14 = PointCloud(list_item_12)
point_cloud_15 = PointCloud(list_item_13)
point_cloud_16 = PointCloud(list_item_14)
point_cloud_17 = PointCloud(list_item_18)
point_cloud_18 = PointCloud(list_item_11)
point_cloud_19 = PointCloud(list_item_15)
point_cloud_20 = PointCloud(list_item_16)
point_cloud_21 = PointCloud(list_item_19)
point_cloud_22 = PointCloud(list_item_20)
scale_11 = Scale(Geometry=point_cloud_13, Center=Point(0, 0, 0), Factor="0.001")  # -> Geometry, Transform
scale_12 = Scale(Geometry=point_cloud_14, Center=Point(0, 0, 0), Factor="0.001")  # -> Geometry, Transform
transform_matrix_11 = TransformMatrix(construct_matrix_11, Digits=3)
transform_matrix_12 = TransformMatrix(construct_matrix_12, Digits=3)
transform_matrix_13 = TransformMatrix(construct_matrix_13, Digits=3)
scale_13 = Scale(Geometry=point_cloud_15, Center=Point(0, 0, 0), Factor="0.001")  # -> Geometry, Transform
scale_14 = Scale(Geometry=point_cloud_16, Center=Point(0, 0, 0), Factor="0.001")  # -> Geometry, Transform
transform_matrix_14 = TransformMatrix(construct_matrix_14, Digits=3)
transform_matrix_15 = TransformMatrix(construct_matrix_15, Digits=3)
scale_15 = Scale(Geometry=point_cloud_17, Center=Point(0, 0, 0), Factor="0.001")  # -> Geometry, Transform
transform_matrix_16 = TransformMatrix(construct_matrix_16, Digits=3)
transform_matrix_17 = TransformMatrix(construct_matrix_17, Digits=3)
scale_16 = Scale(Geometry=point_cloud_18, Center=Point(0, 0, 0), Factor="0.001")  # -> Geometry, Transform
scale_17 = Scale(Geometry=point_cloud_19, Center=Point(0, 0, 0), Factor="0.001")  # -> Geometry, Transform
transform_matrix_18 = TransformMatrix(construct_matrix_18, Digits=3)
scale_18 = Scale(Geometry=point_cloud_20, Center=Point(0, 0, 0), Factor="0.001")  # -> Geometry, Transform
scale_19 = Scale(Geometry=point_cloud_21, Center=Point(0, 0, 0), Factor="0.001")  # -> Geometry, Transform
transform_matrix_19 = TransformMatrix(construct_matrix_19, Digits=3)
transform_matrix_20 = TransformMatrix(construct_matrix_20, Digits=3)
scale_20 = Scale(Geometry=point_cloud_22, Center=Point(0, 0, 0), Factor="0.001")  # -> Geometry, Transform
transform_11 = Transform(Geometry=scale_15.Geometry, Transform=transform_matrix_11)
transform_12 = Transform(Geometry=scale_11.Geometry, Transform=transform_matrix_12)
transform_13 = Transform(Geometry=scale_12.Geometry, Transform=transform_matrix_13)
transform_14 = Transform(Geometry=scale_13.Geometry, Transform=transform_matrix_14)
transform_15 = Transform(Geometry=scale_17.Geometry, Transform=transform_matrix_15)
transform_16 = Transform(Geometry=scale_18.Geometry, Transform=transform_matrix_16)
transform_17 = Transform(Geometry=scale_16.Geometry, Transform=transform_matrix_17)
transform_18 = Transform(Geometry=scale_14.Geometry, Transform=transform_matrix_18)
transform_19 = Transform(Geometry=scale_20.Geometry, Transform=transform_matrix_19)
transform_20 = Transform(Geometry=scale_19.Geometry, Transform=transform_matrix_20)

# ----
# Bake into Layer: MergedFlip
merge = Merge(
    Data1=transform_13,
    Data2=transform_11,
    Data3=transform_12,
    Data4=transform_14,
    Data5=transform_17,
    Data6=transform_15,
    Data7=transform_18,
    Data8=transform_16,
    Data9=transform_20,
    Data10=transform_19)

# ----
# Open the Rhino file: Tranformation_PointClouds
# Bake into Layer: MergedNormal
merge_2 = Merge(
    Data1=transform_3,
    Data2=transform,
    Data3=transform_2,
    Data4=transform_4,
    Data5=transform_7,
    Data6=transform_5,
    Data7=transform_8,
    Data8=transform_6,
    Data9=transform_10,
    Data10=transform_9)

# ---- group: Align the upper and lower part of the scans
# Rotating flipped beam
panel_31 = Panel("MergedNormal")
reference_by_layer = ReferenceByLayer(LayerName="MergedFlip", lightweight=False)
reference_by_layer_2 = ReferenceByLayer(LayerName=panel_31, lightweight=False)
point_cloud_23 = PointCloud(reference_by_layer_2)
point_cloud_24 = PointCloud(reference_by_layer)
csharp_script_3 = CSharpScript(x=point_cloud_24)  # -> out, a; inputs x: list
# ---------- csharp_script_3: C# ----------
// Grasshopper Script Instance
using System;
using System.Collections;
using System.Collections.Generic;
using System.Drawing;

using Rhino;
using Rhino.Geometry;

using Grasshopper;
using Grasshopper.Kernel;
using Grasshopper.Kernel.Data;
using Grasshopper.Kernel.Types;

public class Script_Instance : GH_ScriptInstance
{
  /* 
    Members:
      RhinoDoc RhinoDocument
      GH_Document GrasshopperDocument
      IGH_Component Component
      int Iteration

    Methods (Virtual & overridable):
      Print(string text)
      Print(string format, params object[] args)
      Reflect(object obj)
      Reflect(object obj, string method_name)
  */
  
  private void RunScript(IList<PointCloud> x, object y, ref object a)
  {
    // Write your logic here
        // Initialize a new point cloud to store the merged points
    
        PointCloud mergedCloud = new PointCloud();

        // Iterate through each GH_PointCloud in the input list
        foreach (PointCloud cloud in x)
        {
            // Access the underlying Rhino.Geometry.PointCloud
            PointCloud pointCloud = cloud;

            // Iterate through each point in the current point cloud
            for (int i = 0; i < pointCloud.Count; i++)
            {
                // Get the point and color from the current point cloud
                Point3d point = pointCloud[i].Location;
                Color color = pointCloud[i].Color;

                // Add the point with its color to the merged point cloud
                mergedCloud.Add(point, color);
            }
        }

        // Create a new GH_PointCloud object from the merged point cloud
        GH_PointCloud ghMergedCloud = new GH_PointCloud(mergedCloud);

        // Output the merged point cloud
        a = ghMergedCloud;
    }
    /*
    List<PointCloud> mergedClouds = new List<PointCloud>();

    foreach (List<PointCloud> cloud in x)
    {
        mergedClouds.AddRange(cloud);     
    }



    a = mergedClouds;
    */


  }
# ---------- end csharp_script_3 ----------
csharp_script_4 = CSharpScript(x=point_cloud_23)  # -> out, a; inputs x: list; same code as csharp_script_3
point_cloud_25 = PointCloud(csharp_script_3.a)
point_cloud_attributes = PointCloudAttributes(Cloud=point_cloud_25)  # -> Cloud, Locations, Normals, Colours, Extra, Hidden
# Step4
fit_line = FitLine(Points=point_cloud_attributes.Locations)
perp_frame = PerpFrame(Curve=fit_line, Parameter="0")
bounding_box = BoundingBox(Content=point_cloud_25, Plane=perp_frame)  # -> Box, Box_2
deconstruct_brep = DeconstructBrep(Brep=bounding_box.Box)  # -> Faces, Edges, Vertices
list_item_21 = ListItem(List=deconstruct_brep.Faces, Index="4", Wrap=True)
list_item_22 = ListItem(List=deconstruct_brep.Faces, Index="5", Wrap=True)
area = Area(Geometry=list_item_21)  # -> Area, Centroid
area_2 = Area(Geometry=list_item_22)  # -> Area, Centroid
line = Line(StartPoint=area.Centroid, EndPoint=area_2.Centroid)
rotate_axis = RotateAxis(Geometry=point_cloud_25, Angle=degrees("180"), Axis=line)  # -> Geometry, Transform

# Bake into TransNormal
point_cloud_26 = PointCloud(csharp_script_4.a)

# Bake into TransFlip
point_cloud_27 = PointCloud(rotate_axis.Geometry)

# ---- group: Export the files for further work in cloud compare
# Export for cleaning, aligning and merging in cloudcompare
panel_32 = Panel("\PointCloudsMerged")
text_2 = Text(panel_6)
text_3 = Text(text)
concatenate_22 = Concatenate(Fragment_A=text_3, Fragment_B="_", A="TransNormal")
concatenate_23 = Concatenate(Fragment_A=text_3, Fragment_B="_", A="TransFlip")
reference_by_layer_3 = ReferenceByLayer(LayerName="TransFlip", lightweight=False)
reference_by_layer_4 = ReferenceByLayer(LayerName="TransNormal", lightweight=False)
# Step5
concatenate_24 = Concatenate(Fragment_A=text_2, Fragment_B=text_3, A=panel_32)
export_generic = ExportGeneric(
    FolderPath=concatenate_24,
    FileName=concatenate_23,
    FileExtension=".ply",
    RhinoObjects=reference_by_layer_3,
    AxisSystem=PlaneXY(0, 0, 0),
    Export=False,
    Overwrite=False,
    networkMode=True)
export_generic_2 = ExportGeneric(
    FolderPath=concatenate_24,
    FileName=concatenate_22,
    FileExtension=".ply",
    RhinoObjects=reference_by_layer_4,
    AxisSystem=PlaneXY(0, 0, 0),
    Export=False,
    Overwrite=False,
    networkMode=True)
