# Grasshopper definition Study Case 1 w. Matching Algorithm.gh (Grasshopper 1.0.8)
# plug-ins: Karamba3D, RhinoCodePluginGH, Heteroptera, Pufferfish, Minimum bounding box, LunchBox

license_karamba3d = LicenseKaramba3D()
panel = Panel(license_karamba3d)

# ---- group: VariableInputParameters
yspacing = Slider(4, range=2..6)
xspacing = Slider(5, range=2..5)
floors = Slider(3, range=1..6)
floorheight_m = Slider(4, range=2.4..4)

# ----
rectangle = Rectangle(Plane=PlaneXY(0, 0, 0), XSize="20", YSize="12", Radius=0)  # -> Rectangle, Length
c_script = CSharpScript(
    switcher=Toggle(False),
    canvas_back=ColourSwatch(SwatchColor=RGB(255, 255, 255)),
    canvas_grid=ColourSwatch(SwatchColor=RGB(255, 255, 255)))  # -> out, a; inputs switcher: Boolean, canvas_back: Color, canvas_grid: Color
# ---------- c_script: C# ----------
// Grasshopper Script Instance
#region Usings
using System;
using System.Linq;
using System.Collections;
using System.Collections.Generic;
using System.Drawing;

using Rhino;
using Rhino.Geometry;

using Grasshopper;
using Grasshopper.Kernel;
using Grasshopper.Kernel.Data;
using Grasshopper.Kernel.Types;
#endregion

public class Script_Instance : GH_ScriptInstance
{
    #region Notes
    /* 
      Members:
        RhinoDoc RhinoDocument
        GH_Document GrasshopperDocument
        IGH_Component Component
        int Iteration

      Methods (Virtual & overridable):
        Print(string text)
        Print(string format, params object[] args)
        Reflect(object obj)
        Reflect(object obj, string method_name)
    */
    #endregion

    private void RunScript(
	bool switcher,
	Color canvas_back,
	Color canvas_grid,
	ref object a)
    {
        // Write your logic here
        if (switcher == true)
    {
      Grasshopper.GUI.Canvas.GH_Skin.canvas_grid = canvas_grid;
      Grasshopper.GUI.Canvas.GH_Skin.canvas_back = canvas_back;
      Grasshopper.GUI.Canvas.GH_Skin.canvas_edge = Color.FromArgb(255, 0, 0, 0);
      Grasshopper.GUI.Canvas.GH_Skin.canvas_shade = Color.FromArgb(80, 0, 0, 0);
    }
    else
    {
      //DEFAULTS
      Grasshopper.GUI.Canvas.GH_Skin.canvas_grid = Color.FromArgb(30, 0, 0, 0);
      Grasshopper.GUI.Canvas.GH_Skin.canvas_back = Color.FromArgb(255, 212, 208, 200);
      Grasshopper.GUI.Canvas.GH_Skin.canvas_edge = Color.FromArgb(255, 0, 0, 0);
      Grasshopper.GUI.Canvas.GH_Skin.canvas_shade = Color.FromArgb(80, 0, 0, 0);
    }
    }
}
# ---------- end c_script ----------
numberxspcing = Number(xspacing)
numberyspacing = Number(yspacing)

# ----
# Matching algorithm
panel_2 = Panel("Insert your own file path for the spreadsheet with the matching algorithm")
boolean_toggle = BooleanToggle(True)  # disabled
panel_3 = Panel("MaterialBank")  # disabled
file_path = FilePath(panel_2)  # disabled
excel_reader = ExcelReader(ReadExcelData=boolean_toggle, WorkbookPath=file_path, WorksheetName=panel_3)  # -> Exceptions, ExcelData; disabled
panel_4 = Panel("0")  # disabled
cull_index = CullIndex(List=excel_reader.ExcelData, Indices=panel_4, Wrap=True)  # -> simplify(List); disabled

# ----
# Import MatchingAlgorithm data
panel_5 = Panel("C:\Users\sofie\OneDrive - NTNU\Bygg V24\TKT4950 Master's thesis\08 Final versions\Results")
concatenate = Concatenate(Fragment_A=panel_5, Fragment_B="\", A="MatchingAlgorithmCaseStudy1", B=".xlsx")
file_path_2 = FilePath(concatenate)
excel_reader_2 = ExcelReader(ReadExcelData=Toggle(True), WorkbookPath=file_path_2, WorksheetName="MatchingAlgorithm")  # -> Exceptions, ExcelData
cull_index_2 = CullIndex(List=excel_reader_2.ExcelData, Indices="0", Wrap=True)  # -> simplify(List)

# ---- group: Geometric model
numbertransversebeamsdiv = Panel("3")

# ---- group: Geometric model / creating surfaces and floors
multiplication = Multiplication(A=floors, B=floorheight_m)
surface = Surface(rectangle.Rectangle)
area = Area(Geometry=surface)  # -> Area, Centroid

# ---- group: Geometric model
brep_edges = BrepEdges(Brep=surface)  # -> Naked, Interior, NonManifold
list_item = ListItem(List=brep_edges.Naked, Index=0, Wrap=True)  # -> Item, Item1, Item2, Item3
curve = Curve(list_item.Item)
curve_2 = Curve(list_item.Item3)
point_divide_curve_target_length = PointDivideCurveTargetLength(Curve=curve, Target=numberxspcing, DivisionType="1", EndPoint=False)  # -> flatten(Points), Tangents, Parameters, Length, ResultBoolean
point_divide_curve_target_length_2 = PointDivideCurveTargetLength(Curve=curve_2, Target=numberyspacing, DivisionType="1", EndPoint=False)  # -> flatten(Points), Tangents, Parameters, Length, ResultBoolean
list_length = ListLength(List=point_divide_curve_target_length.Points)
panel_6 = Panel(point_divide_curve_target_length.Length)
panel_7 = Panel(point_divide_curve_target_length_2.Length)
list_length_2 = ListLength(List=point_divide_curve_target_length_2.Points)
xdiv = Number(list_length)
ydiv = Number(list_length_2)
panel_8 = Panel(xdiv)
panel_9 = Panel(ydiv)

numberheight = Number(multiplication)

# ---- group: Geometric model / creating surfaces and floors (continued)
unit_z = UnitZ(Factor=numberheight)
line_sdl = LineSDL(Start=area.Centroid, Direction=unit_z, Length=numberheight)
perp_frames = PerpFrames(Curve=line_sdl, Count=floors, Align=True)  # -> Frames, Parameters
project = Project(Geometry=surface, Plane=perp_frames.Frames)  # -> Geometry, Transform

# ---- group: Geometric model / floors
boolean_toggle_2 = BooleanToggle(True)
split_tree = SplitTree(Data=project.Geometry, Masks=flatten("{0;0}[0]"))  # -> Positive, Negative
clean_tree = CleanTree(RemoveNulls=True, RemoveInvalid=True, RemoveEmpty=boolean_toggle_2, Tree=split_tree.Positive)
clean_tree_2 = CleanTree(RemoveNulls=True, RemoveInvalid=True, RemoveEmpty=boolean_toggle_2, Tree=split_tree.Negative)
surfacegroundfloor = Surface(clean_tree)
surfacefloors = Surface(clean_tree_2)

# ---- group: Geometric model / creating nodes
divide_surface = DivideSurface(Surface=project.Geometry, UCount=expr("x-1", xdiv), VCount=expr("x-1", ydiv))  # -> Points, Normals, Parameters
csharp_script = CSharpScript(inodes=divide_surface.Points)  # -> out, ground, not_ground; inputs inodes: list of Point3d
# ---------- csharp_script: C# ----------
// Grasshopper Script Instance
using System;
using System.Collections;
using System.Collections.Generic;
using System.Drawing;

using Rhino;
using Rhino.Geometry;

using Grasshopper;
using Grasshopper.Kernel;
using Grasshopper.Kernel.Data;
using Grasshopper.Kernel.Types;

public class Script_Instance : GH_ScriptInstance
{
  /* 
    Members:
      RhinoDoc RhinoDocument
      GH_Document GrasshopperDocument
      IGH_Component Component
      int Iteration

    Methods (Virtual & overridable):
      Print(string text)
      Print(string format, params object[] args)
      Reflect(object obj)
      Reflect(object obj, string method_name)
  */
  
  private void RunScript(
	IList<Point3d> inodes,
	ref object ground,
	ref object not_ground)
  {
    // Write your logic here

    List<Point3d> ground_floor = new List<Point3d>();
    List<Point3d> not_ground_floor = new List<Point3d>();

    for (int i = 0 ; i < inodes.Count ; i++)
    {
        if (inodes[i].Z == 0)
        {
            ground_floor.Add(inodes[i]);
        }
        else if (inodes[i].Z != 0)
        {
            not_ground_floor.Add(inodes[i]);
        }
    }

    


    ground = ground_floor;
    not_ground = not_ground_floor;

  }
}
# ---------- end csharp_script ----------
clean_tree_3 = CleanTree(RemoveNulls=True, RemoveInvalid=True, RemoveEmpty=Toggle(True), Tree=csharp_script.not_ground)
clean_tree_4 = CleanTree(RemoveNulls=True, RemoveInvalid=True, RemoveEmpty=Toggle(True), Tree=csharp_script.ground)
pointground = Point(simplify(clean_tree_4))
pointfloors = Point(simplify(clean_tree_3))

# ---- group: Geometric model / facades
numberheight_2 = Number(numberheight)
box_rectangle = BoxRectangle(Rectangle=surfacegroundfloor, Height=numberheight_2)
deconstruct_brep = DeconstructBrep(Brep=box_rectangle)  # -> Faces, Edges, Vertices
list_item_2 = ListItem(List=deconstruct_brep.Faces, Index="3", Wrap=True)
list_item_3 = ListItem(List=deconstruct_brep.Faces, Index="2", Wrap=True)
list_item_4 = ListItem(List=deconstruct_brep.Faces, Index="0", Wrap=True)
list_item_5 = ListItem(List=deconstruct_brep.Faces, Index="1", Wrap=True)
surfacexfacade2 = Surface(list_item_2)
surfaceyfacade1 = Surface(list_item_4)
surfaceyfacade2 = Surface(list_item_3)
surfacexfacade1 = Surface(list_item_5)

# ---- group: Geometric model / Columns
point = Point(simplify(divide_surface.Points))
path_mapper = PathMapper(point, source="{A;B}(i)", target="{i;B}(A)")
polylinecolumn = PolyLine(Vertices=path_mapper, Closed=False)
explode = Explode(Curve=polylinecolumn, Recursive=True)  # -> Segments, Vertices
curve_3 = Curve(explode.Segments)

# ---- group: Geometric model / SupportPoints
point_2 = Point(simplify(pointground))

# ---- group: Geometric model / MainBeamsXAll
point_3 = Point(pointfloors)
path_mapper_2 = PathMapper(point_3, source="{A;B}(i)", target="{i;A}(B)")
polylinebeamsx = PolyLine(Vertices=path_mapper_2, Closed=False)
explode_2 = Explode(Curve=polylinebeamsx, Recursive=True)  # -> Segments, Vertices
curve_4 = Curve(explode_2.Segments)

# ---- group: Geometric model / MainBeamsY_FullLength
point_4 = Point(pointfloors)
polylinebeamsy = PolyLine(Vertices=point_4, Closed=False)
explode_3 = Explode(Curve=polylinebeamsy, Recursive=True)  # -> Segments, Vertices
curve_5 = Curve(explode_3.Segments)

# ---- group: Geometric model / MainBeamsY_Splitted
curvebeamsy = Curve(curve_5)
divide_curve = DivideCurve(Curve=curvebeamsy, CountNumberTransB=numbertransversebeamsdiv, Kinks=False)  # -> Points, Tangents, Parameters
polyline = PolyLine(Vertices=divide_curve.Points, Closed=False)
explode_4 = Explode(Curve=polyline, Recursive=True)  # -> Segments, Vertices
curve_6 = Curve(simplify(explode_4.Segments))

# ---- group: Geometric model / MainBeamsY Splitted w. division for joints
list_length_3 = ListLength(List=curve_6)
subtraction = Subtraction(A=list_length_3, B="2")
tree_branch = TreeBranch(Tree=subtraction, Path="{1;0;0}", MaintainPaths=True)  # -> flatten(Branch)
merge = Merge(Data1="1", Data2=tree_branch, Data3="1")
partition_list = PartitionList(List=curve_6, Size=merge)
split_tree_2 = SplitTree(Data=partition_list, Masks=flatten("{*;*;*;0}"))  # -> Positive, Negative
split_tree_3 = SplitTree(Data=partition_list, Masks=flatten("{*;*;*;1}"))  # -> Positive, Negative
split_tree_4 = SplitTree(Data=partition_list, Masks=flatten("{*;*;*;2}"))  # -> Positive, Negative
entwine = Entwine(Branch00=split_tree_2.Positive, Branch01=split_tree_3.Positive, Branch02=split_tree_4.Positive, FlattenInputs=True)  # -> simplify(Result)

# ---- group: Geometric model / TransverseBeams
point_5 = Point(divide_curve.Points)
split_list = SplitList(List=point_5, Index="1")  # -> ListA, ListB
reverse_list = ReverseList(List=split_list.ListB)
split_list_2 = SplitList(List=reverse_list, Index="1")  # -> ListA, ListB
reverse_list_2 = ReverseList(List=split_list_2.ListB)  # -> simplify(List)
point_6 = Point(reverse_list_2)
path_mapper_3 = PathMapper(point_6, source="{A;B;C}(i)", target="{A;i;C} (B)")
polylinetranversebeams = PolyLine(Vertices=path_mapper_3, Closed=False)
explode_5 = Explode(Curve=polylinetranversebeams, Recursive=True)  # -> Segments, Vertices

# ---- group: Geometric model / MainBeamX Splitted for loading
# BeamWithLoad
ydiv_2 = Number(expr("x-1", ydiv))
concatenate_2 = Concatenate(Fragment_A="{", Fragment_B=ydiv_2, A=";*;*}")  # -> flatten(Result)
split_tree_5 = SplitTree(Data=curve_4, Masks=flatten(["{0;*;*}", concatenate_2]))  # -> Positive, Negative
curveedges = Curve(flatten(split_tree_5.Positive))
curvemiddle = Curve(flatten(split_tree_5.Negative))
entwine_2 = Entwine(Branch00=curveedges, Branch01=curvemiddle, FlattenInputs=True)

# ---- group: Geometric model / Column
cluster = Cluster_2(curve=curve_3, spacingy=ydiv, spacingx=xdiv)  # -> facadecolumns, midcolumns
line = Line(cluster.facadecolumns)
line_2 = Line(cluster.midcolumns)

# ---- group: Supports
points_on_foundation = Point(point_2)
support_karamba3d = SupportKaramba3D(PosInd=points_on_foundation, menu=[buttons(on, on, on, on, on, on)])
support_karamba3d_2 = SupportKaramba3D(support_karamba3d)

# ---- group: Cross Sections
material_selection_karamba3d = MaterialSelectionKaramba3D(menu=[dropdown(1), dropdown(4)])
material_selection_karamba3d_2 = MaterialSelectionKaramba3D(menu=[dropdown(4), dropdown(11)])
gene_pool = GenePool(Decimals=0, Maximum=20, Minimum=8, Value=15)
gene_pool_2 = GenePool(Decimals=0, Maximum=10, Minimum=7, Value=9)
gene_pool_3 = GenePool(Decimals=0, Maximum=24, Minimum=6, Value=15)
gene_pool_4 = GenePool(Decimals=0, Maximum=10, Minimum=7, Value=7)
gene_pool_5 = GenePool(Decimals=0, Maximum=12, Minimum=7, Value=10)
gene_pool_6 = GenePool(Decimals=0, Maximum=44, Minimum=10, Value=18)
gene_pool_7 = GenePool(Decimals=0, Maximum=24, Minimum=6, Value=17)
gene_pool_8 = GenePool(Decimals=0, Maximum=24, Minimum=10, Value=17)
material_karamba3d = MaterialKaramba3D(material_selection_karamba3d_2)
panel_10 = Panel("""MainBeamLeft
MainBeamMid
MainBeamRight""")
division = Division(A=gene_pool, B="4")
cross_section_karamba3d = CrossSectionKaramba3D(
    FamilyNameOfCrossSection="DefaultCroSec",
    NameOfCrossSection=panel_10,
    ElementIdentifier=panel_10,
    Material=material_karamba3d,
    Height_cm=expr("x*2", gene_pool_8),
    UpperFlangeWidth_cm=expr("x*2", gene_pool_5),
    LowerFlangeWidth_cm=expr("x*2", gene_pool_5),
    mode="Trapezoid")
cross_section_karamba3d_2 = CrossSectionKaramba3D(
    FamilyNameOfCrossSection="DefaultCroSec",
    NameOfCrossSection="Brazing",
    ElementIdentifier="Brazing",
    Material=material_selection_karamba3d,
    Diameter_cm=expr("x/2", gene_pool),
    WallThickness_cm=division,
    mode="Circular Hollow")
cross_section_karamba3d_3 = CrossSectionKaramba3D(
    FamilyNameOfCrossSection="DefaultCroSec",
    NameOfCrossSection="Column",
    ElementIdentifier="Column",
    Material=material_karamba3d,
    Height_cm=expr("x*2", gene_pool_6),
    UpperFlangeWidth_cm=expr("x*2", gene_pool_6),
    LowerFlangeWidth_cm=expr("x*2", gene_pool_6),
    mode="Trapezoid")

# ---- group: Loads
# x and y defines the wind direction meaning that
# 
# x = wind in direction x, acting on the smaller y Facade
# 
# y = wind in direction y, acting on the longer x Facade
load_combinations = Panel("""6.10(a) x
6.10(a) y
6.10(b) x
6.10(b) y
SLS""")
spacingycount = Number(expr("x-1", ydiv))
spacingxcount = Number(expr("x-1", xdiv))
surfaceyfacade1_2 = Surface(surfaceyfacade1)
surfacexfacade1_2 = Surface(surfacexfacade1)
windload = Panel("""1.0 * 1.5 * 0.7
1.0 * 1.5 * 0
1.00 * 1.50 * 0.7
1.0 * 1.5 * 0
1.0 * 0.0""")
windload_2 = Panel("""1.0 * 1.5 * 0
1.0 * 1.5 * 0.7
1.00 * 1.50 * 0
1.0 * 1.5 * 0.7
1.0 * 0.7""")
numberfloors = Number(floors)
numberfloors_2 = Number(floors)
spacingycount_2 = Number(expr("x-1", ydiv))
mesh_surface = MeshSurface(Surface=surfaceyfacade1_2, UCount=spacingycount, VCount=numberfloors, Overhang=True, Equalize=False)
numbertransverse = Number(numbertransversebeamsdiv)
liveload = Panel("""3.0 * 1.5 * 0.7
3.0 * 1.5 * 0.7
3.00 * 1.50
3.00 * 1.50
3.00 * 1.00""")
spacingycount_3 = Number(expr("x-1", ydiv))
deadload2 = Panel("""2.0 * 1.35
2.0 * 1.35
2.00 * 1.2
2.00 * 1.2
2.0 * 1.0""")
numbertransverse_2 = Number(numbertransversebeamsdiv)
mesh_surface_2 = MeshSurface(Surface=surfacexfacade1_2, UCount=spacingxcount, VCount=numberfloors_2, Overhang=True, Equalize=False)
# Loads and load combinations
deadload1 = Panel("""1.00 * 1.35
1.00 * 1.35
1.00 * 1.2
1.00 * 1.2
1.0 * 1.0""")
surfacefloors_2 = Surface(surfacefloors)
multiplication_2 = Multiplication(A=numbertransverse, B=spacingycount_2)
unit_y = UnitY(Factor=windload_2)
unit_x = UnitX(Factor=windload)
surfacefloors_3 = Surface(surfacefloors)
multiplication_3 = Multiplication(A=numbertransverse_2, B=spacingycount_3)
unit_z_2 = UnitZ(Factor=expr("-x", deadload1))
unit_z_3 = UnitZ(Factor=expr("-x", deadload2))
unit_z_4 = UnitZ(Factor=expr("-x", liveload))
mesh_surface_3 = MeshSurface(Surface=surfacefloors_3, UCount=spacingxcount, VCount=multiplication_2, Overhang=True, Equalize=False)
mesh_surface_4 = MeshSurface(Surface=surfacefloors_2, UCount=spacingxcount, VCount=multiplication_3, Overhang=True, Equalize=False)
loads_karamba3d = LoadsKaramba3D(Vector=graft(unit_z_2), LCase=graft(load_combinations), mode="Gravity")
load_karamba3d = LoadKaramba(flatten(loads_karamba3d))
# LC0: Dominating deadload + wind on y-facade
# LC0: Dominating deadload + wind on x-facade
# LC1a: Dominating Liveload + wind on y-facade
# LC1b: Dominating Liveload + wind on x-facade
panel_11 = Panel(load_karamba3d)

# ---- group: Geometric model / Brazing
cluster_2 = Cluster(curve=curve_3, spacingy=expr("x-1", ydiv), spacingx=expr("x-1", xdiv))  # -> list, list_2, list_3, list_4

# {0,0}
# {4,5}
line_3 = Line(simplify(cluster_2.list))
line_4 = Line(simplify(cluster_2.list_2))

# {4,0}
# {0,5}
line_5 = Line(simplify(cluster_2.list_3))
line_6 = Line(simplify(cluster_2.list_4))

merge_2 = Merge(Data1=line_3, Data2=line_4, Data3=line_5, Data4=line_6)

# ---- group: Elements
mainbeamy_groups = Panel("""MainBeamLeft
MainBeamMid
MainBeamRight""")
panel_12 = Panel("SecondaryBeams2")
panel_13 = Panel("SecondaryBeams1")
line_7 = Line(curve_4)
line_8 = Line(entwine)
curve_7 = Curve(explode_5.Segments)
line_to_beam_karamba3d = LineToBeamKaramba3D(
    Line=line_8,
    Identifier=graft(mainbeamy_groups),
    New=True,
    Remove=True,
    LimitDistance_m=0.005,
    Bending=True,
    SetBucklingLength=True,
    ToPolylineMaxAngle=0.03,
    ToPolylineTolerance=0.01,
    ToPolylineMaxEdgeLength=0.25)  # -> simplify(Element), Points, Info
line_to_beam_karamba3d_2 = LineToBeamKaramba3D(
    Line=line_7,
    Identifier=panel_13,
    New=True,
    Remove=True,
    LimitDistance_m=0.005,
    Bending=True,
    SetBucklingLength=True,
    ToPolylineMaxAngle=0.03,
    ToPolylineTolerance=0.01,
    ToPolylineMaxEdgeLength=0.25)  # -> Element, Points, Info
line_to_beam_karamba3d_3 = LineToBeamKaramba3D(
    Line=curve_7,
    Identifier=panel_12,
    New=True,
    Remove=True,
    LimitDistance_m=0.005,
    Bending=True,
    SetBucklingLength=True,
    ToPolylineMaxAngle=0.03,
    ToPolylineTolerance=0.01,
    ToPolylineMaxEdgeLength=0.25)  # -> Element, Points, Info
panel_14 = Panel("Column")
panel_15 = Panel("Brazing")
line_9 = Line(flatten(merge_2))
line_10 = Line(curve_3)
line_to_beam_karamba3d_4 = LineToBeamKaramba3D(
    Line=line_10,
    Identifier=panel_14,
    New=True,
    Remove=True,
    LimitDistance_m=0.005,
    Bending=True,
    SetBucklingLength=True,
    ToPolylineMaxAngle=0.03,
    ToPolylineTolerance=0.01,
    ToPolylineMaxEdgeLength=0.25)  # -> Element, Points, Info
line_to_beam_karamba3d_5 = LineToBeamKaramba3D(
    Line=line_9,
    Identifier=panel_15,
    New=True,
    Remove=True,
    LimitDistance_m=0.005,
    Bending=False,
    SetBucklingLength=False,
    ToPolylineMaxAngle=0.03,
    ToPolylineTolerance=0.01,
    ToPolylineMaxEdgeLength=0.25)  # -> Element, Points, Info
element_karamba3d = ElementKaramba3D([line_to_beam_karamba3d_5.Element, line_to_beam_karamba3d_4.Element, line_to_beam_karamba3d_3.Element, line_to_beam_karamba3d_2.Element, line_to_beam_karamba3d.Element])

# ---- group: Loads (continued)
panel_16 = Panel([panel_13, panel_12])
panel_17 = Panel(panel_14)
loads_karamba3d_2 = LoadsKaramba3D(
    Vector=graft(unit_x),
    Mesh=mesh_surface,
    ElementIdentifiers=panel_17,
    LCase=graft(load_combinations),
    mode="MeshLoad -Const.",
    menu=[buttons(off, on, off), buttons(off, on)])
loads_karamba3d_3 = LoadsKaramba3D(
    Vector=graft(unit_y),
    Mesh=mesh_surface_2,
    ElementIdentifiers=panel_17,
    LCase=graft(load_combinations),
    mode="MeshLoad -Const.",
    menu=[buttons(off, on, off), buttons(off, on)])
loads_karamba3d_4 = LoadsKaramba3D(
    Vector=graft(unit_z_3),
    Mesh=mesh_surface_3,
    ElementIdentifiers=panel_16,
    LCase=graft(load_combinations),
    mode="MeshLoad -Const.",
    menu=[buttons(off, on, off), buttons(off, on)])
loads_karamba3d_5 = LoadsKaramba3D(
    Vector=graft(unit_z_4),
    Mesh=mesh_surface_4,
    ElementIdentifiers=panel_16,
    LCase=graft(load_combinations),
    mode="MeshLoad -Const.",
    menu=[buttons(off, on, off), buttons(off, on)])
load_karamba3d_2 = LoadKaramba3D(flatten(loads_karamba3d_2))
load_karamba3d_3 = LoadKaramba3D(flatten(loads_karamba3d_3))
load_karamba3d_4 = LoadKaramba3D(flatten(loads_karamba3d_4))
load_karamba3d_5 = LoadKaramba3D(flatten(loads_karamba3d_5))
load_karamba3d_6 = LoadKaramba3D(flatten([load_karamba3d_4, load_karamba3d, load_karamba3d_5, load_karamba3d_2, load_karamba3d_3]))

# ---- group: Cross Sections (continued)
panel_18 = Panel(panel_13)
panel_19 = Panel(panel_12)
cross_section_karamba3d_4 = CrossSectionKaramba3D(
    FamilyNameOfCrossSection="DefaultCroSec",
    NameOfCrossSection=panel_18,
    ElementIdentifier=panel_18,
    Material=material_karamba3d,
    Height_cm=expr("x*2", gene_pool_3),
    UpperFlangeWidth_cm=expr("x*2", gene_pool_2),
    LowerFlangeWidth_cm=expr("x*2", gene_pool_2),
    mode="Trapezoid")
cross_section_karamba3d_5 = CrossSectionKaramba3D(
    FamilyNameOfCrossSection="DefaultCroSec",
    NameOfCrossSection=panel_19,
    ElementIdentifier=panel_19,
    Material=material_karamba3d,
    Height_cm=expr("x*2", gene_pool_7),
    UpperFlangeWidth_cm=expr("x*2", gene_pool_4),
    LowerFlangeWidth_cm=expr("x*2", gene_pool_4),
    mode="Trapezoid")
cross_section_karamba3d_6 = CrossSectionKaramba3D(flatten([cross_section_karamba3d_4, cross_section_karamba3d_5, cross_section_karamba3d, cross_section_karamba3d_3, cross_section_karamba3d_2]))

# ---- group: Connections
panel_20 = Panel(panel_16)
beam_joints_karamba3d = BeamJointsKaramba3D(
    AtElementIdentifiers=panel_20,
    CtKNMAtStartingNode=Vector(0, 0, 0),
    CrKNmRadAtStartingNode=Vector(0, 0, 0),
    CtKNMAtEndNode=Vector(0, 0, 0),
    CrKNmRadAtEndNode=Vector(0, 0, 0),
    menu=[buttons(off, off, off, off, on, on), buttons(off, off, off, off, on, on)])
beam_joints_karamba3d_2 = BeamJointsKaramba3D(
    AtElementIdentifiers="MainBeamLeft",
    CtKNMAtStartingNode=Vector(0, 0, 0),
    CrKNmRadAtStartingNode=Vector(0, 0, 0),
    CtKNMAtEndNode=Vector(0, 0, 0),
    CrKNmRadAtEndNode=Vector(0, 0, 0),
    menu=[buttons(off, off, off, off, on, on), buttons(off, off, off, off, off, off)])
beam_joints_karamba3d_3 = BeamJointsKaramba3D(
    AtElementIdentifiers="MainBeamRight",
    CtKNMAtStartingNode=Vector(0, 0, 0),
    CrKNmRadAtStartingNode=Vector(0, 0, 0),
    CtKNMAtEndNode=Vector(0, 0, 0),
    CrKNmRadAtEndNode=Vector(0, 0, 0),
    menu=[buttons(off, off, off, off, off, off), buttons(off, off, off, off, on, on)])
beam_joints_karamba3d_4 = BeamJointsKaramba3D(
    AtElementIdentifiers="MainBeamMid",
    CtKNMAtStartingNode=Vector(0, 0, 0),
    CrKNmRadAtStartingNode=Vector(0, 0, 0),
    CtKNMAtEndNode=Vector(0, 0, 0),
    CrKNmRadAtEndNode=Vector(0, 0, 0),
    menu=[buttons(off, off, off, off, off, off), buttons(off, off, off, off, off, off)])
beam_joints_karamba3d_5 = BeamJointsKaramba3D(
    AtElementIdentifiers="Brazing",
    CtKNMAtStartingNode=Vector(0, 0, 0),
    CrKNmRadAtStartingNode=Vector(0, 0, 0),
    CtKNMAtEndNode=Vector(0, 0, 0),
    CrKNmRadAtEndNode=Vector(0, 0, 0),
    menu=[buttons(off, off, off, off, on, on), buttons(off, off, off, off, on, on)])
panel_21 = Panel(panel_17)
beam_joints_karamba3d_6 = BeamJointsKaramba3D(
    AtElementIdentifiers=panel_21,
    CtKNMAtStartingNode=Vector(0, 0, 0),
    CrKNmRadAtStartingNode=Vector(0, 0, 0),
    CtKNMAtEndNode=Vector(0, 0, 0),
    CrKNmRadAtEndNode=Vector(0, 0, 0),
    menu=[buttons(off, off, off, off, off, off), buttons(off, off, off, off, off, off)])
joint_karamba3d = JointKaramba3D([beam_joints_karamba3d_6, beam_joints_karamba3d, beam_joints_karamba3d_4, beam_joints_karamba3d_2, beam_joints_karamba3d_3, beam_joints_karamba3d_5])

# ---- group: Assemble Model - Structural Model
cross_section_karamba3d_7 = CrossSectionKaramba3D(flatten(cross_section_karamba3d_6))
element_karamba3d_2 = ElementKaramba3D(flatten(element_karamba3d))
support_karamba3d_3 = SupportKaramba3D(flatten(support_karamba3d_2))
load_karamba3d_7 = LoadKaramba3D(flatten(load_karamba3d_6))
joint_karamba3d_2 = JointKaramba3D(flatten(joint_karamba3d))
assemble_model_karamba3d = AssembleModelKaramba3D(
    Elem=element_karamba3d_2,
    Support=support_karamba3d_3,
    Load=load_karamba3d_7,
    CrossSection=cross_section_karamba3d_7,
    Joint=joint_karamba3d_2,
    LimitDistance_m=0.005)  # -> Model, Info, Mass_kg, CentreOfGravity, LoadCaseNames
total_mass = Panel(assemble_model_karamba3d.Mass_kg)
load_cases = Panel(assemble_model_karamba3d.LoadCaseNames)
model_karamba3d = ModelKaramba3D(assemble_model_karamba3d.Model)
information_about_the_structural_model = Panel(model_karamba3d)

# ---- group: Results
# Element identifyers
brazing = Text(panel_15)
column = Text(panel_14)
mainbeamsy = Text(mainbeamy_groups)
secondarybeams1 = Text(panel_13)
secondarybeams2 = Text(panel_12)

# ---- group: Optimization 1 - ULS Utilization
panel_22 = Panel(panel_13)
panel_23 = Panel(panel_12)
panel_24 = Panel("""MainBeamLeft
MainBeamMid
MainBeamRight""")
galapagos = Galapagos(
    fitness=number_11,
    gene=[gene_pool_3, gene_pool_2, gene_pool_7, gene_pool_4, gene_pool_8, gene_pool_5, gene_pool_6, gene_pool])

# ---- group: Vertical deflection - example
# vertical deflection example for figures
list = ValueList({"6.10(a) x": 0, "6.10(a) y": 1, "6.10(b) x": 2, "6.10(b) y": 3, "SLS": 4}, selected="SLS")
panel_25 = Panel("""0
0.5""")
secondarybeams1_2 = Text(secondarybeams1)
converting_m_to_cm = Panel("100")
index_ts_0 = Panel("0")
index_ts_0_5 = Panel("1")

# ---- group: Optimization 2 - SLS Deflection
# Before deflection optimization:
# Max declection:
# Secondary Beams1: 2.30 cm OBS!
# Secondary Beams2: 2.84 cm OBS!
# Main Beams Y: 1.25 cm
# 
# Problems with secondary beams, why they will be optimized
panel_26 = Panel("MainBeamMid")
secondarybeams2_2 = Text(secondarybeams2)
secondarybeams1_3 = Text(secondarybeams1)
panel_27 = Panel("""0
0.5""")
panel_28 = Panel("""0
0.5""")
lengthsecondarybeams = Number(panel_6)
lengthsecondarybeams_2 = Number(panel_6)
galapagos_2 = Galapagos(fitness=number_12, gene=[gene_pool_2, gene_pool_3, gene_pool_7, gene_pool_4])

# ---- group: Results
# Deformation visualization
unit_z_5 = UnitZ(Factor=1)
curve_8 = Curve(<curve referenced from the Rhino model>)

# Utilizations of beams
merge_3 = Merge(Data1=secondarybeams1, Data2=secondarybeams2, Data3=mainbeamsy)  # -> flatten(Result)
loadcombinations = Text(load_combinations)
panel_29 = Panel(loadcombinations)

model_karamba3d_2 = ModelKaramba3D(model_karamba3d)
analyze_karamba3d = AnalyzeKaramba3D(Model=model_karamba3d_2)  # -> CalculatedModel, MaximumDisplacement_cm, ResultingForceOfGravity_kN, ElasticEnergyChange_kNm
maximum_displacement = Panel(analyze_karamba3d.MaximumDisplacement_cm)
model_karamba3d_3 = ModelKaramba3D(analyze_karamba3d.CalculatedModel)
model_karamba3d_4 = ModelKaramba3D(analyze_karamba3d.CalculatedModel)
model_karamba3d_5 = ModelKaramba3D(model_karamba3d_4)
information_of_the_model = Panel(model_karamba3d_3)
model_karamba3d_6 = ModelKaramba3D(model_karamba3d_2)

# ---- group: Optimization 1 - ULS Utilization (continued)
model_karamba3d_7 = ModelKaramba3D(model_karamba3d_5)
model_karamba3d_8 = ModelKaramba3D(model_karamba3d_5)
model_karamba3d_9 = ModelKaramba3D(model_karamba3d_5)
utilization_of_elements_karamba3d = UtilizationOfElementsKaramba3D(
    AnalyzedModel=model_karamba3d_7,
    ElementsIdentifiers="Brazing",
    NumberOfSamplePoints=3,
    ElasticDesign=True,
    GammaM0=1,
    GammaM1=1.1,
    SwayFrame=True,
    WithDetails=False,
    mode="Beams")  # -> AnalyzedModel, Utilization, SigMax_kN_cm2, SigMin_kN_cm2, TauMax_kN_cm2, UtilN, UtilVy, UtilVz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
model_karamba3d_10 = ModelKaramba3D(model_karamba3d_5)
model_karamba3d_11 = ModelKaramba3D(model_karamba3d_5)
utilization_of_elements_karamba3d_2 = UtilizationOfElementsKaramba3D(
    AnalyzedModel=model_karamba3d_8,
    ElementsIdentifiers=panel_22,
    NumberOfSamplePoints=3,
    ElasticDesign=True,
    GammaM0=1,
    GammaM1=1.1,
    SwayFrame=True,
    WithDetails=False,
    mode="Beams")  # -> AnalyzedModel, Utilization, SigMax_kN_cm2, SigMin_kN_cm2, TauMax_kN_cm2, UtilN, UtilVy, UtilVz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
utilization_of_elements_karamba3d_3 = UtilizationOfElementsKaramba3D(
    AnalyzedModel=model_karamba3d_11,
    ElementsIdentifiers="Column",
    NumberOfSamplePoints=3,
    ElasticDesign=True,
    GammaM0=1,
    GammaM1=1.1,
    SwayFrame=True,
    WithDetails=False,
    mode="Beams")  # -> AnalyzedModel, Utilization, SigMax_kN_cm2, SigMin_kN_cm2, TauMax_kN_cm2, UtilN, UtilVy, UtilVz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
utilization_of_elements_karamba3d_4 = UtilizationOfElementsKaramba3D(
    AnalyzedModel=model_karamba3d_10,
    ElementsIdentifiers=panel_23,
    NumberOfSamplePoints=3,
    ElasticDesign=True,
    GammaM0=1,
    GammaM1=1.1,
    SwayFrame=True,
    WithDetails=False,
    mode="Beams")  # -> AnalyzedModel, Utilization, SigMax_kN_cm2, SigMin_kN_cm2, TauMax_kN_cm2, UtilN, UtilVy, UtilVz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
utilization_of_elements_karamba3d_5 = UtilizationOfElementsKaramba3D(
    AnalyzedModel=model_karamba3d_9,
    ElementsIdentifiers=panel_24,
    NumberOfSamplePoints=3,
    ElasticDesign=True,
    GammaM0=1,
    GammaM1=1.1,
    SwayFrame=True,
    WithDetails=False,
    mode="Beams")  # -> AnalyzedModel, Utilization, SigMax_kN_cm2, SigMin_kN_cm2, TauMax_kN_cm2, UtilN, UtilVy, UtilVz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
min_max = MinMax(Number=utilization_of_elements_karamba3d.Utilization)  # -> Minimum, Maximum
number = Number(min_max.Maximum)
min_max_2 = MinMax(Number=utilization_of_elements_karamba3d_2.Utilization)  # -> Minimum, Maximum
min_max_3 = MinMax(Number=utilization_of_elements_karamba3d_3.Utilization)  # -> Minimum, Maximum
min_max_4 = MinMax(Number=utilization_of_elements_karamba3d_4.Utilization)  # -> Minimum, Maximum
min_max_5 = MinMax(Number=utilization_of_elements_karamba3d_5.Utilization)  # -> Minimum, Maximum
csharp_script_2 = CSharpScript(iUtilization=number)  # -> out, penalty; inputs iUtilization: Double
# ---------- csharp_script_2: C# ----------
// Grasshopper Script Instance
using System;
using System.Collections;
using System.Collections.Generic;
using System.Drawing;

using Rhino;
using Rhino.Geometry;

using Grasshopper;
using Grasshopper.Kernel;
using Grasshopper.Kernel.Data;
using Grasshopper.Kernel.Types;

public class Script_Instance : GH_ScriptInstance
{
  /* 
    Members:
      RhinoDoc RhinoDocument
      GH_Document GrasshopperDocument
      IGH_Component Component
      int Iteration

    Methods (Virtual & overridable):
      Print(string text)
      Print(string format, params object[] args)
      Reflect(object obj)
      Reflect(object obj, string method_name)
  */
  
  private void RunScript(double iUtilization, ref object penalty)
  {
    // Write your logic here

    double points = 0;

    if (iUtilization < 0.5)
    {
        points = 20;
    }
    if (iUtilization > 0.5)
    {
        points = 8;
    }
    if (iUtilization > 0.7)
    {
        points = 5;
    }
    if (iUtilization > 0.8)
    {
        points = 2;
    }
    if (iUtilization > 0.85)
    {
        points = 0;
    }
    if (iUtilization > 0.9)
    {
        points = 5;
    }
    if (iUtilization > 0.92)
    {
        points = 15;
    }
    if (iUtilization > 0.95)
    {
        points = 20;
    }
    if (iUtilization > 1.0)
    {
        points = 100;
    }
    if (iUtilization > 1.2)
    {
        points = 150;
    }
    if (iUtilization > 1.5)
    {
        points = 200;
    }

    penalty = points;
  }
}
# ---------- end csharp_script_2 ----------
number_2 = Number(min_max_2.Maximum)
number_3 = Number(min_max_3.Maximum)
number_4 = Number(min_max_4.Maximum)
number_5 = Number(min_max_5.Maximum)
csharp_script_3 = CSharpScript(iUtilization=number_2)  # -> out, penalty; inputs iUtilization: Double; same code as csharp_script_2
csharp_script_4 = CSharpScript(iUtilization=number_3)  # -> out, penalty; inputs iUtilization: Double; same code as csharp_script_2
panel_30 = Panel([min_max.Minimum, min_max.Maximum])
csharp_script_5 = CSharpScript(iUtilization=number_4)  # -> out, penalty; inputs iUtilization: Double; same code as csharp_script_2
csharp_script_6 = CSharpScript(iUtilization=number_5)  # -> out, penalty; inputs iUtilization: Double
# ---------- csharp_script_6: C# ----------
// Grasshopper Script Instance
using System;
using System.Collections;
using System.Collections.Generic;
using System.Drawing;

using Rhino;
using Rhino.Geometry;

using Grasshopper;
using Grasshopper.Kernel;
using Grasshopper.Kernel.Data;
using Grasshopper.Kernel.Types;

public class Script_Instance : GH_ScriptInstance
{
  /* 
    Members:
      RhinoDoc RhinoDocument
      GH_Document GrasshopperDocument
      IGH_Component Component
      int Iteration

    Methods (Virtual & overridable):
      Print(string text)
      Print(string format, params object[] args)
      Reflect(object obj)
      Reflect(object obj, string method_name)
  */
  
  private void RunScript(double iUtilization, ref object penalty)
  {

    double points = 0;

    if (iUtilization < 0.5)
    {
        points = 20;
    }
    if (iUtilization > 0.5)
    {
        points = 8;
    }
    if (iUtilization > 0.7)
    {
        points = 5;
    }
    if (iUtilization > 0.8)
    {
        points = 2;
    }
    if (iUtilization > 0.85)
    {
        points = 0;
    }
    if (iUtilization > 0.9)
    {
        points = 5;
    }
    if (iUtilization > 0.92)
    {
        points = 15;
    }
    if (iUtilization > 0.95)
    {
        points = 20;
    }
    if (iUtilization > 1.0)
    {
        points = 100;
    }
    if (iUtilization > 1.2)
    {
        points = 150;
    }
    if (iUtilization > 1.5)
    {
        points = 200;
    }

    penalty = points;
  }
}
# ---------- end csharp_script_6 ----------
panel_31 = Panel(csharp_script_2.penalty)
panel_32 = Panel([min_max_2.Minimum, min_max_2.Maximum])
panel_33 = Panel([min_max_3.Minimum, min_max_3.Maximum])
panel_34 = Panel([min_max_5.Minimum, min_max_5.Maximum])
number_6 = Number(csharp_script_2.penalty)
panel_35 = Panel([min_max_4.Minimum, min_max_4.Maximum])
panel_36 = Panel(csharp_script_3.penalty)
number_7 = Number(csharp_script_3.penalty)
panel_37 = Panel(csharp_script_4.penalty)
number_8 = Number(csharp_script_4.penalty)
number_9 = Number(csharp_script_5.penalty)
number_10 = Number(csharp_script_6.penalty)
panel_38 = Panel(csharp_script_5.penalty)
panel_39 = Panel(csharp_script_6.penalty)
addition = Addition(A=number_10, B=number_9, C=number_7, D=number_8, E=number_6)
panel_40 = Panel(addition)
number_11 = Number(addition)

# ---- group: Optimization 2 - SLS Deflection (continued)
analyze_karamba3d_2 = AnalyzeKaramba3D(Model=model_karamba3d_5)  # -> CalculatedModel, MaximumDisplacement_cm, ResultingForceOfGravity_kN, ElasticEnergyChange_kNm
panel_41 = Panel(analyze_karamba3d_2.MaximumDisplacement_cm)
beam_displacements_karamba3d = BeamDisplacementsKaramba3D(AnalyzedModel=analyze_karamba3d_2.CalculatedModel, BeamsIdentifiers=secondarybeams2_2, LoadCase="SLS", Ts=panel_27)  # -> AnalyzedModel, Translations_m, Rotations_rad
beam_displacements_karamba3d_2 = BeamDisplacementsKaramba3D(AnalyzedModel=analyze_karamba3d_2.CalculatedModel, BeamsIdentifiers="MainBeamLeft", LoadCase="SLS", Ts="0")  # -> AnalyzedModel, Translations_m, Rotations_rad
beam_displacements_karamba3d_3 = BeamDisplacementsKaramba3D(AnalyzedModel=analyze_karamba3d_2.CalculatedModel, BeamsIdentifiers=panel_26, LoadCase="SLS", Ts="0.5")  # -> AnalyzedModel, Translations_m, Rotations_rad
beam_displacements_karamba3d_4 = BeamDisplacementsKaramba3D(AnalyzedModel=analyze_karamba3d_2.CalculatedModel, BeamsIdentifiers=secondarybeams1_3, LoadCase="SLS", Ts=panel_28)  # -> AnalyzedModel, Translations_m, Rotations_rad
list_item_6 = ListItem(List=beam_displacements_karamba3d.Translations_m, Index=0, Wrap=True)
list_item_7 = ListItem(List=beam_displacements_karamba3d_2.Translations_m, Index=0, Wrap=True)
list_item_8 = ListItem(List=beam_displacements_karamba3d_3.Translations_m, Index=0, Wrap=True)
list_item_9 = ListItem(List=beam_displacements_karamba3d.Translations_m, Index=1, Wrap=True)
list_item_10 = ListItem(List=beam_displacements_karamba3d_4.Translations_m, Index=0, Wrap=True)
list_item_11 = ListItem(List=beam_displacements_karamba3d_4.Translations_m, Index=1, Wrap=True)
deconstruct = Deconstruct(Point=list_item_6)  # -> XComponent, YComponent, ZComponent
deconstruct_2 = Deconstruct(Point=list_item_7)  # -> XComponent, YComponent, ZComponent
deconstruct_3 = Deconstruct(Point=list_item_8)  # -> XComponent, YComponent, ZComponent
deconstruct_4 = Deconstruct(Point=list_item_9)  # -> XComponent, YComponent, ZComponent
deconstruct_5 = Deconstruct(Point=list_item_10)  # -> XComponent, YComponent, ZComponent
deconstruct_6 = Deconstruct(Point=list_item_11)  # -> XComponent, YComponent, ZComponent
subtraction_2 = Subtraction(A=deconstruct.ZComponent, B=deconstruct_4.ZComponent)
subtraction_3 = Subtraction(A=deconstruct_2.ZComponent, B=deconstruct_3.ZComponent)
subtraction_4 = Subtraction(A=deconstruct_5.ZComponent, B=deconstruct_6.ZComponent)
absolute = Absolute(Value=subtraction_2)
absolute_2 = Absolute(Value=subtraction_3)
absolute_3 = Absolute(Value=subtraction_4)
multiplication_4 = Multiplication(A=absolute, B="100")  # -> flatten(Result)
multiplication_5 = Multiplication(A=absolute_2, B="100")  # -> flatten(Result)
multiplication_6 = Multiplication(A=absolute_3, B="100")  # -> flatten(Result)
sort_list = SortList(Keys=multiplication_5, ValuesValuesA=multiplication_5)  # -> Keys, ValuesValuesA
sort_list_2 = SortList(Keys=multiplication_6, ValuesValuesA=multiplication_6)  # -> Keys, ValuesValuesA
sort_list_3 = SortList(Keys=multiplication_4, ValuesValuesA=multiplication_4)  # -> Keys, ValuesValuesA
panel_42 = Panel(sort_list_3.ValuesValuesA)
panel_43 = Panel(sort_list.ValuesValuesA)
panel_44 = Panel(sort_list_2.ValuesValuesA)
min_max_6 = MinMax(Number=sort_list_3.ValuesValuesA)  # -> Minimum, Maximum
min_max_7 = MinMax(Number=sort_list_2.ValuesValuesA)  # -> Minimum, Maximum
csharp_script_7 = CSharpScript(iDeformation=min_max_6.Maximum, iLength=lengthsecondarybeams)  # -> out, penalty, a, b; inputs iDeformation: Double, iLength: Double
# ---------- csharp_script_7: C# ----------
// Grasshopper Script Instance
using System;
using System.Collections;
using System.Collections.Generic;
using System.Drawing;

using Rhino;
using Rhino.Geometry;

using Grasshopper;
using Grasshopper.Kernel;
using Grasshopper.Kernel.Data;
using Grasshopper.Kernel.Types;

public class Script_Instance : GH_ScriptInstance
{
  /* 
    Members:
      RhinoDoc RhinoDocument
      GH_Document GrasshopperDocument
      IGH_Component Component
      int Iteration

    Methods (Virtual & overridable):
      Print(string text)
      Print(string format, params object[] args)
      Reflect(object obj)
      Reflect(object obj, string method_name)
  */
  
  private void RunScript(
	double iDeformation,
	double iLength,
	ref object penalty,
	ref object a,
	ref object b)
  {

   
    double points = 0;
    double limit = (iLength*100) / 300;

    if (iDeformation > 1.05 *limit )
    {
        points = 20;
    }
    
    if (iDeformation > 1.1 *limit )
    {
        points = 50;
    }
   
    if (iDeformation > 1.2 *limit )
    {
        points = 100;
    }

    if (iDeformation > 1.35 *limit )
    {
        points = 300;
    }    

    if (iDeformation > 1.5 *limit )
    {
        points = 500;
    }
    
    if (iDeformation > 2.0 *limit )
    {
        points = 1000;
    }

    if (iDeformation < 1.05 * limit )
    {
        points = 18;
    }
    
    if (iDeformation == limit )
    {
        points = 5;
    }
    
    if (iDeformation < limit )
    {
        points = 1;
    }
    
    if (iDeformation < 0.9 * limit )
    {
        points = 0;
    }

    if (iDeformation < 0.8 * limit )
    {
        points = 15;
    }

 
    penalty = points;
    a = limit;
    b = iDeformation;
  }
}
# ---------- end csharp_script_7 ----------
csharp_script_8 = CSharpScript(iDeformation=min_max_7.Maximum, iLength=lengthsecondarybeams_2)  # -> out, penalty; inputs iDeformation: Double, iLength: Double
# ---------- csharp_script_8: C# ----------
// Grasshopper Script Instance
using System;
using System.Collections;
using System.Collections.Generic;
using System.Drawing;

using Rhino;
using Rhino.Geometry;

using Grasshopper;
using Grasshopper.Kernel;
using Grasshopper.Kernel.Data;
using Grasshopper.Kernel.Types;

public class Script_Instance : GH_ScriptInstance
{
  /* 
    Members:
      RhinoDoc RhinoDocument
      GH_Document GrasshopperDocument
      IGH_Component Component
      int Iteration

    Methods (Virtual & overridable):
      Print(string text)
      Print(string format, params object[] args)
      Reflect(object obj)
      Reflect(object obj, string method_name)
  */
  
  private void RunScript(double iDeformation, double iLength, ref object penalty)
  {

    double points = 0;
    double limit = (iLength*100) / 300;

    if (iDeformation > 1.05 *limit )
    {
        points = 20;
    }
    
    if (iDeformation > 1.1 *limit )
    {
        points = 50;
    }
   
    if (iDeformation > 1.2 *limit )
    {
        points = 100;
    }

    if (iDeformation > 1.35 *limit )
    {
        points = 300;
    }    

    if (iDeformation > 1.5 *limit )
    {
        points = 500;
    }
    
    if (iDeformation > 2.0 *limit )
    {
        points = 1000;
    }

    if (iDeformation < 1.05 * limit )
    {
        points = 18;
    }
    
    if (iDeformation == limit )
    {
        points = 5;
    }
    
    if (iDeformation < limit )
    {
        points = 1;
    }
    
    if (iDeformation < 0.9 * limit )
    {
        points = 0;
    }

    if (iDeformation < 0.8 * limit )
    {
        points = 15;
    }

 
    penalty = points;
  }
}
# ---------- end csharp_script_8 ----------
numberutilizationsum = Number(number_11)
panel_45 = Panel([csharp_script_7.a, csharp_script_7.b, csharp_script_8.penalty])
addition_2 = Addition(A=csharp_script_8.penalty, B=csharp_script_7.penalty, C=numberutilizationsum)
panel_46 = Panel([csharp_script_8.penalty, csharp_script_7.penalty, numberutilizationsum])
number_12 = Number(addition_2)
panel_47 = Panel(number_12)

# ---- group: Vertical deflection - example (continued)
model_karamba3d_12 = ModelKaramba3D(analyze_karamba3d_2.CalculatedModel)
beam_displacements_karamba3d_5 = BeamDisplacementsKaramba3D(AnalyzedModel=model_karamba3d_12, BeamsIdentifiers=secondarybeams1_2, LoadCase=list, Ts=panel_25)  # -> AnalyzedModel, Translations_m, Rotations_rad
list_item_12 = ListItem(List=beam_displacements_karamba3d_5.Translations_m, Index=index_ts_0_5, Wrap=True)
list_item_13 = ListItem(List=beam_displacements_karamba3d_5.Translations_m, Index=index_ts_0, Wrap=True)
deconstruct_7 = Deconstruct(Point=list_item_13)  # -> XComponent, YComponent, ZComponent
deconstruct_8 = Deconstruct(Point=list_item_12)  # -> XComponent, YComponent, ZComponent
z_component = Number(deconstruct_7.ZComponent)
z_component_2 = Number(deconstruct_8.ZComponent)
subtraction_5 = Subtraction(A=z_component, B=z_component_2)
absolute_4 = Absolute(Value=subtraction_5)
multiplication_7 = Multiplication(A=absolute_4, B=converting_m_to_cm)  # -> flatten(Result)
sort_list_4 = SortList(Keys=multiplication_7, ValuesValuesA=multiplication_7)  # -> Keys, ValuesValuesA
min_max_8 = MinMax(Number=sort_list_4.ValuesValuesA)  # -> Minimum, Maximum
max_vertical_deformation = Panel(min_max_8.Maximum)

# ---- group: Results (continued)
model_view_karamba3d = ModelViewKaramba3D(Model=model_karamba3d_5, DisplacementDirection=unit_z_5, ResultFactors=1, ResultCase=-1)  # -> Model, DeformedMesh, DeformedAxes, DeformedModel
beam_view_karamba3d = BeamViewKaramba3D(Model=model_view_karamba3d.Model)  # -> Model, MeshesOfRenderedBeams, DeformedBeamAxes, LegendColors, LegendTags
mesh = Mesh(beam_view_karamba3d.MeshesOfRenderedBeams)
legend = Legend(Colour=beam_view_karamba3d.LegendColors, Tags=beam_view_karamba3d.LegendTags, Rectangle=curve_8, LegendType=1)

# ---- group: Results / Coloured model
model_view_karamba3d_2 = ModelViewKaramba3D(Model=model_karamba3d_4, ResultFactors=1, ResultCase=-1)  # -> Model, DeformedMesh, DeformedAxes, DeformedModel
beam_view_karamba3d_2 = BeamViewKaramba3D(Model=model_view_karamba3d_2.Model)  # -> Model, MeshesOfRenderedBeams, DeformedBeamAxes, LegendColors, LegendTags
mesh_2 = Mesh(beam_view_karamba3d_2.MeshesOfRenderedBeams)

# ---- group: Results
# Section Forces
model_view_karamba3d_3 = ModelViewKaramba3D(Model=model_karamba3d_4, ResultFactors=1, ResultCase=-1)  # -> Model, DeformedMesh, DeformedAxes, DeformedModel
beam_view_karamba3d_3 = BeamViewKaramba3D(Model=model_view_karamba3d_3.Model)  # -> Model, MeshesOfRenderedBeams, DeformedBeamAxes, LegendColors, LegendTags

# Model Mass
element_query_karamba3d = ElementQueryKaramba3D(Model=model_karamba3d_4)  # -> Model, Mass_kg, Area_m2, Volume_m3, Meshes
mass_addition = MassAddition(Input=element_query_karamba3d.Mass_kg)  # -> Result, PartialResults
panel_48 = Panel(mass_addition.Result)

utilization_of_elements_karamba3d_6 = UtilizationOfElementsKaramba3D(
    AnalyzedModel=model_karamba3d_4,
    ElementsIdentifiers=merge_3,
    LoadCase=graft(panel_29),
    NumberOfSamplePoints=3,
    ElasticDesign=True,
    GammaM0=1,
    GammaM1=1.1,
    SwayFrame=True,
    WithDetails=False,
    mode="Beams")  # -> AnalyzedModel, Utilization, SigMax_kN_cm2, SigMin_kN_cm2, TauMax_kN_cm2, UtilN, UtilVy, UtilVz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
min_max_9 = MinMax(Number=utilization_of_elements_karamba3d_6.Utilization)  # -> Minimum, Maximum
average = Average(Input=utilization_of_elements_karamba3d_6.Utilization)
panel_49 = Panel(min_max_9.Maximum)
panel_50 = Panel(average)
tree_branch_2 = TreeBranch(Tree=simplify(average), Path="3", MaintainPaths=True)
_6_10b_y = Panel(tree_branch_2)

panel_51 = Panel(model_view_karamba3d_3.Model)

# Utilizations visualization
model_view_karamba3d_4 = ModelViewKaramba3D(Model=model_karamba3d_4, ResultFactors=1, ResultCase=-1)  # -> Model, DeformedMesh, DeformedAxes, DeformedModel
beam_view_karamba3d_4 = BeamViewKaramba3D(Model=model_view_karamba3d_4.Model)  # -> Model, MeshesOfRenderedBeams, DeformedBeamAxes, LegendColors, LegendTags
curve_9 = Curve(<curve referenced from the Rhino model>)
mesh_3 = Mesh(beam_view_karamba3d_4.MeshesOfRenderedBeams)
legend_2 = Legend(Colour=beam_view_karamba3d_4.LegendColors, Tags=beam_view_karamba3d_4.LegendTags, Rectangle=curve_9, LegendType=1)

# ---- group: Demand Bank
model_view_karamba3d_5 = ModelViewKaramba3D(Model=model_karamba3d_6, ResultFactors=1, ResultCase=-1, ElementIdentifiersBreps="MainBeamMid")  # -> Model, DeformedMesh, DeformedAxes, DeformedModel
model_view_karamba3d_6 = ModelViewKaramba3D(Model=model_karamba3d_6, ResultFactors=1, ResultCase=-1, ElementIdentifiersBreps="MainBeamLeft")  # -> Model, DeformedMesh, DeformedAxes, DeformedModel
model_view_karamba3d_7 = ModelViewKaramba3D(Model=model_karamba3d_6, ResultFactors=1, ResultCase=-1, ElementIdentifiersBreps="Column")  # -> Model, DeformedMesh, DeformedAxes, DeformedModel
model_view_karamba3d_8 = ModelViewKaramba3D(Model=model_karamba3d_6, ResultFactors=1, ResultCase=-1, ElementIdentifiersBreps="MainBeamRight")  # -> Model, DeformedMesh, DeformedAxes, DeformedModel
model_view_karamba3d_9 = ModelViewKaramba3D(Model=model_karamba3d_6, ResultFactors=1, ResultCase=-1, ElementIdentifiersBreps="Brazing")  # -> Model, DeformedMesh, DeformedAxes, DeformedModel
model_view_karamba3d_10 = ModelViewKaramba3D(Model=model_karamba3d_6, ResultFactors=1, ResultCase=-1, ElementIdentifiersBreps="SecondaryBeams1")  # -> Model, DeformedMesh, DeformedAxes, DeformedModel
model_view_karamba3d_11 = ModelViewKaramba3D(Model=model_karamba3d_6, ResultFactors=1, ResultCase=-1, ElementIdentifiersBreps="SecondaryBeams2")  # -> Model, DeformedMesh, DeformedAxes, DeformedModel
beam_view_karamba3d_5 = BeamViewKaramba3D(Model=model_view_karamba3d_6.Model)  # -> Model, MeshesOfRenderedBeams, DeformedBeamAxes, LegendColors, LegendTags
beam_view_karamba3d_6 = BeamViewKaramba3D(Model=model_view_karamba3d_7.Model)  # -> Model, MeshesOfRenderedBeams, DeformedBeamAxes, LegendColors, LegendTags
beam_view_karamba3d_7 = BeamViewKaramba3D(Model=model_view_karamba3d_9.Model)  # -> Model, MeshesOfRenderedBeams, DeformedBeamAxes, LegendColors, LegendTags
beam_view_karamba3d_8 = BeamViewKaramba3D(Model=model_view_karamba3d_5.Model)  # -> Model, MeshesOfRenderedBeams, DeformedBeamAxes, LegendColors, LegendTags
beam_view_karamba3d_9 = BeamViewKaramba3D(Model=model_view_karamba3d_8.Model)  # -> Model, MeshesOfRenderedBeams, DeformedBeamAxes, LegendColors, LegendTags
beam_view_karamba3d_10 = BeamViewKaramba3D(Model=model_view_karamba3d_10.Model)  # -> Model, MeshesOfRenderedBeams, DeformedBeamAxes, LegendColors, LegendTags
mesh_4 = Mesh(beam_view_karamba3d_5.MeshesOfRenderedBeams)
mesh_5 = Mesh(beam_view_karamba3d_6.MeshesOfRenderedBeams)
beam_view_karamba3d_11 = BeamViewKaramba3D(Model=model_view_karamba3d_11.Model)  # -> Model, MeshesOfRenderedBeams, DeformedBeamAxes, LegendColors, LegendTags
mesh_6 = Mesh(beam_view_karamba3d_7.MeshesOfRenderedBeams)
mesh_7 = Mesh(beam_view_karamba3d_8.MeshesOfRenderedBeams)
mesh_8 = Mesh(beam_view_karamba3d_9.MeshesOfRenderedBeams)
mesh_9 = Mesh(beam_view_karamba3d_10.MeshesOfRenderedBeams)
disassemble_model_karamba3d = DisassembleModelKaramba3D(Model=model_view_karamba3d_10.Model)  # -> Model, Point, Beam, Shell, Support, Load, Line, Mesh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
explode_object = ExplodeObject(Object=mesh_6, Recursive=False)  # -> graft(Objects)
mesh_10 = Mesh(beam_view_karamba3d_11.MeshesOfRenderedBeams)
disassemble_element_karamba3d = DisassembleElementKaramba3D(Element=disassemble_model_karamba3d.Beam)  # -> Element, ElementIdentifier, AxisOfElement, CrossSection, Joint, Material, LocalCoordinateSystem, ElementIsActive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
explode_object_2 = ExplodeObject(Object=mesh_5, Recursive=False)  # -> graft(Objects)
box = Box(explode_object_2)
unit_z_6 = UnitZ(Factor="0.17")
deconstruct_brep_2 = DeconstructBrep(Brep=box)  # -> Faces, Edges, Vertices
list_item_14 = ListItem(List=deconstruct_brep_2.Faces, Index=-1, Wrap=True)
extrude = Extrude(Base=list_item_14, Direction=unit_z_6)
panel_52 = Panel("0.2")
merge_4 = Merge(Data1=box, Data2=extrude)  # -> flatten(Result)
solid_union = SolidUnion(Breps=[box, extrude])
box_2 = Box(solid_union)
panel_53 = Panel(solid_union)
panel_54 = Panel("20")
addition_3 = Addition(A=panel_54, B=7)
addition_4 = Addition(A=addition_3, B=7)
panel_55 = Panel("Insert your file path to the Excel sheet you want to write to")

explode_object_3 = ExplodeObject(Object=mesh_8, Recursive=False)  # -> graft(Objects)
explode_object_4 = ExplodeObject(Object=mesh_5, Recursive=False)  # -> graft(Objects)
explode_object_5 = ExplodeObject(Object=mesh_7, Recursive=False)  # -> graft(Objects)
explode_object_6 = ExplodeObject(Object=mesh_4, Recursive=False)  # -> graft(Objects)
explode_object_7 = ExplodeObject(Object=mesh_5, Recursive=False)  # -> graft(Objects)
minimumboundindbox = MinimumBoundindBox(Geometry=explode_object_3)  # -> flatten(SecondaryBeams)
minimumboundindbox_2 = MinimumBoundindBox(Geometry=explode_object_4)  # -> flatten(BoundingBox)
minimumboundindbox_3 = MinimumBoundindBox(Geometry=explode_object_5)  # -> simplify(graft(SecondaryBeams))
unit_z_7 = UnitZ(Factor="0.4")
minimumboundindbox_4 = MinimumBoundindBox(Geometry=explode_object_6)  # -> flatten(SecondaryBeams)
minimumboundindbox_5 = MinimumBoundindBox(Geometry=explode_object_7)  # -> flatten(BoundingBox)
unit_z_8 = UnitZ(Factor="0.4")
move = Move(Geometry=minimumboundindbox_5, Motion=unit_z_7)  # -> Geometry, Transform
panel_56 = Panel(minimumboundindbox_3)
brep = Brep(flatten(minimumboundindbox_3))
deconstruct_brep_3 = DeconstructBrep(Brep=brep)  # -> Faces, Edges, Vertices
move_2 = Move(Geometry=minimumboundindbox_2, Motion=unit_z_8)  # -> Geometry, Transform
solid_difference = SolidDifference(BrepsA=minimumboundindbox, BrepsB=move_2.Geometry)  # -> simplify(graft(SecondaryBeamsOutsideColumn))
point_7 = Point(deconstruct_brep_3.Vertices)
solid_difference_2 = SolidDifference(BrepsA=minimumboundindbox_4, BrepsB=move.Geometry)  # -> simplify(graft(SecondaryBeamsOutsideColumn))
solid_union_2 = SolidUnion(Breps=[solid_difference_2, minimumboundindbox_3, solid_difference])
tree_branch_3 = TreeBranch(Tree=solid_union_2, Path="{0}", MaintainPaths=True)
cluster_3 = Cluster_3(geometry=solid_union_2)
panel_57 = Panel(solid_union_2)

mesh_11 = Mesh(mesh_10)
explode_object_8 = ExplodeObject(Object=mesh_11, Recursive=False)  # -> simplify(graft(Objects))
minimumboundindbox_6 = MinimumBoundindBox(Geometry=explode_object_8)  # -> flatten(SecondaryBeams)
minimumboundindbox_7 = MinimumBoundindBox(Geometry=solid_union_2)  # -> flatten(BoundingBox)
unit_z_9 = UnitZ(Factor=expr("-x", panel_52))
unit_z_10 = UnitZ(Factor=panel_52)
solid_difference_3 = SolidDifference(BrepsA=minimumboundindbox_6, BrepsB=minimumboundindbox_7)  # -> simplify(graft(SecondaryBeamsOutsideColumn))
move_3 = Move(Geometry=minimumboundindbox_7, Motion=unit_z_10)  # -> Geometry, Transform
move_4 = Move(Geometry=minimumboundindbox_7, Motion=unit_z_9)  # -> Geometry, Transform
tree_item = TreeItem(Tree=solid_difference_3, Path="10", Index=0, Wrap=True)
minimumboundindbox_8 = MinimumBoundindBox(Geometry=solid_difference_3)
panel_58 = Panel(solid_difference_3)
xy_plane = XYPlane(Origin=Point(0, 0, 0))
brep_2 = Brep(flatten(minimumboundindbox_8))
rotate = Rotate(Geometry=brep_2, Angle=1.570796327, Plane=xy_plane)  # -> Geometry, Transform
list_length_4 = ListLength(List=rotate.Geometry)
series = Series(Start=0, Step=1, Count=list_length_4)
panel_59 = Panel(brep_2)
volume = Volume(Geometry=rotate.Geometry)  # -> Volume, Centroid
construct_point = ConstructPoint(XCoordinate=series, YCoordinate=0, ZCoordinate=0)
orient = Orient(Geometry=rotate.Geometry, Source=volume.Centroid, Target=construct_point)  # -> Geometry, Transform

explode_object_9 = ExplodeObject(Object=mesh_9, Recursive=False)  # -> simplify(graft(Objects))
minimumboundindbox_9 = MinimumBoundindBox(Geometry=explode_object_7)  # -> flatten(BoundingBox)
minimumboundindbox_10 = MinimumBoundindBox(Geometry=explode_object_9)  # -> flatten(SecondaryBeams)
unit_z_11 = UnitZ(Factor="0.4")
move_5 = Move(Geometry=minimumboundindbox_9, Motion=unit_z_11)  # -> Geometry, Transform
solid_difference_4 = SolidDifference(BrepsA=minimumboundindbox_10, BrepsB=move_5.Geometry)  # -> simplify(graft(SecondaryBeamsOutsideColumn))
tree_item_2 = TreeItem(Tree=solid_difference_4, Path="10", Index=0, Wrap=True)
brep_3 = Brep(solid_difference_4)
brep_4 = Brep(flatten(brep_3))
xy_plane_2 = XYPlane(Origin=Point(0, 0, 0))
rotate_2 = Rotate(Geometry=brep_4, Angle=1.570796327, Plane=xy_plane_2)  # -> Geometry, Transform
list_length_5 = ListLength(List=rotate_2.Geometry)
series_2 = Series(Start=0, Step=1, Count=list_length_5)
volume_2 = Volume(Geometry=rotate_2.Geometry)  # -> Volume, Centroid
construct_point_2 = ConstructPoint(XCoordinate=series_2, YCoordinate=0, ZCoordinate=0)
orient_2 = Orient(Geometry=rotate_2.Geometry, Source=volume_2.Centroid, Target=construct_point_2)  # -> Geometry, Transform
brep_5 = Brep(graft(orient_2.Geometry))
minimumboundindbox_11 = MinimumBoundindBox(Geometry=brep_5)

brep_6 = Brep(flatten(minimumboundindbox_11))
brep_7 = Brep(flatten(cluster_3))
brep_8 = Brep(flatten(orient.Geometry))
entwine_3 = Entwine(Branch00=brep_7, Branch01=brep_6, Branch02=brep_8, FlattenInputs=True)
unit_y_2 = UnitY(Factor=panel_54)
unit_y_3 = UnitY(Factor=addition_3)
unit_y_4 = UnitY(Factor=addition_4)
move_6 = Move(Geometry=brep_7, Motion=unit_y_2)  # -> Geometry, Transform
move_7 = Move(Geometry=brep_6, Motion=unit_y_3)  # -> Geometry, Transform
move_8 = Move(Geometry=brep_8, Motion=unit_y_4)  # -> Geometry, Transform

# ---- group: Demand Bank / DemandBank
merge_5 = Merge(Data1=move_6.Geometry, Data2=move_7.Geometry, Data3=move_8.Geometry)  # -> flatten(Result)

# ---- group: Demand Bank
# Input Breps as List
brep_9 = Brep(merge_5)
merge_6 = Merge(Data1=brep_9)  # -> flatten(Result)

# Extracting CS data
# data extraced so height>width
c_script_2 = CSharpScript(iBrep=merge_6)  # -> out, CSdata, a; inputs iBrep: list of Brep
# ---------- c_script_2: C# ----------
// Grasshopper Script Instance
#region Usings
using System;
using System.Linq;
using System.Collections;
using System.Collections.Generic;
using System.Drawing;

using Rhino;
using Rhino.Geometry;

using Grasshopper;
using Grasshopper.Kernel;
using Grasshopper.Kernel.Data;
using Grasshopper.Kernel.Types;
#endregion

public class Script_Instance : GH_ScriptInstance
{
    #region Notes
    /* 
      Members:
        RhinoDoc RhinoDocument
        GH_Document GrasshopperDocument
        IGH_Component Component
        int Iteration

      Methods (Virtual & overridable):
        Print(string text)
        Print(string format, params object[] args)
        Reflect(object obj)
        Reflect(object obj, string method_name)
    */
    #endregion

    private void RunScript(IList<Brep> iBrep, ref object CSdata, ref object a)
    {
        // Write your logic here
        DataTree<double> elementData = new DataTree<double>();
        

        for (int i=0; i<iBrep.Count; i++)
        {
            var edges = iBrep[i].Edges;
           // Use LINQ to get distinct edge lengths
           
            var uniqueLengths = edges
            .Select(edge => Math.Round(edge.ToNurbsCurve().GetLength(),2))
            .Distinct()
            .OrderByDescending(x=>x)
            .ToList();

            double length = Math.Round(uniqueLengths[0]*1000,1);
            double width = Math.Round(uniqueLengths[1]*1000,1);
            double height;
            if (uniqueLengths.Count ==2 )
            {
                height = width;
            }
            else
            {
                height = Math.Round(uniqueLengths[2]*1000,1);
            }
            

            if (width>height)
            {
                double temp = width;
                width=height;
                height = temp;
            }

            // Add data for each iteration to the DataTree
            elementData.Add(i, new GH_Path(0));
            elementData.Add(length, new GH_Path(1));
            elementData.Add(width, new GH_Path(2));
            elementData.Add(height, new GH_Path(3));
            }

        
    
        CSdata = elementData;
        

    }
}
# ---------- end c_script_2 ----------
# WriteToExcel
# OBS! ExcelFile must be closed
panel_60 = Panel("""ElementID
Length[mm]
Width[mm]
Height[mm]""")
file_path_3 = FilePath(panel_55)
excel_write = ExcelWrite(
    WriteExcelData=Toggle(False),
    WorkbookPath=file_path_3,
    WorksheetName="DemandBank",
    ColumnHeadings=panel_60,
    Data=c_script_2.CSdata,
    ClearSheet=Toggle(True))

# ----
# VolumeCriteriaAlgorithm
# Matching algorithm is included directly in the study case
# Also possible to read the demand bank from Excel as well as the material bank.
c_script_3 = CSharpScript(DemandBank=c_script_2.CSdata, MaterialBank=cull_index)  # -> out, demandMatches, demandMatchesBest, demandMatchesNone, matchingDataTree; inputs DemandBank: tree of Double, MaterialBank: tree of Double; disabled
# ---------- c_script_3: C# ----------
// Grasshopper Script Instance
#region Usings
using System;
using System.Linq;
using System.Collections;
using System.Collections.Generic;
using System.Drawing;

using Rhino;
using Rhino.Geometry;

using Grasshopper;
using Grasshopper.Kernel;
using Grasshopper.Kernel.Data;
using Grasshopper.Kernel.Types;
#endregion



public class Script_Instance : GH_ScriptInstance
{
    #region Notes
    /* 
      Members:
        RhinoDoc RhinoDocument
        GH_Document GrasshopperDocument
        IGH_Component Component
        int Iteration

      Methods (Virtual & overridable):
        Print(string text)
        Print(string format, params object[] args)
        Reflect(object obj)
        Reflect(object obj, string method_name)
    */
    #endregion

    private void RunScript(
	DataTree<double> DemandBank,
	DataTree<double> MaterialBank,
	ref object demandMatches,
	ref object demandMatchesBest,
	ref object demandMatchesNone,
	ref object matchingDataTree)
    {
       //Extracting data from the DemandBank
        List<double> demandElement = DemandBank.Branch(0);
        List<double> demandLength = DemandBank.Branch(1);
        List<double> demandWidth = DemandBank.Branch(2);
        List<double> demandHeight = DemandBank.Branch(3);

        //Extracting data from the MaterialBank/supply
        List<double> materialElement = MaterialBank.Branch(0);
        List<double> materialLength = MaterialBank.Branch(1);
        List<double> materialWidth = MaterialBank.Branch(2);
        List<double> materialHeight = MaterialBank.Branch(3);

        //Possible matches
        //List for matches for every demand element
        DataTree<double> dMatch = new DataTree<double>();
        List<int> demandNoMatch = new List<int>();

        for (int i=0; i<demandElement.Count; i++)
        {
            List<double> matchesCurrentDemand = new List<double>(); 
            for (int j=0; j<materialElement.Count; j++)
            {            
                //check length
                if (demandLength[i] <= materialLength[j])
                {
                    if (demandWidth[i] <= materialWidth[j] && demandHeight[i] <= materialHeight[j])
                    {
                        matchesCurrentDemand.Add(materialElement[j]);
                    }
                }

               else { }
            }
            
            dMatch.AddRange(matchesCurrentDemand, new GH_Path(i));
            if (matchesCurrentDemand.Count == 0)
            {
                demandNoMatch.Add(i);
            }
        }

        //Volume utilization ratio
        //Creating list with volumes 
        List<double> dVol = new List<double>();
        List<double> mVol = new List<double>();

        for (int i=0; i<demandElement.Count; i++)
        {
            dVol.Add(demandLength[i]*demandHeight[i]*demandWidth[i]);
        }

        for (int i=0; i<materialElement.Count; i++)
        {
            mVol.Add(materialLength[i]*materialHeight[i]*materialWidth[i]);
        }

        //Finding the volume utilization ratio and store in dictionary              
        Dictionary<(int,int),double> elementDictionary = new Dictionary<(int,int),double>();
        for (int i=0; i<dMatch.BranchCount; i++)
        {
            var dMatchBranches = dMatch.Branch(i);       
            for (int j = 0; j<dMatchBranches.Count;j++)
            {
                int mElement = Convert.ToInt32(dMatchBranches[j]);  //material bank element number
                int dElement = i;                                   //demand bank element number
                double ratio = dVol[i]/mVol[mElement];              //utilization ratio
                
                elementDictionary.Add((dElement,mElement),ratio);
            }
        }

        //Volume criteria
        Dictionary<(int,int),double> elementDictionaryOriginal = elementDictionary;
        Dictionary<(int,int), double> elementDictionaryBest = new Dictionary<(int,int), double>();

        while (elementDictionary.Count>0)
        {
            //Sorting the ratio from highest to lowest based on LINQ 
            var sortedRatios = elementDictionary.OrderByDescending(kv => kv.Value).ToDictionary(kv => kv.Key, kv => kv.Value);

            // Find the highest ratio value in elementDictionary
            double highestRatioValue = elementDictionary.Max(kv => kv.Value);

            // Find all key-value pairs with the highest ratio value
            var highestRatioEntries = elementDictionary.Where(kv => kv.Value == highestRatioValue);

            // If there are multiple entries with the highest ratio value, choose the one where the first key occurs the lowest number of times
            var selectedEntry = highestRatioEntries.OrderBy(kv => elementDictionary.Count(kv2 => kv2.Key.Item1 == kv.Key.Item1)).FirstOrDefault();

            // Add the selected entry to the new dictionary
            elementDictionaryBest.Add(selectedEntry.Key, selectedEntry.Value);

            // Filter the original dictionary to remove entries containing either key item 1 or key item 2
            var filteredEntries = elementDictionary.Where(kv => kv.Key.Item1 != selectedEntry.Key.Item1 && kv.Key.Item2 != selectedEntry.Key.Item2);

            // Create a new dictionary to store the filtered entries
            Dictionary<(int, int), double> newElementDictionary = filteredEntries.ToDictionary(kv => kv.Key, kv => kv.Value);

            // Update the original dictionary reference to point to the new dictionary
            elementDictionary = newElementDictionary;
        }

        // Create a new dictionary to store the pairs where item 1 from the original dictionary is not present
        Dictionary<(int, int), double> elementDictionaryNoMatch = elementDictionaryOriginal
        .Where(kv => !elementDictionary.ContainsKey((kv.Key.Item1, kv.Key.Item2)))
        .ToDictionary(kv => kv.Key, kv => kv.Value);

        // Create a list of demand elements (item 1 from the original dictionary) that have no matches in the best match list
        demandNoMatch.AddRange(elementDictionaryOriginal
            .Select(kv => kv.Key.Item1) // Select item 1 from each key-value pair in the original dictionary
            .Where(demand => !elementDictionaryBest.Any(kv => kv.Key.Item1 == demand)) // Filter out those present in the best match list
            .Distinct() // Ensure only unique values are stored
            .ToList());

        //DataTree to store the matches in
        DataTree<string> matches = new DataTree<string>();
        List<string> demandElements = new List<string>();
        List<string> demandLengths = new List<string>();
        List<string> materialElements = new List<string>();
        List<string> volumeRatio = new List<string>();
        List<string> cutoffMaterial = new List<string>();
        

                
        for (int i=0; i<demandElement.Count; i++)
        {
            demandElements.Add(i.ToString());
            demandLengths.Add(demandLength[i].ToString());
            int demand = i;
            // Find the best match for the current demand element
            bool foundMatch = false;
            foreach (var entry in elementDictionaryBest)
            {
                // If the demand element matches the key's first item
                if (entry.Key.Item1 == demand)
                    {
                    // Add the matching material element to the data tree
                    materialElements.Add(entry.Key.Item2.ToString());
                    volumeRatio.Add(Math.Round((entry.Value)*100,1).ToString());
                    cutoffMaterial.Add(Math.Round(materialLength[entry.Key.Item2]-demandLength[entry.Key.Item1]).ToString());
                    foundMatch = true;
                    break; // Break the loop since we found a match
                    }
            }

            // If no match was found, add "none" to the data tree
            if (!foundMatch)
            {
                materialElements.Add("none");
                volumeRatio.Add("none");
                cutoffMaterial.Add("none");
            }
        }


        matches.AddRange(demandElements, new GH_Path(0));
        matches.AddRange(materialElements, new GH_Path(1));
        matches.AddRange(volumeRatio, new GH_Path(2));
        matches.AddRange(demandLengths, new GH_Path(3));
        matches.AddRange(cutoffMaterial, new GH_Path(4));

        demandMatches = elementDictionaryOriginal.Keys;
        demandMatchesBest = elementDictionaryBest.Keys;
        demandMatchesNone = demandNoMatch;
        matchingDataTree = matches;
        }
    }
# ---------- end c_script_3 ----------
tree_statistics = TreeStatistics(Tree=c_script_3.demandMatchesBest)  # -> Paths, Length, Count; disabled
tree_statistics_2 = TreeStatistics(Tree=c_script_3.demandMatchesNone)  # -> Paths, Length, Count; disabled

# ---- group: MatchingALgorithm Results
matchedelements = Panel(tree_statistics.Length)
nomatches = Panel(tree_statistics_2.Length)

# ----
# MainBeamsY
# Unique naming of identifiers
# SecondaryBeams1
# SecondaryBeams2
model_view_karamba3d_12 = ModelViewKaramba3D(Model=model_karamba3d_4, ResultFactors=1, ResultCase=-1)  # -> Model, DeformedMesh, DeformedAxes, DeformedModel
disassemble_model_karamba3d_2 = DisassembleModelKaramba3D(Model=model_view_karamba3d_12.Model)  # -> Model, Point, Beam, Shell, Support, Load, Line, Mesh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
text = Text(mainbeamsy)
list_length_6 = ListLength(List=move_6.Geometry)
list_length_7 = ListLength(List=move_7.Geometry)
list_item_15 = ListItem(List=text, Index=0, Wrap=True)
list_item_16 = ListItem(List=text, Index=2, Wrap=True)
list_item_17 = ListItem(List=text, Index=1, Wrap=True)
list_length_8 = ListLength(List=move_8.Geometry)
list_length_9 = ListLength(List=move_6.Geometry)
addition_5 = Addition(A=list_length_6, B=list_length_7)
list_length_10 = ListLength(List=move_7.Geometry)
list_length_11 = ListLength(List=move_6.Geometry)
series_3 = Series(Start=addition_5, Step="1", Count=list_length_8)
secondarybeams1_4 = Text(secondarybeams2)
series_4 = Series(Start="0", Step="1", Count=list_length_9)
series_5 = Series(Start=list_length_11, Step="1", Count=list_length_10)
secondarybeams1_5 = Text(secondarybeams1)
dispatch_elements_from_list_of_elements = DispatchElementsFromListOfElementsKaramba3D(Elements=disassemble_model_karamba3d_2.Beam, ElementIdentifiers=flatten(secondarybeams1_4))  # -> SelectedElements, RejectedElements
dispatch_elements_from_list_of_elements_2 = DispatchElementsFromListOfElementsKaramba3D(Elements=disassemble_model_karamba3d_2.Beam, ElementIdentifiers=flatten(list_item_16))  # -> SelectedElements, RejectedElements
dispatch_elements_from_list_of_elements_3 = DispatchElementsFromListOfElementsKaramba3D(Elements=disassemble_model_karamba3d_2.Beam, ElementIdentifiers=flatten(list_item_15))  # -> SelectedElements, RejectedElements
dispatch_elements_from_list_of_elements_4 = DispatchElementsFromListOfElementsKaramba3D(Elements=disassemble_model_karamba3d_2.Beam, ElementIdentifiers=flatten(secondarybeams1_5))  # -> SelectedElements, RejectedElements
dispatch_elements_from_list_of_elements_5 = DispatchElementsFromListOfElementsKaramba3D(Elements=disassemble_model_karamba3d_2.Beam, ElementIdentifiers=flatten(list_item_17))  # -> SelectedElements, RejectedElements
concatenate_3 = Concatenate(FragmentA="Demand_", FragmentB=series_3)
concatenate_4 = Concatenate(FragmentA="Demand_", FragmentB=series_4)
concatenate_5 = Concatenate(FragmentA="Demand_", FragmentB=series_5)
modify_element_karamba3d = ModifyElementKaramba3D(Beam=flatten(dispatch_elements_from_list_of_elements.SelectedElements), BeamIdentifierIndex=concatenate_3, mode="Beam")
modify_element_karamba3d_2 = ModifyElementKaramba3D(Beam=flatten(dispatch_elements_from_list_of_elements_4.SelectedElements), BeamIdentifierIndex=concatenate_5, mode="Beam")
entwine_4 = Entwine(
    Branch00=dispatch_elements_from_list_of_elements_3.SelectedElements,
    Branch01=dispatch_elements_from_list_of_elements_5.SelectedElements,
    Branch02=dispatch_elements_from_list_of_elements_2.SelectedElements,
    FlattenInputs=True)
flip_matrix = FlipMatrix(Data=entwine_4)
modify_element_karamba3d_3 = ModifyElementKaramba3D(Beam=flip_matrix, BeamIdentifierIndex=graft(concatenate_4), mode="Beam")
panel_61 = Panel(modify_element_karamba3d)
panel_62 = Panel(modify_element_karamba3d_2)
dispatch_elements_from_list_of_elements_6 = DispatchElementsFromListOfElementsKaramba3D(Elements=disassemble_model_karamba3d_2.Beam, ElementIdentifiers=flatten([text, secondarybeams1_5, secondarybeams1_4]))  # -> SelectedElements, RejectedElements
element_karamba3d_3 = ElementKaramba3D(flatten([modify_element_karamba3d_3, modify_element_karamba3d_2, modify_element_karamba3d, dispatch_elements_from_list_of_elements_6.RejectedElements]))
assemble_model_karamba3d_2 = AssembleModelKaramba3D(
    Point=disassemble_model_karamba3d_2.Point,
    Elem=element_karamba3d_3,
    Support=disassemble_model_karamba3d_2.Support,
    Load=disassemble_model_karamba3d_2.Load,
    CrossSection=disassemble_model_karamba3d_2.CrossSection,
    Joint=disassemble_model_karamba3d_2.Joint,
    LimitDistance_m=0.005)  # -> Model, Info, Mass_kg, CenterOfGravity, LoadCaseNames

# ----
# Import Material Bank and align with demand bank
panel_63 = Panel("C:\Users\sofie\OneDrive - NTNU\Bygg V24\TKT4950 Master's thesis\08 Final versions\Matching Algorithm")
concatenate_6 = Concatenate(Fragment_A=panel_63, Fragment_B="\", A="ArtificialMaterialBank", B=".3dm")
file_path_4 = FilePath(concatenate_6)
import_content = ImportContent(
    FilePath=file_path_4,
    Name="*",
    Layer="*",
    Linetype="*",
    HatchPattern="*",
    AnnotationStyles="*",
    Materials="*",
    BlockDefinitions="*")  # -> ModelTransform, Objects, Layers, Linetypes, HatchPatterns, AnnotationStyles, Materials, BlockDefinitions
brep_10 = Brep(import_content.Objects)
scale = Scale(Geometry=brep_10, Center=Point(0, 0, 0), Factor="0.001")  # -> Geometry, Transform
addition_6 = Addition(A=addition_4, B=7)
unit_y_5 = UnitY(Factor=addition_6)
move_9 = Move(Geometry=scale.Geometry, Motion=unit_y_5)  # -> Geometry, Transform
plane = Plane(unit_y_5)

data = Data(c_script_3.matchingDataTree)

# ---- group: MaterialBank
brep_11 = Brep(move_9.Geometry)

# ---- group: Model with new names
model_karamba3d_13 = ModelKaramba3D(assemble_model_karamba3d_2.Model)

# ----
# Extracting data
# Sorting away the "none" -
# no match elements
panel_64 = Panel("{3}")
split_tree_6 = SplitTree(Data=data, Masks=flatten(panel_64))  # -> Positive, Negative
split_tree_7 = SplitTree(Data=data, Masks=flatten("{1}"))  # -> Positive, Negative
split_tree_8 = SplitTree(Data=data, Masks=flatten("{0}"))  # -> Positive, Negative
formattostring = Format(Format=split_tree_7.Positive, Culture=127)
cut_off_length = Panel(split_tree_6.Positive)
demand_element_id = Panel(split_tree_8.Positive)
matching_material_element_id = Panel(split_tree_7.Positive)
c_script_4 = CSharpScript(x=formattostring)  # -> out, MatchingElements, NoMatches; inputs x: list of String
# ---------- c_script_4: C# ----------
// Grasshopper Script Instance
#region Usings
using System;
using System.Linq;
using System.Collections;
using System.Collections.Generic;
using System.Drawing;

using Rhino;
using Rhino.Geometry;

using Grasshopper;
using Grasshopper.Kernel;
using Grasshopper.Kernel.Data;
using Grasshopper.Kernel.Types;
#endregion

public class Script_Instance : GH_ScriptInstance
{
    #region Notes
    /* 
      Members:
        RhinoDoc RhinoDocument
        GH_Document GrasshopperDocument
        IGH_Component Component
        int Iteration

      Methods (Virtual & overridable):
        Print(string text)
        Print(string format, params object[] args)
        Reflect(object obj)
        Reflect(object obj, string method_name)
    */
    #endregion

    private void RunScript(
	IList<string> x,
	ref object MatchingElements,
	ref object NoMatches)
    {
        // Write your logic here
        List<int> newList = new List<int>();
        List<int> NoMatch = new List<int>();
        for(int i=0; i < x.Count; i++)
        {
            int result;
            if (int.TryParse(x[i], out result))
            {
                newList.Add(result);
            }

            else
            {
                NoMatch.Add(i);
            }

       
        }
        MatchingElements=newList;
        NoMatches = NoMatch;
    } 
    
}
# ---------- end c_script_4 ----------
dispatch_indices = DispatchIndices(List=split_tree_8.Positive, Indices=c_script_4.NoMatches)  # -> AtI, NotI
list_item_18 = ListItem(List=split_tree_6.Positive, Index=dispatch_indices.NotI, Wrap=True)

# ----
# Visualization Matching algortihm
# Simple mapper
reverse_list_3 = ReverseList(List=brep_11)
disassemble_model_karamba3d_3 = DisassembleModelKaramba3D(Model=model_karamba3d_13)  # -> Model, Point, Beam, Shell, Support, Load, Line, Mesh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

list_item_19 = ListItem(List=reverse_list_3, Index=c_script_4.MatchingElements, Wrap=True)
brep_12 = Brep(list_item_19)

# ----
# Finding endplanes
mesh_12 = Mesh(brep_12)
minimumboundindbox_12 = MinimumBoundindBox(Geometry=graft(mesh_12))  # -> flatten(BoundingBox)
csharp_script_9 = CSharpScript(iBrep=graft(brep_12), iBoundingBox=graft(minimumboundindbox_12))  # -> out, beamStart, beamEnd, outBrep; inputs iBrep: Brep, iBoundingBox: Brep
# ---------- csharp_script_9: C# ----------
// Grasshopper Script Instance
using System;
using System.Linq;
using System.Collections;
using System.Collections.Generic;
using System.Drawing;

using Rhino;
using Rhino.Geometry;

using Grasshopper;
using Grasshopper.Kernel;
using Grasshopper.Kernel.Data;
using Grasshopper.Kernel.Types;

public class Script_Instance : GH_ScriptInstance
{
  /* 
    Members:
      RhinoDoc RhinoDocument
      GH_Document GrasshopperDocument
      IGH_Component Component
      int Iteration

    Methods (Virtual & overridable):
      Print(string text)
      Print(string format, params object[] args)
      Reflect(object obj)
      Reflect(object obj, string method_name)
  */
  
  private void RunScript(
	Brep iBrep_,
	Brep iBoundingBox_,
	ref object beamStart,
	ref object beamEnd,
	ref object outBrep)
  {
    Brep iBrep = iBrep_;
    Brep iBoundingBox = iBoundingBox_;
    
    //Check if brep is solid and flip if needed
    if (!iBrep.IsSolid)
        iBrep = iBrep.CapPlanarHoles(0.01);

    if (iBrep.SolidOrientation == BrepSolidOrientation.Inward)
        iBrep.Flip();
    
    // Find beam endpoints and axis
    var faces = iBoundingBox.Faces;
    List<double> areas = new List<double>();
    Dictionary<Point3d, double> facesDic = new Dictionary<Point3d,double>();
   // Populate dictionary with areas and centroids
    foreach (var face in faces)
    {
        double area = AreaMassProperties.Compute(face).Area;
        Point3d centroid = AreaMassProperties.Compute(face).Centroid;
        facesDic.Add(centroid, area);
    }
    
    var sortedAreas = facesDic.OrderBy(kv => kv.Key.Y).ToList();
   
    //Finding endpoints and beam axis
    Point3d endPoint1 = sortedAreas.First().Key;
    Point3d endPoint2 = sortedAreas.Last().Key;
    Vector3d YZ = new Vector3d(1,0,0);
       
    beamStart = endPoint1;
    beamEnd = endPoint2;
    outBrep = iBrep;
 


  }

//Method for orienting Brep   
    private (Brep, Brep) oriented(Brep iBrep, Brep iBoundingBox) 
    {
        var faces = iBoundingBox.Faces;
        
        Dictionary<BrepFace, Point3d> facesDic = new Dictionary<BrepFace,Point3d>();
        // Populate dictionary with areas and centroids
        foreach (var face in faces)
        {
            Point3d centroid = AreaMassProperties.Compute(face).Centroid;
            facesDic.Add(face, centroid);
        }

           
        var sortedFaces = facesDic.OrderBy(kv => kv.Value.X).ToList();
        // Choose the bottom face as the face with the smallest centroid Z-coordinate
    
        
        BrepFace endFace = sortedFaces.First().Key;

        
        // Calculate the centroid point of the end face
        Point3d centroidEnd = AreaMassProperties.Compute(endFace).Centroid;
     
        // Get the normal of the bottom face
        Vector3d normal = endFace.NormalAt(0, 0);

        // Check if the normal is pointing upwards (positive Z direction)
        bool isUpwardNormal = normal.X > 0;
        
        // Define the target plane as the world XY plane
        Plane targetPlane = Plane.WorldYZ;

        // Define the orientation plane based on the normal direction
        Plane orientationPlane;
        if (isUpwardNormal)
        {
            orientationPlane = new Plane(centroidEnd, normal);
        }
        else
        {
            orientationPlane = new Plane(centroidEnd, -normal);
        }
        

        // Create the transformation from the orientation plane to the target plane
        Transform orient = Transform.PlaneToPlane(orientationPlane, targetPlane);

        iBrep.Transform(orient);
        iBoundingBox.Transform(orient);

        return (iBrep, iBoundingBox);

    }
  
}
# ---------- end csharp_script_9 ----------
point_8 = Point(csharp_script_9.beamStart)
brep_13 = Brep(csharp_script_9.outBrep)
point_9 = Point(csharp_script_9.beamEnd)

# ----
# Splitting brep by "cut-off" length
vector_2pt = Vector2Pt(PointA=point_8, PointB=point_9, Unitize=False)  # -> Vector, Length
brep_14 = Brep(brep_13)
number_13 = Number(list_item_18)
line_sdl_2 = LineSDL(Start=point_8, Direction=vector_2pt.Vector, Length=expr("x/1000", graft(number_13)))
number_slider = Slider(34, range=0..100)
perp_frame = PerpFrame(Curve=line_sdl_2, Parameter="1")
list_item_20 = ListItem(List=flatten(perp_frame), Index=number_slider, Wrap=True)
list_item_21 = ListItem(List=flatten(brep_14), Index=number_slider, Wrap=True)
split_brep = SplitBrep(Brep=brep_14, Cutter=perp_frame)
cap_holes = CapHoles(Brep=split_brep)

# ----
# Circular representation of material bank
panel_65 = Panel("10,6,0")
brep_15 = Brep(simplify(cap_holes))
tree_statistics_3 = TreeStatistics(Tree=brep_15)  # -> Paths, Length, Count
xy_plane_3 = XYPlane(Origin=panel_65)
list_item_22 = ListItem(List=brep_15, Index=0, Wrap=True)
circle = Circle(Plane=xy_plane_3, Radius="20")
divide_curve_2 = DivideCurve(Curve=circle, Count=tree_statistics_3.Count, Kinks=False)  # -> Points, Tangents, Parameters

# ----
# Finding endplanes
mesh_13 = Mesh(list_item_22)
minimumboundindbox_13 = MinimumBoundindBox(Geometry=graft(mesh_13))  # -> flatten(BoundingBox)
csharp_script_10 = CSharpScript(iBrep=graft(list_item_22), iBoundingBox=graft(minimumboundindbox_13))  # -> out, beamStart, beamEnd, outBrep; inputs iBrep: Brep, iBoundingBox: Brep; same code as csharp_script_9
point_10 = Point(csharp_script_10.beamStart)
brep_16 = Brep(csharp_script_10.outBrep)
point_11 = Point(csharp_script_10.beamEnd)

# ---- group: number of reused element
number_14 = Number(tree_statistics_3.Count)

# ----
# Randomize colours
R = Panel("0 To 255")
# VisualMapper
B = Panel("0 To 255")
G = Panel("0 To 255")
random = Random(Range=R, Number=number_14, Seed="20")
random_2 = Random(Range=G, Number=number_14, Seed=2)
random_3 = Random(Range=B, Number=number_14, Seed="30")
round = Round(Number=random)  # -> Nearest, Floor, Ceiling
round_2 = Round(Number=random_2)  # -> Nearest, Floor, Ceiling
round_3 = Round(Number=random_3)  # -> Nearest, Floor, Ceiling
concatenate_7 = Concatenate(FragmentA=round.Floor, FragmentB=",", FragmentA_2=round_2.Floor, FragmentB_2=",", FragmentC=round_3.Floor)

# ----
# Material bank
brep_17 = Brep(cap_holes)
list_item_23 = ListItem(List=brep_17, Index=0, Wrap=True)
mesh_14 = Mesh(list_item_23)
minimumboundindbox_14 = MinimumBoundindBox(Geometry=mesh_14)
deconstruct_brep_4 = DeconstructBrep(Brep=minimumboundindbox_14)  # -> Faces, Edges, Vertices
area_2 = Area(Geometry=deconstruct_brep_4.Faces)  # -> Area, Centroid
deconstruct_9 = Deconstruct(Point=area_2.Centroid)  # -> XComponent, YComponent, ZComponent
sort_list_5 = SortList(Keys=deconstruct_9.ZComponent, ValuesValuesA=area_2.Centroid)  # -> Keys, ValuesValuesA
list_item_24 = ListItem(List=reverse(sort_list_5.ValuesValuesA), Index="0", Wrap=True)
line_11 = Line(StartPoint=point_10, EndPoint=point_11)

# ----
# Orientating beams to center
yz_plane = YZPlane(Origin=point_10)
circular = Point(divide_curve_2.Points)
rotate_3 = Rotate(Geometry=brep_15, Angle=degrees("90"), Plane=yz_plane)  # -> Geometry, Transform
unit_z_12 = UnitZ(Factor=1)
graft_tree = GraftTree(Tree=circular, IncludeEmptyLists=True, IncludeNullItems=True)
line_sdl_3 = LineSDL(Start=graft_tree, Direction=unit_z_12, Length=1)
move_to_point = MoveToPoint(Geometry=rotate_3.Geometry, PointA=point_10, PointB=graft_tree)  # -> Moved, Vector, Transform

# ----
# Finding height axis
mesh_15 = Mesh(move_to_point.Moved)
minimumboundindbox_15 = MinimumBoundindBox(Geometry=mesh_15)
deconstruct_brep_5 = DeconstructBrep(Brep=minimumboundindbox_15)  # -> Faces, Edges, Vertices
area_3 = Area(Geometry=deconstruct_brep_5.Faces)  # -> Area, Centroid
sort_list_6 = SortList(Keys=area_3.Area, ValuesValuesA=deconstruct_brep_5.Faces)  # -> Keys, ValuesValuesA
list_item_25 = ListItem(List=sort_list_6.ValuesValuesA, Index="0", Wrap=True)
surface_2 = Surface(list_item_25)
deconstruct_brep_6 = DeconstructBrep(Brep=surface_2)  # -> Faces, Edges, Vertices
length = Length(Curve=deconstruct_brep_6.Edges)
sort_list_7 = SortList(Keys=length, ValuesValuesA=deconstruct_brep_6.Edges)  # -> Keys, ValuesValuesA
area_4 = Area(Geometry=surface_2)  # -> Area, Centroid
list_item_26 = ListItem(List=sort_list_7.ValuesValuesA, Index="-1", Wrap=True)  # -> simplify(Item)
curve_middle = CurveMiddle(Curve=list_item_26)
move_to_point_2 = MoveToPoint(Geometry=list_item_26, PointA=curve_middle, PointB=area_4.Centroid)  # -> Moved, Vector, Transform
height_axis_of_beam = Line(move_to_point_2.Moved)
project_2 = Project(Geometry=height_axis_of_beam, Plane=PlaneXY(0, 0, 0))  # -> Geometry, Transform
curve_middle_2 = CurveMiddle(Curve=project_2.Geometry)
line_12 = Line(StartPoint=curve_middle_2, EndPoint=panel_65)
xy_plane_4 = XYPlane(Origin=Point(0, 0, 0))
angle = Angle(VectorA=project_2.Geometry, VectorB=line_12, Plane=xy_plane_4)  # -> Angle, Reflex

number_15 = Number(angle.Angle)
rotate_axis = RotateAxis(Geometry=move_to_point.Moved, Angle=number_15, Axis=line_sdl_3)  # -> Geometry, Transform

# ----
# Matching element used part
panel_66 = Panel("\t230, 35, 244")
list_item_27 = ListItem(List=rotate_axis.Geometry, Index=0, Wrap=True)
custom_preview = CustomPreview(Geometry=list_item_27, Material=panel_66)

# ----
# Colouring elements
panel_67 = Panel("Demand_")
match = Number(dispatch_indices.NotI)
nomatch = Number(dispatch_indices.AtI)
concatenate_8 = Concatenate(FragmentA=panel_67, FragmentB=graft(match))
concatenate_9 = Concatenate(FragmentA=panel_67, FragmentB=graft(nomatch))
colour = Colour(panel_66)
text_2 = Text(flatten([brazing, column]))
colour_2 = Colour(ColourSwatch(SwatchColor=RGB(255, 0, 0)))
make_element_set_karamba3d = MakeElementSetKaramba3D(
    ElementIdentifiers=flatten(text_2),
    SetIdentifier="Column&Brazing",
    MinimumSplitLength_m=0.001,
    ColorOfTheSet=ColourSwatch(SwatchColor=RGB(216, 225, 236)))
make_element_set_karamba3d_2 = MakeElementSetKaramba3D(
    ElementIdentifiers=flatten(concatenate_8),
    SetIdentifier="MatchedElements",
    MinimumSplitLength_m=0.001,
    ColorOfTheSet=colour)
make_element_set_karamba3d_3 = MakeElementSetKaramba3D(ElementIdentifiers=flatten(concatenate_9), SetIdentifier="NoMatch", MinimumSplitLength_m=0.001, ColorOfTheSet=colour_2)

# ----
# Rest of the model
assemble_model_karamba3d_3 = AssembleModelKaramba3D(
    Elem=disassemble_model_karamba3d_3.Beam,
    Support=disassemble_model_karamba3d_3.Support,
    Load=disassemble_model_karamba3d_3.Load,
    CrossSection=disassemble_model_karamba3d_3.CrossSection,
    Joint=disassemble_model_karamba3d_3.Joint,
    BeamSet=[make_element_set_karamba3d_3, make_element_set_karamba3d_2, make_element_set_karamba3d],
    LimitDistance_m=0.005)  # -> Model, Info, Mass_kg, CenterOfGravity, LoadCaseNames
model_view_karamba3d_13 = ModelViewKaramba3D(Model=assemble_model_karamba3d_3.Model, ResultFactors=1, ResultCase=-1)  # -> Model, DeformedMesh, DeformedAxes, DeformedModel
beam_view_karamba3d_12 = BeamViewKaramba3D(Model=model_view_karamba3d_13.Model)  # -> Model, MeshesOfRenderedBeams, DeformedBeamAxes, LegendColors, LegendTags
mesh_16 = Mesh(beam_view_karamba3d_12.MeshesOfRenderedBeams)

# ----
# "Cut-off" Material
colour_swatch = ColourSwatch(SwatchColor=RGB(13, 255, 81))
list_item_28 = ListItem(List=rotate_axis.Geometry, Index=1, Wrap=True)
custom_preview_2 = CustomPreview(Geometry=list_item_28, Material=colour_swatch)

# ----
# Rest of the design model
model_view_karamba3d_14 = ModelViewKaramba3D(Model=assemble_model_karamba3d_3.Model, ResultFactors=1, ResultCase=-1, ElementIdentifiersBreps=[text_2, concatenate_9])  # -> Model, DeformedMesh, DeformedAxes, DeformedModel
beam_view_karamba3d_13 = BeamViewKaramba3D(Model=model_view_karamba3d_14.Model)  # -> Model, MeshesOfRenderedBeams, DeformedBeamAxes, LegendColors, LegendTags
mesh_17 = Mesh(beam_view_karamba3d_13.MeshesOfRenderedBeams)

# ----
# Matching element used part
list_item_29 = ListItem(List=rotate_axis.Geometry, Index=0, Wrap=True)

# ----
# Meshes in design model
panel_68 = Panel("1")

# ----
# Complex mapper
make_element_set_karamba3d_4 = MakeElementSetKaramba3D(
    ElementIdentifiers=graft(concatenate_8),
    SetIdentifier=concatenate_8,
    MinimumSplitLength_m=0.001,
    ColorOfTheSet=graft(concatenate_7))  # -> flatten(ElementSet)
assemble_model_karamba3d_4 = AssembleModelKaramba3D(
    Elem=disassemble_model_karamba3d_3.Beam,
    Support=disassemble_model_karamba3d_3.Support,
    Load=disassemble_model_karamba3d_3.Load,
    CrossSection=disassemble_model_karamba3d_3.CrossSection,
    Joint=disassemble_model_karamba3d_3.Joint,
    BeamSet=[make_element_set_karamba3d_3, make_element_set_karamba3d, make_element_set_karamba3d_4],
    LimitDistance_m=0.005)  # -> Model, Info, Mass_kg, CenterOfGravity, LoadCaseNames
element_query_karamba3d_2 = ElementQueryKaramba3D(Model=assemble_model_karamba3d_4.Model, ElementsIdentifiers=concatenate_8)  # -> Model, Mass_kg, Area_m2, Volume_m3, Meshes
model_view_karamba3d_15 = ModelViewKaramba3D(Model=assemble_model_karamba3d_4.Model, ResultFactors=1, ResultCase=-1)  # -> Model, DeformedMesh, DeformedAxes, DeformedModel
beam_view_karamba3d_14 = BeamViewKaramba3D(Model=model_view_karamba3d_15.Model)  # -> Model, MeshesOfRenderedBeams, DeformedBeamAxes, LegendColors, LegendTags
volume_3 = Volume(Geometry=list_item_29)  # -> Volume, Centroid

element_query_karamba3d_3 = ElementQueryKaramba3D(Model=assemble_model_karamba3d_4.Model, ElementsIdentifiers=concatenate_8)  # -> Model, Mass_kg, Area_m2, Volume_m3, Meshes
mesh_18 = Mesh(element_query_karamba3d_3.Meshes)
list_item_30 = ListItem(List=mesh_18, Index=panel_68, Wrap=True)
minimumboundindbox_16 = MinimumBoundindBox(Geometry=list_item_30)
deconstruct_brep_7 = DeconstructBrep(Brep=minimumboundindbox_16)  # -> Faces, Edges, Vertices
area_5 = Area(Geometry=deconstruct_brep_7.Faces)  # -> Area, Centroid
sort_list_8 = SortList(Keys=area_5.Area, ValuesValuesA=area_5.Centroid)  # -> Keys, ValuesValuesA
deconstruct_10 = Deconstruct(Point=area_5.Centroid)  # -> XComponent, YComponent, ZComponent
sort_list_9 = SortList(Keys=deconstruct_10.ZComponent, ValuesValuesA=area_5.Centroid)  # -> Keys, ValuesValuesA
list_item_31 = ListItem(List=sort_list_8.ValuesValuesA, Index=0, Wrap=True)
list_item_32 = ListItem(List=sort_list_8.ValuesValuesA, Index=1, Wrap=True)
list_item_33 = ListItem(List=reverse(sort_list_9.ValuesValuesA), Index="0", Wrap=True)
line_13 = Line(StartPoint=list_item_31, EndPoint=list_item_32)
vector = Vector(line_13)

# ----
# Moving into design model
move_to_point_3 = MoveToPoint(Geometry=list_item_23, PointA=list_item_24, PointB=list_item_33)  # -> Moved, Vector, Transform
move_to_point_4 = MoveToPoint(Geometry=line_11, PointA=list_item_24, PointB=list_item_33)  # -> Moved, Vector, Transform
vector_2 = Vector(move_to_point_4.Moved)
volume_4 = Volume(Geometry=move_to_point_3.Moved)  # -> Volume, Centroid
angle_2 = Angle(VectorA=vector_2, VectorB=vector)  # -> Angle, Reflex
xy_plane_5 = XYPlane(Origin=volume_4.Centroid)
rotate_4 = Rotate(Geometry=move_to_point_3.Moved, Angle=angle_2.Angle, Plane=xy_plane_5)  # -> Geometry, Transform
custom_preview_3 = CustomPreview(Geometry=rotate_4.Geometry, Material=graft(ColourSwatch(SwatchColor=RGB(159, 127, 88))))

mesh_19 = Mesh(element_query_karamba3d_2.Meshes)

list_item_34 = ListItem(List=mesh_19, Index="1", Wrap=True)
volume_5 = Volume(Geometry=list_item_34)  # -> Volume, Centroid
line_14 = Line(StartPoint=volume_5.Centroid, EndPoint=volume_3.Centroid)

# ---- group: Output Mapper
# No match, Column Brazing
# Linking lines
# Matching elements
# "Cut-off" Material
custom_preview_4 = CustomPreview(Geometry=list_item_29, Material=graft(concatenate_7))
custom_preview_5 = CustomPreview(Geometry=line_14, Material=graft(concatenate_7))
custom_preview_6 = CustomPreview(Geometry=list_item_28, Material=colour_swatch)
mesh_20 = Mesh(beam_view_karamba3d_14.MeshesOfRenderedBeams)

# ==== cluster Cluster
spacingx = ClusterInput()
curve = ClusterInput()
spacingy = ClusterInput()
spacingx_2 = Number(spacingx)
curve_2 = Curve(curve)
spacingy_2 = Number(spacingy)
csharp_script = CSharpScript(spacingY=spacingy_2, spacingX=spacingx_2)  # -> out, corner, nextToCorner; inputs spacingY: Int32, spacingX: Int32
# ---------- csharp_script: C# ----------
// Grasshopper Script Instance
using System;
using System.Collections;
using System.Collections.Generic;
using System.Drawing;

using Rhino;
using Rhino.Geometry;

using Grasshopper;
using Grasshopper.Kernel;
using Grasshopper.Kernel.Data;
using Grasshopper.Kernel.Types;

public class Script_Instance : GH_ScriptInstance
{
  /* 
    Members:
      RhinoDoc RhinoDocument
      GH_Document GrasshopperDocument
      IGH_Component Component
      int Iteration

    Methods (Virtual & overridable):
      Print(string text)
      Print(string format, params object[] args)
      Reflect(object obj)
      Reflect(object obj, string method_name)
  */
  
  private void RunScript(
	int spacingY,
	int spacingX,
	ref object corner,
	ref object nextToCorner)
  {
    // Write your logic here

    //Column 1 {4;5;*}
    string pathA = "{" + spacingY + ";" + spacingX + ";*}";
    corner = pathA;

    //Column 2 {3;5;*}
    int sy = spacingY - 1;
    string pathB = "{" + sy + ";" + spacingX + ";*}";

    //Column 2 {4;4;*} 
    int sx = spacingX - 1;
    string pathC = "{" + spacingY + ";" + sx + ";*}";


    List<object> secondColumns = new List<object>();
    secondColumns.Add(pathB);
    secondColumns.Add(pathC);


    nextToCorner = secondColumns;
  }
}
# ---------- end csharp_script ----------
csharp_script_2 = CSharpScript(spacingX=spacingx_2)  # -> out, corner, nextToCorner; inputs spacingX: Int32
# ---------- csharp_script_2: C# ----------
// Grasshopper Script Instance
using System;
using System.Collections;
using System.Collections.Generic;
using System.Drawing;

using Rhino;
using Rhino.Geometry;

using Grasshopper;
using Grasshopper.Kernel;
using Grasshopper.Kernel.Data;
using Grasshopper.Kernel.Types;

public class Script_Instance : GH_ScriptInstance
{
  /* 
    Members:
      RhinoDoc RhinoDocument
      GH_Document GrasshopperDocument
      IGH_Component Component
      int Iteration

    Methods (Virtual & overridable):
      Print(string text)
      Print(string format, params object[] args)
      Reflect(object obj)
      Reflect(object obj, string method_name)
  */
  
  private void RunScript(int spacingX, ref object corner, ref object nextToCorner)
  {
    // Write your logic here

    //Column 1 {0;5;*}
    string pathA = "{" + 0 + ";" + spacingX + ";*}";
    corner = pathA;

    //Column 2 {1;5;*}
    string pathB = "{" + 1 + ";" + spacingX + ";*}";

    //Column 2 {0;4;*} 
    string pathC = "{" + 0 + ";" + (spacingX-1) + ";*}";
    

    List<object> secondColumns = new List<object>();
    secondColumns.Add(pathB);
    secondColumns.Add(pathC);


    nextToCorner = secondColumns;
  }
}
# ---------- end csharp_script_2 ----------
csharp_script_3 = CSharpScript(spacingY=spacingy_2)  # -> out, corner, nextToCorner; inputs spacingY: Int32
# ---------- csharp_script_3: C# ----------
// Grasshopper Script Instance
using System;
using System.Collections;
using System.Collections.Generic;
using System.Drawing;

using Rhino;
using Rhino.Geometry;

using Grasshopper;
using Grasshopper.Kernel;
using Grasshopper.Kernel.Data;
using Grasshopper.Kernel.Types;

public class Script_Instance : GH_ScriptInstance
{
  /* 
    Members:
      RhinoDoc RhinoDocument
      GH_Document GrasshopperDocument
      IGH_Component Component
      int Iteration

    Methods (Virtual & overridable):
      Print(string text)
      Print(string format, params object[] args)
      Reflect(object obj)
      Reflect(object obj, string method_name)
  */
  
  private void RunScript(int spacingY, ref object corner, ref object nextToCorner)
  {
    // Write your logic here

    //Column 1 {4;5;*}
    string pathA = "{" + spacingY + ";" + 0 + ";*}";
    corner = pathA;

    //Column 2 {3;5;*}
    int sy = spacingY - 1;
    string pathB = "{" + sy + ";" + 0 + ";*}";

    //Column 2 {4;4;*} 
    string pathC = "{" + spacingY + ";" + 1 + ";*}";


    List<object> secondColumns = new List<object>();
    secondColumns.Add(pathB);
    secondColumns.Add(pathC);


    nextToCorner = secondColumns;
  }
}
# ---------- end csharp_script_3 ----------
csharp_script_4 = CSharpScript()  # -> out, corner, nextToCorner
# ---------- csharp_script_4: C# ----------
// Grasshopper Script Instance
using System;
using System.Collections;
using System.Collections.Generic;
using System.Drawing;

using Rhino;
using Rhino.Geometry;

using Grasshopper;
using Grasshopper.Kernel;
using Grasshopper.Kernel.Data;
using Grasshopper.Kernel.Types;

public class Script_Instance : GH_ScriptInstance
{
  /* 
    Members:
      RhinoDoc RhinoDocument
      GH_Document GrasshopperDocument
      IGH_Component Component
      int Iteration

    Methods (Virtual & overridable):
      Print(string text)
      Print(string format, params object[] args)
      Reflect(object obj)
      Reflect(object obj, string method_name)
  */
  
  private void RunScript(ref object corner, ref object nextToCorner)
  {
    // Write your logic here

    //Column 1 {0;0;*}
    string pathA = "{" + 0 + ";" + 0 + ";*}";
    corner = pathA;

    //Column 2 {1;0;*}
    string pathB = "{" + 1 + ";" + 0 + ";*}";

    //Column 2 {0;1;*} 
    string pathC = "{" + 0 + ";" + 1 + ";*}";


    List<object> secondColumns = new List<object>();
    secondColumns.Add(pathB);
    secondColumns.Add(pathC);


    nextToCorner = secondColumns;
  }
}
# ---------- end csharp_script_4 ----------
split_tree = SplitTree(Data=curve_2, Masks=flatten(csharp_script_4.corner))  # -> Positive, Negative
split_tree_2 = SplitTree(Data=curve_2, Masks=flatten(csharp_script_4.nextToCorner))  # -> Positive, Negative
split_tree_3 = SplitTree(Data=curve_2, Masks=flatten(csharp_script.corner))  # -> Positive, Negative
split_tree_4 = SplitTree(Data=curve_2, Masks=flatten(csharp_script.nextToCorner))  # -> Positive, Negative
split_tree_5 = SplitTree(Data=curve_2, Masks=flatten(csharp_script_3.corner))  # -> Positive, Negative
split_tree_6 = SplitTree(Data=curve_2, Masks=flatten(csharp_script_3.nextToCorner))  # -> Positive, Negative
split_tree_7 = SplitTree(Data=curve_2, Masks=flatten(csharp_script_2.corner))  # -> Positive, Negative
split_tree_8 = SplitTree(Data=curve_2, Masks=flatten(csharp_script_2.nextToCorner))  # -> Positive, Negative
curve_3 = Curve(split_tree_4.Positive)
curve_4 = Curve(split_tree.Positive)
curve_5 = Curve(split_tree_2.Positive)
curve_6 = Curve(split_tree_3.Positive)
curve_7 = Curve(split_tree_5.Positive)
curve_8 = Curve(split_tree_6.Positive)
curve_9 = Curve(split_tree_7.Positive)
curve_10 = Curve(split_tree_8.Positive)
panel = Panel([csharp_script_4.corner, csharp_script_4.nextToCorner])
end_points = EndPoints(Curve=curve_4)  # -> Start, End
end_points_2 = EndPoints(Curve=curve_5)  # -> Start, End
end_points_3 = EndPoints(Curve=curve_6)  # -> Start, End
end_points_4 = EndPoints(Curve=curve_3)  # -> Start, End
end_points_5 = EndPoints(Curve=curve_7)  # -> Start, End
end_points_6 = EndPoints(Curve=curve_8)  # -> Start, End
end_points_7 = EndPoints(Curve=curve_9)  # -> Start, End
end_points_8 = EndPoints(Curve=curve_10)  # -> Start, End
line = Line(StartPoint=end_points.Start, EndPoint=end_points_2.End)
line_2 = Line(StartPoint=end_points.End, EndPoint=end_points_2.Start)
line_3 = Line(StartPoint=end_points_3.Start, EndPoint=end_points_4.End)
line_4 = Line(StartPoint=end_points_3.End, EndPoint=end_points_4.Start)
line_5 = Line(StartPoint=end_points_5.Start, EndPoint=end_points_6.End)
line_6 = Line(StartPoint=end_points_5.End, EndPoint=end_points_6.Start)
line_7 = Line(StartPoint=end_points_7.Start, EndPoint=end_points_8.End)
line_8 = Line(StartPoint=end_points_7.End, EndPoint=end_points_8.Start)
cull_index = CullIndex(List=line_2, Indices="0", Wrap=True)
cull_index_2 = CullIndex(List=line_4, Indices="0", Wrap=True)
cull_index_3 = CullIndex(List=line_6, Indices="0", Wrap=True)
cull_index_4 = CullIndex(List=line_8, Indices="0", Wrap=True)
cull_nth = CullNth(List=[line, cull_index], CullFrequency=2)
cull_nth_2 = CullNth(List=[line_3, cull_index_2], CullFrequency=2)
cull_nth_3 = CullNth(List=[line_5, cull_index_3], CullFrequency=2)
cull_nth_4 = CullNth(List=[line_7, cull_index_4], CullFrequency=2)
list = ClusterOutput(cull_nth)
list_2 = ClusterOutput(cull_nth_2)
list_3 = ClusterOutput(cull_nth_3)
list_4 = ClusterOutput(cull_nth_4)

# ==== cluster Cluster_2
spacingy = ClusterInput()
spacingx = ClusterInput()
curve = ClusterInput()
curve_2 = Curve(simplify(curve))
spacingy_2 = Number(expr("x-1", spacingy))
spacingx_2 = Number(expr("x-1", spacingx))
csharp_script = CSharpScript(spacingY=spacingy_2, spacingX=spacingx_2)  # -> out, X1, X2, Y1, Y2; inputs spacingY: Int32, spacingX: Int32
# ---------- csharp_script: C# ----------
// Grasshopper Script Instance
using System;
using System.Collections;
using System.Collections.Generic;
using System.Drawing;

using Rhino;
using Rhino.Geometry;

using Grasshopper;
using Grasshopper.Kernel;
using Grasshopper.Kernel.Data;
using Grasshopper.Kernel.Types;

public class Script_Instance : GH_ScriptInstance
{
  /* 
    Members:
      RhinoDoc RhinoDocument
      GH_Document GrasshopperDocument
      IGH_Component Component
      int Iteration

    Methods (Virtual & overridable):
      Print(string text)
      Print(string format, params object[] args)
      Reflect(object obj)
      Reflect(object obj, string method_name)
  */
  
  private void RunScript(
	int spacingY,
	int spacingX,
	ref object X1,
	ref object X2,
	ref object Y1,
	ref object Y2)
  {
    // Write your logic here

    

    /*
    List<object> secondColumns = new List<object>();
    secondColumns.Add(pathB);
    secondColumns.Add(pathC);
    */


    //Facade x-spacing 
    List<object> x1 = new List<object>();
    for (int i = 0; i < spacingX ; i++)
    {
        string facade = "{0;" + i + "}";
        x1.Add(facade);
    }
    X1 = x1;

    List<object> x2 = new List<object>();
    for (int i = 0; i < spacingY ; i++)
    {
        string facade = "{" + i + ";" + spacingX + "}";
        x2.Add(facade);
    }
    X2 = x2;

    //Facade y-spacing 
    List<object> y1 = new List<object>();
    for (int i = 1; i < spacingY+1 ; i++)
    {
        string facade = "{" + i + ";0}";
        y1.Add(facade);
    }
    Y1 = y1;

    List<object> y2 = new List<object>();
    for (int i = 1; i < spacingX+1 ; i++)
    {
        string facade = "{" + spacingY + ";" + i + "}";
        y2.Add(facade);
    }
    Y2 = y2;
    
    



  }
}
# ---------- end csharp_script ----------
split_tree = SplitTree(Data=curve_2, Masks=flatten(csharp_script.X1))  # -> Positive, Negative
split_tree_2 = SplitTree(Data=curve_2, Masks=flatten(csharp_script.X2))  # -> Positive, Negative
split_tree_3 = SplitTree(Data=curve_2, Masks=flatten(csharp_script.Y1))  # -> Positive, Negative
split_tree_4 = SplitTree(Data=curve_2, Masks=flatten(csharp_script.Y2))  # -> Positive, Negative
split_tree_5 = SplitTree(Data=curve_2, Masks=flatten([csharp_script.X1, csharp_script.X2, csharp_script.Y1, csharp_script.Y2]))  # -> Positive, Negative
line = Line(split_tree.Positive)
line_2 = Line(split_tree_2.Positive)
line_3 = Line(split_tree_3.Positive)
line_4 = Line(split_tree_4.Positive)
merge = Merge(Data1=line, Data2=line_2, Data3=line_3, Data4=line_4)
line_5 = Line(split_tree_5.Negative)
facadecolumns = ClusterOutput(merge)
midcolumns = ClusterOutput(line_5)

# ==== cluster Cluster_3
geometry = ClusterInput()
minimumboundindbox = MinimumBoundindBox(Geometry=geometry)
xy_plane = XYPlane(Origin=Point(0, 0, 0))
brep = Brep(flatten(minimumboundindbox))
rotate = Rotate(Geometry=brep, Angle=1.570796327, Plane=xy_plane)  # -> Geometry, Transform
list_length = ListLength(List=brep)
series = Series(Start=0, Step=1, Count=list_length)
panel = Panel(brep)
construct_point = ConstructPoint(XCoordinate=series, YCoordinate=0, ZCoordinate=0)
volume = Volume(Geometry=brep)  # -> Volume, Centroid
orient = Orient(Geometry=brep, Source=volume.Centroid, Target=construct_point)  # -> Geometry, Transform
geometry_2 = ClusterOutput(orient.Geometry)
