# Grasshopper definition Study Case 2.gh (Grasshopper 1.0.8)
# plug-ins: Karamba3D, RhinoCodePluginGH, Heteroptera, Pufferfish, Minimum bounding box, LunchBox

license_karamba3d = LicenseKaramba3D()
panel = Panel(license_karamba3d)

# ---- group: VariableInputParameters
floors = Slider(3, range=1..6)
floorheight_m = Slider(4, range=2.4..4)

# ----
rectangle = Rectangle(Plane=PlaneXY(0, 0, 0), XSize="20", YSize="12", Radius=0)  # -> Rectangle, Length

# ---- group: RhinoInput
curve = Curve(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)

# ---- group: Demand Bank
# Insert your file path to the Excel sheet here:
panel_2 = Panel("C:\Users\rakel\OneDrive - NTNU\Dokumenter\TKT4950 Master's thesis\08 Final versions\Results\MatchingAlgorithmCaseStudy2.xlsx")

# ---- group: Geometrical Model
numbertransversebeamsdiv = Panel("3")

# ---- group: Geometrical Model / creating surfaces and floors
multiplication = Multiplication(A=floors, B=floorheight_m)
surface = Surface(rectangle.Rectangle)
area = Area(Geometry=surface)  # -> Area, Centroid

# ---- group: Geometrical Model
brep_edges = BrepEdges(Brep=surface)  # -> Naked, Interior, NonManifold
list_item = ListItem(List=brep_edges.Naked, Index=0, Wrap=True)  # -> Item, Item1, Item2, Item3
xspacing = Slider(5, range=2..5)
curve_2 = Curve(list_item.Item)
curve_3 = Curve(list_item.Item2)
curve_4 = Curve(list_item.Item1)
curve_5 = Curve(list_item.Item3)
point_divide_curve_target_length = PointDivideCurveTargetLength(Curve=curve_5, Target=Slider(4, range=2..6), DivisionType="1", EndPoint=False)  # -> flatten(Points), Tangents, Parameters, Length, ResultBoolean
point_divide_curve_target_length_2 = PointDivideCurveTargetLength(Curve=curve_2, Target=xspacing, DivisionType="1", EndPoint=False)  # -> flatten(Points), Tangents, Parameters, Length, ResultBoolean
list_length = ListLength(List=point_divide_curve_target_length.Points)
list_length_2 = ListLength(List=point_divide_curve_target_length_2.Points)
panel_3 = Panel(point_divide_curve_target_length.Length)
panel_4 = Panel(point_divide_curve_target_length_2.Length)
ydiv = Number(list_length)
xdiv = Number(list_length_2)
panel_5 = Panel(xdiv)
panel_6 = Panel(ydiv)

numberheight = Number(multiplication)

# ---- group: Geometrical Model / creating surfaces and floors (continued)
unit_z = UnitZ(Factor=numberheight)
line_sdl = LineSDL(Start=area.Centroid, Direction=unit_z, Length=numberheight)
perp_frames = PerpFrames(Curve=line_sdl, Count=floors, Align=True)  # -> Frames, Parameters
project = Project(Geometry=surface, Plane=perp_frames.Frames)  # -> Geometry, Transform

# ---- group: Geometrical Model / floors
boolean_toggle = BooleanToggle(True)
split_tree = SplitTree(Data=project.Geometry, Masks=flatten("{0;0}[0]"))  # -> Positive, Negative
clean_tree = CleanTree(RemoveNulls=True, RemoveInvalid=True, RemoveEmpty=boolean_toggle, Tree=split_tree.Positive)
clean_tree_2 = CleanTree(RemoveNulls=True, RemoveInvalid=True, RemoveEmpty=boolean_toggle, Tree=split_tree.Negative)
surfacegroundfloor = Surface(clean_tree)
surfacefloors = Surface(clean_tree_2)

# ---- group: Geometrical Model / creating nodes
divide_surface = DivideSurface(Surface=project.Geometry, UCount=expr("x-1", xdiv), VCount=expr("x-1", ydiv))  # -> Points, Normals, Parameters
csharp_script = CSharpScript(inodes=divide_surface.Points)  # -> out, ground, not_ground; inputs inodes: list of Point3d
# ---------- csharp_script: C# ----------
// Grasshopper Script Instance
using System;
using System.Collections;
using System.Collections.Generic;
using System.Drawing;

using Rhino;
using Rhino.Geometry;

using Grasshopper;
using Grasshopper.Kernel;
using Grasshopper.Kernel.Data;
using Grasshopper.Kernel.Types;

public class Script_Instance : GH_ScriptInstance
{
  /* 
    Members:
      RhinoDoc RhinoDocument
      GH_Document GrasshopperDocument
      IGH_Component Component
      int Iteration

    Methods (Virtual & overridable):
      Print(string text)
      Print(string format, params object[] args)
      Reflect(object obj)
      Reflect(object obj, string method_name)
  */
  
  private void RunScript(
	IList<Point3d> inodes,
	ref object ground,
	ref object not_ground)
  {
    // Write your logic here

    List<Point3d> ground_floor = new List<Point3d>();
    List<Point3d> not_ground_floor = new List<Point3d>();

    for (int i = 0 ; i < inodes.Count ; i++)
    {
        if (inodes[i].Z == 0)
        {
            ground_floor.Add(inodes[i]);
        }
        else if (inodes[i].Z != 0)
        {
            not_ground_floor.Add(inodes[i]);
        }
    }

    


    ground = ground_floor;
    not_ground = not_ground_floor;

  }
}
# ---------- end csharp_script ----------
clean_tree_3 = CleanTree(RemoveNulls=True, RemoveInvalid=True, RemoveEmpty=Toggle(True), Tree=csharp_script.not_ground)
clean_tree_4 = CleanTree(RemoveNulls=True, RemoveInvalid=True, RemoveEmpty=Toggle(True), Tree=csharp_script.ground)
pointground = Point(simplify(clean_tree_4))
pointfloors = Point(simplify(clean_tree_3))

# ---- group: Geometrical Model / facades
numberheight_2 = Number(numberheight)
box_rectangle = BoxRectangle(Rectangle=surfacegroundfloor, Height=numberheight_2)
deconstruct_brep = DeconstructBrep(Brep=box_rectangle)  # -> Faces, Edges, Vertices
list_item_2 = ListItem(List=deconstruct_brep.Faces, Index="3", Wrap=True)
list_item_3 = ListItem(List=deconstruct_brep.Faces, Index="2", Wrap=True)
list_item_4 = ListItem(List=deconstruct_brep.Faces, Index="0", Wrap=True)
list_item_5 = ListItem(List=deconstruct_brep.Faces, Index="1", Wrap=True)
surfacexfacade2 = Surface(list_item_2)
surfaceyfacade1 = Surface(list_item_4)
surfaceyfacade2 = Surface(list_item_3)
surfacexfacade1 = Surface(list_item_5)

# ---- group: Geometrical Model / Columns
point = Point(simplify(divide_surface.Points))
path_mapper = PathMapper(point, source="{A;B}(i)", target="{i;B}(A)")
polylinecolumn = PolyLine(Vertices=path_mapper, Closed=False)
explode = Explode(Curve=polylinecolumn, Recursive=True)  # -> Segments, Vertices
curve_6 = Curve(explode.Segments)

# ---- group: Geometrical Model / SupportPoints
# manual control - beamsX loading
point_2 = Point(simplify(pointground))

# ---- group: Geometrical Model / MainBeamsXAll
point_3 = Point(pointfloors)
path_mapper_2 = PathMapper(point_3, source="{A;B}(i)", target="{i;A}(B)")
polylinebeamsx = PolyLine(Vertices=path_mapper_2, Closed=False)
explode_2 = Explode(Curve=polylinebeamsx, Recursive=True)  # -> Segments, Vertices
curve_7 = Curve(explode_2.Segments)

# ---- group: Geometrical Model / MainBeamsY_FullLength
point_4 = Point(pointfloors)
polylinebeamsy = PolyLine(Vertices=point_4, Closed=False)
explode_3 = Explode(Curve=polylinebeamsy, Recursive=True)  # -> Segments, Vertices
curve_8 = Curve(explode_3.Segments)

# ---- group: Geometrical Model / MainBeamsY_Splitted
curvebeamsy = Curve(curve_8)
divide_curve = DivideCurve(Curve=curvebeamsy, CountNumberTransB=numbertransversebeamsdiv, Kinks=False)  # -> Points, Tangents, Parameters
polyline = PolyLine(Vertices=divide_curve.Points, Closed=False)
explode_4 = Explode(Curve=polyline, Recursive=True)  # -> Segments, Vertices
curve_9 = Curve(simplify(explode_4.Segments))

# ---- group: Geometrical Model / TransverseBeams
point_5 = Point(divide_curve.Points)
split_list = SplitList(List=point_5, Index="1")  # -> ListA, ListB
reverse_list = ReverseList(List=split_list.ListB)
split_list_2 = SplitList(List=reverse_list, Index="1")  # -> ListA, ListB
reverse_list_2 = ReverseList(List=split_list_2.ListB)  # -> simplify(List)
point_6 = Point(reverse_list_2)
path_mapper_3 = PathMapper(point_6, source="{A;B;C}(i)", target="{A;i;C} (B)")
polylinetranversebeams = PolyLine(Vertices=path_mapper_3, Closed=False)
explode_5 = Explode(Curve=polylinetranversebeams, Recursive=True)  # -> Segments, Vertices
curve_10 = Curve(explode_5.Segments)

# ---- group: Geometrical Model / MainBeamX Splitted for loading
# BeamWithLoad
ydiv_2 = Number(expr("x-1", ydiv))
concatenate = Concatenate(Fragment_A="{", Fragment_B=ydiv_2, A=";*;*}")  # -> flatten(Result)
split_tree_2 = SplitTree(Data=curve_7, Masks=flatten(["{0;*;*}", concatenate]))  # -> Positive, Negative
curveedges = Curve(flatten(split_tree_2.Positive))
curvemiddle = Curve(flatten(split_tree_2.Negative))
entwine = Entwine(Branch00=curveedges, Branch01=curvemiddle, FlattenInputs=True)

# ---- group: Geometrical Model
csharp_script_2 = CSharpScript(iFloors=floors, iSpacingX=xdiv)  # -> out, masks; inputs iFloors: Double, iSpacingX: Double
# ---------- csharp_script_2: C# ----------
// Grasshopper Script Instance
using System;
using System.Collections;
using System.Collections.Generic;
using System.Drawing;

using Rhino;
using Rhino.Geometry;

using Grasshopper;
using Grasshopper.Kernel;
using Grasshopper.Kernel.Data;
using Grasshopper.Kernel.Types;

public class Script_Instance : GH_ScriptInstance
{
  /* 
    Members:
      RhinoDoc RhinoDocument
      GH_Document GrasshopperDocument
      IGH_Component Component
      int Iteration

    Methods (Virtual & overridable):
      Print(string text)
      Print(string format, params object[] args)
      Reflect(object obj)
      Reflect(object obj, string method_name)
  */
  
  private void RunScript(double iFloors, double iSpacingX, ref object masks)
  {
    // Write your logic here

    //masks

    List<object> maskList = new List<object>();
    for (int i = 0 ; i<iFloors ; i++)
    {
        string firstBeam = "{*;0;" + i + "}";
        maskList.Add(firstBeam);
        
        string nextBeam = "{" + "*;" + (iSpacingX-1) + ";" + i + "}";
        maskList.Add(nextBeam);
        
    }
    
    /*
    for (int j = 0; j < iSpacingX; j++)
    {
        string Beam = "{*;" + j + ";*}";
        maskList.Add(Beam);
    }*/
    masks = maskList;
  }
}
# ---------- end csharp_script_2 ----------
split_tree_3 = SplitTree(Data=curve_9, Masks=flatten(csharp_script_2.masks))  # -> Positive, Negative
line = Line(split_tree_3.Negative)
line_2 = Line(split_tree_3.Positive)

# ---- group: Geometrical Model / MainBeamsY Splitted w. division for joints
list_length_3 = ListLength(List=line_2)
subtraction = Subtraction(A=list_length_3, B="2")
tree_branch = TreeBranch(Tree=subtraction, Path="{1;0;0}", MaintainPaths=True)  # -> flatten(Branch)
merge = Merge(Data1="1", Data2=tree_branch, Data3="1")
partition_list = PartitionList(List=line_2, Size=merge)
split_tree_4 = SplitTree(Data=partition_list, Masks=flatten("{*;*;*;0}"))  # -> Positive, Negative
split_tree_5 = SplitTree(Data=partition_list, Masks=flatten("{*;*;*;1}"))  # -> Positive, Negative
split_tree_6 = SplitTree(Data=partition_list, Masks=flatten("{*;*;*;2}"))  # -> Positive, Negative
entwine_2 = Entwine(Branch00=split_tree_4.Positive, Branch01=split_tree_5.Positive, Branch02=split_tree_6.Positive, FlattenInputs=True)  # -> simplify(Result)

list_length_4 = ListLength(List=line)
subtraction_2 = Subtraction(A=list_length_4, B="2")
tree_branch_2 = TreeBranch(Tree=subtraction_2, Path="{1;1;0}", MaintainPaths=True)  # -> flatten(Branch)
merge_2 = Merge(Data1="1", Data2=tree_branch_2, Data3="1")
partition_list_2 = PartitionList(List=line, Size=merge_2)
split_tree_7 = SplitTree(Data=partition_list_2, Masks=flatten("{*;*;*;0}"))  # -> Positive, Negative
split_tree_8 = SplitTree(Data=partition_list_2, Masks=flatten("{*;*;*;1}"))  # -> Positive, Negative
split_tree_9 = SplitTree(Data=partition_list_2, Masks=flatten("{*;*;*;2}"))  # -> Positive, Negative
entwine_3 = Entwine(Branch00=split_tree_7.Positive, Branch01=split_tree_8.Positive, Branch02=split_tree_9.Positive, FlattenInputs=True)  # -> simplify(Result)

# ---- group: Geometrical Model / Column
cluster = Cluster_2(curve=curve_6, spacingy=ydiv, spacingx=xdiv)  # -> facadecolumns, midcolumns
line_3 = Line(cluster.facadecolumns)
line_4 = Line(cluster.midcolumns)

# ---- group: Supports
support_karamba3d = SupportKaramba3D(PosInd=point_2, menu=[buttons(on, on, on, on, on, on)])

# ----
support_karamba3d_2 = SupportKaramba3D(flatten(support_karamba3d))

# ---- group: Id's
panel_7 = Panel("MainBeamLeftOut")
panel_8 = Panel("MainBeamMidOut")
panel_9 = Panel("MainBeamRightOut")
panel_10 = Panel([panel_7, panel_8, panel_9])
panel_11 = Panel("MainBeamLeftIn")
panel_12 = Panel("MainBeamMidIn")
panel_13 = Panel("MainBeamRightIn")
panel_14 = Panel([panel_11, panel_12, panel_13])

# ---- group: Cross Sections
material_selection_karamba3d = MaterialSelectionKaramba3D(menu=[dropdown(4), dropdown(11)])
material_selection_karamba3d_2 = MaterialSelectionKaramba3D(menu=[dropdown(1), dropdown(4)])
material_karamba3d = MaterialKaramba3D(material_selection_karamba3d)
gene_pool = GenePool(Decimals=0, Maximum=13, Minimum=7, Value=7)
gene_pool_2 = GenePool(Decimals=0, Maximum=20, Minimum=14, Value=15)
gene_pool_3 = GenePool(Decimals=0, Maximum=11, Minimum=7, Value=8)
gene_pool_4 = GenePool(Decimals=0, Maximum=12, Minimum=7, Value=11.16666667)
gene_pool_5 = GenePool(Decimals=0, Maximum=16, Minimum=10, Value=12)
gene_pool_6 = GenePool(Decimals=0, Maximum=11, Minimum=7, Value=10.2)
gene_pool_7 = GenePool(Decimals=0, Maximum=16, Minimum=10, Value=14)
gene_pool_8 = GenePool(Decimals=0, Maximum=15, Minimum=9, Value=14)
gene_pool_9 = GenePool(Decimals=0, Maximum=21, Minimum=15, Value=16)
gene_pool_10 = GenePool(Decimals=0, Maximum=13, Minimum=7, Value=8)
gene_pool_11 = GenePool(Decimals=0, Maximum=20, Minimum=14, Value=19)
gene_pool_12 = GenePool(Decimals=0, Maximum=21, Minimum=15, Value=19)
gene_pool_13 = GenePool(Decimals=0, Maximum=19, Minimum=13, Value=15)
panel_15 = Panel([panel_7, panel_8, panel_9])
panel_16 = Panel([panel_11, panel_12, panel_13])
division = Division(A=gene_pool_13, B=2)
division_2 = Division(A=division, B=2)
cross_section_karamba3d = CrossSectionKaramba3D(
    FamilyNameOfCrossSection="DefaultCroSec",
    NameOfCrossSection=panel_15,
    ElementIdentifier=panel_15,
    Material=material_karamba3d,
    Height_cm=expr("x*2", gene_pool_2),
    UpperFlangeWidth_cm=expr("x*2", gene_pool),
    LowerFlangeWidth_cm=expr("x*2", gene_pool),
    mode="Trapezoid")
cross_section_karamba3d_2 = CrossSectionKaramba3D(
    FamilyNameOfCrossSection="DefaultCroSec",
    NameOfCrossSection=panel_16,
    ElementIdentifier=panel_16,
    Material=material_karamba3d,
    Height_cm=expr("x*2", gene_pool_11),
    UpperFlangeWidth_cm=expr("x*2", gene_pool_10),
    LowerFlangeWidth_cm=expr("x*2", gene_pool_10),
    mode="Trapezoid")
cross_section_karamba3d_3 = CrossSectionKaramba3D(
    FamilyNameOfCrossSection="DefaultCroSec",
    NameOfCrossSection="Brazing",
    ElementIdentifier="Brazing",
    Material=material_selection_karamba3d_2,
    Diameter_cm=division,
    WallThickness_cm=division_2,
    mode="Circular Hollow")

# ---- group: Loads and load combinations
# LC0: Dominating deadload + wind on y-facade
# LC0: Dominating deadload + wind on x-facade
# LC1a: Dominating Liveload + wind on y-facade
# LC1b: Dominating Liveload + wind on x-facade
# SLS+wind y
number_xdiv = Number(expr("x-1", xdiv))
ydiv_3 = Number(expr("x-1", ydiv))
load_combinations = Panel("""6.10(a) x
6.10(a) y
6.10(b) x
6.10(b) y
SLS""")

# ---- group: Loads and load combinations / Deadload1
deadload1 = Panel("""1.00 * 1.35
1.00 * 1.35
1.00 * 1.2
1.00 * 1.2
1.0 * 1.0""")
unit_z_2 = UnitZ(Factor=expr("-x", deadload1))
loads_karamba3d = LoadsKaramba3D(Vector=graft(unit_z_2), LCase=graft(load_combinations), mode="Gravity")
load_karamba3d = LoadKaramba(flatten(loads_karamba3d))

# ---- group: Loads and load combinations / WindloadFacadeY
surfaceyfacade1_2 = Surface(surfaceyfacade1)
numberfloors = Number(floors)
windload = Panel("""1.0 * 1.5 * 0.7
1.0 * 1.5 * 0
1.00 * 1.50 * 0.7
1.0 * 1.5 * 0
1.0 * 0.0""")
mesh_surface = MeshSurface(Surface=surfaceyfacade1_2, UCount=ydiv_3, VCount=numberfloors, Overhang=True, Equalize=False)
unit_x = UnitX(Factor=windload)

# ---- group: Liveload
numbertransverse = Number(numbertransversebeamsdiv)
surfacefloors_2 = Surface(surfacefloors)
liveload = Panel("""3.0 * 1.5 * 0.7
3.0 * 1.5 * 0.7
3.00 * 1.50
3.00 * 1.50
3.00 * 1.00""")
multiplication_2 = Multiplication(A=numbertransverse, B=ydiv_3)
mesh_surface_2 = MeshSurface(Surface=surfacefloors_2, UCount=number_xdiv, VCount=multiplication_2, Overhang=True, Equalize=False)
unit_z_3 = UnitZ(Factor=expr("-x", liveload))

# ---- group: Loads and load combinations / WindloadFacadeX
surfacexfacade1_2 = Surface(surfacexfacade1)
windload_2 = Panel("""1.0 * 1.5 * 0
1.0 * 1.5 * 0.7
1.00 * 1.50 * 0
1.0 * 1.5 * 0.7
1.0 * 0.7""")
numberfloors_2 = Number(floors)
mesh_surface_3 = MeshSurface(Surface=surfacexfacade1_2, UCount=number_xdiv, VCount=numberfloors_2, Overhang=True, Equalize=False)
unit_y = UnitY(Factor=windload_2)

# ---- group: Loads and load combinations / Deadload2
numbertransverse_2 = Number(numbertransversebeamsdiv)
surfacefloors_3 = Surface(surfacefloors)
deadload2 = Panel("""2.0 * 1.35
2.0 * 1.35
2.00 * 1.2
2.00 * 1.2
2.0 * 1.0""")
multiplication_3 = Multiplication(A=numbertransverse_2, B=ydiv_3)
mesh_surface_4 = MeshSurface(Surface=surfacefloors_3, UCount=number_xdiv, VCount=multiplication_3, Overhang=True, Equalize=False)
unit_z_4 = UnitZ(Factor=expr("-x", deadload2))

# ---- group: Geometrical Model / Brazing
cluster_2 = Cluster(curve=curve_6, spacingy=expr("x-1", ydiv), spacingx=expr("x-1", xdiv))  # -> list, list_2, list_3, list_4

# {0,0}
# {4,5}
line_5 = Line(simplify(cluster_2.list))
line_6 = Line(simplify(cluster_2.list_2))

# {4,0}
# {0,5}
line_7 = Line(simplify(cluster_2.list_3))
line_8 = Line(simplify(cluster_2.list_4))

merge_3 = Merge(Data1=line_5, Data2=line_6, Data3=line_7, Data4=line_8)

# ---- group: Elements
panel_17 = Panel([panel_7, panel_8, panel_9])
panel_18 = Panel([panel_11, panel_12, panel_13])
unit_z_5 = UnitZ(Factor=1)
panel_19 = Panel("SecondaryBeams1out")
panel_20 = Panel("facadeColumn")
panel_21 = Panel("SecondaryBeams1in")
panel_22 = Panel("SecondaryBeams2")
unit_z_6 = UnitZ(Factor=1)
unit_z_7 = UnitZ(Factor=1)
unit_z_8 = UnitZ(Factor=1)
panel_23 = Panel("midColumn")
unit_z_9 = UnitZ(Factor=1)
panel_24 = Panel("Brazing")
unit_z_10 = UnitZ(Factor=1)
line_9 = Line(flatten(merge_3))
line_10 = Line(line_4)
colour = Colour("35, 49, 244")
colour_2 = Colour("\t49, 244, 35")
colour_3 = Colour("\t244, 35, 49")
colour_4 = Colour("\t230, 35, 244")
colour_5 = Colour("\t35, 244, 230")
line_11 = Line(curveedges)
colour_6 = Colour("\t230, 35, 244")
line_12 = Line(line_3)
colour_7 = Colour("\t244, 35, 49")
line_13 = Line(curvemiddle)
colour_8 = Colour("\t35, 244, 230")
line_to_beam_karamba3d = LineToBeamKaramba3D(
    Line=line_10,
    Colour=colour_7,
    Identifier=panel_23,
    New=True,
    Remove=True,
    LimitDistance_m=0.005,
    Bending=True,
    SetBucklingLength=True,
    ToPolylineMaxAngle=0.03,
    ToPolylineTolerance=0.01,
    ToPolylineMaxEdgeLength=0.25)  # -> Element, Points, Info
line_to_beam_karamba3d_2 = LineToBeamKaramba3D(
    Line=curve_10,
    Colour=colour_2,
    Identifier=panel_22,
    New=True,
    Remove=True,
    LimitDistance_m=0.005,
    ZOrientation=unit_z_6,
    Bending=True,
    SetBucklingLength=True,
    ToPolylineMaxAngle=0.03,
    ToPolylineTolerance=0.01,
    ToPolylineMaxEdgeLength=0.25)  # -> Element, Points, Info
line_to_beam_karamba3d_3 = LineToBeamKaramba3D(
    Line=line_12,
    Colour=colour_3,
    Identifier=panel_20,
    New=True,
    Remove=True,
    LimitDistance_m=0.005,
    Bending=True,
    SetBucklingLength=True,
    ToPolylineMaxAngle=0.03,
    ToPolylineTolerance=0.01,
    ToPolylineMaxEdgeLength=0.25)  # -> Element, Points, Info
line_to_beam_karamba3d_4 = LineToBeamKaramba3D(
    Line=line_11,
    Colour=colour_4,
    Identifier=panel_21,
    New=True,
    Remove=True,
    LimitDistance_m=0.005,
    ZOrientation=unit_z_8,
    Bending=True,
    SetBucklingLength=True,
    ToPolylineMaxAngle=0.03,
    ToPolylineTolerance=0.01,
    ToPolylineMaxEdgeLength=0.25)  # -> Element, Points, Info
line_to_beam_karamba3d_5 = LineToBeamKaramba3D(
    Line=line_13,
    Colour=colour_6,
    Identifier=panel_19,
    New=True,
    Remove=True,
    LimitDistance_m=0.005,
    ZOrientation=unit_z_9,
    Bending=True,
    SetBucklingLength=True,
    ToPolylineMaxAngle=0.03,
    ToPolylineTolerance=0.01,
    ToPolylineMaxEdgeLength=0.25)  # -> Element, Points, Info
line_to_beam_karamba3d_6 = LineToBeamKaramba3D(
    Line=entwine_3,
    Colour=colour_8,
    Identifier=graft(panel_18),
    New=True,
    Remove=True,
    LimitDistance_m=0.005,
    ZOrientation=unit_z_7,
    Bending=True,
    SetBucklingLength=True,
    ToPolylineMaxAngle=0.03,
    ToPolylineTolerance=0.01,
    ToPolylineMaxEdgeLength=0.25)  # -> simplify(Element), Points, Info
line_to_beam_karamba3d_7 = LineToBeamKaramba3D(
    Line=line_9,
    Colour=colour,
    Identifier=panel_24,
    New=True,
    Remove=True,
    LimitDistance_m=0.005,
    ZOrientation=unit_z_10,
    Bending=False,
    SetBucklingLength=False,
    ToPolylineMaxAngle=0.03,
    ToPolylineTolerance=0.01,
    ToPolylineMaxEdgeLength=0.25)  # -> Element, Points, Info
line_to_beam_karamba3d_8 = LineToBeamKaramba3D(
    Line=entwine_2,
    Colour=colour_5,
    Identifier=graft(panel_17),
    New=True,
    Remove=True,
    LimitDistance_m=0.005,
    ZOrientation=unit_z_5,
    Bending=True,
    SetBucklingLength=True,
    ToPolylineMaxAngle=0.03,
    ToPolylineTolerance=0.01,
    ToPolylineMaxEdgeLength=0.25)  # -> simplify(Element), Points, Info
data = Data([line_to_beam_karamba3d_7.Element, line_to_beam_karamba3d_3.Element, line_to_beam_karamba3d.Element, line_to_beam_karamba3d_2.Element, line_to_beam_karamba3d_4.Element, line_to_beam_karamba3d_5.Element, line_to_beam_karamba3d_8.Element, line_to_beam_karamba3d_6.Element])

# ---- group: Id's (continued)
panel_25 = Panel(panel_19)
panel_26 = Panel(panel_22)
panel_27 = Panel(panel_21)
panel_28 = Panel(panel_23)
panel_29 = Panel(panel_20)

# ---- group: Cross Sections (continued)
panel_30 = Panel(panel_26)
panel_31 = Panel(panel_25)
panel_32 = Panel(panel_27)
panel_33 = Panel(panel_28)
panel_34 = Panel(panel_29)
cross_section_karamba3d_4 = CrossSectionKaramba3D(
    FamilyNameOfCrossSection="DefaultCroSec",
    NameOfCrossSection=panel_32,
    ElementIdentifier=panel_32,
    Material=material_karamba3d,
    Height_cm=expr("x*2", gene_pool_5),
    UpperFlangeWidth_cm=expr("x*2", gene_pool_3),
    LowerFlangeWidth_cm=expr("x*2", gene_pool_3),
    mode="Trapezoid")
cross_section_karamba3d_5 = CrossSectionKaramba3D(
    FamilyNameOfCrossSection="DefaultCroSec",
    NameOfCrossSection=panel_30,
    ElementIdentifier=panel_30,
    Material=material_karamba3d,
    Height_cm=expr("x*2", gene_pool_8),
    UpperFlangeWidth_cm=expr("x*2", gene_pool_4),
    LowerFlangeWidth_cm=expr("x*2", gene_pool_4),
    mode="Trapezoid")
cross_section_karamba3d_6 = CrossSectionKaramba3D(
    FamilyNameOfCrossSection="DefaultCroSec",
    NameOfCrossSection=panel_31,
    ElementIdentifier=panel_31,
    Material=material_karamba3d,
    Height_cm=expr("x*2", gene_pool_7),
    UpperFlangeWidth_cm=expr("x*2", gene_pool_6),
    LowerFlangeWidth_cm=expr("x*2", gene_pool_6),
    mode="Trapezoid")
cross_section_karamba3d_7 = CrossSectionKaramba3D(
    FamilyNameOfCrossSection="DefaultCroSec",
    NameOfCrossSection=panel_33,
    ElementIdentifier=panel_33,
    Material=material_karamba3d,
    Height_cm=expr("x*2", gene_pool_12),
    UpperFlangeWidth_cm=expr("x*2", gene_pool_12),
    LowerFlangeWidth_cm=expr("x*2", gene_pool_12),
    mode="Trapezoid")
cross_section_karamba3d_8 = CrossSectionKaramba3D(
    FamilyNameOfCrossSection="DefaultCroSec",
    NameOfCrossSection=panel_34,
    ElementIdentifier=panel_34,
    Material=material_karamba3d,
    Height_cm=expr("x*2", gene_pool_9),
    UpperFlangeWidth_cm=expr("x*2", gene_pool_9),
    LowerFlangeWidth_cm=expr("x*2", gene_pool_9),
    mode="Trapezoid")
cross_section_karamba3d_9 = CrossSectionKaramba3D(flatten([cross_section_karamba3d_3, cross_section_karamba3d_7, cross_section_karamba3d_4, cross_section_karamba3d_6, cross_section_karamba3d_5, cross_section_karamba3d_2, cross_section_karamba3d, cross_section_karamba3d_8]))

# ----
panel_35 = Panel(panel_20)

# ---- group: Loads and load combinations / WindloadFacadeX (continued)
panel_36 = Panel(panel_35)
loads_karamba3d_2 = LoadsKaramba3D(
    Vector=graft(unit_y),
    Mesh=mesh_surface_3,
    ElementIdentifiers=panel_36,
    LCase=graft(load_combinations),
    mode="MeshLoad -Const.",
    menu=[buttons(off, on, off), buttons(off, on)])
load_karamba3d_2 = LoadKaramba3D(flatten(loads_karamba3d_2))

# ---- group: Loads and load combinations / WindloadFacadeY (continued)
panel_37 = Panel(panel_35)
loads_karamba3d_3 = LoadsKaramba3D(
    Vector=graft(unit_x),
    Mesh=mesh_surface,
    ElementIdentifiers=panel_37,
    LCase=graft(load_combinations),
    mode="MeshLoad -Const.",
    menu=[buttons(off, on, off), buttons(off, on)])
load_karamba3d_3 = LoadKaramba3D(flatten(loads_karamba3d_3))

# ---- group: Joints
panel_38 = Panel([panel_8, panel_12])
hinges = Panel([panel_27, panel_25, panel_26])
hinge_start = Panel([panel_7, panel_11])
hinge_end = Panel([panel_9, panel_13])
fixed = Panel([panel_29, panel_28])
beam_joints_karamba3d = BeamJointsKaramba3D(
    AtElementIdentifiers=hinges,
    CtKNMAtStartingNode=Vector(0, 0, 0),
    CrKNmRadAtStartingNode=Vector(0, 0, 0),
    CtKNMAtEndNode=Vector(0, 0, 0),
    CrKNmRadAtEndNode=Vector(0, 0, 0),
    menu=[buttons(off, off, off, off, on, on), buttons(off, off, off, off, on, on)])
beam_joints_karamba3d_2 = BeamJointsKaramba3D(
    AtElementIdentifiers=hinge_start,
    CtKNMAtStartingNode=Vector(0, 0, 0),
    CrKNmRadAtStartingNode=Vector(0, 0, 0),
    CtKNMAtEndNode=Vector(0, 0, 0),
    CrKNmRadAtEndNode=Vector(0, 0, 0),
    menu=[buttons(off, off, off, off, on, on), buttons(off, off, off, off, off, off)])
beam_joints_karamba3d_3 = BeamJointsKaramba3D(
    AtElementIdentifiers=panel_38,
    CtKNMAtStartingNode=Vector(0, 0, 0),
    CrKNmRadAtStartingNode=Vector(0, 0, 0),
    CtKNMAtEndNode=Vector(0, 0, 0),
    CrKNmRadAtEndNode=Vector(0, 0, 0),
    menu=[buttons(off, off, off, off, off, off), buttons(off, off, off, off, off, off)])
beam_joints_karamba3d_4 = BeamJointsKaramba3D(
    AtElementIdentifiers=hinge_end,
    CtKNMAtStartingNode=Vector(0, 0, 0),
    CrKNmRadAtStartingNode=Vector(0, 0, 0),
    CtKNMAtEndNode=Vector(0, 0, 0),
    CrKNmRadAtEndNode=Vector(0, 0, 0),
    menu=[buttons(off, off, off, off, off, off), buttons(off, off, off, off, on, on)])
beam_joints_karamba3d_5 = BeamJointsKaramba3D(
    AtElementIdentifiers=fixed,
    CtKNMAtStartingNode=Vector(0, 0, 0),
    CrKNmRadAtStartingNode=Vector(0, 0, 0),
    CtKNMAtEndNode=Vector(0, 0, 0),
    CrKNmRadAtEndNode=Vector(0, 0, 0),
    menu=[buttons(off, off, off, off, off, off), buttons(off, off, off, off, off, off)])
panel_39 = Panel(beam_joints_karamba3d)
relay = Relay([beam_joints_karamba3d_5, beam_joints_karamba3d, beam_joints_karamba3d_3, beam_joints_karamba3d_2, beam_joints_karamba3d_4])

# ----
cross_section_karamba3d_10 = CrossSectionKaramba3D(flatten(cross_section_karamba3d_9))
element_karamba3d = ElementKaramba3D(flatten(data))
joint_karamba3d = JointKaramba3D(flatten(relay))

# ---- group: Loads and load combinations (continued)
beams = Panel([panel_27, panel_25, panel_26])

# ---- group: Liveload (continued)
loads_karamba3d_4 = LoadsKaramba3D(
    Vector=graft(unit_z_3),
    Mesh=mesh_surface_2,
    ElementIdentifiers=beams,
    LCase=graft(load_combinations),
    mode="MeshLoad -Const.",
    menu=[buttons(off, on, off), buttons(off, on)])
load_karamba3d_4 = LoadKaramba3D(flatten(loads_karamba3d_4))

# ---- group: Loads and load combinations / Deadload2 (continued)
loads_karamba3d_5 = LoadsKaramba3D(
    Vector=graft(unit_z_4),
    Mesh=mesh_surface_4,
    ElementIdentifiers=beams,
    LCase=graft(load_combinations),
    mode="MeshLoad -Const.",
    menu=[buttons(off, on, off), buttons(off, on)])
load_karamba3d_5 = LoadKaramba3D(flatten(loads_karamba3d_5))

# ---- group: Loads and load combinations (continued)
load_karamba3d_6 = LoadKaramba3D(flatten([load_karamba3d_5, load_karamba3d, load_karamba3d_4, load_karamba3d_3, load_karamba3d_2]))

# ----
load_karamba3d_7 = LoadKaramba3D(flatten(load_karamba3d_6))
assemble_model_karamba3d = AssembleModelKaramba3D(
    Elem=element_karamba3d,
    Support=support_karamba3d_2,
    Load=load_karamba3d_7,
    CrossSection=cross_section_karamba3d_10,
    Joint=joint_karamba3d,
    LimitDistance_m=0.005)  # -> Model, Info, Mass_kg, CentreOfGravity, LoadCaseNames
panel_40 = Panel(assemble_model_karamba3d.Mass_kg)
panel_41 = Panel(assemble_model_karamba3d.LoadCaseNames)
panel_42 = Panel(assemble_model_karamba3d.Model)
analyze_karamba3d = AnalyzeKaramba3D(Model=assemble_model_karamba3d.Model)  # -> CalculatedModel, MaximumDisplacement_cm, ResultingForceOfGravity_kN, ElasticEnergyChange_kNm

# ---- group: Optimization 1 - ULS Utilization
panel_43 = Panel([panel_7, panel_8, panel_9])
panel_44 = Panel([panel_11, panel_12, panel_13])
panel_45 = Panel(panel_29)
panel_46 = Panel(panel_26)
panel_47 = Panel(panel_27)
panel_48 = Panel(panel_25)
model_karamba3d = ModelKaramba3D(analyze_karamba3d.CalculatedModel)
panel_49 = Panel(panel_28)
model_karamba3d_2 = ModelKaramba3D(analyze_karamba3d.CalculatedModel)
model_karamba3d_3 = ModelKaramba3D(analyze_karamba3d.CalculatedModel)
model_karamba3d_4 = ModelKaramba3D(analyze_karamba3d.CalculatedModel)
model_karamba3d_5 = ModelKaramba3D(analyze_karamba3d.CalculatedModel)
model_karamba3d_6 = ModelKaramba3D(analyze_karamba3d.CalculatedModel)
model_karamba3d_7 = ModelKaramba3D(analyze_karamba3d.CalculatedModel)
utilization_of_elements_karamba3d = UtilizationOfElementsKaramba3D(
    AnalyzedModel=model_karamba3d_2,
    ElementsIdentifiers="Brazing",
    NumberOfSamplePoints=3,
    ElasticDesign=True,
    GammaM0=1,
    GammaM1=1.1,
    SwayFrame=True,
    WithDetails=False,
    mode="Beams")  # -> AnalyzedModel, Utilization, SigMax_kN_cm2, SigMin_kN_cm2, TauMax_kN_cm2, UtilN, UtilVy, UtilVz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
model_karamba3d_8 = ModelKaramba3D(analyze_karamba3d.CalculatedModel)
utilization_of_elements_karamba3d_2 = UtilizationOfElementsKaramba3D(
    AnalyzedModel=model_karamba3d_3,
    ElementsIdentifiers=panel_43,
    NumberOfSamplePoints=3,
    ElasticDesign=True,
    GammaM0=1,
    GammaM1=1.1,
    SwayFrame=True,
    WithDetails=True,
    mode="Beams")  # -> AnalyzedModel, Utilization, SigMax_kN_cm2, SigMin_kN_cm2, TauMax_kN_cm2, UtilN, UtilVy, UtilVz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
utilization_of_elements_karamba3d_3 = UtilizationOfElementsKaramba3D(
    AnalyzedModel=model_karamba3d_4,
    ElementsIdentifiers=panel_45,
    NumberOfSamplePoints=3,
    ElasticDesign=True,
    GammaM0=1,
    GammaM1=1.1,
    SwayFrame=True,
    WithDetails=False,
    mode="Beams")  # -> AnalyzedModel, Utilization, SigMax_kN_cm2, SigMin_kN_cm2, TauMax_kN_cm2, UtilN, UtilVy, UtilVz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
utilization_of_elements_karamba3d_4 = UtilizationOfElementsKaramba3D(
    AnalyzedModel=model_karamba3d,
    ElementsIdentifiers=panel_49,
    NumberOfSamplePoints=3,
    ElasticDesign=True,
    GammaM0=1,
    GammaM1=1.1,
    SwayFrame=True,
    WithDetails=False,
    mode="Beams")  # -> AnalyzedModel, Utilization, SigMax_kN_cm2, SigMin_kN_cm2, TauMax_kN_cm2, UtilN, UtilVy, UtilVz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
utilization_of_elements_karamba3d_5 = UtilizationOfElementsKaramba3D(
    AnalyzedModel=model_karamba3d_5,
    ElementsIdentifiers=panel_44,
    NumberOfSamplePoints=3,
    ElasticDesign=True,
    GammaM0=1,
    GammaM1=1.1,
    SwayFrame=True,
    WithDetails=False,
    mode="Beams")  # -> AnalyzedModel, Utilization, SigMax_kN_cm2, SigMin_kN_cm2, TauMax_kN_cm2, UtilN, UtilVy, UtilVz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
utilization_of_elements_karamba3d_6 = UtilizationOfElementsKaramba3D(
    AnalyzedModel=model_karamba3d_6,
    ElementsIdentifiers=panel_48,
    NumberOfSamplePoints=3,
    ElasticDesign=True,
    GammaM0=1,
    GammaM1=1.1,
    SwayFrame=True,
    WithDetails=False,
    mode="Beams")  # -> AnalyzedModel, Utilization, SigMax_kN_cm2, SigMin_kN_cm2, TauMax_kN_cm2, UtilN, UtilVy, UtilVz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
utilization_of_elements_karamba3d_7 = UtilizationOfElementsKaramba3D(
    AnalyzedModel=model_karamba3d_7,
    ElementsIdentifiers=panel_47,
    NumberOfSamplePoints=3,
    ElasticDesign=True,
    GammaM0=1,
    GammaM1=1.1,
    SwayFrame=True,
    WithDetails=False,
    mode="Beams")  # -> AnalyzedModel, Utilization, SigMax_kN_cm2, SigMin_kN_cm2, TauMax_kN_cm2, UtilN, UtilVy, UtilVz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
utilization_of_elements_karamba3d_8 = UtilizationOfElementsKaramba3D(
    AnalyzedModel=model_karamba3d_8,
    ElementsIdentifiers=panel_46,
    NumberOfSamplePoints=3,
    ElasticDesign=True,
    GammaM0=1,
    GammaM1=1.1,
    SwayFrame=True,
    WithDetails=False,
    mode="Beams")  # -> AnalyzedModel, Utilization, SigMax_kN_cm2, SigMin_kN_cm2, TauMax_kN_cm2, UtilN, UtilVy, UtilVz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
min_max = MinMax(Number=utilization_of_elements_karamba3d.Utilization)  # -> Minimum, Maximum
min_max_2 = MinMax(Number=utilization_of_elements_karamba3d_2.Utilization)  # -> Minimum, Maximum
min_max_3 = MinMax(Number=utilization_of_elements_karamba3d_3.Utilization)  # -> Minimum, Maximum
min_max_4 = MinMax(Number=utilization_of_elements_karamba3d_4.Utilization)  # -> Minimum, Maximum
number = Number(min_max.Maximum)
min_max_5 = MinMax(Number=utilization_of_elements_karamba3d_5.Utilization)  # -> Minimum, Maximum
csharp_script_3 = CSharpScript(iUtilization=number)  # -> out, penalty; inputs iUtilization: Double
# ---------- csharp_script_3: C# ----------
// Grasshopper Script Instance
using System;
using System.Collections;
using System.Collections.Generic;
using System.Drawing;

using Rhino;
using Rhino.Geometry;

using Grasshopper;
using Grasshopper.Kernel;
using Grasshopper.Kernel.Data;
using Grasshopper.Kernel.Types;

public class Script_Instance : GH_ScriptInstance
{
  /* 
    Members:
      RhinoDoc RhinoDocument
      GH_Document GrasshopperDocument
      IGH_Component Component
      int Iteration

    Methods (Virtual & overridable):
      Print(string text)
      Print(string format, params object[] args)
      Reflect(object obj)
      Reflect(object obj, string method_name)
  */
  
  private void RunScript(double iUtilization, ref object penalty)
  {
    // Write your logic here

    double points = 0;

    if (iUtilization < 0.5)
    {
        points = 20;
    }
    if (iUtilization > 0.5)
    {
        points = 8;
    }
    if (iUtilization > 0.7)
    {
        points = 5;
    }
    if (iUtilization > 0.8)
    {
        points = 2;
    }
    if (iUtilization > 0.85)
    {
        points = 0;
    }
    if (iUtilization > 0.9)
    {
        points = 5;
    }
    if (iUtilization > 0.92)
    {
        points = 15;
    }
    if (iUtilization > 0.95)
    {
        points = 20;
    }
    if (iUtilization > 1.0)
    {
        points = 100;
    }
    if (iUtilization > 1.2)
    {
        points = 150;
    }
    if (iUtilization > 1.5)
    {
        points = 200;
    }

    penalty = points;
  }
}
# ---------- end csharp_script_3 ----------
number_2 = Number(min_max_3.Maximum)
number_3 = Number(min_max_2.Maximum)
number_4 = Number(min_max_4.Maximum)
min_max_6 = MinMax(Number=utilization_of_elements_karamba3d_6.Utilization)  # -> Minimum, Maximum
min_max_7 = MinMax(Number=utilization_of_elements_karamba3d_7.Utilization)  # -> Minimum, Maximum
number_5 = Number(min_max_5.Maximum)
number_6 = Number(min_max_6.Maximum)
min_max_8 = MinMax(Number=utilization_of_elements_karamba3d_8.Utilization)  # -> Minimum, Maximum
csharp_script_4 = CSharpScript(iUtilization=number_4)  # -> out, penalty; inputs iUtilization: Double; same code as csharp_script_3
csharp_script_5 = CSharpScript(iUtilization=number_3)  # -> out, penalty; inputs iUtilization: Double; same code as csharp_script_3
number_7 = Number(min_max_7.Maximum)
csharp_script_6 = CSharpScript(iUtilization=number_2)  # -> out, penalty; inputs iUtilization: Double; same code as csharp_script_3
csharp_script_7 = CSharpScript(iUtilization=number_5)  # -> out, penalty; inputs iUtilization: Double; same code as csharp_script_3
number_8 = Number(min_max_8.Maximum)
panel_50 = Panel([min_max.Minimum, min_max.Maximum])
csharp_script_8 = CSharpScript(iUtilization=number_6)  # -> out, penalty; inputs iUtilization: Double; same code as csharp_script_3
panel_51 = Panel([min_max_3.Minimum, min_max_3.Maximum])
csharp_script_9 = CSharpScript(iUtilization=number_7)  # -> out, penalty; inputs iUtilization: Double; same code as csharp_script_3
panel_52 = Panel([min_max_2.Minimum, min_max_2.Maximum])
panel_53 = Panel([min_max_4.Minimum, min_max_4.Maximum])
panel_54 = Panel([min_max_5.Minimum, min_max_5.Maximum])
number_9 = Number(csharp_script_3.penalty)
panel_55 = Panel([min_max_6.Minimum, min_max_6.Maximum])
csharp_script_10 = CSharpScript(iUtilization=number_8)  # -> out, penalty; inputs iUtilization: Double; same code as csharp_script_3
panel_56 = Panel([min_max_7.Minimum, min_max_7.Maximum])
panel_57 = Panel(csharp_script_3.penalty)
number_10 = Number(csharp_script_5.penalty)
number_11 = Number(csharp_script_6.penalty)
number_12 = Number(csharp_script_4.penalty)
panel_58 = Panel([min_max_8.Minimum, min_max_8.Maximum])
number_13 = Number(csharp_script_7.penalty)
panel_59 = Panel(csharp_script_8.penalty)
panel_60 = Panel(csharp_script_9.penalty)
number_14 = Number(csharp_script_8.penalty)
number_15 = Number(csharp_script_9.penalty)
panel_61 = Panel(number_10)
panel_62 = Panel(csharp_script_4.penalty)
panel_63 = Panel(csharp_script_6.penalty)
number_16 = Number(csharp_script_10.penalty)
panel_64 = Panel(csharp_script_7.penalty)
panel_65 = Panel(csharp_script_10.penalty)
addition = Addition(A=number_10, B=number_13, C=number_16, D=number_14, E=number_15, F=number_11, G=number_9, H=number_12)
galapagos = Galapagos(
    fitness=number_17,
    gene=[gene_pool_5, gene_pool_3, gene_pool_7, gene_pool_6, gene_pool_8, gene_pool_4, gene_pool_2, gene_pool, gene_pool_11, gene_pool_10, gene_pool_12, gene_pool_9, gene_pool_13])
panel_66 = Panel(addition)
number_17 = Number(addition)

# ----
panel_67 = Panel(analyze_karamba3d.MaximumDisplacement_cm)
model_karamba3d_9 = ModelKaramba3D(analyze_karamba3d.CalculatedModel)

# ---- group: Optimization 2 - SLS Deflection
# Before deformation optimization:
# Max deformatio
# Secondary Beams1 in: 2.48 cm OBS!
# Secondary Beams1 out: 2.28 cm OBS!
# Secondary Beams2: 2.72 cm OBS!
# Main Beams Y in: 1.25 cm
# Main Beams Y out: 1.14 cm
# Point_deformation before optimization util+def: 1100p
# Points utilisation before optimization util+def: 7p
# 
# Problems with secondary beams, why they will be optimized
analyze_karamba3d_2 = AnalyzeKaramba3D(Model=model_karamba3d_9)  # -> CalculatedModel, MaximumDisplacement_cm, ResultingForceOfGravity_kN, ElasticEnergyChange_kNm
panel_68 = Panel("""0
1""")
panel_69 = Panel(analyze_karamba3d_2.MaximumDisplacement_cm)
panel_70 = Panel(panel_8)
panel_71 = Panel(panel_7)
panel_72 = Panel(panel_11)
secondarybeams2 = Text(panel_26)
secondarybeams1in = Text(panel_27)
panel_73 = Panel(panel_12)
secondarybeams1out = Text(panel_25)
panel_74 = Panel("""0
0.5""")
panel_75 = Panel("""0
0.5""")
panel_76 = Panel("""0
0.5""")
beam_displacements_karamba3d = BeamDisplacementsKaramba3D(AnalyzedModel=analyze_karamba3d_2.CalculatedModel, BeamsIdentifiers=secondarybeams1in, LoadCase="SLS", Ts=panel_74)  # -> AnalyzedModel, Translations_m, Rotations_rad
beam_displacements_karamba3d_2 = BeamDisplacementsKaramba3D(AnalyzedModel=analyze_karamba3d_2.CalculatedModel, BeamsIdentifiers=secondarybeams2, LoadCase="SLS", Ts=panel_75)  # -> AnalyzedModel, Translations_m, Rotations_rad
beam_displacements_karamba3d_3 = BeamDisplacementsKaramba3D(AnalyzedModel=analyze_karamba3d_2.CalculatedModel, BeamsIdentifiers=panel_71, LoadCase="SLS", Ts="0")  # -> AnalyzedModel, Translations_m, Rotations_rad
beam_displacements_karamba3d_4 = BeamDisplacementsKaramba3D(AnalyzedModel=analyze_karamba3d_2.CalculatedModel, BeamsIdentifiers=panel_70, LoadCase="SLS", Ts="0.5")  # -> AnalyzedModel, Translations_m, Rotations_rad
beam_displacements_karamba3d_5 = BeamDisplacementsKaramba3D(AnalyzedModel=analyze_karamba3d_2.CalculatedModel, BeamsIdentifiers=secondarybeams1out, LoadCase="SLS", Ts=panel_76)  # -> AnalyzedModel, Translations_m, Rotations_rad
beam_displacements_karamba3d_6 = BeamDisplacementsKaramba3D(AnalyzedModel=analyze_karamba3d_2.CalculatedModel, BeamsIdentifiers=panel_72, LoadCase="SLS", Ts="0")  # -> AnalyzedModel, Translations_m, Rotations_rad
beam_displacements_karamba3d_7 = BeamDisplacementsKaramba3D(AnalyzedModel=analyze_karamba3d_2.CalculatedModel, BeamsIdentifiers=panel_73, LoadCase="SLS", Ts="0.5")  # -> AnalyzedModel, Translations_m, Rotations_rad
list_item_6 = ListItem(List=beam_displacements_karamba3d.Translations_m, Index=0, Wrap=True)
list_item_7 = ListItem(List=beam_displacements_karamba3d_3.Translations_m, Index=0, Wrap=True)
list_item_8 = ListItem(List=beam_displacements_karamba3d.Translations_m, Index=1, Wrap=True)
list_item_9 = ListItem(List=beam_displacements_karamba3d_4.Translations_m, Index=0, Wrap=True)
list_item_10 = ListItem(List=beam_displacements_karamba3d_2.Translations_m, Index=1, Wrap=True)
list_item_11 = ListItem(List=beam_displacements_karamba3d_5.Translations_m, Index=0, Wrap=True)
list_item_12 = ListItem(List=beam_displacements_karamba3d_2.Translations_m, Index=0, Wrap=True)
list_item_13 = ListItem(List=beam_displacements_karamba3d_5.Translations_m, Index=1, Wrap=True)
list_item_14 = ListItem(List=beam_displacements_karamba3d_6.Translations_m, Index=0, Wrap=True)
list_item_15 = ListItem(List=beam_displacements_karamba3d_7.Translations_m, Index=0, Wrap=True)
deconstruct = Deconstruct(Point=list_item_6)  # -> XComponent, YComponent, ZComponent
deconstruct_2 = Deconstruct(Point=list_item_8)  # -> XComponent, YComponent, ZComponent
deconstruct_3 = Deconstruct(Point=list_item_12)  # -> XComponent, YComponent, ZComponent
deconstruct_4 = Deconstruct(Point=list_item_7)  # -> XComponent, YComponent, ZComponent
deconstruct_5 = Deconstruct(Point=list_item_9)  # -> XComponent, YComponent, ZComponent
deconstruct_6 = Deconstruct(Point=list_item_10)  # -> XComponent, YComponent, ZComponent
deconstruct_7 = Deconstruct(Point=list_item_11)  # -> XComponent, YComponent, ZComponent
deconstruct_8 = Deconstruct(Point=list_item_13)  # -> XComponent, YComponent, ZComponent
deconstruct_9 = Deconstruct(Point=list_item_14)  # -> XComponent, YComponent, ZComponent
deconstruct_10 = Deconstruct(Point=list_item_15)  # -> XComponent, YComponent, ZComponent
subtraction_3 = Subtraction(A=deconstruct.ZComponent, B=deconstruct_2.ZComponent)
subtraction_4 = Subtraction(A=deconstruct_3.ZComponent, B=deconstruct_6.ZComponent)
subtraction_5 = Subtraction(A=deconstruct_4.ZComponent, B=deconstruct_5.ZComponent)
subtraction_6 = Subtraction(A=deconstruct_7.ZComponent, B=deconstruct_8.ZComponent)
subtraction_7 = Subtraction(A=deconstruct_9.ZComponent, B=deconstruct_10.ZComponent)
absolute = Absolute(Value=subtraction_3)
absolute_2 = Absolute(Value=subtraction_4)
absolute_3 = Absolute(Value=subtraction_5)
absolute_4 = Absolute(Value=subtraction_6)
absolute_5 = Absolute(Value=subtraction_7)
multiplication_4 = Multiplication(A=absolute, B="100")  # -> flatten(Result)
multiplication_5 = Multiplication(A=absolute_2, B="100")  # -> flatten(Result)
multiplication_6 = Multiplication(A=absolute_3, B="100")  # -> flatten(Result)
multiplication_7 = Multiplication(A=absolute_4, B="100")  # -> flatten(Result)
multiplication_8 = Multiplication(A=absolute_5, B="100")  # -> flatten(Result)
sort_list = SortList(Keys=multiplication_4, ValuesValuesA=multiplication_4)  # -> Keys, ValuesValuesA
sort_list_2 = SortList(Keys=multiplication_5, ValuesValuesA=multiplication_5)  # -> Keys, ValuesValuesA
sort_list_3 = SortList(Keys=multiplication_6, ValuesValuesA=multiplication_6)  # -> Keys, ValuesValuesA
sort_list_4 = SortList(Keys=multiplication_7, ValuesValuesA=multiplication_7)  # -> Keys, ValuesValuesA
sort_list_5 = SortList(Keys=multiplication_8, ValuesValuesA=multiplication_8)  # -> Keys, ValuesValuesA
panel_77 = Panel(sort_list_4.ValuesValuesA)
panel_78 = Panel(sort_list.ValuesValuesA)
panel_79 = Panel(sort_list_2.ValuesValuesA)
panel_80 = Panel(sort_list_3.ValuesValuesA)
panel_81 = Panel(sort_list_5.ValuesValuesA)
min_max_9 = MinMax(Number=sort_list.ValuesValuesA)  # -> Minimum, Maximum
min_max_10 = MinMax(Number=sort_list_2.ValuesValuesA)  # -> Minimum, Maximum
min_max_11 = MinMax(Number=sort_list_4.ValuesValuesA)  # -> Minimum, Maximum
lengthsecondarybeams = Number(panel_4)
lengthsecondarybeams_2 = Number(panel_4)
lengthsecondarybeams_3 = Number(panel_4)
csharp_script_11 = CSharpScript(iDeformation=min_max_11.Maximum, iLength=lengthsecondarybeams_3)  # -> out, penalty, a, b; inputs iDeformation: Double, iLength: Double
# ---------- csharp_script_11: C# ----------
// Grasshopper Script Instance
using System;
using System.Collections;
using System.Collections.Generic;
using System.Drawing;

using Rhino;
using Rhino.Geometry;

using Grasshopper;
using Grasshopper.Kernel;
using Grasshopper.Kernel.Data;
using Grasshopper.Kernel.Types;

public class Script_Instance : GH_ScriptInstance
{
  /* 
    Members:
      RhinoDoc RhinoDocument
      GH_Document GrasshopperDocument
      IGH_Component Component
      int Iteration

    Methods (Virtual & overridable):
      Print(string text)
      Print(string format, params object[] args)
      Reflect(object obj)
      Reflect(object obj, string method_name)
  */
  
  private void RunScript(
	double iDeformation,
	double iLength,
	ref object penalty,
	ref object a,
	ref object b)
  {

    double points = 0;
    double limit = (iLength*100) / 300;

   
   if (iDeformation > 1.05 *limit )
    {
        points = 20;
    }

    if (iDeformation > 1.1 *limit )
    {
        points = 50;
    }

    if (iDeformation > 1.2 *limit )
    {
        points = 100;
    }

    if (iDeformation > 1.35 *limit )
    {
        points = 300;
    }    

    if (iDeformation > 1.5 *limit )
    {
        points = 500;
    }
    
    if (iDeformation > 2.0 *limit )
    {
        points = 1000;
    }

    if (iDeformation < 1.05 *limit )
    {
        points = 18;
    }

    if (iDeformation == limit)
    {
        points = 5;
    }
    
    if (iDeformation < limit )
    {
        points = 1;
    }
    
    if (iDeformation < 0.9 * limit )
    {
        points = 0;
    }

    if (iDeformation < 0.8 * limit )
    {
        points = 15;
    }

 
    penalty = points;
    a = limit;
    b = iDeformation;
  }
}
# ---------- end csharp_script_11 ----------
csharp_script_12 = CSharpScript(iDeformation=min_max_9.Maximum, iLength=lengthsecondarybeams_2)  # -> out, penalty, a, b; inputs iDeformation: Double, iLength: Double; same code as csharp_script_11
csharp_script_13 = CSharpScript(iDeformation=min_max_10.Maximum, iLength=lengthsecondarybeams)  # -> out, penalty, a, b; inputs iDeformation: Double, iLength: Double; same code as csharp_script_11
addition_2 = Addition(A=csharp_script_12.penalty, B=csharp_script_11.penalty, C=csharp_script_13.penalty)
number_18 = Number(addition_2)
addition_3 = Addition(A=number_18, B=number_17)
number_19 = Number(addition_3)
panel_82 = Panel(number_18)
galapagos_2 = Galapagos(fitness=number_19, gene=[gene_pool_5, gene_pool_3, gene_pool_7, gene_pool_6, gene_pool_8, gene_pool_4])
panel_83 = Panel(number_19)

# ---- group: Results
mainbeamsyin = Text(panel_14)
mainbeamsyout = Text(panel_10)
column = Text(panel_24)
secondarybeams1in_2 = Text(panel_27)
secondarybeams1out_2 = Text(panel_25)
secondarybeams2_2 = Text(panel_26)
brazing = Text(panel_24)
model_karamba3d_10 = ModelKaramba3D(assemble_model_karamba3d.Model)
analyze_karamba3d_3 = AnalyzeKaramba3D(Model=model_karamba3d_10)  # -> CalculatedModel, MaximumDisplacement_cm, ResultingForceOfGravity_kN, ElasticEnergyChange_kNm
maximum_displacement = Panel(analyze_karamba3d_3.MaximumDisplacement_cm)
model_karamba3d_11 = ModelKaramba3D(analyze_karamba3d_3.CalculatedModel)
model_karamba3d_12 = ModelKaramba3D(model_karamba3d_11)
information_of_the_model = Panel(model_karamba3d_11)
panel_84 = Panel([secondarybeams1in_2, secondarybeams1out_2, secondarybeams2_2, mainbeamsyin, mainbeamsyout])

# ----
model_view_karamba3d = ModelViewKaramba3D(Model=model_karamba3d_9, ResultFactors=1, ResultCase=-1)  # -> Model, DeformedMesh, DeformedAxes, DeformedModel
beam_view_karamba3d = BeamViewKaramba3D(Model=model_view_karamba3d.Model)  # -> Model, MeshesOfRenderedBeams, DeformedBeamAxes, LegendColors, LegendTags

# ---- group: Results
# Deformation visualization
unit_z_11 = UnitZ(Factor=1)
model_view_karamba3d_2 = ModelViewKaramba3D(Model=model_karamba3d_11, DisplacementDirection=unit_z_11, ResultFactors=1, ResultCase=-1)  # -> Model, DeformedMesh, DeformedAxes, DeformedModel
beam_view_karamba3d_2 = BeamViewKaramba3D(Model=model_view_karamba3d_2.Model)  # -> Model, MeshesOfRenderedBeams, DeformedBeamAxes, LegendColors, LegendTags
mesh = Mesh(beam_view_karamba3d_2.MeshesOfRenderedBeams)
curve_11 = Curve(<curve referenced from the Rhino model>)
legend = Legend(Colour=beam_view_karamba3d_2.LegendColors, Tags=beam_view_karamba3d_2.LegendTags, Rectangle=curve_11, LegendType=1)

# ----
mesh_2 = Mesh(beam_view_karamba3d.MeshesOfRenderedBeams)

# ---- group: Results / Coloured model
model_view_karamba3d_3 = ModelViewKaramba3D(Model=model_karamba3d_12, ResultFactors=1, ResultCase=-1)  # -> Model, DeformedMesh, DeformedAxes, DeformedModel
beam_view_karamba3d_3 = BeamViewKaramba3D(Model=model_view_karamba3d_3.Model)  # -> Model, MeshesOfRenderedBeams, DeformedBeamAxes, LegendColors, LegendTags
mesh_3 = Mesh(beam_view_karamba3d_3.MeshesOfRenderedBeams)

# ---- group: Results
# Section Forces
model_view_karamba3d_4 = ModelViewKaramba3D(Model=model_karamba3d_12, ResultFactors=1, ResultCase=-1)  # -> Model, DeformedMesh, DeformedAxes, DeformedModel
beam_view_karamba3d_4 = BeamViewKaramba3D(Model=model_view_karamba3d_4.Model)  # -> Model, MeshesOfRenderedBeams, DeformedBeamAxes, LegendColors, LegendTags

# Utilizations of beams
loadcombinations = Text(load_combinations)
merge_4 = Merge(Data1=secondarybeams1in_2, Data2=secondarybeams1out_2, Data3=secondarybeams2_2, Data4=mainbeamsyin, Data5=mainbeamsyout)  # -> flatten(Result)
panel_85 = Panel(loadcombinations)
utilization_of_elements_karamba3d_9 = UtilizationOfElementsKaramba3D(
    AnalyzedModel=model_karamba3d_12,
    ElementsIdentifiers=merge_4,
    LoadCase=graft(panel_85),
    NumberOfSamplePoints=3,
    ElasticDesign=True,
    GammaM0=1,
    GammaM1=1.1,
    SwayFrame=True,
    WithDetails=False,
    mode="Beams")  # -> AnalyzedModel, Utilization, SigMax_kN_cm2, SigMin_kN_cm2, TauMax_kN_cm2, UtilN, UtilVy, UtilVz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
min_max_12 = MinMax(Number=utilization_of_elements_karamba3d_9.Utilization)  # -> Minimum, Maximum
average = Average(Input=utilization_of_elements_karamba3d_9.Utilization)
tree_branch_3 = TreeBranch(Tree=simplify(min_max_12.Maximum), Path="3", MaintainPaths=True)
panel_86 = Panel(min_max_12.Maximum)
tree_branch_4 = TreeBranch(Tree=simplify(average), Path="3", MaintainPaths=True)
panel_87 = Panel(average)
_6_10b_y = Panel(tree_branch_3)
_6_10b_y_2 = Panel(tree_branch_4)

# Model Mass
element_query_karamba3d = ElementQueryKaramba3D(Model=model_karamba3d_12)  # -> Model, Mass_kg, Area_m2, Volume_m3, Meshes
mass_addition = MassAddition(Input=element_query_karamba3d.Mass_kg)  # -> Result, PartialResults
panel_88 = Panel(mass_addition.Result)

# Utilizations visualization
model_view_karamba3d_5 = ModelViewKaramba3D(Model=model_karamba3d_12, ResultFactors=1, ResultCase=-1)  # -> Model, DeformedMesh, DeformedAxes, DeformedModel
beam_view_karamba3d_5 = BeamViewKaramba3D(Model=model_view_karamba3d_5.Model)  # -> Model, MeshesOfRenderedBeams, DeformedBeamAxes, LegendColors, LegendTags
curve_12 = Curve(<curve referenced from the Rhino model>)
mesh_4 = Mesh(beam_view_karamba3d_5.MeshesOfRenderedBeams)
legend_2 = Legend(Colour=beam_view_karamba3d_5.LegendColors, Tags=beam_view_karamba3d_5.LegendTags, Rectangle=curve_12, LegendType=1)

# ---- group: Coloring of the cross sections. Each cross section group have an unique color
model_view_karamba3d_6 = ModelViewKaramba3D(Model=model_karamba3d_9, ResultFactors=1, ResultCase=-1)  # -> Model, DeformedMesh, DeformedAxes, DeformedModel
disassemble_model_karamba3d = DisassembleModelKaramba3D(Model=model_view_karamba3d_6.Model)  # -> Model, Point, Beam, Shell, Support, Load, Line, Mesh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
disassemble_element_karamba3d = DisassembleElementKaramba3D(Element=disassemble_model_karamba3d.Beam)  # -> Element, ElementIdentifier, AxisOfElement, CrossSection, Joint, Material, LocalCoordinateSystem, ElementIsActive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
disassemble_cross_section_karamba3d = DisassembleCrossSectionKaramba3D(CroSec=disassemble_element_karamba3d.CrossSection)  # -> CrossSection, FamilyNameOfCrossSection, TypeNameOfCrossSection, ElemIdentifiers, Color, Material, LocalEccentricity_cm, flatten(Heights_cm)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
panel_89 = Panel(disassemble_cross_section_karamba3d.Heights_cm)
panel_90 = Panel(disassemble_cross_section_karamba3d.MaximumWidth_cm)
elementidentifyer = Panel(disassemble_element_karamba3d.ElementIdentifier)
rectangle_2 = Rectangle(Plane=PlaneXY(0, 0, 0), XSize=panel_89, YSize=panel_90, Radius=0)  # -> Rectangle, Length
area_2 = Area(Geometry=rectangle_2.Rectangle)  # -> Area, Centroid
point_groups = PointGroups(Points=area_2.Centroid, Distance="0")  # -> simplify(Groups), simplify(Indices)
data_2 = Data(simplify(point_groups.Indices))
indices_groups = Panel(data_2)
list_item_16 = ListItem(List=disassemble_element_karamba3d.ElementIdentifier, Index=data_2, Wrap=True)
tree_statistics = TreeStatistics(Tree=list_item_16)  # -> Paths, Length, Count
panel_91 = Panel(tree_statistics.Count)
random = Random(Range="0 To 255", Number=panel_91, Seed="30")
random_2 = Random(Range="25 To 190", Number=panel_91, Seed="30")
random_3 = Random(Range="5 To 255", Number=panel_91, Seed="20")
panel_92 = Panel(list_item_16)
round = Round(Number=random)  # -> Nearest, Floor, Ceiling
round_2 = Round(Number=random_2)  # -> Nearest, Floor, Ceiling
round_3 = Round(Number=random_3)  # -> Nearest, Floor, Ceiling
tree_statistics_2 = TreeStatistics(Tree=point_groups.Groups)  # -> Paths, Length, Count
concatenate_2 = Concatenate(FragmentA=round.Floor, FragmentB=",", FragmentA_2=round_2.Floor, FragmentB_2=",", FragmentC=round_3.Floor)  # -> simplify(graft(Result))
series = Series(Start=0, Step=1, Count=tree_statistics_2.Count)
concatenate_3 = Concatenate(FragmentA="CrossSection_", FragmentB=series)  # -> simplify(graft(Result))
make_element_set_karamba3d = MakeElementSetKaramba3D(ElementIdentifiers=list_item_16, SetIdentifier=concatenate_3, MinimumSplitLength_m=0.001, ColorOfTheSet=concatenate_2)  # -> simplify(ElementSet)
panel_93 = Panel(concatenate_3)
disassemble_model_karamba3d_2 = DisassembleModelKaramba3D(Model=model_view_karamba3d_6.Model)  # -> Model, Point, Beam, Shell, Support, Load, Line, Mesh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
assemble_model_karamba3d_2 = AssembleModelKaramba3D(
    Elem=disassemble_model_karamba3d_2.Beam,
    Support=disassemble_model_karamba3d_2.Support,
    Load=disassemble_model_karamba3d_2.Load,
    CrossSection=disassemble_model_karamba3d_2.CrossSection,
    Joint=disassemble_model_karamba3d_2.Joint,
    BeamSet=flatten(make_element_set_karamba3d),
    LimitDistance_m=0.005)  # -> Model, Info, Mass_kg, CenterOfGravity, LoadCaseNames
model_view_karamba3d_7 = ModelViewKaramba3D(Model=assemble_model_karamba3d_2.Model, ResultFactors=1, ResultCase=-1)  # -> Model, DeformedMesh, DeformedAxes, DeformedModel
beam_view_karamba3d_6 = BeamViewKaramba3D(Model=model_view_karamba3d_7.Model)  # -> Model, MeshesOfRenderedBeams, DeformedBeamAxes, LegendColors, LegendTags

# ---- group: Demand Bank
panel_94 = Panel(panel_11)
panel_95 = Panel(panel_13)
panel_96 = Panel(panel_12)
panel_97 = Panel(panel_26)
panel_98 = Panel(panel_8)
panel_99 = Panel(panel_7)
panel_100 = Panel(panel_9)
panel_101 = Panel([panel_29, panel_28])
panel_102 = Panel(panel_25)
panel_103 = Panel(panel_27)
model_view_karamba3d_8 = ModelViewKaramba3D(Model=assemble_model_karamba3d.Model, ResultFactors=1, ResultCase=-1, ElementIdentifiersBreps=panel_101)  # -> Model, DeformedMesh, DeformedAxes, DeformedModel
model_view_karamba3d_9 = ModelViewKaramba3D(Model=assemble_model_karamba3d.Model, ResultFactors=1, ResultCase=-1, ElementIdentifiersBreps=panel_94)  # -> Model, DeformedMesh, DeformedAxes, DeformedModel
model_view_karamba3d_10 = ModelViewKaramba3D(Model=assemble_model_karamba3d.Model, ResultFactors=1, ResultCase=-1, ElementIdentifiersBreps=panel_95)  # -> Model, DeformedMesh, DeformedAxes, DeformedModel
model_view_karamba3d_11 = ModelViewKaramba3D(Model=assemble_model_karamba3d.Model, ResultFactors=1, ResultCase=-1, ElementIdentifiersBreps=panel_96)  # -> Model, DeformedMesh, DeformedAxes, DeformedModel
model_view_karamba3d_12 = ModelViewKaramba3D(Model=assemble_model_karamba3d.Model, ResultFactors=1, ResultCase=-1, ElementIdentifiersBreps=panel_97)  # -> Model, DeformedMesh, DeformedAxes, DeformedModel
model_view_karamba3d_13 = ModelViewKaramba3D(Model=assemble_model_karamba3d.Model, ResultFactors=1, ResultCase=-1, ElementIdentifiersBreps=panel_99)  # -> Model, DeformedMesh, DeformedAxes, DeformedModel
model_view_karamba3d_14 = ModelViewKaramba3D(Model=assemble_model_karamba3d.Model, ResultFactors=1, ResultCase=-1, ElementIdentifiersBreps=panel_100)  # -> Model, DeformedMesh, DeformedAxes, DeformedModel
model_view_karamba3d_15 = ModelViewKaramba3D(Model=assemble_model_karamba3d.Model, ResultFactors=1, ResultCase=-1, ElementIdentifiersBreps=panel_98)  # -> Model, DeformedMesh, DeformedAxes, DeformedModel
model_view_karamba3d_16 = ModelViewKaramba3D(Model=assemble_model_karamba3d.Model, ResultFactors=1, ResultCase=-1, ElementIdentifiersBreps=panel_103)  # -> Model, DeformedMesh, DeformedAxes, DeformedModel
model_view_karamba3d_17 = ModelViewKaramba3D(Model=assemble_model_karamba3d.Model, ResultFactors=1, ResultCase=-1, ElementIdentifiersBreps=panel_102)  # -> Model, DeformedMesh, DeformedAxes, DeformedModel
beam_view_karamba3d_7 = BeamViewKaramba3D(Model=model_view_karamba3d_8.Model)  # -> Model, MeshesOfRenderedBeams, DeformedBeamAxes, LegendColors, LegendTags
beam_view_karamba3d_8 = BeamViewKaramba3D(Model=model_view_karamba3d_9.Model)  # -> Model, MeshesOfRenderedBeams, DeformedBeamAxes, LegendColors, LegendTags
beam_view_karamba3d_9 = BeamViewKaramba3D(Model=model_view_karamba3d_10.Model)  # -> Model, MeshesOfRenderedBeams, DeformedBeamAxes, LegendColors, LegendTags
beam_view_karamba3d_10 = BeamViewKaramba3D(Model=model_view_karamba3d_11.Model)  # -> Model, MeshesOfRenderedBeams, DeformedBeamAxes, LegendColors, LegendTags
beam_view_karamba3d_11 = BeamViewKaramba3D(Model=model_view_karamba3d_12.Model)  # -> Model, MeshesOfRenderedBeams, DeformedBeamAxes, LegendColors, LegendTags
beam_view_karamba3d_12 = BeamViewKaramba3D(Model=model_view_karamba3d_13.Model)  # -> Model, MeshesOfRenderedBeams, DeformedBeamAxes, LegendColors, LegendTags
beam_view_karamba3d_13 = BeamViewKaramba3D(Model=model_view_karamba3d_14.Model)  # -> Model, MeshesOfRenderedBeams, DeformedBeamAxes, LegendColors, LegendTags
beam_view_karamba3d_14 = BeamViewKaramba3D(Model=model_view_karamba3d_15.Model)  # -> Model, MeshesOfRenderedBeams, DeformedBeamAxes, LegendColors, LegendTags
beam_view_karamba3d_15 = BeamViewKaramba3D(Model=model_view_karamba3d_16.Model)  # -> Model, MeshesOfRenderedBeams, DeformedBeamAxes, LegendColors, LegendTags
beam_view_karamba3d_16 = BeamViewKaramba3D(Model=model_view_karamba3d_17.Model)  # -> Model, MeshesOfRenderedBeams, DeformedBeamAxes, LegendColors, LegendTags
mesh_5 = Mesh(beam_view_karamba3d_8.MeshesOfRenderedBeams)
mesh_6 = Mesh(beam_view_karamba3d_7.MeshesOfRenderedBeams)
mesh_7 = Mesh(beam_view_karamba3d_9.MeshesOfRenderedBeams)
mesh_8 = Mesh(beam_view_karamba3d_10.MeshesOfRenderedBeams)
mesh_9 = Mesh(beam_view_karamba3d_12.MeshesOfRenderedBeams)
mesh_10 = Mesh(beam_view_karamba3d_11.MeshesOfRenderedBeams)
mesh_11 = Mesh(beam_view_karamba3d_13.MeshesOfRenderedBeams)
mesh_12 = Mesh(beam_view_karamba3d_14.MeshesOfRenderedBeams)
mesh_13 = Mesh(beam_view_karamba3d_15.MeshesOfRenderedBeams)
mesh_14 = Mesh(beam_view_karamba3d_16.MeshesOfRenderedBeams)

explode_object = ExplodeObject(Object=mesh_8, Recursive=False)  # -> graft(Objects)
minimumboundindbox = MinimumBoundindBox(Geometry=explode_object)  # -> simplify(graft(SecondaryBeams))
brep = Brep(flatten(minimumboundindbox))
deconstruct_brep_2 = DeconstructBrep(Brep=brep)  # -> Faces, Edges, Vertices
point_7 = Point(deconstruct_brep_2.Vertices)
fit_line = FitLine(Points=point_7)
curve_middle = CurveMiddle(Curve=fit_line)

explode_object_2 = ExplodeObject(Object=mesh_5, Recursive=False)  # -> graft(Objects)
explode_object_3 = ExplodeObject(Object=mesh_6, Recursive=False)  # -> graft(Objects)
unit_z_12 = UnitZ(Factor="0.4")
minimumboundindbox_2 = MinimumBoundindBox(Geometry=explode_object_3)  # -> flatten(BoundingBox)
minimumboundindbox_3 = MinimumBoundindBox(Geometry=explode_object_2)  # -> flatten(SecondaryBeams)
move = Move(Geometry=minimumboundindbox_2, Motion=unit_z_12)  # -> Geometry, Transform
solid_difference = SolidDifference(BrepsA=minimumboundindbox_3, BrepsB=move.Geometry)  # -> simplify(graft(SecondaryBeamsOutsideColumn))

explode_object_4 = ExplodeObject(Object=mesh_12, Recursive=False)  # -> graft(Objects)
minimumboundindbox_4 = MinimumBoundindBox(Geometry=explode_object_4)  # -> simplify(graft(SecondaryBeams))
brep_2 = Brep(flatten(minimumboundindbox_4))
deconstruct_brep_3 = DeconstructBrep(Brep=brep_2)  # -> Faces, Edges, Vertices
point_8 = Point(deconstruct_brep_3.Vertices)
fit_line_2 = FitLine(Points=point_8)
curve_middle_2 = CurveMiddle(Curve=fit_line_2)

explode_object_5 = ExplodeObject(Object=mesh_7, Recursive=False)  # -> graft(Objects)
explode_object_6 = ExplodeObject(Object=mesh_6, Recursive=False)  # -> graft(Objects)
minimumboundindbox_5 = MinimumBoundindBox(Geometry=explode_object_5)  # -> flatten(SecondaryBeams)
minimumboundindbox_6 = MinimumBoundindBox(Geometry=explode_object_6)  # -> flatten(BoundingBox)
unit_z_13 = UnitZ(Factor="0.4")
move_2 = Move(Geometry=minimumboundindbox_6, Motion=unit_z_13)  # -> Geometry, Transform
solid_difference_2 = SolidDifference(BrepsA=minimumboundindbox_5, BrepsB=move_2.Geometry)  # -> simplify(graft(SecondaryBeamsOutsideColumn))

explode_object_7 = ExplodeObject(Object=mesh_9, Recursive=False)  # -> graft(Objects)
explode_object_8 = ExplodeObject(Object=mesh_6, Recursive=False)  # -> graft(Objects)
unit_z_14 = UnitZ(Factor="0.4")
minimumboundindbox_7 = MinimumBoundindBox(Geometry=explode_object_8)  # -> flatten(BoundingBox)
minimumboundindbox_8 = MinimumBoundindBox(Geometry=explode_object_7)  # -> flatten(SecondaryBeams)
move_3 = Move(Geometry=minimumboundindbox_7, Motion=unit_z_14)  # -> Geometry, Transform
solid_difference_3 = SolidDifference(BrepsA=minimumboundindbox_8, BrepsB=move_3.Geometry)  # -> simplify(graft(SecondaryBeamsOutsideColumn))

explode_object_9 = ExplodeObject(Object=mesh_13, Recursive=False)  # -> simplify(graft(Objects))
minimumboundindbox_9 = MinimumBoundindBox(Geometry=explode_object_9)  # -> flatten(SecondaryBeams)
minimumboundindbox_10 = MinimumBoundindBox(Geometry=explode_object_3)  # -> flatten(BoundingBox)
unit_z_15 = UnitZ(Factor="0.4")
move_4 = Move(Geometry=minimumboundindbox_10, Motion=unit_z_15)  # -> Geometry, Transform
solid_difference_4 = SolidDifference(BrepsA=minimumboundindbox_9, BrepsB=move_4.Geometry)  # -> simplify(graft(SecondaryBeamsOutsideColumn))
tree_item = TreeItem(Tree=solid_difference_4, Path="10", Index=0, Wrap=True)
brep_3 = Brep(solid_difference_4)
brep_4 = Brep(flatten(brep_3))
xy_plane = XYPlane(Origin=Point(0, 0, 0))
rotate = Rotate(Geometry=brep_4, Angle=1.570796327, Plane=xy_plane)  # -> Geometry, Transform
list_length_5 = ListLength(List=rotate.Geometry)
series_2 = Series(Start=0, Step=1, Count=list_length_5)
volume = Volume(Geometry=rotate.Geometry)  # -> Volume, Centroid
construct_point = ConstructPoint(XCoordinate=series_2, YCoordinate=0, ZCoordinate=0)
orient = Orient(Geometry=rotate.Geometry, Source=volume.Centroid, Target=construct_point)  # -> Geometry, Transform
brep_5 = Brep(graft(orient.Geometry))
minimumboundindbox_11 = MinimumBoundindBox(Geometry=brep_5)

explode_object_10 = ExplodeObject(Object=mesh_11, Recursive=False)  # -> graft(Objects)
explode_object_11 = ExplodeObject(Object=mesh_6, Recursive=False)  # -> graft(Objects)
minimumboundindbox_12 = MinimumBoundindBox(Geometry=explode_object_10)  # -> flatten(SecondaryBeams)
minimumboundindbox_13 = MinimumBoundindBox(Geometry=explode_object_11)  # -> flatten(BoundingBox)
unit_z_16 = UnitZ(Factor="0.4")
move_5 = Move(Geometry=minimumboundindbox_13, Motion=unit_z_16)  # -> Geometry, Transform
solid_difference_5 = SolidDifference(BrepsA=minimumboundindbox_12, BrepsB=move_5.Geometry)  # -> simplify(graft(SecondaryBeamsOutsideColumn))

explode_object_12 = ExplodeObject(Object=mesh_14, Recursive=False)  # -> simplify(graft(Objects))
explode_object_13 = ExplodeObject(Object=[mesh_14, mesh_6], Recursive=False)  # -> simplify(graft(Objects))
minimumboundindbox_14 = MinimumBoundindBox(Geometry=explode_object_12)  # -> flatten(SecondaryBeams)
minimumboundindbox_15 = MinimumBoundindBox(Geometry=explode_object_13)  # -> flatten(BoundingBox)
unit_z_17 = UnitZ(Factor="0.4")
move_6 = Move(Geometry=minimumboundindbox_15, Motion=unit_z_17)  # -> Geometry, Transform
solid_difference_6 = SolidDifference(BrepsA=minimumboundindbox_14, BrepsB=move_6.Geometry)  # -> simplify(graft(SecondaryBeamsOutsideColumn))
brep_6 = Brep(solid_difference_6)
brep_7 = Brep(flatten(brep_6))
xy_plane_2 = XYPlane(Origin=Point(0, 0, 0))
rotate_2 = Rotate(Geometry=brep_7, Angle=1.570796327, Plane=xy_plane_2)  # -> Geometry, Transform
list_length_6 = ListLength(List=rotate_2.Geometry)
series_3 = Series(Start=0, Step=1, Count=list_length_6)
volume_2 = Volume(Geometry=rotate_2.Geometry)  # -> Volume, Centroid
construct_point_2 = ConstructPoint(XCoordinate=series_3, YCoordinate=0, ZCoordinate=0)
orient_2 = Orient(Geometry=rotate_2.Geometry, Source=volume_2.Centroid, Target=construct_point_2)  # -> Geometry, Transform
brep_8 = Brep(graft(orient_2.Geometry))
minimumboundindbox_16 = MinimumBoundindBox(Geometry=brep_8)

solid_union = SolidUnion(Breps=[solid_difference, minimumboundindbox, solid_difference_2])
cluster_3 = Cluster_3(geometry=solid_union)

solid_union_2 = SolidUnion(Breps=[solid_difference_3, minimumboundindbox_4, solid_difference_5])
cluster_4 = Cluster_3(geometry=solid_union_2)

mesh_15 = Mesh(mesh_10)
explode_object_14 = ExplodeObject(Object=mesh_15, Recursive=False)  # -> simplify(graft(Objects))
brep_9 = Brep(solid_union)
minimumboundindbox_17 = MinimumBoundindBox(Geometry=solid_union_2)  # -> flatten(BoundingBox)
minimumboundindbox_18 = MinimumBoundindBox(Geometry=brep_9)  # -> flatten(BoundingBox)
minimumboundindbox_19 = MinimumBoundindBox(Geometry=explode_object_14)  # -> flatten(SecondaryBeams)
unit_z_18 = UnitZ(Factor=expr("-x", "0.15"))
unit_z_19 = UnitZ(Factor="0.15")
unit_z_20 = UnitZ(Factor=expr("-x", "0.15"))
unit_z_21 = UnitZ(Factor="0.15")
move_7 = Move(Geometry=minimumboundindbox_18, Motion=unit_z_19)  # -> Geometry, Transform
move_8 = Move(Geometry=minimumboundindbox_18, Motion=unit_z_18)  # -> Geometry, Transform
move_9 = Move(Geometry=minimumboundindbox_17, Motion=unit_z_21)  # -> Geometry, Transform
move_10 = Move(Geometry=minimumboundindbox_17, Motion=unit_z_20)  # -> Geometry, Transform
solid_union_3 = SolidUnion(Breps=[minimumboundindbox_18, move_7.Geometry, move_8.Geometry])  # -> flatten(Result)
solid_union_4 = SolidUnion(Breps=[minimumboundindbox_18, move_7.Geometry, move_8.Geometry, minimumboundindbox_17, move_9.Geometry, move_10.Geometry])  # -> flatten(Result)
solid_difference_7 = SolidDifference(BrepsA=minimumboundindbox_19, BrepsB=[solid_union_3, solid_union_4])  # -> simplify(graft(SecondaryBeamsOutsideColumn))
tree_branch_5 = TreeBranch(Tree=solid_difference_7, Path="{0}", MaintainPaths=True)
minimumboundindbox_20 = MinimumBoundindBox(Geometry=solid_difference_7)
xy_plane_3 = XYPlane(Origin=Point(0, 0, 0))
brep_10 = Brep(flatten(minimumboundindbox_20))
rotate_3 = Rotate(Geometry=brep_10, Angle=1.570796327, Plane=xy_plane_3)  # -> Geometry, Transform
list_length_7 = ListLength(List=rotate_3.Geometry)
series_4 = Series(Start=0, Step=1, Count=list_length_7)
volume_3 = Volume(Geometry=rotate_3.Geometry)  # -> Volume, Centroid
construct_point_3 = ConstructPoint(XCoordinate=series_4, YCoordinate=0, ZCoordinate=0)
orient_3 = Orient(Geometry=rotate_3.Geometry, Source=volume_3.Centroid, Target=construct_point_3)  # -> Geometry, Transform

tree_branch_6 = TreeBranch(Tree=solid_union_2, Path="{0}", MaintainPaths=True)
panel_104 = Panel(solid_union_2)

brep_11 = Brep(flatten(minimumboundindbox_16))
brep_12 = Brep(flatten(cluster_4))
brep_13 = Brep(flatten(minimumboundindbox_11))
brep_14 = Brep(flatten(cluster_3))
brep_15 = Brep(flatten(orient_3.Geometry))
addition_4 = Addition(A="20", B=7)
addition_5 = Addition(A=addition_4, B=7)
addition_6 = Addition(A=addition_5, B=7)
addition_7 = Addition(A=addition_6, B=7)
unit_y_2 = UnitY(Factor="20")
unit_y_3 = UnitY(Factor=addition_4)
unit_y_4 = UnitY(Factor=addition_6)
unit_y_5 = UnitY(Factor=addition_5)
unit_y_6 = UnitY(Factor=addition_7)
move_11 = Move(Geometry=brep_14, Motion=unit_y_2)  # -> Geometry, Transform
move_12 = Move(Geometry=brep_13, Motion=unit_y_3)  # -> Geometry, Transform
move_13 = Move(Geometry=brep_12, Motion=unit_y_4)  # -> Geometry, Transform
move_14 = Move(Geometry=brep_15, Motion=unit_y_5)  # -> Geometry, Transform
move_15 = Move(Geometry=brep_11, Motion=unit_y_6)  # -> Geometry, Transform
merge_5 = Merge(Data1=move_11.Geometry, Data2=move_12.Geometry, Data3=move_14.Geometry, Data4=move_13.Geometry, Data5=move_15.Geometry)  # -> flatten(Result)
brep_16 = Brep(merge_5)

# Input Breps as List
brep_17 = Brep(brep_16)
merge_6 = Merge(Data1=brep_17)  # -> flatten(Result)

# Extracting CS data
# data extraced so height>width
c_script = CSharpScript(iBrep=merge_6)  # -> out, CSdata, a; inputs iBrep: list of Brep
# ---------- c_script: C# ----------
// Grasshopper Script Instance
#region Usings
using System;
using System.Linq;
using System.Collections;
using System.Collections.Generic;
using System.Drawing;

using Rhino;
using Rhino.Geometry;

using Grasshopper;
using Grasshopper.Kernel;
using Grasshopper.Kernel.Data;
using Grasshopper.Kernel.Types;
#endregion

public class Script_Instance : GH_ScriptInstance
{
    #region Notes
    /* 
      Members:
        RhinoDoc RhinoDocument
        GH_Document GrasshopperDocument
        IGH_Component Component
        int Iteration

      Methods (Virtual & overridable):
        Print(string text)
        Print(string format, params object[] args)
        Reflect(object obj)
        Reflect(object obj, string method_name)
    */
    #endregion

    private void RunScript(IList<Brep> iBrep, ref object CSdata, ref object a)
    {
        // Write your logic here
        DataTree<double> elementData = new DataTree<double>();
        

        for (int i=0; i<iBrep.Count; i++)
        {
            var edges = iBrep[i].Edges;
           // Use LINQ to get distinct edge lengths
           
            var uniqueLengths = edges
            .Select(edge => Math.Round(edge.ToNurbsCurve().GetLength(),2))
            .Distinct()
            .OrderByDescending(x=>x)
            .ToList();

            double length = Math.Round(uniqueLengths[0]*1000,1);
            double width = Math.Round(uniqueLengths[1]*1000,1);
            double height;
            if (uniqueLengths.Count ==2 )
            {
                height = width;
            }
            else
            {
                height = Math.Round(uniqueLengths[2]*1000,1);
            }
            

            if (width>height)
            {
                double temp = width;
                width=height;
                height = temp;
            }

            // Add data for each iteration to the DataTree
            elementData.Add(i, new GH_Path(0));
            elementData.Add(length, new GH_Path(1));
            elementData.Add(width, new GH_Path(2));
            elementData.Add(height, new GH_Path(3));
            }

        
    
        CSdata = elementData;
        

    }
}
# ---------- end c_script ----------

# WriteToExcel
# OBS! ExcelFile must be closed
panel_105 = Panel("""ElementID
Length[mm]
Width[mm]
Height[mm]""")
file_path = FilePath(panel_2)
excel_write = ExcelWrite(
    WriteExcelData=Toggle(False),
    WorkbookPath=file_path,
    WorksheetName="DemandBank",
    ColumnHeadings=panel_105,
    Data=c_script.CSdata,
    ClearSheet=Toggle(True))
panel_106 = Panel(excel_write)

this_is_the_file_path_used_to_save_the_d = Panel(file_path)  # "This is the file path used to save the data:"

# ==== cluster Cluster
spacingx = ClusterInput()
curve = ClusterInput()
spacingy = ClusterInput()
spacingx_2 = Number(spacingx)
spacingy_2 = Number(spacingy)
curve_2 = Curve(curve)
csharp_script = CSharpScript(spacingY=spacingy_2, spacingX=spacingx_2)  # -> out, corner, nextToCorner; inputs spacingY: Int32, spacingX: Int32
# ---------- csharp_script: C# ----------
// Grasshopper Script Instance
using System;
using System.Collections;
using System.Collections.Generic;
using System.Drawing;

using Rhino;
using Rhino.Geometry;

using Grasshopper;
using Grasshopper.Kernel;
using Grasshopper.Kernel.Data;
using Grasshopper.Kernel.Types;

public class Script_Instance : GH_ScriptInstance
{
  /* 
    Members:
      RhinoDoc RhinoDocument
      GH_Document GrasshopperDocument
      IGH_Component Component
      int Iteration

    Methods (Virtual & overridable):
      Print(string text)
      Print(string format, params object[] args)
      Reflect(object obj)
      Reflect(object obj, string method_name)
  */
  
  private void RunScript(
	int spacingY,
	int spacingX,
	ref object corner,
	ref object nextToCorner)
  {
    // Write your logic here

    //Column 1 {4;5;*}
    string pathA = "{" + spacingY + ";" + spacingX + ";*}";
    corner = pathA;

    //Column 2 {3;5;*}
    int sy = spacingY - 1;
    string pathB = "{" + sy + ";" + spacingX + ";*}";

    //Column 2 {4;4;*} 
    int sx = spacingX - 1;
    string pathC = "{" + spacingY + ";" + sx + ";*}";


    List<object> secondColumns = new List<object>();
    secondColumns.Add(pathB);
    secondColumns.Add(pathC);


    nextToCorner = secondColumns;
  }
}
# ---------- end csharp_script ----------
csharp_script_2 = CSharpScript(spacingX=spacingx_2)  # -> out, corner, nextToCorner; inputs spacingX: Int32
# ---------- csharp_script_2: C# ----------
// Grasshopper Script Instance
using System;
using System.Collections;
using System.Collections.Generic;
using System.Drawing;

using Rhino;
using Rhino.Geometry;

using Grasshopper;
using Grasshopper.Kernel;
using Grasshopper.Kernel.Data;
using Grasshopper.Kernel.Types;

public class Script_Instance : GH_ScriptInstance
{
  /* 
    Members:
      RhinoDoc RhinoDocument
      GH_Document GrasshopperDocument
      IGH_Component Component
      int Iteration

    Methods (Virtual & overridable):
      Print(string text)
      Print(string format, params object[] args)
      Reflect(object obj)
      Reflect(object obj, string method_name)
  */
  
  private void RunScript(int spacingX, ref object corner, ref object nextToCorner)
  {
    // Write your logic here

    //Column 1 {0;5;*}
    string pathA = "{" + 0 + ";" + spacingX + ";*}";
    corner = pathA;

    //Column 2 {1;5;*}
    string pathB = "{" + 1 + ";" + spacingX + ";*}";

    //Column 2 {0;4;*} 
    string pathC = "{" + 0 + ";" + (spacingX-1) + ";*}";
    

    List<object> secondColumns = new List<object>();
    secondColumns.Add(pathB);
    secondColumns.Add(pathC);


    nextToCorner = secondColumns;
  }
}
# ---------- end csharp_script_2 ----------
csharp_script_3 = CSharpScript(spacingY=spacingy_2)  # -> out, corner, nextToCorner; inputs spacingY: Int32
# ---------- csharp_script_3: C# ----------
// Grasshopper Script Instance
using System;
using System.Collections;
using System.Collections.Generic;
using System.Drawing;

using Rhino;
using Rhino.Geometry;

using Grasshopper;
using Grasshopper.Kernel;
using Grasshopper.Kernel.Data;
using Grasshopper.Kernel.Types;

public class Script_Instance : GH_ScriptInstance
{
  /* 
    Members:
      RhinoDoc RhinoDocument
      GH_Document GrasshopperDocument
      IGH_Component Component
      int Iteration

    Methods (Virtual & overridable):
      Print(string text)
      Print(string format, params object[] args)
      Reflect(object obj)
      Reflect(object obj, string method_name)
  */
  
  private void RunScript(int spacingY, ref object corner, ref object nextToCorner)
  {
    // Write your logic here

    //Column 1 {4;5;*}
    string pathA = "{" + spacingY + ";" + 0 + ";*}";
    corner = pathA;

    //Column 2 {3;5;*}
    int sy = spacingY - 1;
    string pathB = "{" + sy + ";" + 0 + ";*}";

    //Column 2 {4;4;*} 
    string pathC = "{" + spacingY + ";" + 1 + ";*}";


    List<object> secondColumns = new List<object>();
    secondColumns.Add(pathB);
    secondColumns.Add(pathC);


    nextToCorner = secondColumns;
  }
}
# ---------- end csharp_script_3 ----------
csharp_script_4 = CSharpScript()  # -> out, corner, nextToCorner
# ---------- csharp_script_4: C# ----------
// Grasshopper Script Instance
using System;
using System.Collections;
using System.Collections.Generic;
using System.Drawing;

using Rhino;
using Rhino.Geometry;

using Grasshopper;
using Grasshopper.Kernel;
using Grasshopper.Kernel.Data;
using Grasshopper.Kernel.Types;

public class Script_Instance : GH_ScriptInstance
{
  /* 
    Members:
      RhinoDoc RhinoDocument
      GH_Document GrasshopperDocument
      IGH_Component Component
      int Iteration

    Methods (Virtual & overridable):
      Print(string text)
      Print(string format, params object[] args)
      Reflect(object obj)
      Reflect(object obj, string method_name)
  */
  
  private void RunScript(ref object corner, ref object nextToCorner)
  {
    // Write your logic here

    //Column 1 {0;0;*}
    string pathA = "{" + 0 + ";" + 0 + ";*}";
    corner = pathA;

    //Column 2 {1;0;*}
    string pathB = "{" + 1 + ";" + 0 + ";*}";

    //Column 2 {0;1;*} 
    string pathC = "{" + 0 + ";" + 1 + ";*}";


    List<object> secondColumns = new List<object>();
    secondColumns.Add(pathB);
    secondColumns.Add(pathC);


    nextToCorner = secondColumns;
  }
}
# ---------- end csharp_script_4 ----------
split_tree = SplitTree(Data=curve_2, Masks=flatten(csharp_script_4.corner))  # -> Positive, Negative
split_tree_2 = SplitTree(Data=curve_2, Masks=flatten(csharp_script_4.nextToCorner))  # -> Positive, Negative
split_tree_3 = SplitTree(Data=curve_2, Masks=flatten(csharp_script.corner))  # -> Positive, Negative
split_tree_4 = SplitTree(Data=curve_2, Masks=flatten(csharp_script.nextToCorner))  # -> Positive, Negative
split_tree_5 = SplitTree(Data=curve_2, Masks=flatten(csharp_script_3.corner))  # -> Positive, Negative
split_tree_6 = SplitTree(Data=curve_2, Masks=flatten(csharp_script_3.nextToCorner))  # -> Positive, Negative
split_tree_7 = SplitTree(Data=curve_2, Masks=flatten(csharp_script_2.corner))  # -> Positive, Negative
split_tree_8 = SplitTree(Data=curve_2, Masks=flatten(csharp_script_2.nextToCorner))  # -> Positive, Negative
curve_3 = Curve(split_tree_4.Positive)
curve_4 = Curve(split_tree.Positive)
curve_5 = Curve(split_tree_2.Positive)
curve_6 = Curve(split_tree_3.Positive)
curve_7 = Curve(split_tree_5.Positive)
curve_8 = Curve(split_tree_6.Positive)
curve_9 = Curve(split_tree_7.Positive)
curve_10 = Curve(split_tree_8.Positive)
panel = Panel([csharp_script_4.corner, csharp_script_4.nextToCorner])
end_points = EndPoints(Curve=curve_4)  # -> Start, End
end_points_2 = EndPoints(Curve=curve_5)  # -> Start, End
end_points_3 = EndPoints(Curve=curve_6)  # -> Start, End
end_points_4 = EndPoints(Curve=curve_3)  # -> Start, End
end_points_5 = EndPoints(Curve=curve_7)  # -> Start, End
end_points_6 = EndPoints(Curve=curve_8)  # -> Start, End
end_points_7 = EndPoints(Curve=curve_9)  # -> Start, End
end_points_8 = EndPoints(Curve=curve_10)  # -> Start, End
line = Line(StartPoint=end_points.Start, EndPoint=end_points_2.End)
line_2 = Line(StartPoint=end_points.End, EndPoint=end_points_2.Start)
line_3 = Line(StartPoint=end_points_3.Start, EndPoint=end_points_4.End)
line_4 = Line(StartPoint=end_points_3.End, EndPoint=end_points_4.Start)
line_5 = Line(StartPoint=end_points_5.Start, EndPoint=end_points_6.End)
line_6 = Line(StartPoint=end_points_5.End, EndPoint=end_points_6.Start)
line_7 = Line(StartPoint=end_points_7.Start, EndPoint=end_points_8.End)
line_8 = Line(StartPoint=end_points_7.End, EndPoint=end_points_8.Start)
cull_index = CullIndex(List=line_2, Indices="0", Wrap=True)
cull_index_2 = CullIndex(List=line_4, Indices="0", Wrap=True)
cull_index_3 = CullIndex(List=line_6, Indices="0", Wrap=True)
cull_index_4 = CullIndex(List=line_8, Indices="0", Wrap=True)
cull_nth = CullNth(List=[line, cull_index], CullFrequency=2)
cull_nth_2 = CullNth(List=[line_3, cull_index_2], CullFrequency=2)
cull_nth_3 = CullNth(List=[line_5, cull_index_3], CullFrequency=2)
cull_nth_4 = CullNth(List=[line_7, cull_index_4], CullFrequency=2)
list = ClusterOutput(cull_nth)
list_2 = ClusterOutput(cull_nth_2)
list_3 = ClusterOutput(cull_nth_3)
list_4 = ClusterOutput(cull_nth_4)

# ==== cluster Cluster_2
spacingy = ClusterInput()
spacingx = ClusterInput()
curve = ClusterInput()
curve_2 = Curve(simplify(curve))
spacingx_2 = Number(expr("x-1", spacingx))
spacingy_2 = Number(expr("x-1", spacingy))
csharp_script = CSharpScript(spacingY=spacingy_2, spacingX=spacingx_2)  # -> out, X1, X2, Y1, Y2; inputs spacingY: Int32, spacingX: Int32
# ---------- csharp_script: C# ----------
// Grasshopper Script Instance
using System;
using System.Collections;
using System.Collections.Generic;
using System.Drawing;

using Rhino;
using Rhino.Geometry;

using Grasshopper;
using Grasshopper.Kernel;
using Grasshopper.Kernel.Data;
using Grasshopper.Kernel.Types;

public class Script_Instance : GH_ScriptInstance
{
  /* 
    Members:
      RhinoDoc RhinoDocument
      GH_Document GrasshopperDocument
      IGH_Component Component
      int Iteration

    Methods (Virtual & overridable):
      Print(string text)
      Print(string format, params object[] args)
      Reflect(object obj)
      Reflect(object obj, string method_name)
  */
  
  private void RunScript(
	int spacingY,
	int spacingX,
	ref object X1,
	ref object X2,
	ref object Y1,
	ref object Y2)
  {
    // Write your logic here

    

    /*
    List<object> secondColumns = new List<object>();
    secondColumns.Add(pathB);
    secondColumns.Add(pathC);
    */


    //Facade x-spacing 
    List<object> x1 = new List<object>();
    for (int i = 0; i < spacingX ; i++)
    {
        string facade = "{0;" + i + "}";
        x1.Add(facade);
    }
    X1 = x1;

    List<object> x2 = new List<object>();
    for (int i = 0; i < spacingY ; i++)
    {
        string facade = "{" + i + ";" + spacingX + "}";
        x2.Add(facade);
    }
    X2 = x2;

    //Facade y-spacing 
    List<object> y1 = new List<object>();
    for (int i = 1; i < spacingY+1 ; i++)
    {
        string facade = "{" + i + ";0}";
        y1.Add(facade);
    }
    Y1 = y1;

    List<object> y2 = new List<object>();
    for (int i = 1; i < spacingX+1 ; i++)
    {
        string facade = "{" + spacingY + ";" + i + "}";
        y2.Add(facade);
    }
    Y2 = y2;
    
    



  }
}
# ---------- end csharp_script ----------
split_tree = SplitTree(Data=curve_2, Masks=flatten(csharp_script.X1))  # -> Positive, Negative
split_tree_2 = SplitTree(Data=curve_2, Masks=flatten(csharp_script.X2))  # -> Positive, Negative
split_tree_3 = SplitTree(Data=curve_2, Masks=flatten(csharp_script.Y1))  # -> Positive, Negative
split_tree_4 = SplitTree(Data=curve_2, Masks=flatten(csharp_script.Y2))  # -> Positive, Negative
split_tree_5 = SplitTree(Data=curve_2, Masks=flatten([csharp_script.X1, csharp_script.X2, csharp_script.Y1, csharp_script.Y2]))  # -> Positive, Negative
line = Line(split_tree.Positive)
line_2 = Line(split_tree_2.Positive)
line_3 = Line(split_tree_3.Positive)
line_4 = Line(split_tree_4.Positive)
merge = Merge(Data1=line, Data2=line_2, Data3=line_3, Data4=line_4)
line_5 = Line(split_tree_5.Negative)
facadecolumns = ClusterOutput(merge)
midcolumns = ClusterOutput(line_5)

# ==== cluster Cluster_3
geometry = ClusterInput()
minimumboundindbox = MinimumBoundindBox(Geometry=geometry)
xy_plane = XYPlane(Origin=Point(0, 0, 0))
brep = Brep(flatten(minimumboundindbox))
rotate = Rotate(Geometry=brep, Angle=1.570796327, Plane=xy_plane)  # -> Geometry, Transform
list_length = ListLength(List=brep)
series = Series(Start=0, Step=1, Count=list_length)
panel = Panel(brep)
construct_point = ConstructPoint(XCoordinate=series, YCoordinate=0, ZCoordinate=0)
volume = Volume(Geometry=brep)  # -> Volume, Centroid
orient = Orient(Geometry=brep, Source=volume.Centroid, Target=construct_point)  # -> Geometry, Transform
geometry_2 = ClusterOutput(orient.Geometry)
