# Grasshopper definition Study Case 3.gh (Grasshopper 1.0.8)
# plug-ins: Karamba3D, RhinoCodePluginGH, Heteroptera, Pufferfish, Minimum bounding box, LunchBox

license_karamba3d = LicenseKaramba3D()
this_gh_code_is_made_with_karamba3d_2_2 = Panel(license_karamba3d)  # "This GH-code is made with Karamba3D 2.2.0.180-230616"

# ---- group: VariableInputParameters
floors = Slider(3, range=1..6)
floorheight_m = Slider(4, range=2.4..4)

# ----
rectangle = Rectangle(Plane=PlaneXY(0, 0, 0), XSize="20", YSize="12", Radius=0)  # -> Rectangle, Length

# ---- group: RhinoInput
curve = Curve(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)

# ----
numbertransversebeamsdiv = Panel("3")

# ---- group: creating surfaces and floors
multiplication = Multiplication(A=floors, B=floorheight_m)
numberheight = Number(multiplication)
surface = Surface(rectangle.Rectangle)
area = Area(Geometry=surface)  # -> Area, Centroid
unit_z = UnitZ(Factor=numberheight)
line_sdl = LineSDL(Start=area.Centroid, Direction=unit_z, Length=numberheight)
perp_frames = PerpFrames(Curve=line_sdl, Count=floors, Align=True)  # -> Frames, Parameters
project = Project(Geometry=surface, Plane=perp_frames.Frames)  # -> Geometry, Transform

# ---- group: Spacing between supports
brep_edges = BrepEdges(Brep=surface)  # -> Naked, Interior, NonManifold
list_item = ListItem(List=brep_edges.Naked, Index=0, Wrap=True)  # -> Item, Item1, Item2, Item3
xspacing = Slider(5, range=2..5)
# XBeams
# YBeams
number_slider = Slider(4, range=2..6)
curve_2 = Curve(list_item.Item)
curve_3 = Curve(list_item.Item1)
curve_4 = Curve(list_item.Item2)
curve_5 = Curve(list_item.Item3)
point_divide_curve_target_length = PointDivideCurveTargetLength(Curve=curve_2, Target=xspacing, DivisionType="1", EndPoint=False)  # -> flatten(Points), Tangents, Parameters, Length, ResultBoolean
point_divide_curve_target_length_2 = PointDivideCurveTargetLength(Curve=curve_5, Target=number_slider, DivisionType="1", EndPoint=False)  # -> flatten(Points), Tangents, Parameters, Length, ResultBoolean
list_length = ListLength(List=point_divide_curve_target_length.Points)
list_length_2 = ListLength(List=point_divide_curve_target_length_2.Points)
panel = Panel(point_divide_curve_target_length.Length)
panel_2 = Panel(point_divide_curve_target_length_2.Length)
xdiv = Number(list_length)
ydiv = Number(list_length_2)
panel_3 = Panel(xdiv)
panel_4 = Panel(ydiv)

# ---- group: floors
boolean_toggle = BooleanToggle(True)
split_tree = SplitTree(Data=project.Geometry, Masks=flatten("{0;0}[0]"))  # -> Positive, Negative
clean_tree = CleanTree(RemoveNulls=True, RemoveInvalid=True, RemoveEmpty=boolean_toggle, Tree=split_tree.Positive)
clean_tree_2 = CleanTree(RemoveNulls=True, RemoveInvalid=True, RemoveEmpty=boolean_toggle, Tree=split_tree.Negative)
surfacegroundfloor = Surface(clean_tree)
surfacefloors = Surface(clean_tree_2)

# ---- group: creating nodes
divide_surface = DivideSurface(Surface=project.Geometry, UCount=expr("x-1", xdiv), VCount=expr("x-1", ydiv))  # -> Points, Normals, Parameters
csharp_script = CSharpScript(inodes=divide_surface.Points)  # -> out, ground, not_ground; inputs inodes: list of Point3d
# ---------- csharp_script: C# ----------
// Grasshopper Script Instance
using System;
using System.Collections;
using System.Collections.Generic;
using System.Drawing;

using Rhino;
using Rhino.Geometry;

using Grasshopper;
using Grasshopper.Kernel;
using Grasshopper.Kernel.Data;
using Grasshopper.Kernel.Types;

public class Script_Instance : GH_ScriptInstance
{
  /* 
    Members:
      RhinoDoc RhinoDocument
      GH_Document GrasshopperDocument
      IGH_Component Component
      int Iteration

    Methods (Virtual & overridable):
      Print(string text)
      Print(string format, params object[] args)
      Reflect(object obj)
      Reflect(object obj, string method_name)
  */
  
  private void RunScript(
	IList<Point3d> inodes,
	ref object ground,
	ref object not_ground)
  {
    // Write your logic here

    List<Point3d> ground_floor = new List<Point3d>();
    List<Point3d> not_ground_floor = new List<Point3d>();

    for (int i = 0 ; i < inodes.Count ; i++)
    {
        if (inodes[i].Z == 0)
        {
            ground_floor.Add(inodes[i]);
        }
        else if (inodes[i].Z != 0)
        {
            not_ground_floor.Add(inodes[i]);
        }
    }

    


    ground = ground_floor;
    not_ground = not_ground_floor;

  }
}
# ---------- end csharp_script ----------
clean_tree_3 = CleanTree(RemoveNulls=True, RemoveInvalid=True, RemoveEmpty=Toggle(True), Tree=csharp_script.not_ground)
clean_tree_4 = CleanTree(RemoveNulls=True, RemoveInvalid=True, RemoveEmpty=Toggle(True), Tree=csharp_script.ground)
pointground = Point(simplify(clean_tree_4))
pointfloors = Point(simplify(clean_tree_3))

# ---- group: facades
numberheight_2 = Number(numberheight)
box_rectangle = BoxRectangle(Rectangle=surfacegroundfloor, Height=numberheight_2)
deconstruct_brep = DeconstructBrep(Brep=box_rectangle)  # -> Faces, Edges, Vertices
list_item_2 = ListItem(List=deconstruct_brep.Faces, Index="3", Wrap=True)
list_item_3 = ListItem(List=deconstruct_brep.Faces, Index="2", Wrap=True)
list_item_4 = ListItem(List=deconstruct_brep.Faces, Index="0", Wrap=True)
list_item_5 = ListItem(List=deconstruct_brep.Faces, Index="1", Wrap=True)
surfacexfacade2 = Surface(list_item_2)
surfaceyfacade1 = Surface(list_item_4)
surfaceyfacade2 = Surface(list_item_3)
surfacexfacade1 = Surface(list_item_5)

# ---- group: Columns
point = Point(simplify(divide_surface.Points))
path_mapper = PathMapper(point, source="{A;B}(i)", target="{i;B}(A)")
polylinecolumn = PolyLine(Vertices=path_mapper, Closed=False)
explode = Explode(Curve=polylinecolumn, Recursive=True)  # -> Segments, Vertices
curve_6 = Curve(explode.Segments)
cluster = Cluster_2(curve=curve_6, spacingy=ydiv, spacingx=xdiv)  # -> facadecolumns, midcolumns
line = Line(cluster.facadecolumns)
line_2 = Line(cluster.midcolumns)

# ---- group: MainBeamsXAll
point_2 = Point(pointfloors)
path_mapper_2 = PathMapper(point_2, source="{A;B}(i)", target="{i;A}(B)")
polylinebeamsx = PolyLine(Vertices=path_mapper_2, Closed=False)
explode_2 = Explode(Curve=polylinebeamsx, Recursive=True)  # -> Segments, Vertices
curve_7 = Curve(explode_2.Segments)

# ---- group: MainBeamX Splitted for loading
# BeamWithLoad
ydiv_2 = Number(expr("x-1", ydiv))
concatenate = Concatenate(Fragment_A="{", Fragment_B=ydiv_2, A=";*;*}")  # -> flatten(Result)
split_tree_2 = SplitTree(Data=curve_7, Masks=flatten(["{0;*;*}", concatenate]))  # -> Positive, Negative
curvemiddle = Curve(flatten(split_tree_2.Negative))
curveedges = Curve(flatten(split_tree_2.Positive))

# ---- group: MainBeamsY_FullLength
point_3 = Point(pointfloors)
polylinebeamsy = PolyLine(Vertices=point_3, Closed=False)
explode_3 = Explode(Curve=polylinebeamsy, Recursive=True)  # -> Segments, Vertices
curve_8 = Curve(explode_3.Segments)

# ---- group: MainBeamsY_Splitted
curvebeamsy = Curve(curve_8)
divide_curve = DivideCurve(Curve=curvebeamsy, CountNumberTransB=numbertransversebeamsdiv, Kinks=False)  # -> Points, Tangents, Parameters
polyline = PolyLine(Vertices=divide_curve.Points, Closed=False)
explode_4 = Explode(Curve=polyline, Recursive=True)  # -> Segments, Vertices
curve_9 = Curve(simplify(explode_4.Segments))
csharp_script_2 = CSharpScript(iFloors=floors, iSpacingX=xdiv)  # -> out, masks; inputs iFloors: Double, iSpacingX: Double
# ---------- csharp_script_2: C# ----------
// Grasshopper Script Instance
using System;
using System.Collections;
using System.Collections.Generic;
using System.Drawing;

using Rhino;
using Rhino.Geometry;

using Grasshopper;
using Grasshopper.Kernel;
using Grasshopper.Kernel.Data;
using Grasshopper.Kernel.Types;

public class Script_Instance : GH_ScriptInstance
{
  /* 
    Members:
      RhinoDoc RhinoDocument
      GH_Document GrasshopperDocument
      IGH_Component Component
      int Iteration

    Methods (Virtual & overridable):
      Print(string text)
      Print(string format, params object[] args)
      Reflect(object obj)
      Reflect(object obj, string method_name)
  */
  
  private void RunScript(double iFloors, double iSpacingX, ref object masks)
  {
    // Write your logic here

    //masks

    List<object> maskList = new List<object>();
    for (int i = 0 ; i<iFloors ; i++)
    {
        string firstBeam = "{*;0;" + i + "}";
        maskList.Add(firstBeam);
        
        string nextBeam = "{" + "*;" + (iSpacingX-1) + ";" + i + "}";
        maskList.Add(nextBeam);
        
    }
    
    /*
    for (int j = 0; j < iSpacingX; j++)
    {
        string Beam = "{*;" + j + ";*}";
        maskList.Add(Beam);
    }*/
    masks = maskList;
  }
}
# ---------- end csharp_script_2 ----------
split_tree_3 = SplitTree(Data=curve_9, Masks=flatten(csharp_script_2.masks))  # -> Positive, Negative
line_3 = Line(split_tree_3.Negative)
line_4 = Line(split_tree_3.Positive)

# ---- group: MainBeamsY Splitted w. division for joints
list_length_3 = ListLength(List=line_4)
subtraction = Subtraction(A=list_length_3, B="2")
tree_branch = TreeBranch(Tree=subtraction, Path="{1;0;0}", MaintainPaths=True)  # -> flatten(Branch)
merge = Merge(Data1="1", Data2=tree_branch, Data3="1")
partition_list = PartitionList(List=line_4, Size=merge)
split_tree_4 = SplitTree(Data=partition_list, Masks=flatten("{*;*;*;0}"))  # -> Positive, Negative
split_tree_5 = SplitTree(Data=partition_list, Masks=flatten("{*;*;*;1}"))  # -> Positive, Negative
split_tree_6 = SplitTree(Data=partition_list, Masks=flatten("{*;*;*;2}"))  # -> Positive, Negative
entwine = Entwine(Branch00=split_tree_4.Positive, Branch01=split_tree_5.Positive, Branch02=split_tree_6.Positive, FlattenInputs=True)  # -> simplify(Result)

list_length_4 = ListLength(List=line_3)
subtraction_2 = Subtraction(A=list_length_4, B="2")
tree_branch_2 = TreeBranch(Tree=subtraction_2, Path="{1;1;0}", MaintainPaths=True)  # -> flatten(Branch)
merge_2 = Merge(Data1="1", Data2=tree_branch_2, Data3="1")
partition_list_2 = PartitionList(List=line_3, Size=merge_2)
split_tree_7 = SplitTree(Data=partition_list_2, Masks=flatten("{*;*;*;0}"))  # -> Positive, Negative
split_tree_8 = SplitTree(Data=partition_list_2, Masks=flatten("{*;*;*;1}"))  # -> Positive, Negative
split_tree_9 = SplitTree(Data=partition_list_2, Masks=flatten("{*;*;*;2}"))  # -> Positive, Negative
entwine_2 = Entwine(Branch00=split_tree_7.Positive, Branch01=split_tree_8.Positive, Branch02=split_tree_9.Positive, FlattenInputs=True)  # -> simplify(Result)

# ---- group: TransverseBeams
point_4 = Point(divide_curve.Points)
split_list = SplitList(List=point_4, Index="1")  # -> ListA, ListB
reverse_list = ReverseList(List=split_list.ListB)
split_list_2 = SplitList(List=reverse_list, Index="1")  # -> ListA, ListB
reverse_list_2 = ReverseList(List=split_list_2.ListB)  # -> simplify(List)
point_5 = Point(reverse_list_2)
path_mapper_3 = PathMapper(point_5, source="{A;B;C}(i)", target="{A;i;C} (B)")
polylinetranversebeams = PolyLine(Vertices=path_mapper_3, Closed=False)
explode_5 = Explode(Curve=polylinetranversebeams, Recursive=True)  # -> Segments, Vertices
curve_10 = Curve(explode_5.Segments)

# ---- group: SupportPoints
point_6 = Point(simplify(pointground))

# ---- group: Supports
support_karamba3d = SupportKaramba3D(PosInd=point_6, menu=[buttons(on, on, on, on, on, on)])

# ----
support_karamba3d_2 = SupportKaramba3D(flatten(support_karamba3d))

# ---- group: Demand Bank
# Your file path to the Excel sheet shoud be inserted here:
panel_5 = Panel("C:\Users\rakel\OneDrive - NTNU\Dokumenter\TKT4950 Master's thesis\08 Final versions\Results\MatchingAlgorithmCaseStudy2.xlsx")

# ---- group: Cross Sections
material_selection_karamba3d = MaterialSelectionKaramba3D(menu=[dropdown(4), dropdown(11)])
material_selection_karamba3d_2 = MaterialSelectionKaramba3D(menu=[dropdown(1), dropdown(4)])
material_karamba3d = MaterialKaramba3D(material_selection_karamba3d)
gene_pool = GenePool(
    Decimals=0,
    Maximum=15,
    Minimum=9,
    Value=[11, 10, 9, 9, 9, 9, 10, 9, 9, 10, 9, 10, 9, 9, 10, 9, 11, 10, 10, 9, 11, 9, 11, 10])
gene_pool_2 = GenePool(Decimals=0, Maximum=13, Minimum=7, Value=[7, 9, 8, 11, 9, 8, 8, 11, 8, 8, 9, 8, 8, 7, 9, 8, 8, 8, 7, 9, 8, 7, 8, 9])
gene_pool_3 = GenePool(
    Decimals=0,
    Maximum=17,
    Minimum=11,
    Value=[12, 12, 12, 11, 11, 13, 13, 13, 11, 11, 11, 14, 11, 14, 11, 13, 11, 12, 13, 13, 12, 12, 14, 14])
gene_pool_4 = GenePool(Decimals=0, Maximum=19, Minimum=13, Value=[14, 17, 13, 15, 16, 16, 14, 16, 17, 14, 14, 18, 17, 13])
gene_pool_5 = GenePool(Decimals=0, Maximum=11, Minimum=7, Value=[7, 7, 7, 7, 7, 8, 9, 7, 7, 7, 8, 7, 7, 8, 7, 7, 7, 7, 7, 7, 8, 8, 7, 7])
gene_pool_6 = GenePool(Decimals=0, Maximum=14, Minimum=7, Value=[7, 7, 11, 8, 12, 9, 8, 10, 8, 7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])
gene_pool_7 = GenePool(Decimals=0, Maximum=17, Minimum=11, Value=[13, 14, 12, 13, 13, 13, 12, 13, 13, 13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])
gene_pool_8 = GenePool(Decimals=0, Maximum=22, Minimum=16, Value=[17, 21, 17, 20, 17, 20])
gene_pool_9 = GenePool(Decimals=0, Maximum=10, Minimum=7, Value=[7, 8, 7, 7, 8, 8, 7, 7, 9, 9, 7, 8, 7, 8, 8, 8, 9, 8])
gene_pool_10 = GenePool(Decimals=0, Maximum=18, Minimum=13, Value=[14, 14, 14, 14, 14, 13, 14, 14, 17, 13, 14, 13, 14, 13, 13, 13, 17, 14])
gene_pool_11 = GenePool(
    Decimals=0,
    Maximum=18,
    Minimum=13,
    Value=[16, 14, 17, 13, 15, 14, 15, 16, 13, 14, 16, 14, 15, 15, 14, 13, 13, 16, 16, 15, 14, 15, 13, 16])
gene_pool_12 = GenePool(
    Decimals=0,
    Maximum=11,
    Minimum=7,
    Value=[7, 7, 8, 7, 9, 7, 8, 9, 8, 7, 7, 9, 7, 7, 7, 9, 7, 7, 10, 7, 7, 8, 9, 7, 8, 10, 7])
gene_pool_13 = GenePool(
    Decimals=0,
    Maximum=22,
    Minimum=16,
    Value=[19, 19, 16, 16, 19, 16, 16, 16, 17, 19, 17, 16, 20, 16, 16, 17, 20, 16, 21, 17, 16, 16, 17, 19, 16, 19, 17])
division = Division(A=gene_pool_11, B=2)
division_2 = Division(A=division, B=2)

# ---- group: Brazing
cluster_2 = Cluster(curve=curve_6, spacingy=expr("x-1", ydiv), spacingx=expr("x-1", xdiv))  # -> list, list_2, list_3, list_4

# {0,0}
# {4,5}
line_5 = Line(simplify(cluster_2.list))
line_6 = Line(simplify(cluster_2.list_2))

# {4,0}
# {0,5}
line_7 = Line(simplify(cluster_2.list_3))
line_8 = Line(simplify(cluster_2.list_4))

merge_3 = Merge(Data1=line_5, Data2=line_6, Data3=line_7, Data4=line_8)

# ---- group: Elements
tree_branch_3 = TreeBranch(Tree=entwine, Path="2", MaintainPaths=True)
tree_branch_4 = TreeBranch(Tree=entwine_2, Path="1", MaintainPaths=True)
tree_branch_5 = TreeBranch(Tree=entwine_2, Path="0", MaintainPaths=True)
tree_branch_6 = TreeBranch(Tree=entwine, Path="1", MaintainPaths=True)
tree_branch_7 = TreeBranch(Tree=entwine_2, Path="2", MaintainPaths=True)
tree_branch_8 = TreeBranch(Tree=entwine, Path="0", MaintainPaths=True)
list_item_6 = ListItem(List=line, Index="2", Wrap=True)  # -> flatten(Item)
list_item_7 = ListItem(List=line, Index=0, Wrap=True)  # -> flatten(Item)
list_item_8 = ListItem(List=line, Index="1", Wrap=True)  # -> flatten(Item)
list_item_9 = ListItem(List=line_2, Index=0, Wrap=True)  # -> flatten(Item)
list_item_10 = ListItem(List=line_2, Index="1", Wrap=True)  # -> flatten(Item)
list_item_11 = ListItem(List=line_2, Index="2", Wrap=True)  # -> flatten(Item)
list_length_5 = ListLength(List=list_item_10)
list_length_6 = ListLength(List=curveedges)
list_length_7 = ListLength(List=curvemiddle)
list_length_8 = ListLength(List=tree_branch_3)
list_length_9 = ListLength(List=tree_branch_8)
list_length_10 = ListLength(List=tree_branch_6)
list_length_11 = ListLength(List=tree_branch_5)
list_length_12 = ListLength(List=tree_branch_7)
list_length_13 = ListLength(List=tree_branch_4)
list_length_14 = ListLength(List=list_item_7)
list_length_15 = ListLength(List=list_item_7)
list_length_16 = ListLength(List=list_item_8)
list_length_17 = ListLength(List=list_item_8)
series = Series(Start=0, Step=1, Count=list_length_6)
list_length_18 = ListLength(List=list_item_6)
list_length_19 = ListLength(List=list_item_6)
series_2 = Series(Start=0, Step=1, Count=list_length_7)
list_length_20 = ListLength(List=list_item_10)
list_length_21 = ListLength(List=list_item_11)
list_length_22 = ListLength(List=list_item_11)
list_length_23 = ListLength(List=list_item_9)
list_length_24 = ListLength(List=list_item_9)
series_3 = Series(Start=0, Step=1, Count=list_length_8)
series_4 = Series(Start=0, Step=1, Count=list_length_11)
series_5 = Series(Start=0, Step=1, Count=list_length_12)
series_6 = Series(Start=0, Step=1, Count=list_length_13)
series_7 = Series(Start=0, Step=1, Count=list_length_9)
series_8 = Series(Start=0, Step=1, Count=list_length_10)
concatenate_2 = Concatenate(FragmentA="SB1out_name_", FragmentB=series)  # -> simplify(Result)
series_9 = Series(Start=0, Step=1, Count=list_length_14)
series_10 = Series(Start=0, Step=1, Count=list_length_17)
concatenate_3 = Concatenate(FragmentA="SB1in_name_", FragmentB=series_2)  # -> simplify(Result)
series_11 = Series(Start=0, Step=1, Count=list_length_18)
series_12 = Series(Start=0, Step=1, Count=list_length_20)
series_13 = Series(Start=0, Step=1, Count=list_length_24)
series_14 = Series(Start=0, Step=1, Count=list_length_21)
concatenate_4 = Concatenate(FragmentA="MainOut_Right_name_", FragmentB=series_3)  # -> simplify(Result)
concatenate_5 = Concatenate(FragmentA="MainIn_Left_name_", FragmentB=series_4)  # -> simplify(Result)
concatenate_6 = Concatenate(FragmentA="MainIn_Mid_name_", FragmentB=series_6)  # -> simplify(Result)
concatenate_7 = Concatenate(FragmentA="MainOut_Left_name_", FragmentB=series_7)  # -> simplify(Result)
concatenate_8 = Concatenate(FragmentA="MainOut_Mid_name_", FragmentB=series_8)  # -> simplify(Result)
concatenate_9 = Concatenate(FragmentA="MainIn_Right_name_", FragmentB=series_5)  # -> simplify(Result)
concatenate_10 = Concatenate(FragmentA="facC_1_name_", FragmentB=series_9)  # -> simplify(Result)
concatenate_11 = Concatenate(FragmentA="facC_2_name_", FragmentB=series_10)  # -> simplify(Result)
concatenate_12 = Concatenate(FragmentA="facC_3_name_", FragmentB=series_11)  # -> simplify(Result)
concatenate_13 = Concatenate(FragmentA="midC_1_name_", FragmentB=series_13)  # -> simplify(Result)
concatenate_14 = Concatenate(FragmentA="midC_3_name_", FragmentB=series_14)  # -> simplify(Result)
concatenate_15 = Concatenate(FragmentA="midC_2_name_", FragmentB=series_12)  # -> simplify(Result)
panel_6 = Panel(concatenate_4)
panel_7 = Panel(concatenate_5)
panel_8 = Panel(concatenate_6)
panel_9 = Panel(concatenate_8)
panel_10 = Panel(concatenate_9)
panel_11 = Panel(concatenate_7)
panel_12 = Panel(concatenate_12)
panel_13 = Panel(concatenate_10)
panel_14 = Panel(concatenate_11)
panel_15 = Panel(concatenate_13)
panel_16 = Panel(concatenate_15)
panel_17 = Panel(concatenate_14)
unit_z_2 = UnitZ(Factor=1)
unit_z_3 = UnitZ(Factor=1)
unit_z_4 = UnitZ(Factor=1)
unit_z_5 = UnitZ(Factor=1)
unit_z_6 = UnitZ(Factor=1)
unit_z_7 = UnitZ(Factor=1)
unit_z_8 = UnitZ(Factor=1)
unit_z_9 = UnitZ(Factor=1)
unit_z_10 = UnitZ(Factor=1)
unit_z_11 = UnitZ(Factor=1)
line_9 = Line(curveedges)
line_10 = Line(curvemiddle)
line_11 = Line(flatten(curve_10))
list_length_25 = ListLength(List=line_11)
series_15 = Series(Start=0, Step=1, Count=list_length_25)
concatenate_16 = Concatenate(FragmentA="SB2_name_", FragmentB=series_15)  # -> simplify(Result)
panel_18 = Panel(concatenate_16)
line_12 = Line(flatten(merge_3))
list_length_26 = ListLength(List=line_12)
series_16 = Series(Start=0, Step=1, Count=list_length_26)
concatenate_17 = Concatenate(FragmentA="B_name_", FragmentB=series_16)  # -> simplify(Result)
panel_19 = Panel(concatenate_17)
line_13 = Line(flatten(list_item_6))
line_14 = Line(flatten(list_item_8))
line_15 = Line(flatten(list_item_7))
line_16 = Line(flatten(list_item_10))
line_17 = Line(flatten(list_item_9))
line_18 = Line(flatten(list_item_11))
line_to_beam_karamba3d = LineToBeamKaramba3D(
    Line=tree_branch_3,
    Identifier=panel_6,
    New=True,
    Remove=True,
    LimitDistance_m=0.005,
    ZOrientation=unit_z_3,
    Bending=True,
    SetBucklingLength=True,
    ToPolylineMaxAngle=0.03,
    ToPolylineTolerance=0.01,
    ToPolylineMaxEdgeLength=0.25)  # -> simplify(Element), Points, Info
line_to_beam_karamba3d_2 = LineToBeamKaramba3D(
    Line=tree_branch_8,
    Identifier=panel_11,
    New=True,
    Remove=True,
    LimitDistance_m=0.005,
    ZOrientation=unit_z_9,
    Bending=True,
    SetBucklingLength=True,
    ToPolylineMaxAngle=0.03,
    ToPolylineTolerance=0.01,
    ToPolylineMaxEdgeLength=0.25)  # -> simplify(Element), Points, Info
line_to_beam_karamba3d_3 = LineToBeamKaramba3D(
    Line=tree_branch_5,
    Identifier=panel_7,
    New=True,
    Remove=True,
    LimitDistance_m=0.005,
    ZOrientation=unit_z_4,
    Bending=True,
    SetBucklingLength=True,
    ToPolylineMaxAngle=0.03,
    ToPolylineTolerance=0.01,
    ToPolylineMaxEdgeLength=0.25)  # -> simplify(Element), Points, Info
line_to_beam_karamba3d_4 = LineToBeamKaramba3D(
    Line=tree_branch_6,
    Identifier=panel_9,
    New=True,
    Remove=True,
    LimitDistance_m=0.005,
    ZOrientation=unit_z_7,
    Bending=True,
    SetBucklingLength=True,
    ToPolylineMaxAngle=0.03,
    ToPolylineTolerance=0.01,
    ToPolylineMaxEdgeLength=0.25)  # -> simplify(Element), Points, Info
line_to_beam_karamba3d_5 = LineToBeamKaramba3D(
    Line=tree_branch_4,
    Identifier=panel_8,
    New=True,
    Remove=True,
    LimitDistance_m=0.005,
    ZOrientation=unit_z_8,
    Bending=True,
    SetBucklingLength=True,
    ToPolylineMaxAngle=0.03,
    ToPolylineTolerance=0.01,
    ToPolylineMaxEdgeLength=0.25)  # -> simplify(Element), Points, Info
line_to_beam_karamba3d_6 = LineToBeamKaramba3D(
    Line=tree_branch_7,
    Identifier=panel_10,
    New=True,
    Remove=True,
    LimitDistance_m=0.005,
    ZOrientation=unit_z_2,
    Bending=True,
    SetBucklingLength=True,
    ToPolylineMaxAngle=0.03,
    ToPolylineTolerance=0.01,
    ToPolylineMaxEdgeLength=0.25)  # -> simplify(Element), Points, Info
line_to_beam_karamba3d_7 = LineToBeamKaramba3D(
    Line=line_9,
    Identifier=concatenate_2,
    New=True,
    Remove=True,
    LimitDistance_m=0.005,
    ZOrientation=unit_z_5,
    Bending=True,
    SetBucklingLength=True,
    ToPolylineMaxAngle=0.03,
    ToPolylineTolerance=0.01,
    ToPolylineMaxEdgeLength=0.25)  # -> Element, Points, Info
line_to_beam_karamba3d_8 = LineToBeamKaramba3D(
    Line=line_10,
    Identifier=concatenate_3,
    New=True,
    Remove=True,
    LimitDistance_m=0.005,
    ZOrientation=unit_z_6,
    Bending=True,
    SetBucklingLength=True,
    ToPolylineMaxAngle=0.03,
    ToPolylineTolerance=0.01,
    ToPolylineMaxEdgeLength=0.25)  # -> Element, Points, Info
line_to_beam_karamba3d_9 = LineToBeamKaramba3D(
    Line=line_12,
    Identifier=panel_19,
    New=True,
    Remove=True,
    LimitDistance_m=0.005,
    ZOrientation=unit_z_11,
    Bending=False,
    SetBucklingLength=False,
    ToPolylineMaxAngle=0.03,
    ToPolylineTolerance=0.01,
    ToPolylineMaxEdgeLength=0.25)  # -> Element, Points, Info
line_to_beam_karamba3d_10 = LineToBeamKaramba3D(
    Line=line_15,
    Identifier=panel_13,
    New=True,
    Remove=True,
    LimitDistance_m=0.005,
    Bending=True,
    SetBucklingLength=True,
    ToPolylineMaxAngle=0.03,
    ToPolylineTolerance=0.01,
    ToPolylineMaxEdgeLength=0.25)  # -> Element, Points, Info
line_to_beam_karamba3d_11 = LineToBeamKaramba3D(
    Line=line_14,
    Identifier=panel_14,
    New=True,
    Remove=True,
    LimitDistance_m=0.005,
    Bending=True,
    SetBucklingLength=True,
    ToPolylineMaxAngle=0.03,
    ToPolylineTolerance=0.01,
    ToPolylineMaxEdgeLength=0.25)  # -> Element, Points, Info
line_to_beam_karamba3d_12 = LineToBeamKaramba3D(
    Line=line_13,
    Identifier=panel_12,
    New=True,
    Remove=True,
    LimitDistance_m=0.005,
    Bending=True,
    SetBucklingLength=True,
    ToPolylineMaxAngle=0.03,
    ToPolylineTolerance=0.01,
    ToPolylineMaxEdgeLength=0.25)  # -> Element, Points, Info
line_to_beam_karamba3d_13 = LineToBeamKaramba3D(
    Line=line_16,
    Identifier=panel_16,
    New=True,
    Remove=True,
    LimitDistance_m=0.005,
    Bending=True,
    SetBucklingLength=True,
    ToPolylineMaxAngle=0.03,
    ToPolylineTolerance=0.01,
    ToPolylineMaxEdgeLength=0.25)  # -> Element, Points, Info
line_to_beam_karamba3d_14 = LineToBeamKaramba3D(
    Line=line_18,
    Identifier=panel_17,
    New=True,
    Remove=True,
    LimitDistance_m=0.005,
    Bending=True,
    SetBucklingLength=True,
    ToPolylineMaxAngle=0.03,
    ToPolylineTolerance=0.01,
    ToPolylineMaxEdgeLength=0.25)  # -> Element, Points, Info
line_to_beam_karamba3d_15 = LineToBeamKaramba3D(
    Line=line_17,
    Identifier=panel_15,
    New=True,
    Remove=True,
    LimitDistance_m=0.005,
    Bending=True,
    SetBucklingLength=True,
    ToPolylineMaxAngle=0.03,
    ToPolylineTolerance=0.01,
    ToPolylineMaxEdgeLength=0.25)  # -> Element, Points, Info
line_to_beam_karamba3d_16 = LineToBeamKaramba3D(
    Line=line_11,
    Identifier=panel_18,
    New=True,
    Remove=True,
    LimitDistance_m=0.005,
    ZOrientation=unit_z_10,
    Bending=True,
    SetBucklingLength=True,
    ToPolylineMaxAngle=0.03,
    ToPolylineTolerance=0.01,
    ToPolylineMaxEdgeLength=0.25)  # -> Element, Points, Info
data = Data([line_to_beam_karamba3d_9.Element, line_to_beam_karamba3d_16.Element, line_to_beam_karamba3d_7.Element, line_to_beam_karamba3d_8.Element, line_to_beam_karamba3d_3.Element, line_to_beam_karamba3d_5.Element, line_to_beam_karamba3d_6.Element, line_to_beam_karamba3d_4.Element, line_to_beam_karamba3d.Element, line_to_beam_karamba3d_2.Element, line_to_beam_karamba3d_15.Element, line_to_beam_karamba3d_13.Element, line_to_beam_karamba3d_14.Element, line_to_beam_karamba3d_10.Element, line_to_beam_karamba3d_11.Element, line_to_beam_karamba3d_12.Element])

# ----
panel_20 = Panel(concatenate_6)
panel_21 = Panel(concatenate_9)
panel_22 = Panel(panel_7)
panel_23 = Panel(concatenate_4)
panel_24 = Panel(concatenate_13)
panel_25 = Panel(panel_11)
panel_26 = Panel(concatenate_8)
panel_27 = Panel(concatenate_15)
panel_28 = Panel(concatenate_14)
panel_29 = Panel(concatenate_10)
panel_30 = Panel(concatenate_11)
panel_31 = Panel(concatenate_12)
panel_32 = Panel(concatenate_2)
panel_33 = Panel(concatenate_3)
panel_34 = Panel(concatenate_16)
panel_35 = Panel(concatenate_17)

# ---- group: Cross Sections (continued)
list_length_27 = ListLength(List=panel_32)
list_length_28 = ListLength(List=tree_branch_8)
list_length_29 = ListLength(List=tree_branch_6)
list_length_30 = ListLength(List=tree_branch_3)
list_length_31 = ListLength(List=panel_33)
list_length_32 = ListLength(List=panel_34)
series_17 = Series(Start=0, Step=1, Count=list_length_23)
series_18 = Series(Start=0, Step=1, Count=list_length_5)
list_length_33 = ListLength(List=panel_35)
series_19 = Series(Start=0, Step=1, Count=list_length_22)
series_20 = Series(Start=0, Step=1, Count=list_length_15)
series_21 = Series(Start=0, Step=1, Count=list_length_27)
series_22 = Series(Start=0, Step=1, Count=list_length_16)
series_23 = Series(Start=0, Step=1, Count=flatten(list_length_29))
series_24 = Series(Start=0, Step=1, Count=flatten(list_length_28))
series_25 = Series(Start=0, Step=1, Count=list_length_19)
series_26 = Series(Start=0, Step=1, Count=flatten(list_length_30))
series_27 = Series(Start=0, Step=1, Count=list_length_31)
series_28 = Series(Start=0, Step=1, Count=list_length_32)
concatenate_18 = Concatenate(FragmentA="midC_1_CS_", FragmentB=series_17)  # -> simplify(Result)
concatenate_19 = Concatenate(FragmentA="midC_2_CS_", FragmentB=series_18)  # -> simplify(Result)
series_29 = Series(Start=0, Step=1, Count=list_length_33)
concatenate_20 = Concatenate(FragmentA="midC_3_CS_", FragmentB=series_19)  # -> simplify(Result)
concatenate_21 = Concatenate(FragmentA="facC_1_CS_", FragmentB=series_20)  # -> simplify(Result)
concatenate_22 = Concatenate(FragmentA="SB1out_CS_", FragmentB=series_21)  # -> simplify(Result)
concatenate_23 = Concatenate(FragmentA="facC_2_CS_", FragmentB=series_22)  # -> simplify(Result)
concatenate_24 = Concatenate(FragmentA="MainOut_Left_CS_", FragmentB=series_24)  # -> simplify(flatten(Result))
concatenate_25 = Concatenate(FragmentA="facC_3_CS_", FragmentB=series_25)  # -> simplify(Result)
concatenate_26 = Concatenate(FragmentA="MainOut_Mid_CS_", FragmentB=series_23)  # -> simplify(flatten(Result))
concatenate_27 = Concatenate(FragmentA="SB1in_CS_", FragmentB=series_27)  # -> simplify(Result)
concatenate_28 = Concatenate(FragmentA="MainOut_Right_CS_", FragmentB=series_26)  # -> simplify(flatten(Result))
concatenate_29 = Concatenate(FragmentA="SB2_CS_", FragmentB=series_28)  # -> simplify(Result)
concatenate_30 = Concatenate(FragmentA="B_CS_", FragmentB=series_29)  # -> simplify(Result)
panel_36 = Panel(panel_32)
panel_37 = Panel(panel_25)
panel_38 = Panel(panel_26)
panel_39 = Panel(panel_23)
panel_40 = Panel(panel_22)
list_length_34 = ListLength(List=panel_40)
series_30 = Series(Start=0, Step=1, Count=list_length_34)
concatenate_31 = Concatenate(FragmentA="MainIn_Left_CS_", FragmentB=series_30)  # -> simplify(flatten(Result))
panel_41 = Panel(panel_34)
panel_42 = Panel(panel_33)
panel_43 = Panel(panel_20)
list_length_35 = ListLength(List=panel_43)
series_31 = Series(Start=0, Step=1, Count=list_length_35)
concatenate_32 = Concatenate(FragmentA="MainIn_Mid_CS_", FragmentB=series_31)  # -> simplify(flatten(Result))
panel_44 = Panel(panel_21)
list_length_36 = ListLength(List=panel_44)
series_32 = Series(Start=0, Step=1, Count=list_length_36)
concatenate_33 = Concatenate(FragmentA="MainIn_Right_CS_", FragmentB=series_32)  # -> simplify(flatten(Result))
panel_45 = Panel(panel_35)
panel_46 = Panel(panel_24)
panel_47 = Panel(panel_27)
panel_48 = Panel(panel_29)
panel_49 = Panel(panel_28)
panel_50 = Panel(panel_30)
panel_51 = Panel(panel_31)
cross_section_karamba3d = CrossSectionKaramba3D(
    FamilyNameOfCrossSection="DefaultCroSec",
    NameOfCrossSection=concatenate_22,
    ElementIdentifier=panel_36,
    Material=material_karamba3d,
    Height_cm=expr("x*2", gene_pool_3),
    UpperFlangeWidth_cm=expr("x*2", gene_pool_2),
    LowerFlangeWidth_cm=expr("x*2", gene_pool_2),
    mode="Trapezoid")
cross_section_karamba3d_2 = CrossSectionKaramba3D(
    FamilyNameOfCrossSection="DefaultCroSec",
    NameOfCrossSection=concatenate_27,
    ElementIdentifier=panel_42,
    Material=material_karamba3d,
    Height_cm=expr("x*2", gene_pool),
    UpperFlangeWidth_cm=expr("x*2", gene_pool_5),
    LowerFlangeWidth_cm=expr("x*2", gene_pool_5),
    mode="Trapezoid")
cross_section_karamba3d_3 = CrossSectionKaramba3D(
    FamilyNameOfCrossSection="DefaultCroSec",
    NameOfCrossSection=concatenate_29,
    ElementIdentifier=panel_41,
    Material=material_karamba3d,
    Height_cm=expr("x*2", gene_pool_7),
    UpperFlangeWidth_cm=expr("x*2", gene_pool_6),
    LowerFlangeWidth_cm=expr("x*2", gene_pool_6),
    mode="Trapezoid")
cross_section_karamba3d_4 = CrossSectionKaramba3D(
    FamilyNameOfCrossSection="DefaultCroSec",
    NameOfCrossSection=concatenate_24,
    ElementIdentifier=panel_37,
    Material=material_karamba3d,
    Height_cm=expr("x*2", gene_pool_10),
    UpperFlangeWidth_cm=expr("x*2", gene_pool_9),
    LowerFlangeWidth_cm=expr("x*2", gene_pool_9),
    mode="Trapezoid")
cross_section_karamba3d_5 = CrossSectionKaramba3D(
    FamilyNameOfCrossSection="DefaultCroSec",
    NameOfCrossSection=concatenate_26,
    ElementIdentifier=panel_38,
    Material=material_karamba3d,
    Height_cm=expr("x*2", gene_pool_10),
    UpperFlangeWidth_cm=expr("x*2", gene_pool_9),
    LowerFlangeWidth_cm=expr("x*2", gene_pool_9),
    mode="Trapezoid")
cross_section_karamba3d_6 = CrossSectionKaramba3D(
    FamilyNameOfCrossSection="DefaultCroSec",
    NameOfCrossSection=concatenate_30,
    ElementIdentifier=panel_45,
    Material=material_selection_karamba3d_2,
    Diameter_cm=division,
    WallThickness_cm=division_2,
    mode="Circular Hollow")
cross_section_karamba3d_7 = CrossSectionKaramba3D(
    FamilyNameOfCrossSection="DefaultCroSec",
    NameOfCrossSection=concatenate_28,
    ElementIdentifier=panel_39,
    Material=material_karamba3d,
    Height_cm=expr("x*2", gene_pool_10),
    UpperFlangeWidth_cm=expr("x*2", gene_pool_9),
    LowerFlangeWidth_cm=expr("x*2", gene_pool_9),
    mode="Trapezoid")
cross_section_karamba3d_8 = CrossSectionKaramba3D(
    FamilyNameOfCrossSection="DefaultCroSec",
    NameOfCrossSection=concatenate_18,
    ElementIdentifier=panel_46,
    Material=material_karamba3d,
    Height_cm=expr("x*2", gene_pool_8),
    UpperFlangeWidth_cm=expr("x*2", gene_pool_8),
    LowerFlangeWidth_cm=expr("x*2", gene_pool_8),
    mode="Trapezoid")
cross_section_karamba3d_9 = CrossSectionKaramba3D(
    FamilyNameOfCrossSection="DefaultCroSec",
    NameOfCrossSection=concatenate_19,
    ElementIdentifier=panel_47,
    Material=material_karamba3d,
    Height_cm=expr("x*2", gene_pool_8),
    UpperFlangeWidth_cm=expr("x*2", gene_pool_8),
    LowerFlangeWidth_cm=expr("x*2", gene_pool_8),
    mode="Trapezoid")
cross_section_karamba3d_10 = CrossSectionKaramba3D(
    FamilyNameOfCrossSection="DefaultCroSec",
    NameOfCrossSection=concatenate_20,
    ElementIdentifier=panel_49,
    Material=material_karamba3d,
    Height_cm=expr("x*2", gene_pool_8),
    UpperFlangeWidth_cm=expr("x*2", gene_pool_8),
    LowerFlangeWidth_cm=expr("x*2", gene_pool_8),
    mode="Trapezoid")
cross_section_karamba3d_11 = CrossSectionKaramba3D(
    FamilyNameOfCrossSection="DefaultCroSec",
    NameOfCrossSection=concatenate_21,
    ElementIdentifier=panel_48,
    Material=material_karamba3d,
    Height_cm=expr("x*2", gene_pool_4),
    UpperFlangeWidth_cm=expr("x*2", gene_pool_4),
    LowerFlangeWidth_cm=expr("x*2", gene_pool_4),
    mode="Trapezoid")
cross_section_karamba3d_12 = CrossSectionKaramba3D(
    FamilyNameOfCrossSection="DefaultCroSec",
    NameOfCrossSection=concatenate_23,
    ElementIdentifier=panel_50,
    Material=material_karamba3d,
    Height_cm=expr("x*2", gene_pool_4),
    UpperFlangeWidth_cm=expr("x*2", gene_pool_4),
    LowerFlangeWidth_cm=expr("x*2", gene_pool_4),
    mode="Trapezoid")
cross_section_karamba3d_13 = CrossSectionKaramba3D(
    FamilyNameOfCrossSection="DefaultCroSec",
    NameOfCrossSection=concatenate_25,
    ElementIdentifier=panel_51,
    Material=material_karamba3d,
    Height_cm=expr("x*2", gene_pool_4),
    UpperFlangeWidth_cm=expr("x*2", gene_pool_4),
    LowerFlangeWidth_cm=expr("x*2", gene_pool_4),
    mode="Trapezoid")
cross_section_karamba3d_14 = CrossSectionKaramba3D(
    FamilyNameOfCrossSection="DefaultCroSec",
    NameOfCrossSection=concatenate_31,
    ElementIdentifier=panel_40,
    Material=material_karamba3d,
    Height_cm=expr("x*2", gene_pool_13),
    UpperFlangeWidth_cm=expr("x*2", gene_pool_12),
    LowerFlangeWidth_cm=expr("x*2", gene_pool_12),
    mode="Trapezoid")
cross_section_karamba3d_15 = CrossSectionKaramba3D(
    FamilyNameOfCrossSection="DefaultCroSec",
    NameOfCrossSection=concatenate_32,
    ElementIdentifier=panel_43,
    Material=material_karamba3d,
    Height_cm=expr("x*2", gene_pool_13),
    UpperFlangeWidth_cm=expr("x*2", gene_pool_12),
    LowerFlangeWidth_cm=expr("x*2", gene_pool_12),
    mode="Trapezoid")
cross_section_karamba3d_16 = CrossSectionKaramba3D(
    FamilyNameOfCrossSection="DefaultCroSec",
    NameOfCrossSection=concatenate_33,
    ElementIdentifier=panel_44,
    Material=material_karamba3d,
    Height_cm=expr("x*2", gene_pool_13),
    UpperFlangeWidth_cm=expr("x*2", gene_pool_12),
    LowerFlangeWidth_cm=expr("x*2", gene_pool_12),
    mode="Trapezoid")
cross_section_karamba3d_17 = CrossSectionKaramba3D(flatten([cross_section_karamba3d_6, cross_section_karamba3d_8, cross_section_karamba3d, cross_section_karamba3d_2, cross_section_karamba3d_3, cross_section_karamba3d_14, cross_section_karamba3d_4, cross_section_karamba3d_15, cross_section_karamba3d_16, cross_section_karamba3d_5, cross_section_karamba3d_7, cross_section_karamba3d_9, cross_section_karamba3d_10, cross_section_karamba3d_11, cross_section_karamba3d_12, cross_section_karamba3d_13]))

# ---- group: Joints
panel_52 = Panel(panel_20)
hinges = Panel([panel_34, panel_32, panel_33])
hinge_start = Panel(panel_22)
hinge_end = Panel(panel_21)
fixed = Panel([panel_29, panel_30, panel_31, panel_24, panel_27, panel_28])
beam_joints_karamba3d = BeamJointsKaramba3D(
    AtElementIdentifiers=hinges,
    CtKNMAtStartingNode=Vector(0, 0, 0),
    CrKNmRadAtStartingNode=Vector(0, 0, 0),
    CtKNMAtEndNode=Vector(0, 0, 0),
    CrKNmRadAtEndNode=Vector(0, 0, 0),
    menu=[buttons(off, off, off, off, on, on), buttons(off, off, off, off, on, on)])
beam_joints_karamba3d_2 = BeamJointsKaramba3D(
    AtElementIdentifiers=hinge_start,
    CtKNMAtStartingNode=Vector(0, 0, 0),
    CrKNmRadAtStartingNode=Vector(0, 0, 0),
    CtKNMAtEndNode=Vector(0, 0, 0),
    CrKNmRadAtEndNode=Vector(0, 0, 0),
    menu=[buttons(off, off, off, off, on, on), buttons(off, off, off, off, off, off)])
beam_joints_karamba3d_3 = BeamJointsKaramba3D(
    AtElementIdentifiers=panel_52,
    CtKNMAtStartingNode=Vector(0, 0, 0),
    CrKNmRadAtStartingNode=Vector(0, 0, 0),
    CtKNMAtEndNode=Vector(0, 0, 0),
    CrKNmRadAtEndNode=Vector(0, 0, 0),
    menu=[buttons(off, off, off, off, off, off), buttons(off, off, off, off, off, off)])
beam_joints_karamba3d_4 = BeamJointsKaramba3D(
    AtElementIdentifiers=hinge_end,
    CtKNMAtStartingNode=Vector(0, 0, 0),
    CrKNmRadAtStartingNode=Vector(0, 0, 0),
    CtKNMAtEndNode=Vector(0, 0, 0),
    CrKNmRadAtEndNode=Vector(0, 0, 0),
    menu=[buttons(off, off, off, off, off, off), buttons(off, off, off, off, on, on)])
beam_joints_karamba3d_5 = BeamJointsKaramba3D(
    AtElementIdentifiers=fixed,
    CtKNMAtStartingNode=Vector(0, 0, 0),
    CrKNmRadAtStartingNode=Vector(0, 0, 0),
    CtKNMAtEndNode=Vector(0, 0, 0),
    CrKNmRadAtEndNode=Vector(0, 0, 0),
    menu=[buttons(off, off, off, off, off, off), buttons(off, off, off, off, off, off)])
hinge_end_2 = Panel(panel_23)
panel_53 = Panel(panel_26)
hinge_start_2 = Panel(panel_25)
panel_54 = Panel(beam_joints_karamba3d)
beam_joints_karamba3d_6 = BeamJointsKaramba3D(
    AtElementIdentifiers=hinge_start_2,
    CtKNMAtStartingNode=Vector(0, 0, 0),
    CrKNmRadAtStartingNode=Vector(0, 0, 0),
    CtKNMAtEndNode=Vector(0, 0, 0),
    CrKNmRadAtEndNode=Vector(0, 0, 0),
    menu=[buttons(off, off, off, off, on, on), buttons(off, off, off, off, off, off)])
beam_joints_karamba3d_7 = BeamJointsKaramba3D(
    AtElementIdentifiers=panel_53,
    CtKNMAtStartingNode=Vector(0, 0, 0),
    CrKNmRadAtStartingNode=Vector(0, 0, 0),
    CtKNMAtEndNode=Vector(0, 0, 0),
    CrKNmRadAtEndNode=Vector(0, 0, 0),
    menu=[buttons(off, off, off, off, off, off), buttons(off, off, off, off, off, off)])
beam_joints_karamba3d_8 = BeamJointsKaramba3D(
    AtElementIdentifiers=hinge_end_2,
    CtKNMAtStartingNode=Vector(0, 0, 0),
    CrKNmRadAtStartingNode=Vector(0, 0, 0),
    CtKNMAtEndNode=Vector(0, 0, 0),
    CrKNmRadAtEndNode=Vector(0, 0, 0),
    menu=[buttons(off, off, off, off, off, off), buttons(off, off, off, off, on, on)])
relay = Relay([beam_joints_karamba3d_5, beam_joints_karamba3d, beam_joints_karamba3d_3, beam_joints_karamba3d_2, beam_joints_karamba3d_4, beam_joints_karamba3d_7, beam_joints_karamba3d_6, beam_joints_karamba3d_8])

# ----
cross_section_karamba3d_18 = CrossSectionKaramba3D(flatten(cross_section_karamba3d_17))
element_karamba3d = ElementKaramba3D(flatten(data))
joint_karamba3d = JointKaramba3D(flatten(relay))

beams = Panel([panel_34, panel_33, panel_32])
panel_55 = Panel([panel_29, panel_30, panel_31])
number_xdiv = Number(expr("x-1", xdiv))
ydiv_3 = Number(expr("x-1", ydiv))
load_combinations = Panel("""6.10(a) x
6.10(a) y
6.10(b) x
6.10(b) y
SLS""")

# ---- group: Liveload
numbertransverse = Number(numbertransversebeamsdiv)
surfacefloors_2 = Surface(surfacefloors)
liveload = Panel("""3.0 * 1.5 * 0.7
3.0 * 1.5 * 0.7
3.00 * 1.50
3.00 * 1.50
3.00 * 1.00""")
multiplication_2 = Multiplication(A=numbertransverse, B=ydiv_3)
mesh_surface = MeshSurface(Surface=surfacefloors_2, UCount=number_xdiv, VCount=multiplication_2, Overhang=True, Equalize=False)
unit_z_12 = UnitZ(Factor=expr("-x", liveload))
loads_karamba3d = LoadsKaramba3D(
    Vector=graft(unit_z_12),
    Mesh=mesh_surface,
    ElementIdentifiers=simplify(beams),
    LCase=graft(load_combinations),
    mode="MeshLoad -Const.",
    menu=[buttons(off, on, off), buttons(off, on)])
load_karamba3d = LoadKaramba3D(flatten(loads_karamba3d))

# ---- group: WindloadFacadeY
surfaceyfacade1_2 = Surface(surfaceyfacade1)
numberfloors = Number(floors)
windload = Panel("""1.0 * 1.5 * 0.7
1.0 * 1.5 * 0
1.00 * 1.50 * 0.7
1.0 * 1.5 * 0
1.0 * 0.0""")
mesh_surface_2 = MeshSurface(Surface=surfaceyfacade1_2, UCount=ydiv_3, VCount=numberfloors, Overhang=True, Equalize=False)
panel_56 = Panel(panel_55)
unit_x = UnitX(Factor=windload)
loads_karamba3d_2 = LoadsKaramba3D(
    Vector=graft(unit_x),
    Mesh=mesh_surface_2,
    ElementIdentifiers=panel_56,
    LCase=graft(load_combinations),
    mode="MeshLoad -Const.",
    menu=[buttons(off, on, off), buttons(off, on)])
load_karamba3d_2 = LoadKaramba3D(flatten(loads_karamba3d_2))

# ---- group: Deadload2
numbertransverse_2 = Number(numbertransversebeamsdiv)
surfacefloors_3 = Surface(surfacefloors)
deadload2 = Panel("""2.0 * 1.35
2.0 * 1.35
2.00 * 1.2
2.00 * 1.2
2.0 * 1.0""")
multiplication_3 = Multiplication(A=numbertransverse_2, B=ydiv_3)
mesh_surface_3 = MeshSurface(Surface=surfacefloors_3, UCount=number_xdiv, VCount=multiplication_3, Overhang=True, Equalize=False)
unit_z_13 = UnitZ(Factor=expr("-x", deadload2))
loads_karamba3d_3 = LoadsKaramba3D(
    Vector=graft(unit_z_13),
    Mesh=mesh_surface_3,
    ElementIdentifiers=beams,
    LCase=graft(load_combinations),
    mode="MeshLoad -Const.",
    menu=[buttons(off, on, off), buttons(off, on)])
load_karamba3d_3 = LoadKaramba3D(flatten(loads_karamba3d_3))

# ---- group: WindloadFacadeX
surfacexfacade1_2 = Surface(surfacexfacade1)
windload_2 = Panel("""1.0 * 1.5 * 0
1.0 * 1.5 * 0.7
1.00 * 1.50 * 0
1.0 * 1.5 * 0.7
1.0 * 0.7""")
numberfloors_2 = Number(floors)
panel_57 = Panel(panel_55)
mesh_surface_4 = MeshSurface(Surface=surfacexfacade1_2, UCount=number_xdiv, VCount=numberfloors_2, Overhang=True, Equalize=False)
unit_y = UnitY(Factor=windload_2)
loads_karamba3d_4 = LoadsKaramba3D(
    Vector=graft(unit_y),
    Mesh=mesh_surface_4,
    ElementIdentifiers=panel_57,
    LCase=graft(load_combinations),
    mode="MeshLoad -Const.",
    menu=[buttons(off, on, off), buttons(off, on)])
load_karamba3d_4 = LoadKaramba3D(flatten(loads_karamba3d_4))

# ---- group: Deadload1
deadload1 = Panel("""1.00 * 1.35
1.00 * 1.35
1.00 * 1.2
1.00 * 1.2
1.0 * 1.0""")
unit_z_14 = UnitZ(Factor=expr("-x", deadload1))
loads_karamba3d_5 = LoadsKaramba3D(Vector=graft(unit_z_14), LCase=graft(load_combinations), mode="Gravity")
# LC0: Dominating deadload + wind on y-facade
# LC0: Dominating deadload + wind on x-facade
# LC1a: Dominating Liveload + wind on y-facade
# LC1b: Dominating Liveload + wind on x-facade
# SLS+wind y
load_karamba3d_5 = LoadKaramba(flatten(loads_karamba3d_5))

# ----
load_karamba3d_6 = LoadKaramba3D(flatten([load_karamba3d_3, load_karamba3d_5, load_karamba3d, load_karamba3d_2, load_karamba3d_4]))

load_karamba3d_7 = LoadKaramba3D(flatten(load_karamba3d_6))
assemble_model_karamba3d = AssembleModelKaramba3D(
    Elem=element_karamba3d,
    Support=support_karamba3d_2,
    Load=load_karamba3d_7,
    CrossSection=cross_section_karamba3d_18,
    Joint=joint_karamba3d,
    LimitDistance_m=0.005)  # -> Model, Info, Mass_kg, CentreOfGravity, LoadCaseNames
panel_58 = Panel(assemble_model_karamba3d.Mass_kg)
panel_59 = Panel(assemble_model_karamba3d.LoadCaseNames)
panel_60 = Panel(assemble_model_karamba3d.Model)
analyze_karamba3d = AnalyzeKaramba3D(Model=assemble_model_karamba3d.Model)  # -> CalculatedModel, MaximumDisplacement_cm, ResultingForceOfGravity_kN, ElasticEnergyChange_kNm

# ---- group: Optimization 1 - ULS Utilization
panel_61 = Panel([panel_22, panel_20, panel_21])
panel_62 = Panel([panel_25, panel_26, panel_23])
panel_63 = Panel([panel_24, panel_27, panel_28])
panel_64 = Panel([panel_29, panel_30, panel_31])
panel_65 = Panel(panel_34)
panel_66 = Panel(panel_35)
panel_67 = Panel(panel_32)
panel_68 = Panel(panel_33)
model_karamba3d = ModelKaramba3D(analyze_karamba3d.CalculatedModel)
model_karamba3d_2 = ModelKaramba3D(analyze_karamba3d.CalculatedModel)
model_karamba3d_3 = ModelKaramba3D(analyze_karamba3d.CalculatedModel)
model_karamba3d_4 = ModelKaramba3D(analyze_karamba3d.CalculatedModel)
model_karamba3d_5 = ModelKaramba3D(analyze_karamba3d.CalculatedModel)
model_karamba3d_6 = ModelKaramba3D(analyze_karamba3d.CalculatedModel)
model_karamba3d_7 = ModelKaramba3D(analyze_karamba3d.CalculatedModel)
model_karamba3d_8 = ModelKaramba3D(analyze_karamba3d.CalculatedModel)
utilization_of_elements_karamba3d = UtilizationOfElementsKaramba3D(
    AnalyzedModel=model_karamba3d_4,
    ElementsIdentifiers=flatten(panel_61),
    NumberOfSamplePoints=3,
    ElasticDesign=True,
    GammaM0=1,
    GammaM1=1.1,
    SwayFrame=True,
    WithDetails=False,
    mode="Beams")  # -> AnalyzedModel, Utilization, SigMax_kN_cm2, SigMin_kN_cm2, TauMax_kN_cm2, UtilN, UtilVy, UtilVz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
utilization_of_elements_karamba3d_2 = UtilizationOfElementsKaramba3D(
    AnalyzedModel=model_karamba3d_8,
    ElementsIdentifiers=flatten(panel_62),
    NumberOfSamplePoints=3,
    ElasticDesign=True,
    GammaM0=1,
    GammaM1=1.1,
    SwayFrame=True,
    WithDetails=False,
    mode="Beams")  # -> AnalyzedModel, Utilization, SigMax_kN_cm2, SigMin_kN_cm2, TauMax_kN_cm2, UtilN, UtilVy, UtilVz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
utilization_of_elements_karamba3d_3 = UtilizationOfElementsKaramba3D(
    AnalyzedModel=model_karamba3d_5,
    ElementsIdentifiers=panel_64,
    NumberOfSamplePoints=3,
    ElasticDesign=True,
    GammaM0=1,
    GammaM1=1.1,
    SwayFrame=True,
    WithDetails=False,
    mode="Beams")  # -> AnalyzedModel, Utilization, SigMax_kN_cm2, SigMin_kN_cm2, TauMax_kN_cm2, UtilN, UtilVy, UtilVz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
utilization_of_elements_karamba3d_4 = UtilizationOfElementsKaramba3D(
    AnalyzedModel=model_karamba3d_7,
    ElementsIdentifiers=panel_65,
    NumberOfSamplePoints=3,
    ElasticDesign=True,
    GammaM0=1,
    GammaM1=1.1,
    SwayFrame=True,
    WithDetails=False,
    mode="Beams")  # -> AnalyzedModel, Utilization, SigMax_kN_cm2, SigMin_kN_cm2, TauMax_kN_cm2, UtilN, UtilVy, UtilVz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
utilization_of_elements_karamba3d_5 = UtilizationOfElementsKaramba3D(
    AnalyzedModel=model_karamba3d_6,
    ElementsIdentifiers=panel_63,
    NumberOfSamplePoints=3,
    ElasticDesign=True,
    GammaM0=1,
    GammaM1=1.1,
    SwayFrame=True,
    WithDetails=False,
    mode="Beams")  # -> AnalyzedModel, Utilization, SigMax_kN_cm2, SigMin_kN_cm2, TauMax_kN_cm2, UtilN, UtilVy, UtilVz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
utilization_of_elements_karamba3d_6 = UtilizationOfElementsKaramba3D(
    AnalyzedModel=model_karamba3d,
    ElementsIdentifiers=panel_68,
    NumberOfSamplePoints=3,
    ElasticDesign=True,
    GammaM0=1,
    GammaM1=1.1,
    SwayFrame=True,
    WithDetails=False,
    mode="Beams")  # -> AnalyzedModel, Utilization, SigMax_kN_cm2, SigMin_kN_cm2, TauMax_kN_cm2, UtilN, UtilVy, UtilVz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
utilization_of_elements_karamba3d_7 = UtilizationOfElementsKaramba3D(
    AnalyzedModel=model_karamba3d_3,
    ElementsIdentifiers=panel_66,
    NumberOfSamplePoints=3,
    ElasticDesign=True,
    GammaM0=1,
    GammaM1=1.1,
    SwayFrame=True,
    WithDetails=False,
    mode="Beams")  # -> AnalyzedModel, Utilization, SigMax_kN_cm2, SigMin_kN_cm2, TauMax_kN_cm2, UtilN, UtilVy, UtilVz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
utilization_of_elements_karamba3d_8 = UtilizationOfElementsKaramba3D(
    AnalyzedModel=model_karamba3d_2,
    ElementsIdentifiers=panel_67,
    NumberOfSamplePoints=3,
    ElasticDesign=True,
    GammaM0=1,
    GammaM1=1.1,
    SwayFrame=True,
    WithDetails=False,
    mode="Beams")  # -> AnalyzedModel, Utilization, SigMax_kN_cm2, SigMin_kN_cm2, TauMax_kN_cm2, UtilN, UtilVy, UtilVz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
min_max = MinMax(Number=utilization_of_elements_karamba3d_3.Utilization)  # -> Minimum, Maximum
min_max_2 = MinMax(Number=utilization_of_elements_karamba3d_4.Utilization)  # -> Minimum, Maximum
min_max_3 = MinMax(Number=utilization_of_elements_karamba3d_5.Utilization)  # -> Minimum, Maximum
min_max_4 = MinMax(Number=utilization_of_elements_karamba3d_6.Utilization)  # -> Minimum, Maximum
min_max_5 = MinMax(Number=utilization_of_elements_karamba3d_7.Utilization)  # -> Minimum, Maximum
min_max_6 = MinMax(Number=utilization_of_elements_karamba3d_8.Utilization)  # -> Minimum, Maximum
min_max_7 = MinMax(Number=utilization_of_elements_karamba3d.Utilization)  # -> Minimum, Maximum
min_max_8 = MinMax(Number=utilization_of_elements_karamba3d_2.Utilization)  # -> Minimum, Maximum
number = Number(min_max_4.Maximum)
number_2 = Number(min_max_2.Maximum)
number_3 = Number(min_max.Maximum)
number_4 = Number(min_max_3.Maximum)
number_5 = Number(min_max_5.Maximum)
number_6 = Number(min_max_6.Maximum)
number_7 = Number(min_max_7.Maximum)
number_8 = Number(min_max_8.Maximum)
csharp_script_3 = CSharpScript(iUtilization=number)  # -> out, penalty; inputs iUtilization: Double
# ---------- csharp_script_3: C# ----------
// Grasshopper Script Instance
using System;
using System.Collections;
using System.Collections.Generic;
using System.Drawing;

using Rhino;
using Rhino.Geometry;

using Grasshopper;
using Grasshopper.Kernel;
using Grasshopper.Kernel.Data;
using Grasshopper.Kernel.Types;

public class Script_Instance : GH_ScriptInstance
{
  /* 
    Members:
      RhinoDoc RhinoDocument
      GH_Document GrasshopperDocument
      IGH_Component Component
      int Iteration

    Methods (Virtual & overridable):
      Print(string text)
      Print(string format, params object[] args)
      Reflect(object obj)
      Reflect(object obj, string method_name)
  */
  
  private void RunScript(double iUtilization, ref object penalty)
  {
    // Write your logic here

    double points = 0;

    if (iUtilization < 0.5)
    {
        points = 20;
    }
    if (iUtilization > 0.5)
    {
        points = 8;
    }
    if (iUtilization > 0.7)
    {
        points = 5;
    }
    if (iUtilization > 0.8)
    {
        points = 2;
    }
    if (iUtilization > 0.85)
    {
        points = 0;
    }
    if (iUtilization > 0.9)
    {
        points = 5;
    }
    if (iUtilization > 0.92)
    {
        points = 15;
    }
    if (iUtilization > 0.95)
    {
        points = 20;
    }
    if (iUtilization > 1.0)
    {
        points = 100;
    }
    if (iUtilization > 1.2)
    {
        points = 150;
    }
    if (iUtilization > 1.5)
    {
        points = 200;
    }

    penalty = points;
  }
}
# ---------- end csharp_script_3 ----------
csharp_script_4 = CSharpScript(iUtilization=number_5)  # -> out, penalty; inputs iUtilization: Double; same code as csharp_script_3
csharp_script_5 = CSharpScript(iUtilization=number_2)  # -> out, penalty; inputs iUtilization: Double; same code as csharp_script_3
csharp_script_6 = CSharpScript(iUtilization=number_7)  # -> out, penalty; inputs iUtilization: Double; same code as csharp_script_3
csharp_script_7 = CSharpScript(iUtilization=number_8)  # -> out, penalty; inputs iUtilization: Double; same code as csharp_script_3
csharp_script_8 = CSharpScript(iUtilization=number_3)  # -> out, penalty; inputs iUtilization: Double; same code as csharp_script_3
csharp_script_9 = CSharpScript(iUtilization=number_6)  # -> out, penalty; inputs iUtilization: Double; same code as csharp_script_3
csharp_script_10 = CSharpScript(iUtilization=number_4)  # -> out, penalty; inputs iUtilization: Double; same code as csharp_script_3
panel_69 = Panel([min_max_7.Minimum, min_max_7.Maximum])
panel_70 = Panel([min_max_2.Minimum, min_max_2.Maximum])
panel_71 = Panel([min_max.Minimum, min_max.Maximum])
panel_72 = Panel([min_max_5.Minimum, min_max_5.Maximum])
panel_73 = Panel([min_max_3.Minimum, min_max_3.Maximum])
panel_74 = Panel([min_max_6.Minimum, min_max_6.Maximum])
panel_75 = Panel([min_max_4.Minimum, min_max_4.Maximum])
panel_76 = Panel([min_max_8.Minimum, min_max_8.Maximum])
panel_77 = Panel(csharp_script_8.penalty)
panel_78 = Panel(csharp_script_9.penalty)
number_9 = Number(csharp_script_3.penalty)
number_10 = Number(csharp_script_5.penalty)
number_11 = Number(csharp_script_10.penalty)
number_12 = Number(csharp_script_8.penalty)
number_13 = Number(csharp_script_4.penalty)
number_14 = Number(csharp_script_9.penalty)
number_15 = Number(csharp_script_6.penalty)
number_16 = Number(csharp_script_7.penalty)
panel_79 = Panel(csharp_script_3.penalty)
panel_80 = Panel(csharp_script_4.penalty)
panel_81 = Panel(csharp_script_5.penalty)
panel_82 = Panel(csharp_script_6.penalty)
panel_83 = Panel(csharp_script_7.penalty)
panel_84 = Panel(csharp_script_10.penalty)
addition = Addition(A=number_15, B=number_16, C=number_11, D=number_14, E=number_12, F=number_10, G=number_9, H=number_13)
panel_85 = Panel(addition)
galapagos = Galapagos(
    fitness=number_17,
    gene=[gene_pool, gene_pool_5, gene_pool_3, gene_pool_2, gene_pool_7, gene_pool_6, gene_pool_10, gene_pool_9, gene_pool_13, gene_pool_12, gene_pool_8, gene_pool_11, gene_pool_4])
number_17 = Number(addition)

# ----
panel_86 = Panel(analyze_karamba3d.MaximumDisplacement_cm)
model_karamba3d_9 = ModelKaramba3D(analyze_karamba3d.CalculatedModel)

# ---- group: Results
secondarybeams2 = Text(panel_34)
mainbeamsyin = Text(flatten([panel_20, panel_22, panel_21]))
secondarybeams1in = Text(panel_33)
secondarybeams1out = Text(panel_32)
mainbeamsyout = Text(flatten([panel_25, panel_26, panel_23]))
model_karamba3d_10 = ModelKaramba3D(assemble_model_karamba3d.Model)
analyze_karamba3d_2 = AnalyzeKaramba3D(Model=model_karamba3d_10)  # -> CalculatedModel, MaximumDisplacement_cm, ResultingForceOfGravity_kN, ElasticEnergyChange_kNm
maximum_displacement = Panel(analyze_karamba3d_2.MaximumDisplacement_cm)
model_karamba3d_11 = ModelKaramba3D(analyze_karamba3d_2.CalculatedModel)
model_karamba3d_12 = ModelKaramba3D(model_karamba3d_11)
information_of_the_model = Panel(model_karamba3d_11)

# ---- group: Results / Coloured model
model_view_karamba3d = ModelViewKaramba3D(Model=model_karamba3d_12, ResultFactors=1, ResultCase=-1)  # -> Model, DeformedMesh, DeformedAxes, DeformedModel
beam_view_karamba3d = BeamViewKaramba3D(Model=model_view_karamba3d.Model)  # -> Model, MeshesOfRenderedBeams, DeformedBeamAxes, LegendColors, LegendTags
mesh = Mesh(beam_view_karamba3d.MeshesOfRenderedBeams)

# ---- group: Results
# Section Forces
model_view_karamba3d_2 = ModelViewKaramba3D(Model=model_karamba3d_12, ResultFactors=1, ResultCase=-1)  # -> Model, DeformedMesh, DeformedAxes, DeformedModel
beam_view_karamba3d_2 = BeamViewKaramba3D(Model=model_view_karamba3d_2.Model)  # -> Model, MeshesOfRenderedBeams, DeformedBeamAxes, LegendColors, LegendTags

# Model Mass
element_query_karamba3d = ElementQueryKaramba3D(Model=model_karamba3d_12)  # -> Model, Mass_kg, Area_m2, Volume_m3, Meshes
mass_addition = MassAddition(Input=element_query_karamba3d.Mass_kg)  # -> Result, PartialResults
panel_87 = Panel(mass_addition.Result)

# Utilizations of beams
loadcombinations = Text(load_combinations)
merge_4 = Merge(Data1=secondarybeams1in, Data2=secondarybeams1out, Data3=secondarybeams2, Data4=mainbeamsyin, Data5=mainbeamsyout)  # -> flatten(Result)
panel_88 = Panel(loadcombinations)
utilization_of_elements_karamba3d_9 = UtilizationOfElementsKaramba3D(
    AnalyzedModel=model_karamba3d_12,
    ElementsIdentifiers=merge_4,
    LoadCase=graft(panel_88),
    NumberOfSamplePoints=3,
    ElasticDesign=True,
    GammaM0=1,
    GammaM1=1.1,
    SwayFrame=True,
    WithDetails=False,
    mode="Beams")  # -> AnalyzedModel, Utilization, SigMax_kN_cm2, SigMin_kN_cm2, TauMax_kN_cm2, UtilN, UtilVy, UtilVz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
min_max_9 = MinMax(Number=utilization_of_elements_karamba3d_9.Utilization)  # -> Minimum, Maximum
average = Average(Input=utilization_of_elements_karamba3d_9.Utilization)
tree_branch_9 = TreeBranch(Tree=simplify(min_max_9.Maximum), Path="3", MaintainPaths=True)
panel_89 = Panel(min_max_9.Maximum)
tree_branch_10 = TreeBranch(Tree=simplify(average), Path="3", MaintainPaths=True)
panel_90 = Panel(average)
_6_10b_y = Panel(tree_branch_9)
_6_10b_y_2 = Panel(tree_branch_10)

# Deformation visualization
unit_z_15 = UnitZ(Factor=1)
model_view_karamba3d_3 = ModelViewKaramba3D(Model=model_karamba3d_11, DisplacementDirection=unit_z_15, ResultFactors=1, ResultCase=-1)  # -> Model, DeformedMesh, DeformedAxes, DeformedModel
beam_view_karamba3d_3 = BeamViewKaramba3D(Model=model_view_karamba3d_3.Model)  # -> Model, MeshesOfRenderedBeams, DeformedBeamAxes, LegendColors, LegendTags
mesh_2 = Mesh(beam_view_karamba3d_3.MeshesOfRenderedBeams)
curve_11 = Curve(<curve referenced from the Rhino model>)
legend = Legend(Colour=beam_view_karamba3d_3.LegendColors, Tags=beam_view_karamba3d_3.LegendTags, Rectangle=curve_11, LegendType=1)

# ----
model_view_karamba3d_4 = ModelViewKaramba3D(Model=model_karamba3d_9, ResultFactors=1, ResultCase=-1)  # -> Model, DeformedMesh, DeformedAxes, DeformedModel
beam_view_karamba3d_4 = BeamViewKaramba3D(Model=model_view_karamba3d_4.Model)  # -> Model, MeshesOfRenderedBeams, DeformedBeamAxes, LegendColors, LegendTags

# ---- group: Results
# Utilizations visualization
model_view_karamba3d_5 = ModelViewKaramba3D(Model=model_karamba3d_12, ResultFactors=1, ResultCase=-1)  # -> Model, DeformedMesh, DeformedAxes, DeformedModel
beam_view_karamba3d_5 = BeamViewKaramba3D(Model=model_view_karamba3d_5.Model)  # -> Model, MeshesOfRenderedBeams, DeformedBeamAxes, LegendColors, LegendTags
curve_12 = Curve(<curve referenced from the Rhino model>)
mesh_3 = Mesh(beam_view_karamba3d_5.MeshesOfRenderedBeams)
legend_2 = Legend(Colour=beam_view_karamba3d_5.LegendColors, Tags=beam_view_karamba3d_5.LegendTags, Rectangle=curve_12, LegendType=1)

# ---- group: Optimization 2 - SLS Deflection
# Before deformation optimization:
# Max deformatio
# Secondary Beams1 in: 7.55 cm OBS!
# Secondary Beams1 out: 2.16 cm OBS!
# Secondary Beams2: 4.28 cm OBS!
# Main Beams Y in: 2.06 cm OBS!
# Main Beams Y out: 1.65 cm
# 
# Penalty before opt2_sec: 470 p util
# Penalty before opt2_sec: 2100 p util+def
# Penalty after opt2_sec:
analyze_karamba3d_3 = AnalyzeKaramba3D(Model=model_karamba3d_9)  # -> CalculatedModel, MaximumDisplacement_cm, ResultingForceOfGravity_kN, ElasticEnergyChange_kNm
panel_91 = Panel(analyze_karamba3d_3.MaximumDisplacement_cm)
panel_92 = Panel(panel_22)
panel_93 = Panel(panel_20)
panel_94 = Panel(panel_25)
panel_95 = Panel(panel_26)
secondarybeams2_2 = Text(panel_34)
secondarybeams1in_2 = Text(panel_33)
secondarybeams1out_2 = Text(panel_32)
panel_96 = Panel("""0
0.5""")
panel_97 = Panel("""0
0.5""")
panel_98 = Panel("""0
0.5""")
beam_displacements_karamba3d = BeamDisplacementsKaramba3D(AnalyzedModel=analyze_karamba3d_3.CalculatedModel, BeamsIdentifiers=secondarybeams1in_2, LoadCase="SLS", Ts=panel_96)  # -> AnalyzedModel, Translations_m, Rotations_rad
beam_displacements_karamba3d_2 = BeamDisplacementsKaramba3D(AnalyzedModel=analyze_karamba3d_3.CalculatedModel, BeamsIdentifiers=secondarybeams2_2, LoadCase="SLS", Ts=panel_97)  # -> AnalyzedModel, Translations_m, Rotations_rad
beam_displacements_karamba3d_3 = BeamDisplacementsKaramba3D(AnalyzedModel=analyze_karamba3d_3.CalculatedModel, BeamsIdentifiers=secondarybeams1out_2, LoadCase="SLS", Ts=panel_98)  # -> AnalyzedModel, Translations_m, Rotations_rad
beam_displacements_karamba3d_4 = BeamDisplacementsKaramba3D(AnalyzedModel=analyze_karamba3d_3.CalculatedModel, BeamsIdentifiers=panel_92, LoadCase="SLS", Ts="0")  # -> AnalyzedModel, Translations_m, Rotations_rad
beam_displacements_karamba3d_5 = BeamDisplacementsKaramba3D(AnalyzedModel=analyze_karamba3d_3.CalculatedModel, BeamsIdentifiers=panel_93, LoadCase="SLS", Ts="0.5")  # -> AnalyzedModel, Translations_m, Rotations_rad
beam_displacements_karamba3d_6 = BeamDisplacementsKaramba3D(AnalyzedModel=analyze_karamba3d_3.CalculatedModel, BeamsIdentifiers=panel_94, LoadCase="SLS", Ts="0")  # -> AnalyzedModel, Translations_m, Rotations_rad
beam_displacements_karamba3d_7 = BeamDisplacementsKaramba3D(AnalyzedModel=analyze_karamba3d_3.CalculatedModel, BeamsIdentifiers=panel_95, LoadCase="SLS", Ts="0.5")  # -> AnalyzedModel, Translations_m, Rotations_rad
list_item_12 = ListItem(List=beam_displacements_karamba3d.Translations_m, Index=0, Wrap=True)
list_item_13 = ListItem(List=beam_displacements_karamba3d.Translations_m, Index=1, Wrap=True)
list_item_14 = ListItem(List=beam_displacements_karamba3d_2.Translations_m, Index=1, Wrap=True)
list_item_15 = ListItem(List=beam_displacements_karamba3d_3.Translations_m, Index=0, Wrap=True)
list_item_16 = ListItem(List=beam_displacements_karamba3d_2.Translations_m, Index=0, Wrap=True)
list_item_17 = ListItem(List=beam_displacements_karamba3d_3.Translations_m, Index=1, Wrap=True)
list_item_18 = ListItem(List=beam_displacements_karamba3d_4.Translations_m, Index=0, Wrap=True)
list_item_19 = ListItem(List=beam_displacements_karamba3d_5.Translations_m, Index=0, Wrap=True)
list_item_20 = ListItem(List=beam_displacements_karamba3d_6.Translations_m, Index=0, Wrap=True)
list_item_21 = ListItem(List=beam_displacements_karamba3d_7.Translations_m, Index=0, Wrap=True)
deconstruct = Deconstruct(Point=list_item_12)  # -> XComponent, YComponent, ZComponent
deconstruct_2 = Deconstruct(Point=list_item_13)  # -> XComponent, YComponent, ZComponent
deconstruct_3 = Deconstruct(Point=list_item_16)  # -> XComponent, YComponent, ZComponent
deconstruct_4 = Deconstruct(Point=list_item_14)  # -> XComponent, YComponent, ZComponent
deconstruct_5 = Deconstruct(Point=list_item_15)  # -> XComponent, YComponent, ZComponent
deconstruct_6 = Deconstruct(Point=list_item_17)  # -> XComponent, YComponent, ZComponent
deconstruct_7 = Deconstruct(Point=list_item_18)  # -> XComponent, YComponent, ZComponent
deconstruct_8 = Deconstruct(Point=list_item_19)  # -> XComponent, YComponent, ZComponent
deconstruct_9 = Deconstruct(Point=list_item_20)  # -> XComponent, YComponent, ZComponent
deconstruct_10 = Deconstruct(Point=list_item_21)  # -> XComponent, YComponent, ZComponent
subtraction_3 = Subtraction(A=deconstruct.ZComponent, B=deconstruct_2.ZComponent)
subtraction_4 = Subtraction(A=deconstruct_3.ZComponent, B=deconstruct_4.ZComponent)
subtraction_5 = Subtraction(A=deconstruct_5.ZComponent, B=deconstruct_6.ZComponent)
subtraction_6 = Subtraction(A=deconstruct_7.ZComponent, B=deconstruct_8.ZComponent)
subtraction_7 = Subtraction(A=deconstruct_9.ZComponent, B=deconstruct_10.ZComponent)
absolute = Absolute(Value=subtraction_3)
absolute_2 = Absolute(Value=subtraction_4)
absolute_3 = Absolute(Value=subtraction_5)
absolute_4 = Absolute(Value=subtraction_6)
absolute_5 = Absolute(Value=subtraction_7)
multiplication_4 = Multiplication(A=absolute, B="100")  # -> flatten(Result)
multiplication_5 = Multiplication(A=absolute_2, B="100")  # -> flatten(Result)
multiplication_6 = Multiplication(A=absolute_3, B="100")  # -> flatten(Result)
multiplication_7 = Multiplication(A=absolute_4, B="100")  # -> flatten(Result)
multiplication_8 = Multiplication(A=absolute_5, B="100")  # -> flatten(Result)
sort_list = SortList(Keys=multiplication_4, ValuesValuesA=multiplication_4)  # -> Keys, ValuesValuesA
sort_list_2 = SortList(Keys=multiplication_5, ValuesValuesA=multiplication_5)  # -> Keys, ValuesValuesA
sort_list_3 = SortList(Keys=multiplication_6, ValuesValuesA=multiplication_6)  # -> Keys, ValuesValuesA
sort_list_4 = SortList(Keys=multiplication_7, ValuesValuesA=multiplication_7)  # -> Keys, ValuesValuesA
sort_list_5 = SortList(Keys=multiplication_8, ValuesValuesA=multiplication_8)  # -> Keys, ValuesValuesA
panel_99 = Panel(sort_list.ValuesValuesA)
panel_100 = Panel(sort_list_2.ValuesValuesA)
panel_101 = Panel(sort_list_3.ValuesValuesA)
panel_102 = Panel(sort_list_4.ValuesValuesA)
panel_103 = Panel(sort_list_5.ValuesValuesA)
min_max_10 = MinMax(Number=sort_list.ValuesValuesA)  # -> Minimum, Maximum
min_max_11 = MinMax(Number=sort_list_2.ValuesValuesA)  # -> Minimum, Maximum
min_max_12 = MinMax(Number=sort_list_3.ValuesValuesA)  # -> Minimum, Maximum
lengthsecondarybeams = Number(panel)
lengthsecondarybeams_2 = Number(panel)
lengthsecondarybeams_3 = Number(panel)
csharp_script_11 = CSharpScript(iDeformation=min_max_11.Maximum, iLength=lengthsecondarybeams)  # -> out, penalty, a, b; inputs iDeformation: Double, iLength: Double
# ---------- csharp_script_11: C# ----------
// Grasshopper Script Instance
using System;
using System.Collections;
using System.Collections.Generic;
using System.Drawing;

using Rhino;
using Rhino.Geometry;

using Grasshopper;
using Grasshopper.Kernel;
using Grasshopper.Kernel.Data;
using Grasshopper.Kernel.Types;

public class Script_Instance : GH_ScriptInstance
{
  /* 
    Members:
      RhinoDoc RhinoDocument
      GH_Document GrasshopperDocument
      IGH_Component Component
      int Iteration

    Methods (Virtual & overridable):
      Print(string text)
      Print(string format, params object[] args)
      Reflect(object obj)
      Reflect(object obj, string method_name)
  */
  
  private void RunScript(
	double iDeformation,
	double iLength,
	ref object penalty,
	ref object a,
	ref object b)
  {

    double points = 0;
    double limit = (iLength*100) / 300;

   
   if (iDeformation > 1.05 *limit )
    {
        points = 20;
    }

    if (iDeformation > 1.1 *limit )
    {
        points = 50;
    }

    if (iDeformation > 1.2 *limit )
    {
        points = 100;
    }

    if (iDeformation > 1.35 *limit )
    {
        points = 300;
    }    

    if (iDeformation > 1.5 *limit )
    {
        points = 500;
    }
    
    if (iDeformation > 2.0 *limit )
    {
        points = 1000;
    }

    if (iDeformation < 1.05 *limit )
    {
        points = 18;
    }

    if (iDeformation == limit)
    {
        points = 5;
    }
    
    if (iDeformation < limit )
    {
        points = 1;
    }
    
    if (iDeformation < 0.9 * limit )
    {
        points = 0;
    }

    if (iDeformation < 0.8 * limit )
    {
        points = 15;
    }

 
    penalty = points;
    a = limit;
    b = iDeformation;
  }
}
# ---------- end csharp_script_11 ----------
csharp_script_12 = CSharpScript(iDeformation=min_max_10.Maximum, iLength=lengthsecondarybeams_2)  # -> out, penalty, a, b; inputs iDeformation: Double, iLength: Double; same code as csharp_script_11
csharp_script_13 = CSharpScript(iDeformation=min_max_12.Maximum, iLength=lengthsecondarybeams_3)  # -> out, penalty, a, b; inputs iDeformation: Double, iLength: Double; same code as csharp_script_11
addition_2 = Addition(A=csharp_script_12.penalty, B=csharp_script_13.penalty, C=csharp_script_11.penalty)
galapagos_2 = Galapagos(fitness=number_18, gene=[gene_pool, gene_pool_5, gene_pool_3, gene_pool_2, gene_pool_7, gene_pool_6])
number_18 = Number(addition_2)
addition_3 = Addition(A=number_18, B=number_17)
panel_104 = Panel(addition_3)
panel_105 = Panel(number_18)
number_19 = Number(addition_3)

# ---- group: Coloring each group of cross section into a unique color
model_view_karamba3d_6 = ModelViewKaramba3D(Model=model_karamba3d_11, ResultFactors=1, ResultCase=-1)  # -> Model, DeformedMesh, DeformedAxes, DeformedModel
group_number = Slider(4, range=0..11)
disassemble_model_karamba3d = DisassembleModelKaramba3D(Model=model_view_karamba3d_6.Model)  # -> Model, Point, Beam, Shell, Support, Load, Line, Mesh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
disassemble_element_karamba3d = DisassembleElementKaramba3D(Element=disassemble_model_karamba3d.Beam)  # -> Element, ElementIdentifier, AxisOfElement, CrossSection, Joint, Material, LocalCoordinateSystem, ElementIsActive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
disassemble_cross_section_karamba3d = DisassembleCrossSectionKaramba3D(CroSec=disassemble_element_karamba3d.CrossSection)  # -> CrossSection, FamilyNameOfCrossSection, flatten(TypeNameOfCrossSection), flatten(ElemIdentifiers), Color, Material, LocalEccentricity_cm, flatten(Heights_cm)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
panel_106 = Panel(disassemble_cross_section_karamba3d.MaximumWidth_cm)
heights = Panel(disassemble_cross_section_karamba3d.Heights_cm)
rectangle_2 = Rectangle(Plane=PlaneXY(0, 0, 0), XSize=heights, YSize=panel_106, Radius=0)  # -> Rectangle, Length
area_2 = Area(Geometry=rectangle_2.Rectangle)  # -> Area, Centroid
panel_107 = Panel(area_2.Centroid)
point_groups = PointGroups(Points=area_2.Centroid, Distance="0")  # -> simplify(Groups), simplify(Indices)
data_2 = Data(simplify(point_groups.Indices))
list_item_22 = ListItem(List=disassemble_cross_section_karamba3d.Heights_cm, Index=data_2, Wrap=True)
list_item_23 = ListItem(List=disassemble_cross_section_karamba3d.ElemIdentifiers, Index=data_2, Wrap=True)
list_item_24 = ListItem(List=disassemble_cross_section_karamba3d.MaximumWidth_cm, Index=data_2, Wrap=True)
tree_branch_11 = TreeBranch(Tree=list_item_22, Path=group_number, MaintainPaths=True)
tree_branch_12 = TreeBranch(Tree=list_item_24, Path=group_number, MaintainPaths=True)
tree_branch_13 = TreeBranch(Tree=list_item_23, Path=group_number, MaintainPaths=True)
list_item_25 = ListItem(List=disassemble_cross_section_karamba3d.ElemIdentifiers, Index=data_2, Wrap=True)
height = Panel(tree_branch_11)
elementidentifyer = Panel(list_item_25)
width = Panel(tree_branch_12)
indices_groups = Panel(data_2)
id_in_group = Panel(tree_branch_13)
tree_statistics = TreeStatistics(Tree=list_item_25)  # -> Paths, Length, Count
panel_108 = Panel(tree_statistics.Count)
random = Random(Range="0 To 255", Number=panel_108, Seed="30")
random_2 = Random(Range="25 To 190", Number=panel_108, Seed="30")
random_3 = Random(Range="5 To 255", Number=panel_108, Seed="20")
round = Round(Number=random)  # -> Nearest, Floor, Ceiling
round_2 = Round(Number=random_2)  # -> Nearest, Floor, Ceiling
round_3 = Round(Number=random_3)  # -> Nearest, Floor, Ceiling
tree_statistics_2 = TreeStatistics(Tree=point_groups.Groups)  # -> Paths, Length, Count
concatenate_34 = Concatenate(FragmentA=round.Floor, FragmentB=",", FragmentA_2=round_2.Floor, FragmentB_2=",", FragmentC=round_3.Floor)  # -> graft(Result)
series_33 = Series(Start=0, Step=1, Count=tree_statistics_2.Count)
concatenate_35 = Concatenate(FragmentA="CrossSection_", FragmentB=series_33)  # -> simplify(graft(Result))
make_element_set_karamba3d = MakeElementSetKaramba3D(ElementIdentifiers=list_item_25, SetIdentifier=concatenate_35, MinimumSplitLength_m=0.001, ColorOfTheSet=concatenate_34)  # -> simplify(ElementSet)
disassemble_model_karamba3d_2 = DisassembleModelKaramba3D(Model=model_view_karamba3d_6.Model)  # -> Model, Point, Beam, Shell, Support, Load, Line, Mesh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
assemble_model_karamba3d_2 = AssembleModelKaramba3D(
    Elem=disassemble_model_karamba3d.Beam,
    Support=disassemble_model_karamba3d_2.Support,
    Load=disassemble_model_karamba3d_2.Load,
    CrossSection=disassemble_model_karamba3d_2.CrossSection,
    Joint=disassemble_model_karamba3d_2.Joint,
    BeamSet=flatten(make_element_set_karamba3d),
    LimitDistance_m=0.005)  # -> Model, Info, Mass_kg, CenterOfGravity, LoadCaseNames
model_view_karamba3d_7 = ModelViewKaramba3D(Model=assemble_model_karamba3d_2.Model, ResultFactors=1, ResultCase=-1)  # -> Model, DeformedMesh, DeformedAxes, DeformedModel
beam_view_karamba3d_6 = BeamViewKaramba3D(Model=model_view_karamba3d_7.Model)  # -> Model, MeshesOfRenderedBeams, DeformedBeamAxes, LegendColors, LegendTags

# ---- group: Demand Bank
panel_109 = Panel(panel_22)
panel_110 = Panel(panel_21)
panel_111 = Panel([panel_24, panel_27, panel_28, panel_29, panel_30, panel_31])
panel_112 = Panel(panel_34)
panel_113 = Panel(panel_20)
panel_114 = Panel(panel_25)
panel_115 = Panel(panel_23)
panel_116 = Panel(panel_26)
panel_117 = Panel(panel_33)
panel_118 = Panel(panel_32)
model_view_karamba3d_8 = ModelViewKaramba3D(Model=assemble_model_karamba3d.Model, ResultFactors=1, ResultCase=-1, ElementIdentifiersBreps=panel_111)  # -> Model, DeformedMesh, DeformedAxes, DeformedModel
model_view_karamba3d_9 = ModelViewKaramba3D(Model=assemble_model_karamba3d.Model, ResultFactors=1, ResultCase=-1, ElementIdentifiersBreps=panel_109)  # -> Model, DeformedMesh, DeformedAxes, DeformedModel
model_view_karamba3d_10 = ModelViewKaramba3D(Model=assemble_model_karamba3d.Model, ResultFactors=1, ResultCase=-1, ElementIdentifiersBreps=panel_113)  # -> Model, DeformedMesh, DeformedAxes, DeformedModel
model_view_karamba3d_11 = ModelViewKaramba3D(Model=assemble_model_karamba3d.Model, ResultFactors=1, ResultCase=-1, ElementIdentifiersBreps=panel_110)  # -> Model, DeformedMesh, DeformedAxes, DeformedModel
model_view_karamba3d_12 = ModelViewKaramba3D(Model=assemble_model_karamba3d.Model, ResultFactors=1, ResultCase=-1, ElementIdentifiersBreps=panel_112)  # -> Model, DeformedMesh, DeformedAxes, DeformedModel
model_view_karamba3d_13 = ModelViewKaramba3D(Model=assemble_model_karamba3d.Model, ResultFactors=1, ResultCase=-1, ElementIdentifiersBreps=panel_114)  # -> Model, DeformedMesh, DeformedAxes, DeformedModel
model_view_karamba3d_14 = ModelViewKaramba3D(Model=assemble_model_karamba3d.Model, ResultFactors=1, ResultCase=-1, ElementIdentifiersBreps=panel_115)  # -> Model, DeformedMesh, DeformedAxes, DeformedModel
model_view_karamba3d_15 = ModelViewKaramba3D(Model=assemble_model_karamba3d.Model, ResultFactors=1, ResultCase=-1, ElementIdentifiersBreps=panel_116)  # -> Model, DeformedMesh, DeformedAxes, DeformedModel
model_view_karamba3d_16 = ModelViewKaramba3D(Model=assemble_model_karamba3d.Model, ResultFactors=1, ResultCase=-1, ElementIdentifiersBreps=panel_118)  # -> Model, DeformedMesh, DeformedAxes, DeformedModel
model_view_karamba3d_17 = ModelViewKaramba3D(Model=assemble_model_karamba3d.Model, ResultFactors=1, ResultCase=-1, ElementIdentifiersBreps=panel_117)  # -> Model, DeformedMesh, DeformedAxes, DeformedModel
beam_view_karamba3d_7 = BeamViewKaramba3D(Model=model_view_karamba3d_9.Model)  # -> Model, MeshesOfRenderedBeams, DeformedBeamAxes, LegendColors, LegendTags
beam_view_karamba3d_8 = BeamViewKaramba3D(Model=model_view_karamba3d_11.Model)  # -> Model, MeshesOfRenderedBeams, DeformedBeamAxes, LegendColors, LegendTags
beam_view_karamba3d_9 = BeamViewKaramba3D(Model=model_view_karamba3d_8.Model)  # -> Model, MeshesOfRenderedBeams, DeformedBeamAxes, LegendColors, LegendTags
beam_view_karamba3d_10 = BeamViewKaramba3D(Model=model_view_karamba3d_10.Model)  # -> Model, MeshesOfRenderedBeams, DeformedBeamAxes, LegendColors, LegendTags
beam_view_karamba3d_11 = BeamViewKaramba3D(Model=model_view_karamba3d_12.Model)  # -> Model, MeshesOfRenderedBeams, DeformedBeamAxes, LegendColors, LegendTags
beam_view_karamba3d_12 = BeamViewKaramba3D(Model=model_view_karamba3d_13.Model)  # -> Model, MeshesOfRenderedBeams, DeformedBeamAxes, LegendColors, LegendTags
beam_view_karamba3d_13 = BeamViewKaramba3D(Model=model_view_karamba3d_14.Model)  # -> Model, MeshesOfRenderedBeams, DeformedBeamAxes, LegendColors, LegendTags
beam_view_karamba3d_14 = BeamViewKaramba3D(Model=model_view_karamba3d_15.Model)  # -> Model, MeshesOfRenderedBeams, DeformedBeamAxes, LegendColors, LegendTags
mesh_4 = Mesh(beam_view_karamba3d_8.MeshesOfRenderedBeams)
beam_view_karamba3d_15 = BeamViewKaramba3D(Model=model_view_karamba3d_16.Model)  # -> Model, MeshesOfRenderedBeams, DeformedBeamAxes, LegendColors, LegendTags
beam_view_karamba3d_16 = BeamViewKaramba3D(Model=model_view_karamba3d_17.Model)  # -> Model, MeshesOfRenderedBeams, DeformedBeamAxes, LegendColors, LegendTags
mesh_5 = Mesh(simplify(beam_view_karamba3d_7.MeshesOfRenderedBeams))
mesh_6 = Mesh(beam_view_karamba3d_9.MeshesOfRenderedBeams)
mesh_7 = Mesh(beam_view_karamba3d_10.MeshesOfRenderedBeams)
mesh_8 = Mesh(beam_view_karamba3d_12.MeshesOfRenderedBeams)
mesh_9 = Mesh(beam_view_karamba3d_11.MeshesOfRenderedBeams)
mesh_10 = Mesh(beam_view_karamba3d_13.MeshesOfRenderedBeams)
mesh_11 = Mesh(beam_view_karamba3d_14.MeshesOfRenderedBeams)
mesh_12 = Mesh(beam_view_karamba3d_15.MeshesOfRenderedBeams)
mesh_13 = Mesh(beam_view_karamba3d_16.MeshesOfRenderedBeams)
panel_119 = Panel("MainBeamXin")

explode_object = ExplodeObject(Object=mesh_7, Recursive=False)  # -> graft(Objects)
minimumboundindbox = MinimumBoundindBox(Geometry=explode_object)  # -> simplify(graft(SecondaryBeams))
brep = Brep(flatten(minimumboundindbox))
deconstruct_brep_2 = DeconstructBrep(Brep=brep)  # -> Faces, Edges, Vertices
point_7 = Point(deconstruct_brep_2.Vertices)
fit_line = FitLine(Points=point_7)
curve_middle = CurveMiddle(Curve=fit_line)

explode_object_2 = ExplodeObject(Object=mesh_6, Recursive=False)  # -> graft(Objects)
explode_object_3 = ExplodeObject(Object=mesh_4, Recursive=False)  # -> graft(Objects)
minimumboundindbox_2 = MinimumBoundindBox(Geometry=explode_object_3)  # -> flatten(SecondaryBeams)
minimumboundindbox_3 = MinimumBoundindBox(Geometry=explode_object_2)  # -> flatten(BoundingBox)
unit_z_16 = UnitZ(Factor="0.4")
move = Move(Geometry=minimumboundindbox_3, Motion=unit_z_16)  # -> Geometry, Transform
solid_difference = SolidDifference(BrepsA=minimumboundindbox_2, BrepsB=move.Geometry)  # -> simplify(graft(SecondaryBeamsOutsideColumn))

explode_object_4 = ExplodeObject(Object=mesh_5, Recursive=False)  # -> graft(Objects)
explode_object_5 = ExplodeObject(Object=mesh_6, Recursive=False)  # -> graft(Objects)
minimumboundindbox_4 = MinimumBoundindBox(Geometry=explode_object_4)  # -> flatten(SecondaryBeams)
unit_z_17 = UnitZ(Factor="0.4")
minimumboundindbox_5 = MinimumBoundindBox(Geometry=explode_object_5)  # -> flatten(BoundingBox)
move_2 = Move(Geometry=minimumboundindbox_5, Motion=unit_z_17)  # -> Geometry, Transform
solid_difference_2 = SolidDifference(BrepsA=minimumboundindbox_4, BrepsB=move_2.Geometry)  # -> simplify(graft(SecondaryBeamsOutsideColumn))

explode_object_6 = ExplodeObject(Object=mesh_11, Recursive=False)  # -> graft(Objects)
minimumboundindbox_6 = MinimumBoundindBox(Geometry=explode_object_6)  # -> simplify(graft(SecondaryBeams))

explode_object_7 = ExplodeObject(Object=mesh_8, Recursive=False)  # -> graft(Objects)
explode_object_8 = ExplodeObject(Object=mesh_6, Recursive=False)  # -> graft(Objects)
unit_z_18 = UnitZ(Factor="0.4")
minimumboundindbox_7 = MinimumBoundindBox(Geometry=explode_object_8)  # -> flatten(BoundingBox)
minimumboundindbox_8 = MinimumBoundindBox(Geometry=explode_object_7)  # -> flatten(SecondaryBeams)
move_3 = Move(Geometry=minimumboundindbox_7, Motion=unit_z_18)  # -> Geometry, Transform
solid_difference_3 = SolidDifference(BrepsA=minimumboundindbox_8, BrepsB=move_3.Geometry)  # -> simplify(graft(SecondaryBeamsOutsideColumn))

explode_object_9 = ExplodeObject(Object=mesh_12, Recursive=False)  # -> simplify(graft(Objects))
minimumboundindbox_9 = MinimumBoundindBox(Geometry=explode_object_5)  # -> flatten(BoundingBox)
minimumboundindbox_10 = MinimumBoundindBox(Geometry=explode_object_9)  # -> flatten(SecondaryBeams)
unit_z_19 = UnitZ(Factor="0.4")
move_4 = Move(Geometry=minimumboundindbox_9, Motion=unit_z_19)  # -> Geometry, Transform
solid_difference_4 = SolidDifference(BrepsA=minimumboundindbox_10, BrepsB=move_4.Geometry)  # -> simplify(graft(SecondaryBeamsOutsideColumn))
tree_item = TreeItem(Tree=solid_difference_4, Path="10", Index=0, Wrap=True)
brep_2 = Brep(solid_difference_4)
brep_3 = Brep(flatten(brep_2))
xy_plane = XYPlane(Origin=Point(0, 0, 0))
rotate = Rotate(Geometry=brep_3, Angle=1.570796327, Plane=xy_plane)  # -> Geometry, Transform
list_length_37 = ListLength(List=rotate.Geometry)
series_34 = Series(Start=0, Step=1, Count=list_length_37)
volume = Volume(Geometry=rotate.Geometry)  # -> Volume, Centroid
construct_point = ConstructPoint(XCoordinate=series_34, YCoordinate=0, ZCoordinate=0)
orient = Orient(Geometry=rotate.Geometry, Source=volume.Centroid, Target=construct_point)  # -> Geometry, Transform
brep_4 = Brep(graft(orient.Geometry))
minimumboundindbox_11 = MinimumBoundindBox(Geometry=brep_4)

explode_object_10 = ExplodeObject(Object=mesh_10, Recursive=False)  # -> graft(Objects)
explode_object_11 = ExplodeObject(Object=mesh_6, Recursive=False)  # -> graft(Objects)
minimumboundindbox_12 = MinimumBoundindBox(Geometry=explode_object_10)  # -> flatten(SecondaryBeams)
minimumboundindbox_13 = MinimumBoundindBox(Geometry=explode_object_11)  # -> flatten(BoundingBox)
unit_z_20 = UnitZ(Factor="0.4")
move_5 = Move(Geometry=minimumboundindbox_13, Motion=unit_z_20)  # -> Geometry, Transform
solid_difference_5 = SolidDifference(BrepsA=minimumboundindbox_12, BrepsB=move_5.Geometry)  # -> simplify(graft(SecondaryBeamsOutsideColumn))

explode_object_12 = ExplodeObject(Object=mesh_13, Recursive=False)  # -> simplify(graft(Objects))
explode_object_13 = ExplodeObject(Object=mesh_6, Recursive=False)  # -> simplify(graft(Objects))
minimumboundindbox_14 = MinimumBoundindBox(Geometry=explode_object_13)  # -> flatten(BoundingBox)
minimumboundindbox_15 = MinimumBoundindBox(Geometry=explode_object_12)  # -> flatten(SecondaryBeams)
unit_z_21 = UnitZ(Factor="0.4")
move_6 = Move(Geometry=minimumboundindbox_14, Motion=unit_z_21)  # -> Geometry, Transform
solid_difference_6 = SolidDifference(BrepsA=minimumboundindbox_15, BrepsB=move_6.Geometry)  # -> simplify(graft(SecondaryBeamsOutsideColumn))
brep_5 = Brep(solid_difference_6)
brep_6 = Brep(flatten(brep_5))
xy_plane_2 = XYPlane(Origin=Point(0, 0, 0))
rotate_2 = Rotate(Geometry=brep_6, Angle=1.570796327, Plane=xy_plane_2)  # -> Geometry, Transform
list_length_38 = ListLength(List=rotate_2.Geometry)
series_35 = Series(Start=0, Step=1, Count=list_length_38)
volume_2 = Volume(Geometry=rotate_2.Geometry)  # -> Volume, Centroid
construct_point_2 = ConstructPoint(XCoordinate=series_35, YCoordinate=0, ZCoordinate=0)
orient_2 = Orient(Geometry=rotate_2.Geometry, Source=volume_2.Centroid, Target=construct_point_2)  # -> Geometry, Transform
brep_7 = Brep(graft(orient_2.Geometry))
minimumboundindbox_16 = MinimumBoundindBox(Geometry=brep_7)

solid_union = SolidUnion(Breps=[solid_difference_2, solid_difference, minimumboundindbox])
cluster_3 = Cluster_3(geometry=solid_union)

brep_8 = Brep(solid_union)
mesh_14 = Mesh(mesh_9)
explode_object_14 = ExplodeObject(Object=mesh_14, Recursive=False)  # -> simplify(graft(Objects))
minimumboundindbox_17 = MinimumBoundindBox(Geometry=brep_8)  # -> flatten(BoundingBox)
minimumboundindbox_18 = MinimumBoundindBox(Geometry=explode_object_14)  # -> flatten(SecondaryBeams)
unit_z_22 = UnitZ(Factor=expr("-x", "0.15"))
unit_z_23 = UnitZ(Factor="0.15")
unit_z_24 = UnitZ(Factor=expr("-x", "0.15"))
unit_z_25 = UnitZ(Factor="0.15")
move_7 = Move(Geometry=minimumboundindbox_17, Motion=unit_z_23)  # -> Geometry, Transform
move_8 = Move(Geometry=minimumboundindbox_17, Motion=unit_z_22)  # -> Geometry, Transform
solid_union_2 = SolidUnion(Breps=[minimumboundindbox_17, move_7.Geometry, move_8.Geometry])  # -> flatten(Result)
xy_plane_3 = XYPlane(Origin=Point(0, 0, 0))

panel_120 = Panel(explode_object_4)
tree_branch_14 = TreeBranch(Tree=solid_difference_2, Path="0", MaintainPaths=True)
solid_union_3 = SolidUnion(Breps=[solid_difference_3, minimumboundindbox_6, solid_difference_5])
cluster_4 = Cluster_3(geometry=solid_union_3)

minimumboundindbox_19 = MinimumBoundindBox(Geometry=solid_union_3)  # -> flatten(BoundingBox)
move_9 = Move(Geometry=minimumboundindbox_19, Motion=unit_z_25)  # -> Geometry, Transform
move_10 = Move(Geometry=minimumboundindbox_19, Motion=unit_z_24)  # -> Geometry, Transform
solid_union_4 = SolidUnion(Breps=[minimumboundindbox_17, move_7.Geometry, move_8.Geometry, minimumboundindbox_19, move_9.Geometry, move_10.Geometry])  # -> flatten(Result)
solid_difference_7 = SolidDifference(BrepsA=minimumboundindbox_18, BrepsB=[solid_union_2, solid_union_4])  # -> simplify(graft(SecondaryBeamsOutsideColumn))
minimumboundindbox_20 = MinimumBoundindBox(Geometry=solid_difference_7)
brep_9 = Brep(flatten(minimumboundindbox_20))
rotate_3 = Rotate(Geometry=brep_9, Angle=1.570796327, Plane=xy_plane_3)  # -> Geometry, Transform
list_length_39 = ListLength(List=rotate_3.Geometry)
series_36 = Series(Start=0, Step=1, Count=list_length_39)
volume_3 = Volume(Geometry=rotate_3.Geometry)  # -> Volume, Centroid
construct_point_3 = ConstructPoint(XCoordinate=series_36, YCoordinate=0, ZCoordinate=0)
orient_3 = Orient(Geometry=rotate_3.Geometry, Source=volume_3.Centroid, Target=construct_point_3)  # -> Geometry, Transform

brep_10 = Brep(flatten(cluster_4))
brep_11 = Brep(flatten(minimumboundindbox_11))
brep_12 = Brep(flatten(minimumboundindbox_16))
brep_13 = Brep(flatten(cluster_3))
brep_14 = Brep(flatten(orient_3.Geometry))
addition_4 = Addition(A="20", B=7)
addition_5 = Addition(A=addition_4, B=7)
addition_6 = Addition(A=addition_5, B=7)
addition_7 = Addition(A=addition_6, B=7)
unit_y_2 = UnitY(Factor="20")
unit_y_3 = UnitY(Factor=addition_4)
unit_y_4 = UnitY(Factor=addition_6)
unit_y_5 = UnitY(Factor=addition_5)
unit_y_6 = UnitY(Factor=addition_7)
move_11 = Move(Geometry=brep_13, Motion=unit_y_2)  # -> Geometry, Transform
move_12 = Move(Geometry=brep_11, Motion=unit_y_3)  # -> Geometry, Transform
move_13 = Move(Geometry=brep_10, Motion=unit_y_4)  # -> Geometry, Transform
move_14 = Move(Geometry=brep_14, Motion=unit_y_5)  # -> Geometry, Transform
move_15 = Move(Geometry=brep_12, Motion=unit_y_6)  # -> Geometry, Transform
merge_5 = Merge(Data1=move_11.Geometry, Data2=move_12.Geometry, Data3=move_14.Geometry, Data4=move_13.Geometry, Data5=move_15.Geometry)  # -> flatten(Result)
brep_15 = Brep(merge_5)

# Input Breps as List
brep_16 = Brep(brep_15)
merge_6 = Merge(Data1=brep_16)  # -> flatten(Result)

# Extracting CS data
# data extraced so height>width
c_script = CSharpScript(iBrep=merge_6)  # -> out, CSdata, a; inputs iBrep: list of Brep
# ---------- c_script: C# ----------
// Grasshopper Script Instance
#region Usings
using System;
using System.Linq;
using System.Collections;
using System.Collections.Generic;
using System.Drawing;

using Rhino;
using Rhino.Geometry;

using Grasshopper;
using Grasshopper.Kernel;
using Grasshopper.Kernel.Data;
using Grasshopper.Kernel.Types;
#endregion

public class Script_Instance : GH_ScriptInstance
{
    #region Notes
    /* 
      Members:
        RhinoDoc RhinoDocument
        GH_Document GrasshopperDocument
        IGH_Component Component
        int Iteration

      Methods (Virtual & overridable):
        Print(string text)
        Print(string format, params object[] args)
        Reflect(object obj)
        Reflect(object obj, string method_name)
    */
    #endregion

    private void RunScript(IList<Brep> iBrep, ref object CSdata, ref object a)
    {
        // Write your logic here
        DataTree<double> elementData = new DataTree<double>();
        

        for (int i=0; i<iBrep.Count; i++)
        {
            var edges = iBrep[i].Edges;
           // Use LINQ to get distinct edge lengths
           
            var uniqueLengths = edges
            .Select(edge => Math.Round(edge.ToNurbsCurve().GetLength(),2))
            .Distinct()
            .OrderByDescending(x=>x)
            .ToList();

            double length = Math.Round(uniqueLengths[0]*1000,1);
            double width = Math.Round(uniqueLengths[1]*1000,1);
            double height;
            if (uniqueLengths.Count ==2 )
            {
                height = width;
            }
            else
            {
                height = Math.Round(uniqueLengths[2]*1000,1);
            }
            

            if (width>height)
            {
                double temp = width;
                width=height;
                height = temp;
            }

            // Add data for each iteration to the DataTree
            elementData.Add(i, new GH_Path(0));
            elementData.Add(length, new GH_Path(1));
            elementData.Add(width, new GH_Path(2));
            elementData.Add(height, new GH_Path(3));
            }

        
    
        CSdata = elementData;
        

    }
}
# ---------- end c_script ----------

# WriteToExcel
# OBS! ExcelFile must be closed
panel_121 = Panel("""ElementID
Length[mm]
Width[mm]
Height[mm]""")
file_path = FilePath(panel_5)
excel_write = ExcelWrite(
    WriteExcelData=Toggle(False),
    WorkbookPath=file_path,
    WorksheetName="DemandBank",
    ColumnHeadings=panel_121,
    Data=c_script.CSdata,
    ClearSheet=Toggle(True))
panel_122 = Panel(excel_write)

this_is_the_file_path_inserted = Panel(file_path)

# ==== cluster Cluster
spacingx = ClusterInput()
curve = ClusterInput()
spacingy = ClusterInput()
spacingx_2 = Number(spacingx)
curve_2 = Curve(curve)
spacingy_2 = Number(spacingy)
csharp_script = CSharpScript(spacingY=spacingy_2, spacingX=spacingx_2)  # -> out, corner, nextToCorner; inputs spacingY: Int32, spacingX: Int32
# ---------- csharp_script: C# ----------
// Grasshopper Script Instance
using System;
using System.Collections;
using System.Collections.Generic;
using System.Drawing;

using Rhino;
using Rhino.Geometry;

using Grasshopper;
using Grasshopper.Kernel;
using Grasshopper.Kernel.Data;
using Grasshopper.Kernel.Types;

public class Script_Instance : GH_ScriptInstance
{
  /* 
    Members:
      RhinoDoc RhinoDocument
      GH_Document GrasshopperDocument
      IGH_Component Component
      int Iteration

    Methods (Virtual & overridable):
      Print(string text)
      Print(string format, params object[] args)
      Reflect(object obj)
      Reflect(object obj, string method_name)
  */
  
  private void RunScript(
	int spacingY,
	int spacingX,
	ref object corner,
	ref object nextToCorner)
  {
    // Write your logic here

    //Column 1 {4;5;*}
    string pathA = "{" + spacingY + ";" + spacingX + ";*}";
    corner = pathA;

    //Column 2 {3;5;*}
    int sy = spacingY - 1;
    string pathB = "{" + sy + ";" + spacingX + ";*}";

    //Column 2 {4;4;*} 
    int sx = spacingX - 1;
    string pathC = "{" + spacingY + ";" + sx + ";*}";


    List<object> secondColumns = new List<object>();
    secondColumns.Add(pathB);
    secondColumns.Add(pathC);


    nextToCorner = secondColumns;
  }
}
# ---------- end csharp_script ----------
csharp_script_2 = CSharpScript(spacingX=spacingx_2)  # -> out, corner, nextToCorner; inputs spacingX: Int32
# ---------- csharp_script_2: C# ----------
// Grasshopper Script Instance
using System;
using System.Collections;
using System.Collections.Generic;
using System.Drawing;

using Rhino;
using Rhino.Geometry;

using Grasshopper;
using Grasshopper.Kernel;
using Grasshopper.Kernel.Data;
using Grasshopper.Kernel.Types;

public class Script_Instance : GH_ScriptInstance
{
  /* 
    Members:
      RhinoDoc RhinoDocument
      GH_Document GrasshopperDocument
      IGH_Component Component
      int Iteration

    Methods (Virtual & overridable):
      Print(string text)
      Print(string format, params object[] args)
      Reflect(object obj)
      Reflect(object obj, string method_name)
  */
  
  private void RunScript(int spacingX, ref object corner, ref object nextToCorner)
  {
    // Write your logic here

    //Column 1 {0;5;*}
    string pathA = "{" + 0 + ";" + spacingX + ";*}";
    corner = pathA;

    //Column 2 {1;5;*}
    string pathB = "{" + 1 + ";" + spacingX + ";*}";

    //Column 2 {0;4;*} 
    string pathC = "{" + 0 + ";" + (spacingX-1) + ";*}";
    

    List<object> secondColumns = new List<object>();
    secondColumns.Add(pathB);
    secondColumns.Add(pathC);


    nextToCorner = secondColumns;
  }
}
# ---------- end csharp_script_2 ----------
csharp_script_3 = CSharpScript(spacingY=spacingy_2)  # -> out, corner, nextToCorner; inputs spacingY: Int32
# ---------- csharp_script_3: C# ----------
// Grasshopper Script Instance
using System;
using System.Collections;
using System.Collections.Generic;
using System.Drawing;

using Rhino;
using Rhino.Geometry;

using Grasshopper;
using Grasshopper.Kernel;
using Grasshopper.Kernel.Data;
using Grasshopper.Kernel.Types;

public class Script_Instance : GH_ScriptInstance
{
  /* 
    Members:
      RhinoDoc RhinoDocument
      GH_Document GrasshopperDocument
      IGH_Component Component
      int Iteration

    Methods (Virtual & overridable):
      Print(string text)
      Print(string format, params object[] args)
      Reflect(object obj)
      Reflect(object obj, string method_name)
  */
  
  private void RunScript(int spacingY, ref object corner, ref object nextToCorner)
  {
    // Write your logic here

    //Column 1 {4;5;*}
    string pathA = "{" + spacingY + ";" + 0 + ";*}";
    corner = pathA;

    //Column 2 {3;5;*}
    int sy = spacingY - 1;
    string pathB = "{" + sy + ";" + 0 + ";*}";

    //Column 2 {4;4;*} 
    string pathC = "{" + spacingY + ";" + 1 + ";*}";


    List<object> secondColumns = new List<object>();
    secondColumns.Add(pathB);
    secondColumns.Add(pathC);


    nextToCorner = secondColumns;
  }
}
# ---------- end csharp_script_3 ----------
csharp_script_4 = CSharpScript()  # -> out, corner, nextToCorner
# ---------- csharp_script_4: C# ----------
// Grasshopper Script Instance
using System;
using System.Collections;
using System.Collections.Generic;
using System.Drawing;

using Rhino;
using Rhino.Geometry;

using Grasshopper;
using Grasshopper.Kernel;
using Grasshopper.Kernel.Data;
using Grasshopper.Kernel.Types;

public class Script_Instance : GH_ScriptInstance
{
  /* 
    Members:
      RhinoDoc RhinoDocument
      GH_Document GrasshopperDocument
      IGH_Component Component
      int Iteration

    Methods (Virtual & overridable):
      Print(string text)
      Print(string format, params object[] args)
      Reflect(object obj)
      Reflect(object obj, string method_name)
  */
  
  private void RunScript(ref object corner, ref object nextToCorner)
  {
    // Write your logic here

    //Column 1 {0;0;*}
    string pathA = "{" + 0 + ";" + 0 + ";*}";
    corner = pathA;

    //Column 2 {1;0;*}
    string pathB = "{" + 1 + ";" + 0 + ";*}";

    //Column 2 {0;1;*} 
    string pathC = "{" + 0 + ";" + 1 + ";*}";


    List<object> secondColumns = new List<object>();
    secondColumns.Add(pathB);
    secondColumns.Add(pathC);


    nextToCorner = secondColumns;
  }
}
# ---------- end csharp_script_4 ----------
split_tree = SplitTree(Data=curve_2, Masks=flatten(csharp_script_4.corner))  # -> Positive, Negative
split_tree_2 = SplitTree(Data=curve_2, Masks=flatten(csharp_script_4.nextToCorner))  # -> Positive, Negative
split_tree_3 = SplitTree(Data=curve_2, Masks=flatten(csharp_script.corner))  # -> Positive, Negative
split_tree_4 = SplitTree(Data=curve_2, Masks=flatten(csharp_script.nextToCorner))  # -> Positive, Negative
split_tree_5 = SplitTree(Data=curve_2, Masks=flatten(csharp_script_3.corner))  # -> Positive, Negative
split_tree_6 = SplitTree(Data=curve_2, Masks=flatten(csharp_script_3.nextToCorner))  # -> Positive, Negative
split_tree_7 = SplitTree(Data=curve_2, Masks=flatten(csharp_script_2.corner))  # -> Positive, Negative
split_tree_8 = SplitTree(Data=curve_2, Masks=flatten(csharp_script_2.nextToCorner))  # -> Positive, Negative
curve_3 = Curve(split_tree_4.Positive)
curve_4 = Curve(split_tree.Positive)
curve_5 = Curve(split_tree_2.Positive)
curve_6 = Curve(split_tree_3.Positive)
curve_7 = Curve(split_tree_5.Positive)
curve_8 = Curve(split_tree_6.Positive)
curve_9 = Curve(split_tree_7.Positive)
curve_10 = Curve(split_tree_8.Positive)
panel = Panel([csharp_script_4.corner, csharp_script_4.nextToCorner])
end_points = EndPoints(Curve=curve_4)  # -> Start, End
end_points_2 = EndPoints(Curve=curve_5)  # -> Start, End
end_points_3 = EndPoints(Curve=curve_6)  # -> Start, End
end_points_4 = EndPoints(Curve=curve_3)  # -> Start, End
end_points_5 = EndPoints(Curve=curve_7)  # -> Start, End
end_points_6 = EndPoints(Curve=curve_8)  # -> Start, End
end_points_7 = EndPoints(Curve=curve_9)  # -> Start, End
end_points_8 = EndPoints(Curve=curve_10)  # -> Start, End
line = Line(StartPoint=end_points.Start, EndPoint=end_points_2.End)
line_2 = Line(StartPoint=end_points.End, EndPoint=end_points_2.Start)
line_3 = Line(StartPoint=end_points_3.Start, EndPoint=end_points_4.End)
line_4 = Line(StartPoint=end_points_3.End, EndPoint=end_points_4.Start)
line_5 = Line(StartPoint=end_points_5.Start, EndPoint=end_points_6.End)
line_6 = Line(StartPoint=end_points_5.End, EndPoint=end_points_6.Start)
line_7 = Line(StartPoint=end_points_7.Start, EndPoint=end_points_8.End)
line_8 = Line(StartPoint=end_points_7.End, EndPoint=end_points_8.Start)
cull_index = CullIndex(List=line_2, Indices="0", Wrap=True)
cull_index_2 = CullIndex(List=line_4, Indices="0", Wrap=True)
cull_index_3 = CullIndex(List=line_6, Indices="0", Wrap=True)
cull_index_4 = CullIndex(List=line_8, Indices="0", Wrap=True)
cull_nth = CullNth(List=[line, cull_index], CullFrequency=2)
cull_nth_2 = CullNth(List=[line_3, cull_index_2], CullFrequency=2)
cull_nth_3 = CullNth(List=[line_5, cull_index_3], CullFrequency=2)
cull_nth_4 = CullNth(List=[line_7, cull_index_4], CullFrequency=2)
list = ClusterOutput(cull_nth)
list_2 = ClusterOutput(cull_nth_2)
list_3 = ClusterOutput(cull_nth_3)
list_4 = ClusterOutput(cull_nth_4)

# ==== cluster Cluster_2
spacingy = ClusterInput()
spacingx = ClusterInput()
curve = ClusterInput()
curve_2 = Curve(simplify(curve))
spacingy_2 = Number(expr("x-1", spacingy))
spacingx_2 = Number(expr("x-1", spacingx))
csharp_script = CSharpScript(spacingY=spacingy_2, spacingX=spacingx_2)  # -> out, X1, X2, Y1, Y2; inputs spacingY: Int32, spacingX: Int32
# ---------- csharp_script: C# ----------
// Grasshopper Script Instance
using System;
using System.Collections;
using System.Collections.Generic;
using System.Drawing;

using Rhino;
using Rhino.Geometry;

using Grasshopper;
using Grasshopper.Kernel;
using Grasshopper.Kernel.Data;
using Grasshopper.Kernel.Types;

public class Script_Instance : GH_ScriptInstance
{
  /* 
    Members:
      RhinoDoc RhinoDocument
      GH_Document GrasshopperDocument
      IGH_Component Component
      int Iteration

    Methods (Virtual & overridable):
      Print(string text)
      Print(string format, params object[] args)
      Reflect(object obj)
      Reflect(object obj, string method_name)
  */
  
  private void RunScript(
	int spacingY,
	int spacingX,
	ref object X1,
	ref object X2,
	ref object Y1,
	ref object Y2)
  {
    // Write your logic here

    

    /*
    List<object> secondColumns = new List<object>();
    secondColumns.Add(pathB);
    secondColumns.Add(pathC);
    */


    //Facade x-spacing 
    List<object> x1 = new List<object>();
    for (int i = 0; i < spacingX ; i++)
    {
        string facade = "{0;" + i + "}";
        x1.Add(facade);
    }
    X1 = x1;

    List<object> x2 = new List<object>();
    for (int i = 0; i < spacingY ; i++)
    {
        string facade = "{" + i + ";" + spacingX + "}";
        x2.Add(facade);
    }
    X2 = x2;

    //Facade y-spacing 
    List<object> y1 = new List<object>();
    for (int i = 1; i < spacingY+1 ; i++)
    {
        string facade = "{" + i + ";0}";
        y1.Add(facade);
    }
    Y1 = y1;

    List<object> y2 = new List<object>();
    for (int i = 1; i < spacingX+1 ; i++)
    {
        string facade = "{" + spacingY + ";" + i + "}";
        y2.Add(facade);
    }
    Y2 = y2;
    
    



  }
}
# ---------- end csharp_script ----------
split_tree = SplitTree(Data=curve_2, Masks=flatten(csharp_script.X1))  # -> Positive, Negative
split_tree_2 = SplitTree(Data=curve_2, Masks=flatten(csharp_script.X2))  # -> Positive, Negative
split_tree_3 = SplitTree(Data=curve_2, Masks=flatten(csharp_script.Y1))  # -> Positive, Negative
split_tree_4 = SplitTree(Data=curve_2, Masks=flatten(csharp_script.Y2))  # -> Positive, Negative
split_tree_5 = SplitTree(Data=curve_2, Masks=flatten([csharp_script.X1, csharp_script.X2, csharp_script.Y1, csharp_script.Y2]))  # -> Positive, Negative
line = Line(split_tree.Positive)
line_2 = Line(split_tree_2.Positive)
line_3 = Line(split_tree_3.Positive)
line_4 = Line(split_tree_4.Positive)
merge = Merge(Data1=line, Data2=line_2, Data3=line_3, Data4=line_4)
line_5 = Line(split_tree_5.Negative)
facadecolumns = ClusterOutput(merge)
midcolumns = ClusterOutput(line_5)

# ==== cluster Cluster_3
geometry = ClusterInput()
minimumboundindbox = MinimumBoundindBox(Geometry=geometry)
xy_plane = XYPlane(Origin=Point(0, 0, 0))
brep = Brep(flatten(minimumboundindbox))
rotate = Rotate(Geometry=brep, Angle=1.570796327, Plane=xy_plane)  # -> Geometry, Transform
list_length = ListLength(List=brep)
series = Series(Start=0, Step=1, Count=list_length)
panel = Panel(brep)
construct_point = ConstructPoint(XCoordinate=series, YCoordinate=0, ZCoordinate=0)
volume = Volume(Geometry=brep)  # -> Volume, Centroid
orient = Orient(Geometry=brep, Source=volume.Centroid, Target=construct_point)  # -> Geometry, Transform
geometry_2 = ClusterOutput(orient.Geometry)
